# Grasshopper definition 201109_ilaria_1.gh (Grasshopper 1.0.7)

number_slider = Slider(-56, range=-500..360)  # disabled
number_slider_2 = Slider(100, range=-360..360)  # disabled
_0 = Number(0)
_0_2 = Number(0)  # disabled
construct_point = ConstructPoint(XCoordinate=Slider(2, range=-500..360), YCoordinate=Slider(290, range=-360..360), ZCoordinate=_0)
construct_point_2 = ConstructPoint(XCoordinate=number_slider, YCoordinate=number_slider_2, ZCoordinate=_0_2)  # disabled
xy_plane = XYPlane(Origin=construct_point)
xy_plane_2 = XYPlane(Origin=construct_point_2)  # disabled
r = Slider(120, range=0..1000)
a = Slider(45, range=-180..360)
count = Slider(4, range=0..10)
r_2 = Slider(120, range=0..1000)  # disabled
a_2 = Slider(45, range=-180..360)  # disabled
count_2 = Slider(4, range=0..10)  # disabled
arc = Arc(Plane=xy_plane, Radius=r, Angle=a)  # -> Arc, Length
mortar = Slider(1.5, range=0..2)
arc_2 = Arc(Plane=xy_plane_2, Radius=r_2, Angle=a_2)  # -> Arc, Length; disabled
mortar_2 = Slider(1.5, range=0..2)  # disabled
polar_array = PolarArray(Geometry=arc.Arc, Plane=xy_plane, Count=count, Angle=6.283185307)  # -> Geometry, Transform
polar_array_2 = PolarArray(Geometry=arc_2.Arc, Plane=xy_plane_2, Count=count_2, Angle=6.283185307)  # -> Geometry, Transform; disabled
p_s = Slider(0, range=0..10)
p_s_2 = Slider(0, range=0..10)
p_s_3 = Slider(0, range=0..10)
a_3 = Slider(3, range=0..10)
ghpython_script = GhPythonScript(crv=flatten(polar_array.Geometry), mortar=mortar)  # -> out, planes, meshes, bricks, base_planes; inputs crv: Curve
# ---------- ghpython_script: Python ----------
from compas_rhino import unload_modules
unload_modules('model')

import rhinoscriptsyntax as rs
import Rhino.Geometry as rg

from model import Brick, Wall

blength = Brick.REFERENCE_LENGTH
bheight = Brick.REFERENCE_HEIGHT
bwidth = Brick.REFERENCE_WIDTH

planes = []
meshes = []
bricks = []
base_planes = []

params = rg.Curve.DivideByLength (crv, (blength+bwidth)/2 + mortar, False)
#params1 = enumerate(params)  
#print (params1)

layers = 10
for i in range(layers):
    for j in range(len(params)):
#       for k in range(len(params)):
#            
#            if i % 2 == 0:
#                layer_offset = bwidth
#                brick_pointing_out = True
#                
#            elif i % 2 == 1:
#                layer_offset = bwidth * 1.5
#                brick_pointing_out = True
#                
#            else:
#                layer_offset = 0
#                brick_pointing_out = False
                
                
                param = params[j]
                brick_pos = rg.Curve.PointAt(crv, param)
                brick_tan = rg.Curve.TangentAt(crv, param)
                vec1 = rg.Vector3d.CrossProduct(brick_tan, rg.Vector3d.ZAxis)
                vec2 = rg.Vector3d.CrossProduct(vec1, rg.Vector3d.ZAxis)
                vec3 = rg.Vector3d.Negate(vec2)
                
                if j%2==0:
                    plane = rg.Plane(brick_pos, vec2, vec1)
                    plane.Translate(rg.Vector3d.ZAxis * i * bheight)
                    rg.Plane.Translate(plane, vec1*(bwidth/2))
                    
                else:
                    plane = rg.Plane(brick_pos, vec1, vec3)
                    plane.Translate(rg.Vector3d.ZAxis * i * bheight)
                    
                myBrick = Brick(plane)
                meshes.append (myBrick.mesh())
                base_planes = myBrick.base_plane()
                bricks.append(myBrick)

"""
for i in range (10):
    clone_plane = rg.Plane.Clone(plane)
    rg.Plane.Translate(clone_plane, (i*bheight)*plane.ZAxis)
    new_planes.append(clone_plane)
    
    
if i%3==0:
    layer_offset = bwidth
    brick_pointing_out = True
    
elif i%3 == 1:
    layer_offset = bwidth*2
    brick_pointing_out = True
    
else:
    layer_offset = 0
    brick_pointing_out = False
    
    #myBrick = Brick(new_planes)
    #meshes.append(myBrick.mesh())
#print plane
myBrick = Brick(plane)
meshes.append(myBrick.mesh())
"""
# ---------- end ghpython_script ----------
ghpython_script_2 = GhPythonScript(crv=flatten(polar_array_2.Geometry), mortar=mortar_2)  # -> out, planes, meshes, bricks, base_planes; inputs crv: Curve; disabled; same code as ghpython_script
bricks = GhPythonScript()  # -> out, bricks
# ---------- bricks: Python ----------
from compas_rhino import unload_modules
unload_modules('model')

import Rhino.Geometry as rg

from model import Brick

import math as m




bricks = []


for i in range(10):  # layer count
    for j in range(10):  # layer length

        if i % 2 == 0:
            x_pos = j * (Brick.REFERENCE_LENGTH+1)
            rotation = m.radians(10)
        else:
            x_pos = j * (Brick.REFERENCE_LENGTH+1) + (Brick.REFERENCE_LENGTH/2)-1
            rotation = m.radians(-10)

        z_pos = i * (Brick.REFERENCE_HEIGHT)

        origin = rg.Point3d(x_pos, 0, z_pos)
        plane = rg.Plane(origin, rg.Vector3d.XAxis, rg.Vector3d.YAxis)
        plane.Rotate(rotation, rg.Vector3d.ZAxis)
        bricks.append(Brick(plane))
# ---------- end bricks ----------
bricks_2 = GhPythonScript()  # -> out, bricks; disabled; same code as bricks
ghpython_script_3 = GhPythonScript(crv=flatten(polar_array.Geometry), amplitude=a_3, phase_shift=p_s_3, move_x=p_s_2, move_y=p_s, mortar=mortar)  # -> out, planes, meshes, bricks, base_planes; inputs crv: Curve
# ---------- ghpython_script_3: Python ----------
from compas_rhino import unload_modules
unload_modules('model')

import rhinoscriptsyntax as rs
import Rhino.Geometry as rg

from model import Brick, Wall, Fabrication

import math

blength = Brick.REFERENCE_LENGTH
bheight = Brick.REFERENCE_HEIGHT
bwidth = Brick.REFERENCE_WIDTH

planes = []
meshes = []
bricks = []
base_planes = []

params = rg.Curve.DivideByLength (crv, (blength+bwidth)/2 + mortar, False)
#params1 = enumerate(params)  
#print (params1)

layers = 10
for i in range(layers):
    
    #x_offset = amplitude*math.sin(i/((6/5)*math.pi) +  phase_shift)
    
    for j in range(len(params)):
                
                
                param = params[j]
                brick_pos = rg.Curve.PointAt(crv, param)
                brick_tan = rg.Curve.TangentAt(crv, param)
                vec1 = rg.Vector3d.CrossProduct(brick_tan, rg.Vector3d.ZAxis)
                vec2 = rg.Vector3d.CrossProduct(vec1, rg.Vector3d.ZAxis)
                vec3 = rg.Vector3d.Negate(vec2)
                
                if j%2==0:
                    plane = rg.Plane(brick_pos  , vec2, vec1)
                    plane.Translate(rg.Vector3d.ZAxis * i * bheight)
                    rg.Plane.Translate(plane, vec1*(bwidth/2))
                    
                else:
                    plane = rg.Plane(brick_pos, vec1, vec3)
                    plane.Translate(rg.Vector3d.ZAxis * i * bheight)
                    
                    
                for k in range(len(params)):
                    if i % 2 == 0:
                        layer_offset = bwidth
                        brick_pointing_out = True
                        rg.Plane.Translate(plane , vec1*(bwidth/2))
                        
                    elif i % 2 == 1:
                        layer_offset = bwidth * 1.5
                        brick_pointing_out = True
                        rg.Plane.Translate(plane , vec1*(bwidth/2))
                        
                    else:
                        layer_offset = 0
                        brick_pointing_out = False
                
                    
                    
                    for i in range (12):
                        

                        x_offset = amplitude*math.sin(i/((6/5)*math.pi) +  phase_shift)
                    
                        if i%2==0:      
                            layer_offset = bwidth
                            
                            brick_pointing_out = True
                            
                        elif i%2==1:
                           layer_offset = bwidth*1.5
                           
                           brick_pointing_out = True
                            
                        else:
                            layer_offset = 0
                            
                            brick_pointing_out = False
                            
                        
                        for j in range (12):
                            x_value = (blength-bwidth)/2
                            y_value = ((blength+bwidth)/2 + mortar )*j + layer_offset
                            z_value = bheight * i
                            
                            if j % 2 == 0:
                                plane = rg.Plane(rg.Point3d( 0 - x_offset - move_x, y_value - move_y, z_value), rg.Vector3d.XAxis, rg.Vector3d.YAxis)
                                
                                myBrick = Brick(plane)
                                meshes.append(myBrick.mesh())
                            
                            else:
                                plane = rg.Plane(rg.Point3d(-x_value - x_offset - move_x, y_value - move_y, z_value), rg.Vector3d.XAxis, rg.Vector3d.YAxis)
                                rot_plane = plane.Clone()
                                rg.Plane.Rotate(rot_plane, math.radians(90), plane.ZAxis, rot_plane.Origin)
                                plane = rot_plane 
                                        
                    
                    
                myBrick = Brick(plane)
                meshes.append (myBrick.mesh())
                base_planes = myBrick.base_plane()
                bricks.append(myBrick)



planes = []
meshes = []
bricks = []
base_planes = []
x_offset = 0


for i in range (12):

    x_offset = amplitude*math.sin(i/((6/5)*math.pi) +  phase_shift)

    if i%2==0:      
        layer_offset = bwidth
        
        brick_pointing_out = True
        
    elif i%2==1:
       layer_offset = bwidth*1.5
       
       brick_pointing_out = True
        
    else:
        layer_offset = 0
        
        brick_pointing_out = False
        
    
    for j in range (12):
        x_value = (blength-bwidth)/2
        y_value = ((blength+bwidth)/2 + mortar )*j + layer_offset
        z_value = bheight * i
        
        if j % 2 == 0:
            plane = rg.Plane(rg.Point3d( 0 - x_offset - move_x, y_value - move_y, z_value), rg.Vector3d.XAxis, rg.Vector3d.YAxis)
            
            myBrick = Brick(plane)
            meshes.append(myBrick.mesh())
        
        else:
            plane = rg.Plane(rg.Point3d(-x_value - x_offset - move_x, y_value - move_y, z_value), rg.Vector3d.XAxis, rg.Vector3d.YAxis)
            rot_plane = plane.Clone()
            rg.Plane.Rotate(rot_plane, math.radians(90), plane.ZAxis, rot_plane.Origin)
            plane = rot_plane 
            

        myBrick = Brick(plane)
        meshes.append(myBrick.mesh())
        base_planes = myBrick.base_plane()
        bricks.append(myBrick)
# ---------- end ghpython_script_3 ----------
geo = Geometry([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])
geo_2 = Geometry([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])  # disabled
geometry = Geometry(ghpython_script.base_planes)
geometry_2 = Geometry(ghpython_script.planes)
geometry_3 = Geometry(ghpython_script.meshes)
geometry_4 = Geometry(ghpython_script_2.planes)  # disabled
geometry_5 = Geometry(ghpython_script_2.base_planes)  # disabled
visualization = GhPythonScript(bricks=bricks.bricks, robot_base=geo)  # -> out, geo, transformed_robot_base, v_w_p, s_crv; inputs bricks: list, robot_base: list of Brep
# ---------- visualization: Python ----------
"""Generates a 3D model of the wall

Returns
----------
geo : [Rhino Geometry Surface, Rhino Geometry Surface, ...]

"""
from compas_rhino import unload_modules
unload_modules('model')

import Rhino.Geometry as rg

from model import Fabrication
from model import Brick

planes = []
geo = []

for brick in bricks:
    geo.append(brick.mesh())

visualizeFabrication = Fabrication(brick_planes=planes)
visualizeFabrication.procedure(transform=False)


# return 
robot_matrix = visualizeFabrication.robot_transformation()
transformed_robot_base = []
for brep in robot_base:
    trans_brep = brep.Duplicate()
    trans_brep.Transform(robot_matrix)
    transformed_robot_base.append(trans_brep)
# ---------- end visualization ----------
geometry_6 = Geometry(ghpython_script_2.meshes)  # disabled
visualization_2 = GhPythonScript(bricks=bricks_2.bricks, robot_base=geo_2)  # -> out, geo, transformed_robot_base, v_w_p, s_crv; inputs bricks: list, robot_base: list of Brep; disabled; same code as visualization
mesh = Mesh(ghpython_script_3.meshes)
number_slider_3 = Slider(1, range=0..10)  # disabled
data = Data(ghpython_script.bricks)
explode_tree = ExplodeTree(Data=ghpython_script_2.bricks)  # -> Branch0, Branch1, Branch2, Branch3; disabled
panel = Panel("{0,2,.....}")  # disabled
split_tree = SplitTree(Data=ghpython_script.bricks, Masks=flatten("{0}[0,2,4,...]"))  # -> Positive, Negative
number_slider_4 = Slider(5, range=0..6)
split_tree_2 = SplitTree(Data=ghpython_script_2.meshes, Masks=flatten(panel))  # -> Positive, Negative; disabled
grp = Group(visualization.geo)  # disabled
geo_3 = Geometry(visualization.transformed_robot_base)
geo_4 = Geometry(visualization.s_crv)
number_slider_5 = Slider(1, range=0..10)  # disabled
grp_2 = Group(visualization_2.geo)  # disabled
number_slider_6 = Slider(3, range=0..1000)  # disabled
geo_5 = Geometry(visualization_2.transformed_robot_base)  # disabled
geo_6 = Geometry(visualization.v_w_p)
geo_7 = Geometry(visualization_2.s_crv)  # disabled
number_slider_7 = Slider(5, range=0..10)  # disabled
geo_8 = Geometry(visualization_2.v_w_p)  # disabled
partition_list = PartitionList(List=explode_tree.Branch0, Size=number_slider_3)  # disabled
construct_domain = ConstructDomain(DomainStart=Slider(54, range=0..54), DomainEnd=Slider(59, range=0..60))
combine_data = CombineData(Input0=explode_tree.Branch0, Input1=explode_tree.Branch1, Input2=explode_tree.Branch2, Input3=explode_tree.Branch3)  # -> Result, Index; disabled
clean_tree = CleanTree(RemoveNulls=True, RemoveInvalid=True, RemoveEmpty=False, Tree=split_tree.Negative)
clean_tree_2 = CleanTree(RemoveNulls=True, RemoveInvalid=True, RemoveEmpty=False, Tree=split_tree_2.Negative)  # disabled

# ----
# Fabrication
fabrication = GhPythonScript(bricks=ghpython_script_3.bricks)  # -> out, rhino_base_way_planes, robot_planes; inputs bricks: list
# ---------- fabrication: Python ----------
from compas_rhino import unload_modules
unload_modules('model')

import Rhino.Geometry as rg
import simple_comm as c
import simple_ur_script as ur

import math as m

from model import Brick

blength = Brick.REFERENCE_LENGTH
bheight = Brick.REFERENCE_HEIGHT
bwidth = Brick.REFERENCE_WIDTH

send = False

geo = []
rhino_base_way_planes = []
for brick in bricks:
    rhino_base_way_planes.append(brick.base_plane())
    
    


def tcp(script):
    """ This funktion sets tcp 
    """
    script += ur.set_tcp_by_angles(
        0.0, 0.0, 74.0, m.radians(0.0), m.radians(180.0), m.radians(0))
    return script

def set_robot_base_plane_from_pts():

    pt_0 = rg.Point3d(299, 63, 2)  # base plane origin
    # point on base plane positive x direction
    pt_1 = rg.Point3d(499, 63, 2)
    pt_2 = rg.Point3d(499, 299, 2)  # point on base plane positive xy

    robot_base = rg.Plane(pt_0, pt_1-pt_0, pt_2-pt_0)
    return robot_base

def rhino_to_robot_space(rhino_plane):
    """ this funktion translates planes from the rhino cordinate system to
    the robot cordinate system 
    """
    robot_plane = rhino_plane.Clone()
    _r_matrix = rg.Transform.PlaneToPlane(
        rg.Plane.WorldXY, set_robot_base_plane_from_pts())
    print robot_plane.Origin
    print(robot_plane.Transform(_r_matrix))
    print robot_plane.Origin
    return robot_plane

def pickup_brick(pick_up_plane, script):
    """Pick up a brick procedure

    Parameters
    ----------
    pick_up_plane : rhino.geometry.plane
    
    Returns:
    Procedure for pickin up plane
    """
    accel = 0.2    # m/s2
    vel = 0.2      # m/s

    safe_distance = 50
    
    way_planes = []

    safe_plane = pick_up_plane.Clone()
    safe_plane.Translate(rg.Vector3d(0, 0, safe_distance))

    script += ur.move_l(safe_plane, accel, vel)
    way_planes.append(safe_plane)

    script += ur.move_l(pick_up_plane, accel, vel)
    way_planes.append(pick_up_plane)

    script += ur.set_digital_out(4, True)
    script += ur.sleep(1)

    script += ur.move_l(safe_plane, accel, vel)
    way_planes.append(safe_plane)

    return script 

def place_brick(plane, script):
    """
    this function gereates the robotic sequience for placing a brick
    Requires a plane wich describes the possition of the brick"""

    safe_distance = 50
    accel = 0.1
    vel = 0.1
    way_planes = []

    safe_plane = plane.Clone()
    safe_plane.Translate(rg.Vector3d(0, 0, safe_distance))

    script += ur.move_l(safe_plane, accel, vel)
    way_planes.append(safe_plane)

    script += ur.move_l(plane, accel, vel)
    way_planes.append(plane)

    script += ur.set_digital_out(4, False)
    script += ur.sleep(1)

    script += ur.move_l(safe_plane, accel, vel)
    way_planes.append(safe_plane)

    return script

""" Robotic fabrication procedure
"""
script = ""

script = tcp(script)



"""pick _up plane is measured in the robot base plane
"""
pick_up_plane = rg.Plane(rg.Point3d(-56, 505, 0), rg.Vector3d.XAxis, rg.Vector3d.YAxis)


pick_up_planes =[]
for i in range(6):  # rows x-direction
    for j in range(12):  # rows y-direction
        x_pos = i * (Brick.REFERENCE_LENGTH)
        y_pos = j * (Brick.REFERENCE_WIDTH)
        origin = rg.Point3d(-57+x_pos, 505-y_pos, 0)
        pick_up_plane = rg.Plane(origin, rg.Vector3d.XAxis, rg.Vector3d.YAxis)
        pick_up_planes.append(pick_up_plane)
pick_up_planes.reverse()


robot_planes = []

"""We are translating all way_planes from rhino base to robot_base
"""
for rhino_plane in (rhino_base_way_planes):
    robot_planes.append(rhino_to_robot_space(rhino_plane))


for robot_plane, pick_up_plane in zip(robot_planes, pick_up_planes):
    #pick up a plane 
    script = pickup_brick(pick_up_plane, script)
    script = place_brick(robot_plane, script)
    

    
script = c.concatenate_script(script)


if send:
    c.send_script(script, "192.168.10.10")
    
    
    
    
    
#    pick_up_planes =[]
#for i in range(6):  # rows x-direction
#    for j in range(12):  # rows y-direction
#        x_pos = i * (Brick.REFERENCE_LENGTH)
#        y_pos = j * (Brick.REFERENCE_WIDTH)
#        origin = rg.Point3d(-57+x_pos, 507-y_pos, 0)
#        pick_up_plane = rg.Plane(origin, rg.Vector3d.XAxis, rg.Vector3d.YAxis)
#        pick_up_planes.append(pick_up_plane)
#pick_up_planes.reverse()
# ---------- end fabrication ----------
geometry_7 = Geometry(fabrication.robot_planes)

data_2 = Data(combine_data.Result)  # disabled
data_3 = Data(partition_list)  # disabled
series = Series(Start=Slider(0, range=0..5), Step=number_slider_4, Count=Slider(6, range=0..24))
range = Range(Domain=number_slider_7, Steps=10)  # disabled
range_2 = Range(Domain=construct_domain, Steps=number_slider_4)

# ----
# Fabrication
fabrication_2 = GhPythonScript(bricks=data_2)  # -> out, rhino_base_way_planes, robot_planes; inputs bricks: list; disabled
# ---------- fabrication_2: Python ----------
from compas_rhino import unload_modules
unload_modules('model')

import Rhino.Geometry as rg
import simple_comm as c
import simple_ur_script as ur

import math as m

from model import Brick

blength = Brick.REFERENCE_LENGTH
bheight = Brick.REFERENCE_HEIGHT
bwidth = Brick.REFERENCE_WIDTH

send = False

geo = []
rhino_base_way_planes = []
for brick in bricks:
    rhino_base_way_planes.append(brick.base_plane())
    
    


def tcp(script):
    """ This funktion sets tcp 
    """
    script += ur.set_tcp_by_angles(
        0.0, 0.0, 74.0, m.radians(0.0), m.radians(180.0), m.radians(0))
    return script

def set_robot_base_plane_from_pts():

    pt_0 = rg.Point3d(299, 63, 2)  # base plane origin
    # point on base plane positive x direction
    pt_1 = rg.Point3d(499, 63, 2)
    pt_2 = rg.Point3d(499, 299, 2)  # point on base plane positive xy

    robot_base = rg.Plane(pt_0, pt_1-pt_0, pt_2-pt_0)
    return robot_base

def rhino_to_robot_space(rhino_plane):
    """ this funktion translates planes from the rhino cordinate system to
    the robot cordinate system 
    """
    robot_plane = rhino_plane.Clone()
    _r_matrix = rg.Transform.PlaneToPlane(
        rg.Plane.WorldXY, set_robot_base_plane_from_pts())
    print robot_plane.Origin
    print(robot_plane.Transform(_r_matrix))
    print robot_plane.Origin
    return robot_plane

def pickup_brick(pick_up_plane, script):
    """Pick up a brick procedure

    Parameters
    ----------
    pick_up_plane : rhino.geometry.plane
    
    Returns:
    Procedure for pickin up plane
    """
    accel = 0.1    # m/s2
    vel = 0.1      # m/s

    safe_distance = 50
    
    way_planes = []

    safe_plane = pick_up_plane.Clone()
    safe_plane.Translate(rg.Vector3d(0, 0, safe_distance))

    script += ur.move_l(safe_plane, accel, vel)
    way_planes.append(safe_plane)

    script += ur.move_l(pick_up_plane, accel, vel)
    way_planes.append(pick_up_plane)

    script += ur.set_digital_out(4, True)
    script += ur.sleep(1)

    script += ur.move_l(safe_plane, accel, vel)
    way_planes.append(safe_plane)

    return script 

def place_brick(plane, script):
    """
    this function gereates the robotic sequience for placing a brick
    Requires a plane wich describes the possition of the brick"""

    safe_distance = 50
    accel = 0.1
    vel = 0.1
    way_planes = []

    safe_plane = plane.Clone()
    safe_plane.Translate(rg.Vector3d(0, 0, safe_distance))

    script += ur.move_l(safe_plane, accel, vel)
    way_planes.append(safe_plane)

    script += ur.move_l(plane, accel, vel)
    way_planes.append(plane)

    script += ur.set_digital_out(4, False)
    script += ur.sleep(1)

    script += ur.move_l(safe_plane, accel, vel)
    way_planes.append(safe_plane)

    return script

""" Robotic fabrication procedure
"""
script = ""

script = tcp(script)



"""pick _up plane is measured in the robot base plane
"""
pick_up_plane = rg.Plane(rg.Point3d(-56, 505, 0), rg.Vector3d.XAxis, rg.Vector3d.YAxis)


pick_up_planes =[]
for i in range(6):  # rows x-direction
    for j in range(12):  # rows y-direction
        x_pos = i * (Brick.REFERENCE_LENGTH)
        y_pos = j * (Brick.REFERENCE_WIDTH)
        origin = rg.Point3d(-57+x_pos, 505-y_pos, 0)
        pick_up_plane = rg.Plane(origin, rg.Vector3d.XAxis, rg.Vector3d.YAxis)
        pick_up_planes.append(pick_up_plane)
pick_up_planes.reverse()


robot_planes = []

"""We are translating all way_planes from rhino base to robot_base
"""
for rhino_plane in (rhino_base_way_planes):
    robot_planes.append(rhino_to_robot_space(rhino_plane))


for robot_plane, pick_up_plane in zip(robot_planes, pick_up_planes):
    #pick up a plane 
    script = pickup_brick(pick_up_plane, script)
    script = place_brick(robot_plane, script)
    

    
script = c.concatenate_script(script)


if send:
    c.send_script(script, "192.168.10.10")
    
    
    
    
    
#    pick_up_planes =[]
#for i in range(6):  # rows x-direction
#    for j in range(12):  # rows y-direction
#        x_pos = i * (Brick.REFERENCE_LENGTH)
#        y_pos = j * (Brick.REFERENCE_WIDTH)
#        origin = rg.Point3d(-57+x_pos, 507-y_pos, 0)
#        pick_up_plane = rg.Plane(origin, rg.Vector3d.XAxis, rg.Vector3d.YAxis)
#        pick_up_planes.append(pick_up_plane)
#pick_up_planes.reverse()
# ---------- end fabrication_2 ----------
geometry_8 = Geometry(fabrication_2.robot_planes)  # disabled

list_item = ListItem(List=geometry_6, Index=number_slider_5, Wrap=True)  # disabled
data_4 = Data(clean_tree)
data_5 = Data(clean_tree_2)  # disabled
list_item_2 = ListItem(List=data_4, Index=range_2, Wrap=True)
list_item_3 = ListItem(List=data_5, Index=range, Wrap=True)  # disabled
param_viewer = ParamViewer()  # disabled
data_6 = Data(flatten(list_item_2))
mesh_2 = Mesh(list_item_3)  # disabled

# ----
# Fabrication
fabrication_3 = GhPythonScript(bricks=data_6)  # -> out, rhino_base_way_planes, robot_planes; inputs bricks: list; same code as fabrication
geometry_9 = Geometry(fabrication_3.robot_planes)
