# Grasshopper definition 201110_ilaria_2.gh (Grasshopper 1.0.7)

number_slider = Slider(-56, range=-500..360)  # disabled
number_slider_2 = Slider(100, range=-360..360)  # disabled
_0 = Number(0)
_0_2 = Number(0)  # disabled
construct_point = ConstructPoint(XCoordinate=Slider(2, range=-500..360), YCoordinate=Slider(290, range=-360..360), ZCoordinate=_0)
construct_point_2 = ConstructPoint(XCoordinate=number_slider, YCoordinate=number_slider_2, ZCoordinate=_0_2)  # disabled
xy_plane = XYPlane(Origin=construct_point)
xy_plane_2 = XYPlane(Origin=construct_point_2)  # disabled
count = Slider(4, range=0..10)
r = Slider(120, range=0..1000)
a = Slider(45, range=-180..360)
r_2 = Slider(120, range=0..1000)  # disabled
a_2 = Slider(45, range=-180..360)  # disabled
count_2 = Slider(4, range=0..10)  # disabled
mortar = Slider(1.5, range=0..2)
arc = Arc(Plane=xy_plane, Radius=r, Angle=a)  # -> Arc, Length
polar_array = PolarArray(Geometry=arc.Arc, Plane=xy_plane, Count=count, Angle=6.283185307)  # -> Geometry, Transform
arc_2 = Arc(Plane=xy_plane_2, Radius=r_2, Angle=a_2)  # -> Arc, Length; disabled
mortar_2 = Slider(1.5, range=0..2)  # disabled
polar_array_2 = PolarArray(Geometry=arc_2.Arc, Plane=xy_plane_2, Count=count_2, Angle=6.283185307)  # -> Geometry, Transform; disabled
ghpython_script = GhPythonScript(curve_segments=polar_array.Geometry, mortar=mortar, amplitude=Slider(1, range=0..10), phase_shift=Slider(0, range=0..1))  # -> out, planes, meshes, bricks, base_planes; inputs curve_segments: list of Curve
# ---------- ghpython_script: Python ----------
from compas_rhino import unload_modules
unload_modules('model')

import rhinoscriptsyntax as rs
import Rhino.Geometry as rg
import math

from model import Brick, Wall

blength = Brick.REFERENCE_LENGTH
bheight = Brick.REFERENCE_HEIGHT
bwidth = Brick.REFERENCE_WIDTH

planes = []
meshes = []
bricks = []
base_planes = []


for crv in curve_segments:
    params = rg.Curve.DivideByLength (crv, (blength+bwidth)/2 + mortar, True)

    layers = 10
    for i in range(layers):
        cos = amplitude * math.cos(i/((1/2)*math.pi) + phase_shift)
        new_crv = crv.Duplicate()
        trans_height = rg.Transform.Translation(0,0,i*bheight)
        trans_length = rg.Transform.Translation(cos, 0,0)
        new_crv.Transform(trans_height)

        
        for j in range(len(params)):
            
            if i % 2 == 0:
                layer_offset = bwidth * 0.45
                brick_pointing_out = True
                
#            elif i % 2 == 1:
#                layer_offset = bwidth * 0.45
#                brick_pointing_out = True
             
            else:
                layer_offset = 0
                brick_pointing_out = True

            param = params[j]
            brick_pos = []
            brick_pos = rg.Curve.PointAt(new_crv, param)
            for k in range(len(params)):
                brick_pos.Transform(trans_length)
            brick_tan = rg.Curve.TangentAt(new_crv, param)
            vec1 = rg.Vector3d.CrossProduct(brick_tan, rg.Vector3d.ZAxis)
            vec2 = rg.Vector3d.CrossProduct(vec1, rg.Vector3d.ZAxis)
            vec3 = rg.Vector3d.Negate(vec2)
            
            brick_offset_vec = brick_tan*layer_offset
            
            if j%2==0:
                plane = rg.Plane(brick_pos+brick_offset_vec, vec2, vec1)
#                plane.Translate(rg.Vector3d.ZAxis * i * bheight)
                rg.Plane.Translate(plane, vec1*(bwidth/2))
                
                myBrick = Brick(plane)
                meshes.append (myBrick.mesh())
                base_planes = myBrick.base_plane()
                bricks.append(myBrick)
                

                
            else:
                plane = rg.Plane(brick_pos+brick_offset_vec, vec1, vec3) 
#                plane.Translate(rg.Vector3d.ZAxis * i * bheight)
                
                if brick_pointing_out:
                                
                    myBrick = Brick(plane)
                    meshes.append (myBrick.mesh())
                    base_planes = myBrick.base_plane()
                    bricks.append(myBrick)
# ---------- end ghpython_script ----------
ghpython_script_2 = GhPythonScript(crv=flatten(polar_array_2.Geometry), mortar=mortar_2)  # -> out, planes, meshes, bricks, base_planes; inputs crv: Curve; disabled
# ---------- ghpython_script_2: Python ----------
from compas_rhino import unload_modules
unload_modules('model')

import rhinoscriptsyntax as rs
import Rhino.Geometry as rg

from model import Brick, Wall

blength = Brick.REFERENCE_LENGTH
bheight = Brick.REFERENCE_HEIGHT
bwidth = Brick.REFERENCE_WIDTH

planes = []
meshes = []
bricks = []
base_planes = []

params = rg.Curve.DivideByLength (crv, (blength+bwidth)/2 + mortar, False)
#params1 = enumerate(params)  
#print (params1)

layers = 10
for i in range(layers):
    for j in range(len(params)):
#       for k in range(len(params)):
#            
#            if i % 2 == 0:
#                layer_offset = bwidth
#                brick_pointing_out = True
#                
#            elif i % 2 == 1:
#                layer_offset = bwidth * 1.5
#                brick_pointing_out = True
#                
#            else:
#                layer_offset = 0
#                brick_pointing_out = False
                
                
                param = params[j]
                brick_pos = rg.Curve.PointAt(crv, param)
                brick_tan = rg.Curve.TangentAt(crv, param)
                vec1 = rg.Vector3d.CrossProduct(brick_tan, rg.Vector3d.ZAxis)
                vec2 = rg.Vector3d.CrossProduct(vec1, rg.Vector3d.ZAxis)
                vec3 = rg.Vector3d.Negate(vec2)
                
                if j%2==0:
                    plane = rg.Plane(brick_pos, vec2, vec1)
                    plane.Translate(rg.Vector3d.ZAxis * i * bheight)
                    rg.Plane.Translate(plane, vec1*(bwidth/2))
                    
                else:
                    plane = rg.Plane(brick_pos, vec1, vec3)
                    plane.Translate(rg.Vector3d.ZAxis * i * bheight)
                    
                myBrick = Brick(plane)
                meshes.append (myBrick.mesh())
                base_planes = myBrick.base_plane()
                bricks.append(myBrick)

"""
for i in range (10):
    clone_plane = rg.Plane.Clone(plane)
    rg.Plane.Translate(clone_plane, (i*bheight)*plane.ZAxis)
    new_planes.append(clone_plane)
    
    
if i%3==0:
    layer_offset = bwidth
    brick_pointing_out = True
    
elif i%3 == 1:
    layer_offset = bwidth*2
    brick_pointing_out = True
    
else:
    layer_offset = 0
    brick_pointing_out = False
    
    #myBrick = Brick(new_planes)
    #meshes.append(myBrick.mesh())
#print plane
myBrick = Brick(plane)
meshes.append(myBrick.mesh())
"""
# ---------- end ghpython_script_2 ----------
bricks = GhPythonScript()  # -> out, bricks; disabled
# ---------- bricks: Python ----------
from compas_rhino import unload_modules
unload_modules('model')

import Rhino.Geometry as rg

from model import Brick

import math as m




bricks = []


for i in range(10):  # layer count
    for j in range(10):  # layer length

        if i % 2 == 0:
            x_pos = j * (Brick.REFERENCE_LENGTH+1)
            rotation = m.radians(10)
        else:
            x_pos = j * (Brick.REFERENCE_LENGTH+1) + (Brick.REFERENCE_LENGTH/2)-1
            rotation = m.radians(-10)

        z_pos = i * (Brick.REFERENCE_HEIGHT)

        origin = rg.Point3d(x_pos, 0, z_pos)
        plane = rg.Plane(origin, rg.Vector3d.XAxis, rg.Vector3d.YAxis)
        plane.Rotate(rotation, rg.Vector3d.ZAxis)
        bricks.append(Brick(plane))
# ---------- end bricks ----------
geometry = Geometry(ghpython_script.meshes)
geo = Geometry([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])  # disabled
geometry_2 = Geometry(ghpython_script.base_planes)
geometry_3 = Geometry(ghpython_script.planes)
geometry_4 = Geometry(ghpython_script_2.planes)  # disabled
geometry_5 = Geometry(ghpython_script_2.base_planes)  # disabled
geometry_6 = Geometry(ghpython_script_2.meshes)  # disabled
visualization = GhPythonScript(bricks=bricks.bricks, robot_base=geo)  # -> out, geo, transformed_robot_base, v_w_p, s_crv; inputs bricks: list, robot_base: list of Brep; disabled
# ---------- visualization: Python ----------
"""Generates a 3D model of the wall

Returns
----------
geo : [Rhino Geometry Surface, Rhino Geometry Surface, ...]

"""
from compas_rhino import unload_modules
unload_modules('model')

import Rhino.Geometry as rg

from model import Fabrication
from model import Brick

planes = []
geo = []

for brick in bricks:
    geo.append(brick.mesh())

visualizeFabrication = Fabrication(brick_planes=planes)
visualizeFabrication.procedure(transform=False)


# return 
robot_matrix = visualizeFabrication.robot_transformation()
transformed_robot_base = []
for brep in robot_base:
    trans_brep = brep.Duplicate()
    trans_brep.Transform(robot_matrix)
    transformed_robot_base.append(trans_brep)
# ---------- end visualization ----------
number_slider_3 = Slider(1, range=0..10)  # disabled
list_item = ListItem(List=ghpython_script.bricks, Index=Slider(280, range=0..280), Wrap=True)
data = Data(ghpython_script.bricks)
data_2 = Data(list_item)
explode_tree = ExplodeTree(Data=ghpython_script_2.bricks)  # -> Branch0, Branch1, Branch2, Branch3; disabled
panel = Panel("{0,2,.....}")  # disabled
split_tree = SplitTree(Data=list_item, Masks=flatten("{0}[0,2,4,...]"))  # -> Positive, Negative
split_tree_2 = SplitTree(Data=ghpython_script_2.meshes, Masks=flatten(panel))  # -> Positive, Negative; disabled
number_slider_4 = Slider(5, range=0..6)
number_slider_5 = Slider(1, range=0..10)  # disabled
grp = Group(visualization.geo)  # disabled
number_slider_6 = Slider(3, range=0..1000)  # disabled
geo_2 = Geometry(visualization.transformed_robot_base)  # disabled
geo_3 = Geometry(visualization.s_crv)  # disabled
number_slider_7 = Slider(5, range=0..10)  # disabled
geo_4 = Geometry(visualization.v_w_p)  # disabled
partition_list = PartitionList(List=explode_tree.Branch0, Size=number_slider_3)  # disabled
construct_domain = ConstructDomain(DomainStart=Slider(54, range=0..54), DomainEnd=Slider(59, range=0..60))
combine_data = CombineData(Input0=explode_tree.Branch0, Input1=explode_tree.Branch1, Input2=explode_tree.Branch2, Input3=explode_tree.Branch3)  # -> Result, Index; disabled
clean_tree = CleanTree(RemoveNulls=True, RemoveInvalid=True, RemoveEmpty=False, Tree=split_tree.Negative)
clean_tree_2 = CleanTree(RemoveNulls=True, RemoveInvalid=True, RemoveEmpty=False, Tree=split_tree_2.Negative)  # disabled
data_3 = Data(combine_data.Result)  # disabled
data_4 = Data(partition_list)  # disabled
series = Series(Start=Slider(0, range=0..5), Step=number_slider_4, Count=Slider(6, range=0..24))
range = Range(Domain=number_slider_7, Steps=10)  # disabled
range_2 = Range(Domain=construct_domain, Steps=number_slider_4)

# ----
# Fabrication
fabrication = GhPythonScript(bricks=data_3)  # -> out, rhino_base_way_planes, robot_planes; inputs bricks: list; disabled
# ---------- fabrication: Python ----------
from compas_rhino import unload_modules
unload_modules('model')

import Rhino.Geometry as rg
import simple_comm as c
import simple_ur_script as ur

import math as m

from model import Brick

blength = Brick.REFERENCE_LENGTH
bheight = Brick.REFERENCE_HEIGHT
bwidth = Brick.REFERENCE_WIDTH

send = False

geo = []
rhino_base_way_planes = []
for brick in bricks:
    rhino_base_way_planes.append(brick.base_plane())
    
    


def tcp(script):
    """ This funktion sets tcp 
    """
    script += ur.set_tcp_by_angles(
        0.0, 0.0, 74.0, m.radians(0.0), m.radians(180.0), m.radians(0))
    return script

def set_robot_base_plane_from_pts():

    pt_0 = rg.Point3d(299, 63, 2)  # base plane origin
    # point on base plane positive x direction
    pt_1 = rg.Point3d(499, 63, 2)
    pt_2 = rg.Point3d(499, 299, 2)  # point on base plane positive xy

    robot_base = rg.Plane(pt_0, pt_1-pt_0, pt_2-pt_0)
    return robot_base

def rhino_to_robot_space(rhino_plane):
    """ this funktion translates planes from the rhino cordinate system to
    the robot cordinate system 
    """
    robot_plane = rhino_plane.Clone()
    _r_matrix = rg.Transform.PlaneToPlane(
        rg.Plane.WorldXY, set_robot_base_plane_from_pts())
    print robot_plane.Origin
    print(robot_plane.Transform(_r_matrix))
    print robot_plane.Origin
    return robot_plane

def pickup_brick(pick_up_plane, script):
    """Pick up a brick procedure

    Parameters
    ----------
    pick_up_plane : rhino.geometry.plane
    
    Returns:
    Procedure for pickin up plane
    """
    accel = 0.1    # m/s2
    vel = 0.1      # m/s

    safe_distance = 50
    
    way_planes = []

    safe_plane = pick_up_plane.Clone()
    safe_plane.Translate(rg.Vector3d(0, 0, safe_distance))

    script += ur.move_l(safe_plane, accel, vel)
    way_planes.append(safe_plane)

    script += ur.move_l(pick_up_plane, accel, vel)
    way_planes.append(pick_up_plane)

    script += ur.set_digital_out(4, True)
    script += ur.sleep(1)

    script += ur.move_l(safe_plane, accel, vel)
    way_planes.append(safe_plane)

    return script 

def place_brick(plane, script):
    """
    this function gereates the robotic sequience for placing a brick
    Requires a plane wich describes the possition of the brick"""

    safe_distance = 50
    accel = 0.1
    vel = 0.1
    way_planes = []

    safe_plane = plane.Clone()
    safe_plane.Translate(rg.Vector3d(0, 0, safe_distance))

    script += ur.move_l(safe_plane, accel, vel)
    way_planes.append(safe_plane)

    script += ur.move_l(plane, accel, vel)
    way_planes.append(plane)

    script += ur.set_digital_out(4, False)
    script += ur.sleep(1)

    script += ur.move_l(safe_plane, accel, vel)
    way_planes.append(safe_plane)

    return script

""" Robotic fabrication procedure
"""
script = ""

script = tcp(script)



"""pick _up plane is measured in the robot base plane
"""
pick_up_plane = rg.Plane(rg.Point3d(-56, 505, 0), rg.Vector3d.XAxis, rg.Vector3d.YAxis)


pick_up_planes =[]
for i in range(6):  # rows x-direction
    for j in range(12):  # rows y-direction
        x_pos = i * (Brick.REFERENCE_LENGTH)
        y_pos = j * (Brick.REFERENCE_WIDTH)
        origin = rg.Point3d(-57+x_pos, 505-y_pos, 0)
        pick_up_plane = rg.Plane(origin, rg.Vector3d.XAxis, rg.Vector3d.YAxis)
        pick_up_planes.append(pick_up_plane)
pick_up_planes.reverse()


robot_planes = []

"""We are translating all way_planes from rhino base to robot_base
"""
for rhino_plane in (rhino_base_way_planes):
    robot_planes.append(rhino_to_robot_space(rhino_plane))


for robot_plane, pick_up_plane in zip(robot_planes, pick_up_planes):
    #pick up a plane 
    script = pickup_brick(pick_up_plane, script)
    script = place_brick(robot_plane, script)
    

    
script = c.concatenate_script(script)


if send:
    c.send_script(script, "192.168.10.10")
    
    
    
    
    
#    pick_up_planes =[]
#for i in range(6):  # rows x-direction
#    for j in range(12):  # rows y-direction
#        x_pos = i * (Brick.REFERENCE_LENGTH)
#        y_pos = j * (Brick.REFERENCE_WIDTH)
#        origin = rg.Point3d(-57+x_pos, 507-y_pos, 0)
#        pick_up_plane = rg.Plane(origin, rg.Vector3d.XAxis, rg.Vector3d.YAxis)
#        pick_up_planes.append(pick_up_plane)
#pick_up_planes.reverse()
# ---------- end fabrication ----------
geometry_7 = Geometry(fabrication.robot_planes)  # disabled

list_item_2 = ListItem(List=geometry_6, Index=number_slider_5, Wrap=True)  # disabled
data_5 = Data(clean_tree)
data_6 = Data(clean_tree_2)  # disabled
ghpython_script_3 = GhPythonScript(brick=list_item)  # -> out, mesh
# ---------- ghpython_script_3: Python ----------
mesh = brick.mesh()
# ---------- end ghpython_script_3 ----------
list_item_3 = ListItem(List=list_item, Index=range_2, Wrap=True)
list_item_4 = ListItem(List=data_6, Index=range, Wrap=True)  # disabled
param_viewer = ParamViewer()  # disabled
data_7 = Data(flatten(list_item_3))
mesh = Mesh(list_item_4)  # disabled
bricks_2 = GhPythonScript()  # -> out, bricks; same code as bricks
geometry_8 = Geometry(ghpython_script_3.mesh)

# ----
# Fabrication
fabrication_2 = GhPythonScript(bricks=list_item)  # -> out, rhino_base_way_planes, robot_planes; inputs bricks: list
# ---------- fabrication_2: Python ----------
from compas_rhino import unload_modules
unload_modules('model')

import Rhino.Geometry as rg
import simple_comm as c
import simple_ur_script as ur

import math as m

from model import Brick

blength = Brick.REFERENCE_LENGTH
bheight = Brick.REFERENCE_HEIGHT
bwidth = Brick.REFERENCE_WIDTH

send = False

geo = []
rhino_base_way_planes = []
for brick in bricks:
    rhino_base_way_planes.append(brick.base_plane())
    
    


def tcp(script):
    """ This funktion sets tcp 
    """
    script += ur.set_tcp_by_angles(
        0.0, 0.0, 74.0, m.radians(0.0), m.radians(180.0), m.radians(0))
    return script

def set_robot_base_plane_from_pts():

    pt_0 = rg.Point3d(299, 63, 2)  # base plane origin
    # point on base plane positive x direction
    pt_1 = rg.Point3d(499, 63, 2)
    pt_2 = rg.Point3d(499, 299, 2)  # point on base plane positive xy

    robot_base = rg.Plane(pt_0, pt_1-pt_0, pt_2-pt_0)
    return robot_base

def rhino_to_robot_space(rhino_plane):
    """ this funktion translates planes from the rhino cordinate system to
    the robot cordinate system 
    """
    robot_plane = rhino_plane.Clone()
    _r_matrix = rg.Transform.PlaneToPlane(
        rg.Plane.WorldXY, set_robot_base_plane_from_pts())
    print robot_plane.Origin
    print(robot_plane.Transform(_r_matrix))
    print robot_plane.Origin
    return robot_plane

def pickup_brick(pick_up_plane, script):
    """Pick up a brick procedure

    Parameters
    ----------
    pick_up_plane : rhino.geometry.plane
    
    Returns:
    Procedure for pickin up plane
    """
    accel = 0.2    # m/s2
    vel = 0.2      # m/s

    safe_distance = 50
    
    way_planes = []

    safe_plane = pick_up_plane.Clone()
    safe_plane.Translate(rg.Vector3d(0, 0, safe_distance))

    script += ur.move_l(safe_plane, accel, vel)
    way_planes.append(safe_plane)

    script += ur.move_l(pick_up_plane, accel, vel)
    way_planes.append(pick_up_plane)

    script += ur.set_digital_out(4, True)
    script += ur.sleep(1)

    script += ur.move_l(safe_plane, accel, vel)
    way_planes.append(safe_plane)

    return script 

def place_brick(plane, script):
    """
    this function gereates the robotic sequience for placing a brick
    Requires a plane wich describes the possition of the brick"""

    safe_distance = 50
    accel = 0.1
    vel = 0.1
    way_planes = []

    safe_plane = plane.Clone()
    safe_plane.Translate(rg.Vector3d(0, 0, safe_distance))

    script += ur.move_l(safe_plane, accel, vel)
    way_planes.append(safe_plane)

    script += ur.move_l(plane, accel, vel)
    way_planes.append(plane)

    script += ur.set_digital_out(4, False)
    script += ur.sleep(1)

    script += ur.move_l(safe_plane, accel, vel)
    way_planes.append(safe_plane)

    return script

""" Robotic fabrication procedure
"""
script = ""

script = tcp(script)



"""pick _up plane is measured in the robot base plane
"""
pick_up_plane = rg.Plane(rg.Point3d(-56, 505, 0), rg.Vector3d.XAxis, rg.Vector3d.YAxis)


pick_up_planes =[]
for i in range(6):  # rows x-direction
    for j in range(12):  # rows y-direction
        x_pos = i * (Brick.REFERENCE_LENGTH)
        y_pos = j * (Brick.REFERENCE_WIDTH)
        origin = rg.Point3d(-57+x_pos, 505-y_pos, 0)
        pick_up_plane = rg.Plane(origin, rg.Vector3d.XAxis, rg.Vector3d.YAxis)
        pick_up_planes.append(pick_up_plane)
pick_up_planes.reverse()


robot_planes = []

"""We are translating all way_planes from rhino base to robot_base
"""
for rhino_plane in (rhino_base_way_planes):
    robot_planes.append(rhino_to_robot_space(rhino_plane))


for robot_plane, pick_up_plane in zip(robot_planes, pick_up_planes):
    #pick up a plane 
    script = pickup_brick(pick_up_plane, script)
    script = place_brick(robot_plane, script)
    

    
script = c.concatenate_script(script)


if send:
    c.send_script(script, "192.168.10.10")
    
    
    
    
    
#    pick_up_planes =[]
#for i in range(6):  # rows x-direction
#    for j in range(12):  # rows y-direction
#        x_pos = i * (Brick.REFERENCE_LENGTH)
#        y_pos = j * (Brick.REFERENCE_WIDTH)
#        origin = rg.Point3d(-57+x_pos, 507-y_pos, 0)
#        pick_up_plane = rg.Plane(origin, rg.Vector3d.XAxis, rg.Vector3d.YAxis)
#        pick_up_planes.append(pick_up_plane)
#pick_up_planes.reverse()
# ---------- end fabrication_2 ----------
geometry_9 = Geometry(fabrication_2.robot_planes)

geo_5 = Geometry([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])
visualization_2 = GhPythonScript(bricks=bricks_2.bricks, robot_base=geo_5)  # -> out, geo, transformed_robot_base, v_w_p, s_crv; inputs bricks: list, robot_base: list of Brep; same code as visualization
grp_2 = Group(visualization_2.geo)
geo_6 = Geometry(visualization_2.transformed_robot_base)
geo_7 = Geometry(visualization_2.s_crv)
geo_8 = Geometry(visualization_2.v_w_p)

# ---- group: SINE CURVE
amplitude = Slider(29, range=0..1000)
time = Slider(68.4, range=0..100)
length = Slider(10, range=0..10)
X = UnitX(Factor=time)
# SINE CURVE CREATION
# Parameters Adjustments
pt = Point(Point(0, 0, 0))
arrlinear = LinearArray(Geometry=pt, Direction=X, Count=length)  # -> Geometry, Transform
pdecon = Deconstruct(Point=arrlinear.Geometry)  # -> XComponent, YComponent, ZComponent
sin = Sine(Value=pdecon.XComponent)
multiplication = Multiplication(A=sin, B=amplitude)
pt_2 = ConstructPoint(XCoordinate=pdecon.XComponent, YCoordinate=multiplication, ZCoordinate=0)
nurbs = NurbsCurve(Vertices=pt_2, Degree=3, Periodic=False)  # -> Curve, Length, Domain
rotate = Rotate(Geometry=nurbs.Curve, Angle=1.570796327, Plane=PlaneXY(0, 0, 0))  # -> Geometry, Transform
X_2 = UnitX(Factor=Slider(316, range=0..1000))
move = Move(Geometry=rotate.Geometry, Motion=X_2)  # -> Geometry, Transform

# ----
inclination = Slider(0.17, range=0.01..1)
direction = Slider(1, range=-1..1)

# ---- group: SINE CURVE
amplitude_2 = Slider(29, range=0..1000)  # disabled
# SINE CURVE CREATION
# Parameters Adjustments
time_2 = Slider(68.4, range=0..100)  # disabled
length_2 = Slider(7, range=0..10)  # disabled
X_3 = UnitX(Factor=time_2)  # disabled
pt_3 = Point(Point(0, 0, 0))  # disabled
arrlinear_2 = LinearArray(Geometry=pt_3, Direction=X_3, Count=length_2)  # -> Geometry, Transform; disabled
pdecon_2 = Deconstruct(Point=arrlinear_2.Geometry)  # -> XComponent, YComponent, ZComponent; disabled
sin_2 = Sine(Value=pdecon_2.XComponent)  # disabled
multiplication_2 = Multiplication(A=sin_2, B=amplitude_2)  # disabled
pt_4 = ConstructPoint(XCoordinate=pdecon_2.XComponent, YCoordinate=multiplication_2, ZCoordinate=0)  # disabled
nurbs_2 = NurbsCurve(Vertices=pt_4, Degree=3, Periodic=False)  # -> Curve, Length, Domain; disabled
rotate_2 = Rotate(Geometry=nurbs_2.Curve, Angle=1.570796327, Plane=PlaneXY(0, 0, 0))  # -> Geometry, Transform; disabled
number_slider_8 = Slider(316, range=0..1000)  # disabled
X_4 = UnitX(Factor=number_slider_8)  # disabled
move_2 = Move(Geometry=rotate_2.Geometry, Motion=X_4)  # -> Geometry, Transform; disabled

# ----
inclination_2 = Slider(0.17, range=0.01..1)  # disabled
direction_2 = Slider(1, range=-1..1)  # disabled
mortar_3 = Slider(1, range=0..2)

number_slider_9 = Slider(9, range=0..100)  # disabled
number_slider_10 = Slider(29.5, range=0..100)  # disabled
number_slider_11 = Slider(21.9, range=0..100)  # disabled
crv = Curve(move_2.Geometry)  # disabled
python = GhPythonScript(
    curve=crv,
    rows_number=number_slider_9,
    double_row_dis=number_slider_10,
    single_row_dis=number_slider_11,
    factor=inclination_2,
    direction=direction_2)  # -> out, planes, rows; inputs curve: Curve, rows_number: Int32, direction: Int32; disabled
# ---------- python: Python ----------
from compas_rhino import unload_modules
unload_modules('model')

from model import Wall
from model import Fabrication
from model import Brick
import Rhino.Geometry as rg
import math as m

## A class to create planes on a curve
##setting the rotation and the distance between them
##Example: cplanes=Planes_from_Curve(mycurve,rotation,distance,flip).planes
class Planes_from_Curve():
    
    def __init__(self,curve,rotation=0,distance=(Brick.REFERENCE_LENGTH+2)/2,translate=False):
        self.curve=curve
        self.planes=[]
        self.rotation=rotation
        self.translate = translate
        if self.translate==False:
            params = rg.Curve.DivideByLength(curve,distance, True)
            self.planes=self.Create_planes(params)
        else:
            params = rg.Curve.DivideByLength(curve,distance/2, True)
            new_params=[]
            for i,p in enumerate(params):
                if i%2==0:
                    new_params.append(p)
            self.planes=self.Create_planes(new_params)
            
    def Create_planes(self,params):
        cplanes=[]
        for j,param in enumerate(params):
            brick_pos = rg.Curve.PointAt(self.curve, param)
            brick_tan = rg.Curve.TangentAt(self.curve, param)
            vec1 = rg.Vector3d.CrossProduct(brick_tan, rg.Vector3d.ZAxis)
            vec2 = rg.Vector3d.CrossProduct(vec1, rg.Vector3d.ZAxis)
            plane = rg.Plane(brick_pos, vec1, vec2)
            plane.Rotate(self.rotation,rg.Vector3d.ZAxis)
            cplanes.append(plane)
        return cplanes
        


def remove_dupes(mylist):
    newlist = [mylist[0]]
    for e in mylist:
        if e not in newlist:
            newlist.append(e)
    return newlist

####################################
# CURVE_CREATION
####################################
## 
rows=[]

for i in range(rows_number):
    new_curve = curve.Duplicate()
    #define z.value for each crv
    trans = rg.Transform.Translation(0,0,i*Brick.REFERENCE_HEIGHT)
    new_curve.Transform(trans)
    params = rg.Curve.DivideByCount(new_curve, 10, True)
    c_start_point=rg.Curve.PointAt(new_curve, params[0])
    cpoints=[]
    #define offset for each crv depending on the curvature
    ##PRINCIPLES: value = ( distance_from_the_start_of_curve*harmonic stacking* factor(from slider in gh)
    for j,p in enumerate(params):
        cpoint = rg.Curve.PointAt(new_curve, p)
        if 0 <= i <= rows_number/2:
            value =(cpoint.X-c_start_point.X)*((i - rows_number/2))*factor
        else:
            value =(cpoint.X-c_start_point.X)*(-(i - rows_number/2))*factor
            
        trans = rg.Transform.Translation(value*direction,0,0)
        cpoint.Transform(trans)
        cpoints.append(cpoint)
    new_curve = rg.Curve.CreateControlPointCurve(cpoints) 
    rows.append(new_curve)


####Creation of double curves and brick-planes 
curves=[]
curves1=[]
planes=[]
translate=False

for i,crv in enumerate(rows):

    curves.append(crv)
    cplanes=Planes_from_Curve(crv,m.pi*0.5,single_row_dis,False).planes
    for c in cplanes:
        planes.append(c)

planes = remove_dupes(planes)
# ---------- end python ----------
geo_9 = Geometry(python.planes)  # disabled
crv_2 = Curve(python.rows)  # disabled

panel_2 = Panel("L Brick Wall")
ghpython_script_4 = GhPythonScript(
    layers=Slider(16, range=0..20),
    crv=move.Geometry,
    mortar=mortar_3,
    amplitude=Slider(0.03, range=0..10),
    phase_shift=Slider(0, range=0..1),
    factor=inclination,
    direction=direction)  # -> out, meshes, bricks, base_planes, brick_points, normals; inputs layers: Int32, crv: Curve
# ---------- ghpython_script_4: Python ----------
from compas_rhino import unload_modules
unload_modules('model')

import rhinoscriptsyntax as rs
import Rhino.Geometry as rg
import math

from model import Brick, Wall

blength = Brick.REFERENCE_LENGTH
bheight = Brick.REFERENCE_HEIGHT
bwidth = Brick.REFERENCE_WIDTH

meshes = []
bricks = []
base_planes = []
rows=[]

brick_points = []
normals = []

params = rg.Curve.DivideByLength (crv, (blength+bwidth)/2 + mortar, False)

for i in range(layers):
    new_crv = crv.Duplicate()
    ##############################
    #copy and distribute in height
    ##############################
    trans_height = rg.Transform.Translation(0,0,i*bheight)
    new_crv.Transform(trans_height)

    ############
    #layer shift
    ############
    
    
    if i % 2 == 0:
        layer_offset = bwidth * (1/2)

    else:
        layer_offset = 0


    for j in range(len(params)):
        
        param = params[j]
        brick_pos = []
        brick_pos = rg.Curve.PointAt(new_crv, param)
        
        brick_points.append (brick_pos)
        
        brick_tan = rg.Curve.TangentAt(new_crv, param)
        vec1 = rg.Vector3d.CrossProduct(brick_tan, rg.Vector3d.ZAxis)
        
        normal = rg.Curve.CurvatureAt(new_crv, param)
        normals.append (normal)
        vec2 = rg.Vector3d.CrossProduct(vec1, rg.Vector3d.ZAxis)
        vec3 = rg.Vector3d.Negate(vec2)
        
        brick_offset_vec = brick_tan*layer_offset

        ##########
        #flip of the protruding brick on the half of the sin period (len(params))
        #########
        
        if j % 2 == 1:
            plane = rg.Plane(brick_pos+brick_offset_vec, vec2, vec1)
                
        elif j % 2 == 0 and normal.X > 0:
            plane = rg.Plane(brick_pos+brick_offset_vec, vec1, vec3)
            rg.Plane.Translate(plane, vec1*((blength-bwidth)/2))
            
        elif j % 2 == 0 and normal.X > 0:
            plane = rg.Plane(brick_pos+brick_offset_vec, vec2, vec1)
            rg.Plane.Translate(plane, vec1*(blength/2))
                
        else:
            plane = rg.Plane(brick_pos+brick_offset_vec, vec1, vec3)
            rg.Plane.Translate(plane, vec1*((-1)*bwidth/2))
                
                
"""
        if j<(len(params)/2) and j % 2==1:
            plane = rg.Plane(brick_pos+brick_offset_vec, vec2, vec1)
            rg.Plane.Translate(plane, vec1)

            
        elif j>(len(params)/2) and j % 2==1:
            plane = rg.Plane(brick_pos+brick_offset_vec, vec2, vec1)
            rg.Plane.Translate(plane, vec1*(-1))

            
        elif j>(len(params)/2) and j % 2==0:
            plane = rg.Plane(brick_pos+brick_offset_vec, vec1, vec3)
            rg.Plane.Translate(plane, vec1*(bwidth/2))

        else:
            plane = rg.Plane(brick_pos+brick_offset_vec, vec1, vec3)
            rg.Plane.Translate(plane, vec1*((-1)*bwidth/2))
            
        if i % 2 == 0 and i>8 and j%2==0:
            continue
        else:
"""
            myBrick = Brick(plane)
            meshes.append (myBrick.mesh())
            base_planes = myBrick.base_plane()
            bricks.append(myBrick)

    #################################
    #min and max distance in section from base curve
    #################################
"""
    c_start_point=rg.Curve.PointAt(new_crv, params[0])
    cpoints=[]
    for j,p in enumerate(params):
        cpoint = rg.Curve.PointAt(new_crv, p)
        if 0 <= i <= layers/2 :
            value =(cpoint.X-c_start_point.X)*((i - layers/2))*factor
        else:
            value =(cpoint.X-c_start_point.X)*(-(i - layers/2))*factor
        trans = rg.Transform.Translation(value*direction,0,0)
        cpoint.Transform(trans)
        cpoints.append(cpoint)
    new_crv = rg.Curve.CreateControlPointCurve(cpoints) 
    rows.append(new_crv)
"""
# ---------- end ghpython_script_4 ----------
panel_3 = Panel("Wall Generation")  # disabled
multiplication_3 = Multiplication(A=ghpython_script_4.normals, B=Slider(10000, range=0..10000))
geometry_10 = Geometry(ghpython_script_4.base_planes)
geometry_11 = Geometry(ghpython_script_4.meshes)
vector_display_ex = VectorDisplayEx(Point=ghpython_script_4.brick_points, Vector=multiplication_3, Colour=RGB(0, 0, 0), Width=2)
data_8 = Data(ghpython_script_4.bricks)

# ----
# Fabrication
fabrication_3 = GhPythonScript(bricks=data_8)  # -> out, rhino_base_way_planes, robot_planes; inputs bricks: list; same code as fabrication_2
geometry_12 = Geometry(fabrication_3.robot_planes)

python_2 = GhPythonScript(planes=geo_9)  # -> out, bricks; inputs planes: list of Plane; disabled
# ---------- python_2: Python ----------
from compas_rhino import unload_modules
unload_modules('model')

from model import Wall
from model import Fabrication
from model import Brick
import Rhino.Geometry as rg
import math as m

bricks=[]
for plane in planes:
    brick=Brick(plane)
    bricks.append(brick.mesh())
# ---------- end python_2 ----------
mesh_2 = Mesh(python_2.bricks)  # disabled
