# Grasshopper definition 20201103_robotic_brick.ghx (Grasshopper 1.0.7)

number_slider = Slider(10, range=0..100)  # disabled
python = GhPythonScript(x=number_slider, y=number_slider)  # -> out, line_00, line_01, conectLine; disabled
# ---------- python: Python ----------
__author__ = "WeiTingChen"
__version__ = "2020.10.09"

import rhinoscriptsyntax as rs
import Rhino.Geometry as rg
import ghpythonlib.components as gh

# create the Grid


pt_00 = rg.Point3d(0,0,0)
pt_01 = rg.Point3d(x,0,0)
pt_02 = rg.Point3d(0,y,0)
pt_03 = rg.Point3d(x,y,0)

line_00 = rg.NurbsCurve.Create(False, 1, [pt_00, pt_01])
line_01 = rg.NurbsCurve.Create(False, 1, [pt_03, pt_01])
params_00 = line_00.DivideByLength(1,True)
params_01 = line_01.DivideByLength(1,True)


divd_pt = []
for param0, param1 in zip(params_00, params_01):
    divd_pt01 = line_00.PointAt(param0)
    divd_pt02 = line_01.PointAt(param1)
    conectLine = (rg.NurbsCurve.Create(False, 1, [divd_pt01, divd_pt02]))
    params = conectLine.DivideByLength(1,True)
    for param in params:
        divd_pt =conectLine.PointAt(param)
# ---------- end python ----------
python_2 = GhPythonScript(count=Slider(3, range=0..100))  # -> out, meshes; inputs count: Int32
# ---------- python_2: Python ----------
from compas_rhino import unload_modules
unload_modules('model')

import Rhino.Geometry as rg
from model import Brick
import math 

planes_base = []
planes = []
x = Brick.REFERENCE_LENGTH
y = Brick.REFERENCE_WIDTH
z = Brick.REFERENCE_HEIGHT

for i in range(count):
    for j in range(count):
        for k in range(count):
            x_value = x*i
            y_value = y*j
            z_vaule = z*k
            plane_origin = rg.Point3d(x_value, y_value, z_vaule)
            plane = rg.Plane(
                    plane_origin, rg.Vector3d.XAxis, rg.Vector3d.YAxis)
            if i%2 == 0 or j%2 ==1:
                plane.Rotate(math.radians(5),rg.Vector3d.ZAxis)
            planes_base.append(plane)
            bri = Brick(plane)
            planes.append(bri.picking_plane())

meshes = []
for plane in planes_base:
    bri = Brick(plane)
    meshes.append(bri.mesh())
# ---------- end python_2 ----------
python_3 = GhPythonScript()  # -> out, line
# ---------- python_3: Python ----------
__author__ = "WeiTingChen"
__version__ = "2020.10.09"

import rhinoscriptsyntax as rs
import Rhino.Geometry as rg
import ghpythonlib.components as gh


line = []
for i in range(0, 200, 10):
    line.append(rg.Line(rg.Point3d(0,200/2 - i,0), rg.Point3d(i,200/2,0)))
# ---------- end python_3 ----------
row = Slider(20, range=0..100)
column = Slider(20, range=0..100)
row_2 = Slider(5, range=0..100)
row_3 = Slider(10, range=0..100)
number_slider_2 = Slider(5, range=0..10)  # disabled
pt = Point(Point(373.3700429, 35, 90.44124029))
crv = Curve(<curve referenced from the Rhino model>)
geo = Geometry([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])
bricks = GhPythonScript(robot_base_geometry=geo)  # -> out, surfaces, planes, robot_crv, transformed_robot_base, meshes; inputs robot_base_geometry: list of Brep
# ---------- bricks: Python ----------
from compas_rhino import unload_modules
unload_modules('model')


from model import Brick
from model import Fabrication
import Rhino.Geometry as rg
import math as m


planes = []
meshes = []
#for i in range (1):
#    for j in range (2):
#        if i % 2 == 1:
#            x_value = (Brick.REFERENCE_LENGTH * j)+(1*j) 
#            
#            z_value = Brick.REFERENCE_HEIGHT * i +i*1
#            
#            
#        else:
#            x_value = (Brick.REFERENCE_LENGTH * j)+(1*j) 
#            
#            z_value = Brick.REFERENCE_HEIGHT * i +i*1
            

def herring_bone(plane):
    
    # first brick
    #plane_origin = rg.Point3d(Brick.REFERENCE_WIDTH/2,Brick.REFERENCE_LENGTH/2,0)
    plane_origin = plane.Origin + (plane.XAxis * Brick.REFERENCE_WIDTH/2) + (plane.YAxis *Brick.REFERENCE_LENGTH/2)
    brick_1_plane = rg.Plane(plane_origin, plane.XAxis, plane.YAxis)
    plane.Rotate(m.radians(90), rg.Vector3d.ZAxis)
    plane_rot = plane.Clone()
    myBrick_rot = Brick(plane_rot)
    
    
    #print plane_rot
    planes.append(myBrick_rot.picking_plane())
    meshes.append(myBrick_rot.mesh())
    #print meshes
    
    # second brick
    #plane_origin = rg.Point3d(Brick.REFERENCE_LENGTH/2 + Brick.REFERENCE_WIDTH
    #                       ,Brick.REFERENCE_WIDTH/2,0)
    plane_origin = plane.Origin - (plane.XAxis * (Brick.REFERENCE_LENGTH/2 - Brick.REFERENCE_WIDTH/2)) - (plane.YAxis *((Brick.REFERENCE_LENGTH/2)+ Brick.REFERENCE_WIDTH/2))
                           
    plane_brick_2 = rg.Plane(plane_origin, rg.Vector3d.XAxis, rg.Vector3d.YAxis)
    myBrick = Brick(plane_brick_2)
    planes.append(myBrick.picking_plane())
    meshes.append(myBrick.mesh())
    
    
    
    
    
    return meshes



test_plane = rg.Plane(rg.Point3d(0,0,100), rg.Vector3d.XAxis, rg.Vector3d.YAxis)

herring_bone(test_plane)
meshes = []
for i in range (10):
    brick_plane = rg.Plane(rg.Point3d(Brick.REFERENCE_WIDTH*i,Brick.REFERENCE_WIDTH*i,100), rg.Vector3d.XAxis, rg.Vector3d.YAxis)
    meshes.extend(herring_bone(brick_plane))
# ---------- end bricks ----------

# ---- group: attractorWall
python_4 = GhPythonScript(row=row, column=column, attractor=pt, attractorCrv=crv, scale=Slider(0.5, range=0..1))  # -> out, f_planes, planes_base, meshes; inputs row: Int32, column: Int32, attractor: Point3d, attractorCrv: Curve
# ---------- python_4: Python ----------
__author__ = "WeiTingChen"
__version__ = "2020.10.09"

from compas_rhino import unload_modules
unload_modules('model')
import Rhino.Geometry as rg
from model import Brick
import math as m


def wall(row, column):
    planes = []
    planes_base = []
    for i in range(column):
        for j in range(row):
            if i % 2 ==1:
                x_value = (Brick.REFERENCE_LENGTH + 1) * j + (Brick.REFERENCE_LENGTH/2)
            else:
                x_value = (Brick.REFERENCE_LENGTH + 1) * j
            z_value = (Brick.REFERENCE_HEIGHT) * i
            plane_origin = rg.Point3d(x_value, 0, z_value)
            plane = rg.Plane(plane_origin, rg.Vector3d.XAxis, rg.Vector3d.YAxis)
            planes_base.append(plane)
            myBrick = Brick(plane)
            planes.append(myBrick.picking_plane())
    return planes, planes_base

def rotate(plane,attractorCrv,scale):
    new_plane = []
    # get the closet points from points
    success, t = attractorCrv.ClosestPoint(plane.Origin)
    crv_pt = attractorCrv.PointAt(t)
    distance = plane.Origin.DistanceTo(crv_pt)
    #distance = attractor.DistanceTo(plane.Origin)
    rotation = m.radians(distance * scale)
    new_plane.append(plane.Rotate(rotation, rg.Vector3d.ZAxis))
    return new_plane

def get_model():
    planes, planes_base = wall(row, column)
    
    # get fabrcation base
    f_planes = []
    for plane in planes:
        rotate(plane,attractorCrv,scale)
        f_planes.append(plane)
        
    meshes =[]
    # create mesh by planes_bas
    for plane_base in planes_base:
        rotate(plane_base,attractorCrv,scale)
        wallBrick = Brick(plane_base)
        meshes.append(wallBrick.mesh())
    return meshes, f_planes


meshes, f_planes = get_model()
# ---------- end python_4 ----------

# ----
python_5 = GhPythonScript(x_gap=Slider(1.5, range=0..10), z_gap=Slider(1.624, range=0..10))  # -> out, planes, meshes
# ---------- python_5: Python ----------
__author__ = "WeiTingChen"
__version__ = "2020.10.09"

from compas_rhino import unload_modules
unload_modules('model')
import Rhino.Geometry as rg
from model import Brick


planes = []
meshes =[]


for i in range(10):
    for j in range(5):
        if i % 2 ==1:
            x_value = (Brick.REFERENCE_LENGTH + x_gap) * j + (Brick.REFERENCE_LENGTH/2)
            z_value = (Brick.REFERENCE_HEIGHT + z_gap) * i
        else:
            x_value = (Brick.REFERENCE_LENGTH + x_gap) * j
            z_value = (Brick.REFERENCE_HEIGHT + z_gap) * i
        plane_origin = rg.Point3d(x_value, 0, z_value)
        plane = rg.Plane(plane_origin, rg.Vector3d.XAxis, rg.Vector3d.YAxis)
        
        myBrick = Brick(plane)
        planes.append(myBrick.picking_plane())
        meshes.append(myBrick.mesh())
# ---------- end python_5 ----------

# ---- group: boxbrick
python_6 = GhPythonScript(row=row_2, column=row_2, height=row_2, angle=Slider(113.7, range=0..360))  # -> out, f_planes, meshes; inputs row: Int32, column: Int32, height: Int32
# ---------- python_6: Python ----------
__author__ = "WeiTingChen"
__version__ = "2020.10.09"

from compas_rhino import unload_modules
unload_modules('model')
import Rhino.Geometry as rg
from model import Brick
import math as m

# Brick Size = 25 * 12 * 8
def wall_straght(row, column, height):
    planes = []
    planes_base = []
    x = (Brick.REFERENCE_LENGTH/2 + Brick.REFERENCE_WIDTH/2)
    y = (Brick.REFERENCE_WIDTH+0.5)
    z = Brick.REFERENCE_HEIGHT 
    for i in range(row):
        for j in range(column):
            for k in range(height):
                if (i % 2 == 0 and k % 2 == 0) or (i % 2 == 1 and k % 2 == 1)  :
                    x_value = x * i +1
                    y_value = y * j
                    z_value = z * k
                    plane_origin = rg.Point3d(x_value, y_value, z_value)
                    plane = rg.Plane(plane_origin, rg.Vector3d.XAxis, rg.Vector3d.YAxis)
                    planes_base.append(plane)
                    myBrick = Brick(plane)
                    planes.append(myBrick.picking_plane())
    return planes, planes_base

def wall_straght_rotate(row, column, height):
    planes = []
    planes_base = []
    x = ((Brick.REFERENCE_LENGTH+Brick.REFERENCE_WIDTH)/2)
    y = (Brick.REFERENCE_LENGTH+0.5) 
    z = Brick.REFERENCE_HEIGHT 
    for i in range(row):
        for j in range(int(column/2)):
            for k in range(height):
                if ( i % 2 == 1 and k % 2 == 0 ) or ( i % 2 == 0 and k % 2 == 1):
                    x_value = x * i
                    y_value = y * j
                    z_value = z * k
                    plane_origin = rg.Point3d(x_value, y_value, z_value)
                    plane = rg.Plane(plane_origin, rg.Vector3d.XAxis, rg.Vector3d.YAxis)
                    #rotate
                    plane.Rotate(m.radians(angle), rg.Vector3d.ZAxis)
                    planes_base.append(plane)
                    myBrick = Brick(plane)
                    planes.append(myBrick.picking_plane())
    return planes, planes_base

def get_model():
    planes01, planes_base01 = wall_straght_rotate(row, column, height)
    planes02, planes_base02 = wall_straght(row, column, height)
    # get fabrcation base
    f_planes = []
    for plane in planes01, planes02:
        #rotate(plane,attractorCrv,scale)
        f_planes.append(plane)
        f_planes.append(plane)
    meshes =[]
    # create mesh by planes_bas
    for plane in planes_base01, planes_base02:
        wallBrick = Brick(planes_base01)
        wallBrick = Brick(planes_base02)
        meshes.append(wallBrick.mesh())
meshes =[]
planes01, planes_base01 = wall_straght_rotate(row, column, height)
planes02, planes_base02 = wall_straght(row, column, height)

for plane01 in planes_base01:
    wallBrick = Brick(plane01)
    meshes.append(wallBrick.mesh())

for plane02 in planes_base02:
    # striaght
    wallBrick = Brick(plane02)
    meshes.append(wallBrick.mesh())
# ---------- end python_6 ----------

# ----
python_7 = GhPythonScript(row=number_slider_2)  # -> out, planes, meshes_h, meshes_v; inputs row: Int32; disabled
# ---------- python_7: Python ----------
from compas_rhino import unload_modules
unload_modules('model')

import Rhino.Geometry as rg
from model import Brick
import math


def brick_horizontal_laying(row, gap):
    planes = []
    meshes = []
    x = Brick.REFERENCE_LENGTH / 2 
    y = Brick.REFERENCE_WIDTH + 1 
    
    for i in range(row):
        x_value = x * i + Brick.REFERENCE_LENGTH
        y_value = y * i + Brick.REFERENCE_WIDTH/2
        plane_origin = rg.Point3d(x_value, y_value, 0)
        plane = rg.Plane(plane_origin, rg.Vector3d.XAxis, rg.Vector3d.YAxis)
        planes.append(plane)
        b = Brick(plane)
        meshes.append(b.mesh())
    return planes, meshes


def brick_Vertical_laying(row, gap):
    planes = []
    meshes = []
    x = Brick.REFERENCE_LENGTH / 2 
    y = Brick.REFERENCE_WIDTH + 1 
    strat_vaule_x = Brick.REFERENCE_WIDTH/2 + 1 
    strat_vaule_y = Brick.REFERENCE_WIDTH/2 + Brick.REFERENCE_LENGTH / 2 + 1
    
    for i in range(row):
        x_value = x * i + Brick.REFERENCE_WIDTH/2
        y_value = y * i + Brick.REFERENCE_LENGTH / 2
        plane_origin = rg.Point3d(x_value, y_value, 0)
        plane = rg.Plane(plane_origin, rg.Vector3d.XAxis, rg.Vector3d.YAxis)
        plane.Rotate(math.radians(90), rg.Vector3d.ZAxis)
        planes.append(plane)
        b = Brick(plane)
        meshes.append(b.mesh())
    return planes, meshes



planes, meshes_h = brick_horizontal_laying(row,0.5)
planes02, meshes_v = brick_Vertical_laying(row,0.5)
# ---------- end python_7 ----------

# ---- group: attractorWall / CurveColestpoint
python_8 = GhPythonScript(x=crv, y=pt)  # -> out, a; inputs x: Curve, y: Point3d
# ---------- python_8: Python ----------
__author__ = "WeiTingChen"
__version__ = "2020.10.09"

import rhinoscriptsyntax as rs
import Rhino.Geometry as rg
import ghpythonlib.components as gh


succe, t = x.ClosestPoint(y)
crv_pt = x.PointAt(t)
a = crv_pt
# ---------- end python_8 ----------

# ----
pt_2 = Point(python_5.planes)
geo_2 = Geometry(python_6.meshes)
geo_3 = Geometry(python_4.f_planes)
geo_4 = Geometry(python_4.meshes)
order = PointOrder(Points=pt_2)
crv_2 = Curve(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)
number_slider_3 = Slider(0.03, range=0..1)  # disabled
number_slider_4 = Slider(100, range=0..100)  # disabled
row_4 = Slider(20, range=0..100)
column_2 = Slider(20, range=0..100)

# ---- group: find the plane by direction
python_9 = GhPythonScript(curves=crv_2)  # -> out, planes; inputs curves: list of Curve
# ---------- python_9: Python ----------
__author__ = "WeiTingChen"
__version__ = "2020.10.09"

import rhinoscriptsyntax as rs
import Rhino.Geometry as rg
import ghpythonlib.components as gh

from compas_rhino import unload_modules
unload_modules('model')

from model import Brick



def curve_to_planes():
    brick_planes = []
    for curve in curves:
        params = curve.DivideByLength(Brick.REFERENCE_LENGTH, False)
        for param in params:
            brick_pos = rg.Curve.PointAt(curve, param)
            brick_tan = rg.Curve.TangentAt(curve, param) # follow like tangenAt
            vec1 = rg.Vector3d.CrossProduct(brick_tan, rg.Vector3d.ZAxis)
            vec2 = rg.Vector3d.CrossProduct(vec1, rg.Vector3d.ZAxis)
            
            plane = rg.Plane(brick_pos,vec1, vec2)
            brick_planes.append(plane)
    return brick_planes

planes = curve_to_planes()
# ---------- end python_9 ----------

# ----
pt_3 = Point(Point(373.3700429, 35, 90.44124029))
crv_3 = Curve(<curve referenced from the Rhino model>)
python_10 = GhPythonScript(count=number_slider_4, height=number_slider_3)  # -> out, srf; inputs count: Int32; disabled
# ---------- python_10: Python ----------
__author__ = "WeiTingChen"
__version__ = "2020.10.09"

import rhinoscriptsyntax as rs
import Rhino.Geometry as rg
import math

# spiral
points =[]
points02 = []
for i in range(count):
    randian = math.exp(i*0.01)
    spiral = math.pi * 2 * i *0.01
    points.append(rg.Point3d(
                  randian*math.cos(spiral), randian*math.sin(spiral), i*height))

for i in range(count):
    randian = math.exp(i*0.01)
    spiral = math.pi * 2 * i *0.01
    points02.append(rg.Point3d(
                  randian*math.cos(spiral), randian*math.sin(spiral), 0))


curve01 = [rg.Curve.CreateControlPointCurve(points[20:count], 3),
          rg.Curve.CreateControlPointCurve(points02[20:count], 3)]


srf = rg.Brep.CreateFromLoft(curve01, rg.Point3d.Unset, rg.Point3d.Unset, rg.LoftType.Normal, False)
# ---------- end python_10 ----------

# ---- group: WeaveWall
python_11 = GhPythonScript(row=row_4, column=column_2, attractor=pt_3, attractorCrv=crv_3, scale=Slider(0.5, range=0..1))  # -> out, f_planes, planes_base, meshes; inputs row: Int32, column: Int32, attractor: Point3d, attractorCrv: Curve
# ---------- python_11: Python ----------
__author__ = "WeiTingChen"
__version__ = "2020.10.09"

from compas_rhino import unload_modules
unload_modules('model')
import Rhino.Geometry as rg
from model import Brick
import math


def wall(row, column):
    planes = []
    planes_base = []
    for i in range(column):
        for j in range(row):
            
            if i % 2 == 1:
                x_value = (Brick.REFERENCE_LENGTH + 1) * j + (Brick.REFERENCE_LENGTH/2)
            else:
                x_value = (Brick.REFERENCE_LENGTH + 1) * j
            z_value = (Brick.REFERENCE_HEIGHT) * i
            radian = math.cos(math.pi*i/column + j +j/row)*6
            plane_origin = rg.Point3d(x_value, radian, z_value)
            plane = rg.Plane(plane_origin, rg.Vector3d.XAxis, rg.Vector3d.YAxis)
            planes_base.append(plane)
            myBrick = Brick(plane)
            planes.append(myBrick.picking_plane())
    return planes, planes_base

def rotate(plane,attractorCrv,scale):
    new_plane = []
    # get the closet points from points
    success, t = attractorCrv.ClosestPoint(plane.Origin)
    crv_pt = attractorCrv.PointAt(t)
    distance = plane.Origin.DistanceTo(crv_pt)
    #distance = attractor.DistanceTo(plane.Origin)
    rotation = m.radians(distance * scale)
    new_plane.append(plane.Rotate(rotation, rg.Vector3d.ZAxis))
    return new_plane

def get_model():
    planes, planes_base = wall(row, column)
    
    # get fabrcation base
    f_planes = []
    for plane in planes:
        #rotate(plane,attractorCrv,scale)
        f_planes.append(plane)
        
    meshes =[]
    # create mesh by planes_bas
    for plane_base in planes_base:
        #rotate(plane_base,attractorCrv,scale)
        wallBrick = Brick(plane_base)
        meshes.append(wallBrick.mesh())
    return meshes, f_planes


meshes, f_planes = get_model()
# ---------- end python_11 ----------

# ----
geo_5 = Geometry(python_11.f_planes)
geo_6 = Geometry(python_11.meshes)
python_12 = GhPythonScript(count=Slider(35, range=0..100))  # -> out, a; inputs count: Int32
# ---------- python_12: Python ----------
__author__ = "WeiTingChen"
__version__ = "2020.10.09"

import rhinoscriptsyntax as rs
import Rhino.Geometry as rg
import ghpythonlib.components as gh
import math

a =[]
for i in range(count):
    x = i
    y = math.sin(math.pi*i/count + i)
    
    pt = rg.Point3d(x, y, 0)
    a.append(pt)
# ---------- end python_12 ----------
