# Grasshopper definition 20201104_HerringBrick.gh (Grasshopper 1.0.7)

python = GhPythonScript()  # -> out, num, crvs, num2, numlist, clearlist
# ---------- python: Python ----------
__author__ = "WeiTingChen"
__version__ = "2020.10.09"

import rhinoscriptsyntax as rs
import Rhino.Geometry as rg
import ghpythonlib.components as gh

num =[]
num2 =[]
for i in range(10):
    num.append(rg.Point3d(i,i,i))
    num2.append(rg.Point3d(-i,i,i))

crvs = rg.NurbsCurve.Create(False,1,num)

numlist = []

numlist.append(num)
numlist.append(num2)
print type (numlist)

clearlist =[]

for list in numlist:
    for point in list:
        clearlist.append(point)
#flatten
# ---------- end python ----------
python_2 = GhPythonScript(x=python.numlist)  # -> out, a
# ---------- python_2: Python ----------
__author__ = "WeiTingChen"
__version__ = "2020.10.09"

import rhinoscriptsyntax as rs
import Rhino.Geometry as rg
import ghpythonlib.components as gh



a =x
# ---------- end python_2 ----------
panel = Panel(python_2.a)
panel_2 = Panel(python.numlist)
panel_3 = Panel(python.clearlist)
number_slider = Slider(5, range=0..100)  # disabled
number_slider_2 = Slider(2, range=0..100)  # disabled
rotate_angle = Slider(6.97, range=0..30)  # disabled
rotate_angle_2 = Slider(20, range=0..30)
number_slider_3 = Slider(20, range=0..100)  # disabled
number_slider_4 = Slider(5, range=0..100)  # disabled
bricks = GhPythonScript()  # -> out, planes, meshes; inputs robot_base_geometry: list of Brep; disabled
# ---------- bricks: Python ----------
from compas_rhino import unload_modules
unload_modules('model')
from model import Brick
import Rhino.Geometry as rg
import math as m



def herring_bone(plane):
    planes = []
    meshes = []
    # first brick
    plane_origin = (plane.Origin + 
                    (plane.XAxis * Brick.REFERENCE_WIDTH/2) + 
                     (plane.YAxis *Brick.REFERENCE_LENGTH/2))
    brick_1_plane = rg.Plane(plane_origin, plane.XAxis, plane.YAxis)
    plane.Rotate(m.radians(90), rg.Vector3d.ZAxis)
    plane_rot = plane.Clone()
    brick_rot = Brick(plane_rot)
    planes.append(myBrick_rot.picking_plane())
    #meshes.append(myBrick_rot.mesh())
    
    # second brick
    plane_origin = (plane.Origin - 
                    (plane.XAxis * (Brick.REFERENCE_LENGTH/2 - Brick.REFERENCE_WIDTH/2)) 
                    - (plane.YAxis *((Brick.REFERENCE_LENGTH/2)+ Brick.REFERENCE_WIDTH/2)))
                    
    plane_brick_2 = rg.Plane(plane_origin, rg.Vector3d.XAxis, rg.Vector3d.YAxis)
    myBrick = Brick(plane_brick_2)
    planes.append(myBrick.picking_plane())
    #meshes.append(myBrick.mesh())
    return meshes



test_plane = rg.Plane(rg.Point3d(0,0,0), rg.Vector3d.XAxis, rg.Vector3d.YAxis)

herring_bone(test_plane)
meshes = []
for i in range (1):
    brick_plane = rg.Plane(rg.Point3d(Brick.REFERENCE_WIDTH*i,Brick.REFERENCE_WIDTH*i,100), rg.Vector3d.XAxis, rg.Vector3d.YAxis)
    meshes.extend(herring_bone(brick_plane))
# ---------- end bricks ----------
pt = Point(Point(28.4153801, 37.74651724, 0))
python_3 = GhPythonScript(row=Slider(5, range=0..10))  # -> out, planes, meshes_h, meshes_v; inputs row: Int32
# ---------- python_3: Python ----------
from compas_rhino import unload_modules
unload_modules('model')

import Rhino.Geometry as rg
from model import Brick
import math

def herring_bone(plane, row):
    planes = []
    meshes = []
    
    
    
    
    
    
    
    


def brick_horizontal_laying(row, gap):
    planes = []
    meshes = []
    x = Brick.REFERENCE_LENGTH / 2 
    y = Brick.REFERENCE_WIDTH + 1 
    
    for i in range(row):
        x_value = x * i + Brick.REFERENCE_LENGTH
        y_value = y * i + Brick.REFERENCE_WIDTH/2
        plane_origin = rg.Point3d(x_value, y_value, 0)
        plane = rg.Plane(plane_origin, rg.Vector3d.XAxis, rg.Vector3d.YAxis)
        planes.append(plane)
        b = Brick(plane)
        meshes.append(b.mesh())
    return planes, meshes


def brick_Vertical_laying(row, gap):
    planes = []
    meshes = []
    x = Brick.REFERENCE_LENGTH / 2 
    y = Brick.REFERENCE_WIDTH + 1 
    strat_vaule_x = Brick.REFERENCE_WIDTH/2 + 1 
    strat_vaule_y = Brick.REFERENCE_WIDTH/2 + Brick.REFERENCE_LENGTH / 2 + 1
    
    for i in range(row):
        x_value = x * i + Brick.REFERENCE_WIDTH/2
        y_value = y * i + Brick.REFERENCE_LENGTH / 2
        plane_origin = rg.Point3d(x_value, y_value, 0)
        plane = rg.Plane(plane_origin, rg.Vector3d.XAxis, rg.Vector3d.YAxis)
        plane.Rotate(math.radians(90), rg.Vector3d.ZAxis)
        planes.append(plane)
        b = Brick(plane)
        meshes.append(b.mesh())
    return planes, meshes



planes, meshes_h = brick_horizontal_laying(row,0.5)
planes02, meshes_v = brick_Vertical_laying(row,0.5)
# ---------- end python_3 ----------

# ---- group: HerringBrcik
python_4 = GhPythonScript(plan_depth=number_slider_4, height=number_slider_3)  # -> out, planes, meshes; inputs plan_depth: Int32, height: Int32; disabled
# ---------- python_4: Python ----------
from compas_rhino import unload_modules
unload_modules('model')

from model import Brick
import Rhino.Geometry as rg
import math

def herring_Brick(plane):
    planes = []
    planes_base =[]
    
    # first brick
    plane_origin = (plane.Origin
                   +(plane.XAxis * Brick.REFERENCE_WIDTH/2)
                   +(plane.YAxis * Brick.REFERENCE_LENGTH/2))
    
    brick_1_plane = rg.Plane(plane_origin, plane.XAxis, plane.YAxis)
    brick_1_plane.Rotate(math.radians(90), rg.Vector3d.ZAxis)
    planes_base.append(brick_1_plane)
    plane_rot = brick_1_plane.Clone()
    brick_rot = Brick(plane_rot)
    planes.append(brick_rot.picking_plane())
    
    # second brick
    plane_2_origin = (plane.Origin 
                   +(plane.XAxis * (Brick.REFERENCE_LENGTH-0.5))
                   +(plane.YAxis * Brick.REFERENCE_WIDTH/2))
    
    brick_2_plane = rg.Plane(plane_2_origin, plane.XAxis, plane.YAxis)
    brick_2_plane.Rotate(math.radians(0), rg.Vector3d.ZAxis)
    planes_base.append(brick_2_plane)
    plane_2_rot = brick_2_plane.Clone()
    brick_2_rot = Brick(plane_2_rot)
    planes.append(brick_2_rot.picking_plane())
    
    # third brick
    plane_3_origin = (plane.Origin 
                        -(plane.XAxis/2)
                        +(plane.YAxis 
                        *(Brick.REFERENCE_LENGTH + Brick.REFERENCE_WIDTH/2)))
    
    brick_3_plane = rg.Plane(plane_3_origin, plane.XAxis, plane.YAxis)
    brick_3_plane.Rotate(math.radians(0), rg.Vector3d.ZAxis)
    planes_base.append(brick_3_plane)
    plane_3_rot = brick_3_plane.Clone()
    brick_3_rot = Brick(plane_3_rot)
    planes.append(brick_3_rot.picking_plane())
    
    return planes, planes_base

meshes =[]
planes = []
planes_base = []

for i in range(plan_depth):
    for j in range(height):
        # plan gap
        gap_h = Brick.REFERENCE_WIDTH
        # vertcal gap
        gap_v = Brick.REFERENCE_HEIGHT
        brick_plane = rg.Plane(rg.Point3d(gap_h * i, gap_h* i, j*gap_v),
                                rg.Vector3d.XAxis, 
                                rg.Vector3d.YAxis)
        #T = rg.Transform.Rotation(math.radians(10)*i, rg.Point3d(0,0,0))
        brick_plane.Rotate(math.radians(10)*j, rg.Vector3d.ZAxis, rg.Point3d(0,0,0))
        planes.extend(herring_Brick(brick_plane))
        # print(herring_Brick(brick_plane)[0][0])
        planes_base.extend(herring_Brick(brick_plane)[1])
for plane in planes_base:
    b = Brick(plane)
    meshes.append(b.mesh())
# ---------- end python_4 ----------

python_5 = GhPythonScript(plan_depth=Slider(5, range=0..100), height=Slider(10, range=0..100), angle=rotate_angle_2, rotate_centre=pt)  # -> out, planes, planes_base, meshes; inputs plan_depth: Int32, height: Int32, rotate_centre: Point3d
# ---------- python_5: Python ----------
from compas_rhino import unload_modules
unload_modules('model')

from model import Brick
import Rhino.Geometry as rg
import math

def herring_Brick(plane):
    planes = []
    planes_base =[]
    
    # first brick
    plane_origin = (plane.Origin
                   +(plane.XAxis * Brick.REFERENCE_WIDTH/2)
                   +(plane.YAxis * Brick.REFERENCE_LENGTH/2))
    
    brick_1_plane = rg.Plane(plane_origin, plane.XAxis, plane.YAxis)
    brick_1_plane.Rotate(math.radians(90), rg.Vector3d.ZAxis)
    planes_base.append(brick_1_plane)
    plane_rot = brick_1_plane.Clone()
    brick_rot = Brick(plane_rot)
    planes.append(brick_rot.picking_plane())
    
    # second brick
    plane_2_origin = (plane.Origin 
                   +(plane.XAxis * (Brick.REFERENCE_LENGTH-0.5))
                   +(plane.YAxis * Brick.REFERENCE_WIDTH/2))
    
    brick_2_plane = rg.Plane(plane_2_origin, plane.XAxis, plane.YAxis)
    brick_2_plane.Rotate(math.radians(0), rg.Vector3d.ZAxis)
    planes_base.append(brick_2_plane)
    plane_2_rot = brick_2_plane.Clone()
    brick_2_rot = Brick(plane_2_rot)
    planes.append(brick_2_rot.picking_plane())
    
    # third brick
    plane_3_origin = (plane.Origin 
                        -(plane.XAxis/2)
                        +(plane.YAxis 
                        *(Brick.REFERENCE_LENGTH + Brick.REFERENCE_WIDTH/2)))
    
    brick_3_plane = rg.Plane(plane_3_origin, plane.XAxis, plane.YAxis)
    brick_3_plane.Rotate(math.radians(0), rg.Vector3d.ZAxis)
    planes_base.append(brick_3_plane)
    plane_3_rot = brick_3_plane.Clone()
    brick_3_rot = Brick(plane_3_rot)
    planes.append(brick_3_rot.picking_plane())
    
    return planes, planes_base


def del_nosupport_brick(plane, planes):
    
    plane_origin = plane.Origin
    planes_orgin = planes.Origin
    distance  = plane.DistanceTo(plane_origin)
    print(distance)

meshes =[]
planes = []
planes_base = []

# rotate and stack bricks 
for i in range(plan_depth):
    for j in range(height):
        # plan gap
        gap_h = Brick.REFERENCE_WIDTH
        # vertcal gap
        gap_v = Brick.REFERENCE_HEIGHT
        brick_plane = rg.Plane(rg.Point3d(gap_h * i, gap_h* i, j*gap_v),
                                rg.Vector3d.XAxis, 
                                rg.Vector3d.YAxis)
        #T = rg.Transform.Rotation(math.radians(10)*i, rg.Point3d(0,0,0))
        brick_plane.Rotate(math.radians(angle)*j, rg.Vector3d.ZAxis, rotate_centre)
        planes.extend(herring_Brick(brick_plane)[0])
        # print(herring_Brick(brick_plane)[0][0])
        planes_base.extend(herring_Brick(brick_plane)[1])
        
for plane in planes_base:
    b = Brick(plane)
    meshes.append(b.mesh())
# ---------- end python_5 ----------

python_6 = GhPythonScript(plan_depth=number_slider, height=number_slider_2, angle=rotate_angle)  # -> out, planes, planes_base, meshes; inputs plan_depth: Int32, height: Int32; disabled
# ---------- python_6: Python ----------
from compas_rhino import unload_modules
unload_modules('model')

from model import Brick
import Rhino.Geometry as rg
import math

def herring_Brick(plane):
    planes = []
    planes_base =[]
    
    # first brick
    plane_origin = (plane.Origin
                   +(plane.XAxis * Brick.REFERENCE_WIDTH/2)
                   +(plane.YAxis * Brick.REFERENCE_LENGTH/2))
    
    brick_1_plane = rg.Plane(plane_origin, plane.XAxis, plane.YAxis)
    brick_1_plane.Rotate(math.radians(90), rg.Vector3d.ZAxis)
    planes_base.append(brick_1_plane)
    plane_rot = brick_1_plane.Clone()
    brick_rot = Brick(plane_rot)
    planes.append(brick_rot.picking_plane())
    
    # second brick
    plane_2_origin = (plane.Origin 
                   +(plane.XAxis * (Brick.REFERENCE_LENGTH-0.5))
                   +(plane.YAxis * Brick.REFERENCE_WIDTH/2))
    
    brick_2_plane = rg.Plane(plane_2_origin, plane.XAxis, plane.YAxis)
    brick_2_plane.Rotate(math.radians(0), rg.Vector3d.ZAxis)
    planes_base.append(brick_2_plane)
    plane_2_rot = brick_2_plane.Clone()
    brick_2_rot = Brick(plane_2_rot)
    planes.append(brick_2_rot.picking_plane())
    
    # third brick
    plane_3_origin = (plane.Origin 
                        -(plane.XAxis/2)
                        +(plane.YAxis 
                        *(Brick.REFERENCE_LENGTH + Brick.REFERENCE_WIDTH/2)))
    
    brick_3_plane = rg.Plane(plane_3_origin, plane.XAxis, plane.YAxis)
    brick_3_plane.Rotate(math.radians(0), rg.Vector3d.ZAxis)
    planes_base.append(brick_3_plane)
    plane_3_rot = brick_3_plane.Clone()
    brick_3_rot = Brick(plane_3_rot)
    planes.append(brick_3_rot.picking_plane())
    
    return planes, planes_base


def del_nosupport_brick(plane, planes):
    
    plane_origin = plane.Origin
    planes_orgin = planes.Origin
    distance  = plane.DistanceTo(plane_origin)
    print(distance)

meshes =[]
planes = []
planes_base = []

# rotate and stack bricks 
for i in range(plan_depth):
    for j in range(height):
        # plan gap
        gap_h = Brick.REFERENCE_WIDTH
        # vertcal gap
        gap_v = Brick.REFERENCE_HEIGHT
        brick_plane = rg.Plane(rg.Point3d(gap_h * i, gap_h* i, j*gap_v),
                                rg.Vector3d.XAxis, 
                                rg.Vector3d.YAxis)
        #T = rg.Transform.Rotation(math.radians(10)*i, rg.Point3d(0,0,0))
        brick_plane.Rotate(math.radians(angle)*j, rg.Vector3d.ZAxis, rg.Point3d(0,0,0))
        planes.extend(herring_Brick(brick_plane)[0])
        # print(herring_Brick(brick_plane)[0][0])
        planes_base.extend(herring_Brick(brick_plane)[1])
        
for plane in planes_base:
    b = Brick(plane)
    meshes.append(b.mesh())
# ---------- end python_6 ----------

# ----
geo = Geometry(bricks.meshes)  # disabled
geo_2 = Geometry(python_4.meshes)  # disabled
pln = Plane(python_6.planes)  # disabled
pln_2 = Plane(python_6.planes_base)  # disabled
geo_3 = Geometry(python_6.meshes)  # disabled
geo_4 = Geometry(python_5.meshes)
pln_3 = Plane(python_5.planes)
pln_4 = Plane(python_5.planes_base)
