# Grasshopper definition 20201106_fabrication_file_python_modified.ghx (Grasshopper 1.0.7)

vector_z = Slider(1.8, range=-500..500)
vector_x = Slider(150, range=-500..500)
vector_y = Slider(420, range=-500..500)
geometry = Geometry([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])
bricks = GhPythonScript(
    robot_base_geometry=geometry,
    x_number=Slider(2, range=0..100),
    y_number=Slider(2, range=0..100),
    z_number=Slider(8, range=0..100))  # -> out, geo, planes; inputs robot_base_geometry: list of Brep, x_number: Int32, y_number: Int32, z_number: Int32
# ---------- bricks: Python ----------
from compas_rhino import unload_modules
unload_modules('model')

import Rhino.Geometry as rg
import Rhino.Collections as rc

from model import Brick
import math as m

x_vec = rg.Vector3d(1,0,0)
y_vec = rg.Vector3d(0,1,0)

plane_for_l = rg.Plane(rg.Point3d(0,0,100), x_vec, y_vec)

plane_for_test = rg.Plane(rg.Point3d(100,0,100), x_vec, y_vec)


class LBrick():
    def __init__(self, plane):
        self.plane = plane
        
        
    def create(self):
         myBrick = Brick(self.plane)
         
         brick_1 = myBrick.mesh()
         
         plane_for_brick_2 = rg.Plane.Clone(self.plane)
         
         moving_brick_2_vector_x = plane_for_brick_2.XAxis
         moving_brick_2_vector_y = plane_for_brick_2.YAxis
         
         rg.Plane.Translate(plane_for_brick_2, ((Brick.REFERENCE_LENGTH/2 + Brick.REFERENCE_WIDTH/2) + 2) * moving_brick_2_vector_x)
         rg.Plane.Translate(plane_for_brick_2,  moving_brick_2_vector_y * (Brick.REFERENCE_LENGTH-Brick.REFERENCE_WIDTH)/2)
         
         
         
         rg.Plane.Rotate(plane_for_brick_2, m.radians(90),plane_for_brick_2.ZAxis, plane_for_brick_2.Origin)
         
         
         myBrick_2 = Brick(plane_for_brick_2)
         
         brick_2 = myBrick_2.mesh()
         
         
         return myBrick, myBrick_2


lbricks = []


planes = []
geo = []
for k in range (z_number):
    for i in range(x_number):
        for j in range (y_number):
            if k % 2 == 1:
                 #######old param (22*i+10,36*j+20+(k/2)
                 
                plane = rg.Plane(rg.Point3d(20*i+28,36*j+25,(Brick.REFERENCE_HEIGHT*k +1)),rg.Vector3d(1,0,0), rg.Vector3d(0,1,0))
                rg.Plane.Rotate(plane, m.radians(-135),  plane.ZAxis, plane.Origin)
                
            else:
                #######old param(22*i,36*j+(k/2)
                plane = rg.Plane(rg.Point3d(21*i+5,36*j+5,(Brick.REFERENCE_HEIGHT*k+1)),rg.Vector3d(1,0,0), rg.Vector3d(0,1,0))
                rg.Plane.Rotate(plane, m.radians(45),  plane.ZAxis, plane.Origin)
                
                
        
            myLBrick = LBrick(plane)
            myBrick = Brick(plane)
            #planes.append(myBrick.base_plane())
            brick_1, brick_2 = myLBrick.create()
            
            planes.append(brick_1.base_plane())
            planes.append(brick_2.base_plane())
# ---------- end bricks ----------
geometry_2 = Geometry(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)
ghpython_script = GhPythonScript(brep=geometry_2)  # -> out, bbox, bool_diff; inputs brep: Brep
# ---------- ghpython_script: Python ----------
import Rhino.Geometry as rg
import rhinoscriptsyntax as rs

bbox = brep.GetBoundingBox(True)

bbox_br = bbox.ToBrep()

bool_diff = rg.Brep.CreateBooleanDifference(bbox_br, brep, 1)
# ---------- end ghpython_script ----------
geo = Geometry(bricks.planes)
point = Point(bricks.planes)
ghpython_script_2 = GhPythonScript(plane=bricks.planes, x=vector_x, y=vector_y, z=vector_z)  # -> out, planes, bricks; inputs plane: Plane
# ---------- ghpython_script_2: Python ----------
import Rhino.Geometry as rg
import rhinoscriptsyntax as rs

from model import Brick

def move_planes():
    plane.Translate(rg.Vector3d(x,y,z))
    return plane
planes = move_planes()


bricks = Brick(planes)
# ---------- end ghpython_script_2 ----------
button = Button()
ghpython_script_3 = GhPythonScript(my_shape=ghpython_script.bool_diff, points=point)  # -> out, glue, no_glue, glue_planes, no_glue_planes; inputs my_shape: Brep, points: list of Point3d
# ---------- ghpython_script_3: Python ----------
__author__ = "beril"
__version__ = "2020.11.05"

import rhinoscriptsyntax as rs
import Rhino.Geometry as rg

glue = []
no_glue = []
for point in points:
    is_inside = rg.Brep.IsPointInside(my_shape, point, 0.1, True)
    if is_inside == True:
        glue.append(point)
    else:
        no_glue.append(point)
        
        
glue_planes = []
no_glue_planes = []        
for point_g in glue:
    plane_g = rg.Plane(point_g, rg.Vector3d(0,0,1))
    glue_planes.append(plane_g)
for point_n in no_glue:
    plane_n = rg.Plane(point_n, rg.Vector3d(0,0,1))
    no_glue_planes.append(plane_n)
# ---------- end ghpython_script_3 ----------
geo_2 = Geometry(ghpython_script_2.planes)
fabrication = GhPythonScript(bricks=ghpython_script_2.bricks, send=button)  # -> out, rhino_base_way_planes, robot_planes; inputs bricks: list; disabled
# ---------- fabrication: Python ----------
from compas_rhino import unload_modules
unload_modules('model')

from model import Brick

import Rhino.Geometry as rg
import simple_comm as c
import simple_ur_script as ur

import math as m

geo = []
rhino_base_way_planes = []
for brick in bricks:
    rhino_base_way_planes.append(brick.base_plane())
    
 


def tcp(script):
    """ This funktion sets tcp 
    """
    script += ur.set_tcp_by_angles(
        0.0, 0.0, 74.0, m.radians(0.0), m.radians(180.0), m.radians(0))
    return script

def set_robot_base_plane_from_pts():
    

    pt_0 = rg.Point3d(0, 0, 0)  # base plane origin
    # point on base plane positive x direction
    pt_1 = rg.Point3d(299, 0, 0)
    pt_2 = rg.Point3d(299, 299, 0)  # point on base plane positive xy
    
    robot_base = rg.Plane(pt_0, pt_1-pt_0, pt_2-pt_0)
    return robot_base 

""" 
    pt_0 = rg.Point3d(299, 63, 0)  # base plane origin
    # point on base plane positive x direction
    pt_1 = rg.Point3d(499, 63, 0)
    pt_2 = rg.Point3d(499, 299, 0)  # point on base plane positive xy
"""


def rhino_to_robot_space(rhino_plane):
    """ this funktion translates planes from the rhino cordinate system to
    the robot cordinate system 
    """
    robot_plane = rhino_plane.Clone()
    _r_matrix = rg.Transform.PlaneToPlane(
        rg.Plane.WorldXY, set_robot_base_plane_from_pts())
    print robot_plane.Origin
    print(robot_plane.Transform(_r_matrix))
    print robot_plane.Origin
    return robot_plane
    
    
    
def pickup_brick(pick_up_plane, script):
    """Pick up a brick procedure

    Parameters
    ----------
    pick_up_plane : rhino.geometry.plane
    
    Returns:
    Procedure for pickin up plane
    """
    accel = 0.1    # m/s2
    vel = 0.1      # m/s

    safe_distance = 30
    
    way_planes = []

    safe_plane = pick_up_plane.Clone()
    safe_plane.Translate(rg.Vector3d(0, 0, safe_distance))

    script += ur.move_l(safe_plane, accel, vel)
    way_planes.append(safe_plane)

    script += ur.move_l(pick_up_plane, accel, vel)
    way_planes.append(pick_up_plane)

    script += ur.set_digital_out(4, True)
    script += ur.sleep(1)

    script += ur.move_l(safe_plane, accel, vel)
    way_planes.append(safe_plane)

    return script 

def place_brick(plane, script):
    """
    this function gereates the robotic sequience for placing a brick
    Requires a plane wich describes the possition of the brick"""

    safe_distance = 30
    accel = 0.1
    vel = 0.1
    way_planes = []

    safe_plane = plane.Clone()
    safe_plane.Translate(rg.Vector3d(0, 0, safe_distance))

    script += ur.move_l(safe_plane, accel, vel)
    way_planes.append(safe_plane)

    script += ur.move_l(plane, accel, vel)
    way_planes.append(plane)

    script += ur.set_digital_out(4, False)
    script += ur.sleep(1)

    script += ur.move_l(safe_plane, accel, vel)
    way_planes.append(safe_plane)

    return script

""" Robotic fabrication procedure
"""
script = ""

script = tcp(script)



"""pick _up plane is measured in the robot base plane
"""
pick_up_planes =[]
for i in range(6):  # rows x-direction
    for j in range(10):  # rows y-direction
        x_pos = i * (Brick.REFERENCE_LENGTH)
        y_pos = j * (Brick.REFERENCE_WIDTH)
        origin = rg.Point3d(-56+x_pos, 505-y_pos, 0)
        pick_up_plane = rg.Plane(origin, rg.Vector3d.XAxis, rg.Vector3d.YAxis)
        pick_up_planes.append(pick_up_plane)
pick_up_planes.reverse()

robot_planes = []

"""We are translating all way_planes from rhino base to robot_base
"""
for rhino_plane in (rhino_base_way_planes):
    robot_planes.append(rhino_to_robot_space(rhino_plane))


for robot_plane, pick_up_plane in zip(robot_planes, pick_up_planes):
    #pick up a plane 
    script = pickup_brick(pick_up_plane, script)
    script = place_brick(robot_plane, script)
    
script = c.concatenate_script(script)

send = True
if send:
    c.send_script(script, "192.168.10.10")
# ---------- end fabrication ----------

# ---- group: Guillaume code new procedure
fabrication_2 = GhPythonScript(send=button)  # -> out, rhino_base_way_planes, robot_planes; inputs bricks: list
# ---------- fabrication_2: Python ----------
from compas_rhino import unload_modules
unload_modules('model')

from model import Brick

import Rhino.Geometry as rg
import simple_comm as c
import simple_ur_script as ur

import math as m

geo = []
rhino_base_way_planes = []


Paccel = 0.1    # m/s2
Pvel = 0.1      # m/s

Taccel = 0.3    # m/s2
Tvel = 0.3      # m/s

for brick in bricks:
    rhino_base_way_planes.append(brick.base_plane())

def tcp(script):
    """ This funktion sets tcp 
    """
    script += ur.set_tcp_by_angles(
        0.0, 0.0, 74.0, m.radians(0.0), m.radians(180.0), m.radians(0))
    return script

def set_robot_base_plane_from_pts():
    

    pt_0 = rg.Point3d(0, 0, 0)  # base plane origin
    # point on base plane positive x direction
    pt_1 = rg.Point3d(299, 0, 0)
    pt_2 = rg.Point3d(299, 299, 0)  # point on base plane positive xy
    
    robot_base = rg.Plane(pt_0, pt_1-pt_0, pt_2-pt_0)
    return robot_base 

""" 
    pt_0 = rg.Point3d(299, 63, 0)  # base plane origin
    # point on base plane positive x direction
    pt_1 = rg.Point3d(499, 63, 0)
    pt_2 = rg.Point3d(499, 299, 0)  # point on base plane positive xy
"""


def rhino_to_robot_space(rhino_plane):
    """ this funktion translates planes from the rhino cordinate system to
    the robot cordinate system 
    """
    robot_plane = rhino_plane.Clone()
    _r_matrix = rg.Transform.PlaneToPlane(
        rg.Plane.WorldXY, set_robot_base_plane_from_pts())
    return robot_plane


def pickup_brick(pick_up_plane, script):
    """Pick up a brick procedure

    Parameters
    ----------
    pick_up_plane : rhino.geometry.plane
    
    Returns:
    Procedure for pickin up plane
    """
    safe_distance = 30
    
    way_planes = []

    safe_plane = pick_up_plane.Clone()
    safe_plane.Translate(rg.Vector3d(0, 0, safe_distance))

    script += ur.move_l(safe_plane, Taccel, Tvel)
    way_planes.append(safe_plane)
    
    #to slow done line 85, 91

    script += ur.move_l(pick_up_plane, Paccel, Pvel)
    way_planes.append(pick_up_plane)

    script += ur.set_digital_out(4, True)
    script += ur.sleep(1)

    script += ur.move_l(safe_plane, Paccel, Pvel)
    way_planes.append(safe_plane)

    return script 


def glue_brick(script):
    glue_plane = rg.Plane(rg.Point3d(-30, 320, 2),rg.Vector3d(0,0,1))
    #maybe add a second plane to improve glue procedure
    safe_distance = 50
    way_planes = []
    
    safe_plane = glue_plane.Clone()
    
    safe_plane.Translate(rg.Vector3d(0, 0, safe_distance))
    
    script += ur.move_l(safe_plane, Taccel, Tvel)
    way_planes.append(safe_plane)
    
    script += ur.move_l(glue_plane, Paccel, Pvel)
    way_planes.append(glue_plane)
    
    script += ur.set_digital_out(4, True)
    script += ur.sleep(1)
    
    script += ur.move_l(safe_plane, Paccel, Pvel)
    way_planes.append(safe_plane)
    
    return script



def place_brick(plane, script):
    """
    this function gereates the robotic sequience for placing a brick
    Requires a plane wich describes the possition of the brick"""

    safe_distance = 30
    way_planes = []

    safe_plane = plane.Clone()
    safe_plane.Translate(rg.Vector3d(0, 0, safe_distance))

    script += ur.move_l(safe_plane, Taccel, Tvel)
    way_planes.append(safe_plane)

    script += ur.move_l(plane, Paccel, Pvel)
    way_planes.append(plane)

    script += ur.set_digital_out(4, False)
    script += ur.sleep(10)

    script += ur.move_l(safe_plane, Paccel, Pvel)
    way_planes.append(safe_plane)

    return script

""" Robotic fabrication procedure
"""
script = ""

script = tcp(script)



"""pick _up plane is measured in the robot base plane
"""
pick_up_planes =[]
for i in range(5):  # rows x-direction
    for j in range(10):  # rows y-direction
        x_pos = i * (Brick.REFERENCE_LENGTH + 5)
        y_pos = j * (Brick.REFERENCE_WIDTH + 5)
        origin = rg.Point3d(-56+x_pos, 505-y_pos, 0) # Z parameter to be define 
        pick_up_plane = rg.Plane(origin, rg.Vector3d.XAxis, rg.Vector3d.YAxis)
        pick_up_planes.append(pick_up_plane)
pick_up_planes.reverse()

robot_planes = []

"""We are translating all way_planes from rhino base to robot_base
"""
for rhino_plane in (rhino_base_way_planes):
    robot_planes.append(rhino_to_robot_space(rhino_plane))


for robot_plane in (robot_planes):
    #pick up a plane 
    script = pickup_brick(pick_up_plane, script)
    script = glue_brick(script)
    script = place_brick(robot_plane, script)
    
script = c.concatenate_script(script)

send = True
if send:
    c.send_script(script, "192.168.10.10")
# ---------- end fabrication_2 ----------

# ----
custom_preview = CustomPreview(Geometry=ghpython_script_3.glue, Material=ColourSwatch(SwatchColor=RGB(242, 165, 22)))
custom_preview_2 = CustomPreview(Geometry=ghpython_script_3.no_glue_planes, Material=ColourSwatch(SwatchColor=RGB(21, 53, 232)))
