# Grasshopper definition Brick.gh (Grasshopper 1.0.7)

python = GhPythonScript()  # -> out, brick_planes
# ---------- python: Python ----------
from compas_rhino import unload_modules
unload_modules('model')
import Rhino.Geometry as rg
from model import Brick

x_cnt = 10
z_cnt = 5

b_length = Brick.REFERENCE_LENGTH
b_width = Brick.REFERENCE_WIDTH
b_height = Brick.REFERENCE_HEIGHT

brick_planes = []
for i in range(z_cnt):  # layer count
    for j in range(x_cnt):  # layer length

        if i % 2 == 0:
            x_pos = j * (b_length+1)
        else:
            x_pos = j * (b_length+1) + (b_length/2)-1

        z_pos = i * (b_height)
        origin = rg.Point3d(x_pos, 0, z_pos)
        plane = rg.Plane(origin, rg.Vector3d.XAxis, rg.Vector3d.YAxis)
        Attractor = rg.Point3d(10,10,0)
        distance = Attractor.DistanceTo(origin)
        rotation = distance * 0.3
        plane.Rotate(rotation, rg.Vector3d.ZAxis)
        brick_planes.append(plane)
# ---------- end python ----------
