# Grasshopper definition Brick_Expore_1104.gh (Grasshopper 1.0.7)
# plug-ins: Moonlight

# ---- group: Brick_without offset
crv = Curve(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)  # disabled
python = GhPythonScript(curves=crv)  # -> out, pts, plane, meshes, planes; inputs curves: list of Curve; disabled
# ---------- python: Python ----------
from compas_rhino import unload_modules
unload_modules('model_Explore')

from model_Explore import Brick
from model_Explore import Fabrication
import random as r
import Rhino.Geometry as rg
import rhinoscriptsyntax as rs
import math as m
import simple_comm as c
import simple_ur_script as ur

def brick_possitions_split(planes):
    """Genrates a Rhino Geometry plane for each brick

    Returns
    ----------
    brick_planes : [Rhino Geometry Plane, Rhino Geometry Plane, ...]

    """
    
    brick_planes = []
  
    pts = []
    y_positive = 0
    y_negative = 0
    
    for i  in range (2):  # layer heigh
        for j, plane in enumerate(planes):  # layer length
            if i % 2 == 0:
                x_pos = plane.OriginX
                y_pos = plane.OriginY# why no rg
                z_value = Brick.REFERENCE_HEIGHT * i + i*1
                if j < 4 or j >=14:
                    pts.append(rg.Point3d(x_pos, y_pos, z_value))

                    # create planes here aswell
#---------------------------------------------------------------------------
                if 4 <= j < 9:
                    for k in range(2):
                        if k == 0:
                            y_positive += 9
                            y_offset_vector = plane.XAxis  #rg.Plane.YAxis 
                            
                            pt2 = rg.Point3d(x_pos, y_pos, z_value) + y_offset_vector*y_positive
                            pts.append(pt2)
                            
                            # create the plane 
                            
                            # when you split, use the y axis of the plane to copy and offset the new plane
                        else:
                            y_negative -= 9
                            y_offset_vector = plane.XAxis
                            
                            pt2 = rg.Point3d(x_pos, y_pos, z_value) + y_offset_vector*y_negative
                            pts.append(pt2)
                elif 9 <= j < 14:
                    for k in range(2):
                        if k == 0:
                            y_positive -= 9
                            y_offset_vector = plane.XAxis
                            
                            pt2 = rg.Point3d(x_pos, y_pos, z_value) + y_offset_vector*y_positive
                            pts.append(pt2)
                        else:
                            y_negative += 9
                            y_offset_vector = plane.XAxis
                            pt2 = rg.Point3d(x_pos, y_pos, z_value) + y_offset_vector*y_negative
                            pts.append(pt2)
#---------------------------------------------------------------------------
            else:
                x_pos = plane.OriginX 
                y_pos = plane.OriginY
                z_value = Brick.REFERENCE_HEIGHT * i + i*1
                if j < 4 or j >=14:
                    #pts.append(plane.Origin)
                    pts.append(rg.Point3d(x_pos, y_pos, z_value))
                if 4 <= j < 9:
                    for k in range(2):
                        if k == 0:
                            y_positive += 9
                            y_offset_vector = plane.XAxis
                            pt2 = rg.Point3d(x_pos, y_pos, z_value) + y_offset_vector*y_positive
                            pts.append(pt2)
                        else:
                            y_negative -= 9
                            y_offset_vector = plane.XAxis
                            pt2 = rg.Point3d(x_pos, y_pos, z_value) + y_offset_vector*y_negative
                            pts.append(pt2)
                elif 9 <= j < 14:
                    for k in range(2):
                        if k == 0:
                            y_positive -= 9
                            y_offset_vector = plane.XAxis
                            pt2 = rg.Point3d(x_pos, y_pos, z_value) + y_offset_vector*y_positive
                            pts.append(pt2)
                        else:
                            y_negative += 9
                            y_offset_vector = plane.XAxis
                            pt2 = rg.Point3d(x_pos, y_pos, z_value) + y_offset_vector*y_negative
                            pts.append(pt2)

    return pts

def curve_to_planes():
    brick_planes = []
    for curve in curves:
        params = rg.Curve.DivideByLength(curve,Brick.REFERENCE_LENGTH,False)
        for param in params:
            brick_pos = rg.Curve.PointAt(curve,param)
            brick_tan = rg.Curve.TangentAt(curve,param)
            
            vec1= rg.Vector3d.CrossProduct(brick_tan,rg. Vector3d.ZAxis)
            vec2= rg.Vector3d.CrossProduct(vec1,rg.Vector3d.ZAxis)
            plane = rg.Plane(brick_pos,vec1,vec2)
            brick_planes.append(plane)

    return brick_planes
planes=curve_to_planes()

pts = brick_possitions_split(planes)
# ---------- end python ----------
pln = Plane(python.planes)  # disabled
number_slider = Slider(10, range=0..100)  # disabled
mesh = Mesh(python.meshes)  # disabled
pln_2 = Plane(python.plane)  # disabled
pt = Point(python.pts)  # disabled
item = ListItem(List=pt, Index=number_slider, Wrap=True)  # disabled

# ----
data = Data(["Grasshopper.Kernel.Types.GH_ObjectWrapper", "Grasshopper.Kernel.Types.GH_ObjectWrapper", "Grasshopper.Kernel.Types.GH_ObjectWrapper", "Grasshopper.Kernel.Types.GH_ObjectWrapper", "Grasshopper.Kernel.Types.GH_ObjectWrapper", "Grasshopper.Kernel.Types.GH_ObjectWrapper"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])
moonlight = Moonlight(Mode=True)

# ---- group: Curve_to_Plane_offset
python_2 = GhPythonScript(curves=crv)  # -> out, planes_odd, pts; inputs curves: list of Curve
# ---------- python_2: Python ----------
from compas_rhino import unload_modules
unload_modules('model')

import Rhino.Geometry as rg
import rhinoscriptsyntax as rs
from model import Brick


#def curve_to_planes():
#    brick_planes = []
#    
#    for curve in curves:
#        params = rg.Curve.DivideByLength(curve, Brick.REFERENCE_LENGTH, False)
#        print (params)
#        for param in params:
#            brick_pos = rg.Curve.PointAt(curve, param)
#            brick_tan = rg.Curve.TangentAt(curve, param)
#            vec1 = rg.Vector3d.CrossProduct(brick_tan, rg.Vector3d.ZAxis)
#            vec2 = rg.Vector3d.CrossProduct(vec1, rg.Vector3d.ZAxis)
#            
#            plane = rg.Plane(brick_pos, vec1, vec2)
#            brick_planes.append(plane)
#    return brick_planes
#    
#planes = curve_to_planes()

def curve_to_planes_eo():
    brick_planes_even =[]
    brick_planes_odd =[]
    brick_planes = []
    brick_planes_o = []
    for curve in curves:
        params = rg.Curve.DivideByLength(curve,Brick.REFERENCE_LENGTH/2,False)
        for param in params:
            brick_pos = rg.Curve.PointAt(curve,param)
            brick_tan = rg.Curve.TangentAt(curve,param)
            
            vec1= rg.Vector3d.CrossProduct(brick_tan,rg. Vector3d.ZAxis)
            vec2= rg.Vector3d.CrossProduct(vec1,rg.Vector3d.ZAxis)
            plane = rg.Plane(brick_pos,-vec2,-vec1)
            brick_planes.append(plane)
            
    for i, plane in enumerate(brick_planes):
        if i % 2 == 0:
            brick_planes_even.append(plane)
        else:
            brick_planes_odd.append(plane)
            
    brick_planes_o.append(brick_planes_even)
    brick_planes_o.append(brick_planes_odd)
    #return brick_planes_even, brick_planes_odd
    return brick_planes_o

planes=curve_to_planes_eo()
planes_odd = planes[1]
# ---------- end python_2 ----------
pln_3 = Plane(python_2.planes_odd)
preview = CustomPreview(Geometry=pln_3, Material=ColourSwatch(SwatchColor=RGB(255, 167, 184)))

# ----
pt_2 = Point(python_2.pts)
number_slider_2 = Slider(6, range=0..100)
number_slider_3 = Slider(0.6, range=0..2)
number_slider_4 = Slider(4, range=0..100)

# ---- group: Brick_offset
number_slider_5 = Slider(8, range=0..30)  # disabled
number_slider_6 = Slider(24, range=0..60)  # disabled
addition = Addition(A=number_slider_5, B=number_slider_6)  # disabled
panel = Panel("2")  # disabled
crv_2 = Curve(<curve referenced from the Rhino model>)  # disabled
division = Division(A=addition, B=panel)  # disabled
python_3 = GhPythonScript(curves=crv_2, split_start=number_slider_5, split_end=number_slider_6, split_mid=division)  # -> out, pts, planes, picking_planes, meshes, curve_planes; inputs curves: list of Curve, split_start: Int32, split_end: Int32, split_mid: Int32; disabled
# ---------- python_3: Python ----------
from compas_rhino import unload_modules
unload_modules('model_Explore')

from model_Explore import Brick
from model_Explore import Fabrication
import random as r
import Rhino.Geometry as rg
import rhinoscriptsyntax as rs
import math as m
import simple_comm as c
import simple_ur_script as ur

def brick_possitions_split(curve_planes):
    """Genrates a Rhino Geometry plane for each brick

    Returns
    ----------
    brick_planes : [Rhino Geometry Plane, Rhino Geometry Plane, ...]

    """
    pts = []
    planes = []
    y_positive = 0
    y_negative = 0
    
    for i  in range (9):  # layer heigh
        if i % 2 == 0:
            for j, plane in enumerate(curve_planes[0]):  # layer length
                x_pos = plane.OriginX
                y_pos = plane.OriginY# why no rg
                z_value = Brick.REFERENCE_HEIGHT * i + i*1
                if j < split_start or j >= split_end:
                    pts.append(rg.Point3d(x_pos, y_pos, z_value))
                    planes.append(rg.Plane(rg.Point3d(x_pos, y_pos, z_value), plane.XAxis, plane.YAxis))#P
                    # create planes here aswell
#---------------------------------------------------------------------------
                if split_start <= j < split_mid:
                    for k in range(2):
                        if k == 0:
                            y_positive += 9
                            y_offset_vector = plane.YAxis  #rg.Plane.YAxis 
                            
                            pt2 = rg.Point3d(x_pos, y_pos, z_value) + y_offset_vector*y_positive
                            pts.append(pt2)
                            planes.append(rg.Plane(pt2, plane.XAxis, plane.YAxis))
                            # create the plane 
                            
                            # when you split, use the y axis of the plane to copy and offset the new plane
                        else:
                            y_negative -= 9
                            y_offset_vector = plane.YAxis
                            
                            pt2 = rg.Point3d(x_pos, y_pos, z_value) + y_offset_vector*y_negative
                            pts.append(pt2)
                            planes.append(rg.Plane(pt2, plane.XAxis, plane.YAxis))
                elif split_mid <= j < split_end:
                    for k in range(2):
                        if k == 0:
                            y_positive -= 9
                            y_offset_vector = plane.YAxis
                            
                            pt2 = rg.Point3d(x_pos, y_pos, z_value) + y_offset_vector*y_positive
                            pts.append(pt2)
                            planes.append(rg.Plane(pt2, plane.XAxis, plane.YAxis))
                        else:
                            y_negative += 9
                            y_offset_vector = plane.YAxis
                            pt2 = rg.Point3d(x_pos, y_pos, z_value) + y_offset_vector*y_negative
                            pts.append(pt2)
                            planes.append(rg.Plane(pt2, plane.XAxis, plane.YAxis))
#---------------------------------------------------------------------------
        else:
            for j, plane in enumerate(curve_planes[1]):
                x_pos = plane.OriginX 
                y_pos = plane.OriginY
                z_value = Brick.REFERENCE_HEIGHT * i + i*1
                if j < split_start or j >= split_end:
                    pts.append(rg.Point3d(x_pos, y_pos, z_value))
                    planes.append(rg.Plane(rg.Point3d(x_pos, y_pos, z_value), plane.XAxis, plane.YAxis))
                    
                if split_start <= j < split_mid:
                    for k in range(2):
                        if k == 0:
                            y_positive += 9
                            y_offset_vector = plane.YAxis
                            pt2 = rg.Point3d(x_pos, y_pos, z_value) + y_offset_vector*y_positive
                            pts.append(pt2)
                            planes.append(rg.Plane(pt2, plane.XAxis, plane.YAxis))
                        else:
                            y_negative -= 9
                            y_offset_vector = plane.YAxis
                            pt2 = rg.Point3d(x_pos, y_pos, z_value) + y_offset_vector*y_negative
                            pts.append(pt2)
                            planes.append(rg.Plane(pt2, plane.XAxis, plane.YAxis))
                elif split_mid <= j < split_end:
                    for k in range(2):
                        if k == 0:
                            y_positive -= 9
                            y_offset_vector = plane.YAxis
                            pt2 = rg.Point3d(x_pos, y_pos, z_value) + y_offset_vector*y_positive
                            pts.append(pt2)
                            planes.append(rg.Plane(pt2, plane.XAxis, plane.YAxis))
                        else:
                            y_negative += 9
                            y_offset_vector = plane.YAxis
                            pt2 = rg.Point3d(x_pos, y_pos, z_value) + y_offset_vector*y_negative
                            pts.append(pt2)
                            planes.append(rg.Plane(pt2, plane.XAxis, plane.YAxis))
                            

    return planes
    
def curve_to_planes_eo():
    brick_planes_even =[]
    brick_planes_odd =[]
    brick_planes = []
    brick_planes_o = []
    for curve in curves:
        params = rg.Curve.DivideByLength(curve,Brick.REFERENCE_LENGTH/2,False)
        for param in params:
            brick_pos = rg.Curve.PointAt(curve,param)
            brick_tan = rg.Curve.TangentAt(curve,param)

            vec1= rg.Vector3d.CrossProduct(brick_tan,rg. Vector3d.ZAxis)
            vec2= rg.Vector3d.CrossProduct(vec1,rg.Vector3d.ZAxis)
            plane = rg.Plane(brick_pos,vec2,vec1)
            
            brick_planes.append(plane)

    for i, plane in enumerate(brick_planes):
        if i % 2 == 0:
            brick_planes_even.append(plane)
        else:
            brick_planes_odd.append(plane)
            
    brick_planes_o.append(brick_planes_even)
    brick_planes_o.append(brick_planes_odd)
    #return brick_planes_even, brick_planes_odd
    return brick_planes_o

curve_planes=curve_to_planes_eo() #planes_even = planes[0] planes_odd = planes[1] 
planes = brick_possitions_split(curve_planes)


picking_planes = []
meshes = []
for p in planes:
    myBrick = Brick(p)
    picking_planes.append(myBrick.picking_plane())
    meshes.append(myBrick.mesh())
# ---------- end python_3 ----------
pln_4 = Plane(python_3.picking_planes)  # disabled
mesh_2 = Mesh(python_3.meshes)  # disabled
number_slider_7 = Slider(0, range=0..100)  # disabled
pt_3 = Point(python_3.pts)  # disabled
pln_5 = Plane(python_3.planes)  # disabled
swatch = ColourSwatch(SwatchColor=RGB(255, 167, 184))  # disabled
item_2 = ListItem(List=mesh_2, Index=number_slider_7, Wrap=True)  # disabled
preview_2 = CustomPreview(Geometry=item_2, Material=swatch)  # disabled

# ----
number_slider_8 = Slider(5.6, range=0..20)

python_4 = GhPythonScript()  # -> out, pts
# ---------- python_4: Python ----------
from compas_rhino import unload_modules
unload_modules('model_Explore')

from model_Explore import Brick
from model_Explore import Fabrication
import random as r
import Rhino.Geometry as rg
import rhinoscriptsyntax as rs
import math as m
from math import e, sqrt, pi
import simple_comm as c
import simple_ur_script as ur

def brick_possitions_split():
    """Genrates a Rhino Geometry plane for each brick

    Returns
    ----------
    brick_planes : [Rhino Geometry Plane, Rhino Geometry Plane, ...]

    """
    brick_planes = []
  
    pts = []
    bpts = []
    y_positive = 0
    y_negtive = 0
    y_list = [1,9,1,5,1,5,1,5,1,5]

    for i in range(20):  # layer count
        x_pos = i * (Brick.REFERENCE_LENGTH+1)
        #print (x_pos)

        if 4 <= i < 14:
            #y_pos = [y_pos+9 if j==0 else y_posn-9 for j in range(2)]
            #print (y_pos)
            for j in range(2):

                if j == 0:
                    y_positive = y_list[i-4]
                    pt2 = rg.Point3d(x_pos, y_positive, 0)
                    pts.append(pt2)

                else:
                    y_negtive -= 9
                    pt2 = rg.Point3d(x_pos, y_negtive, 0)
                    pts.append(pt2)

#        elif 9 <= i < 14:
#            
#            for j in range(2):
#
#                if j == 0:
#                    y_positive -= 9
#                    pt2 = rg.Point3d(x_pos, y_positive, 0)
#                    pts.append(pt2)
#
#                else:
#                    y_negtive += 9
#                    pt2 = rg.Point3d(x_pos, y_negtive, 0)
#                    pts.append(pt2)

        else:
            y_pos = 0
            #print (x_pos)
            pt1 = rg.Point3d(x_pos, y_pos, 0)

            pts.append(pt1)

    return pts

pts = brick_possitions_split()
# ---------- end python_4 ----------
item_3 = ListItem(List=python_4.pts, Index=Slider(20, range=0..20), Wrap=True)
pt_4 = Point(graft(python_4.pts))

crv_3 = Curve(<curve referenced from the Rhino model>)
number_slider_9 = Slider(2, range=0..30)
number_slider_10 = Slider(12, range=0..60)
addition_2 = Addition(A=number_slider_9, B=number_slider_10)
division_2 = Division(A=addition_2, B="2")
python_5 = GhPythonScript(
    s=number_slider_8,
    curves=crv_3,
    wall_height=number_slider_2,
    gap=number_slider_3,
    split_start=number_slider_9,
    split_end=number_slider_10,
    split_mid=division_2)  # -> out, pts, planes, picking_planes, meshes, curve_planes, test_brick; inputs s: Int32, curves: list of Curve, wall_height: Int32, split_start: Int32, split_end: Int32, split_mid: Int32
# ---------- python_5: Python ----------
from compas_rhino import unload_modules
unload_modules('model_Explore')

from model_Explore import Brick
from model_Explore import Fabrication
import random as r
import Rhino.Geometry as rg
import rhinoscriptsyntax as rs
import math as m
import simple_comm as c
import simple_ur_script as ur



def curve_to_planes_eo():
    brick_planes_even =[]
    brick_planes_odd =[]
    brick_planes = []
    brick_planes_o = []
    rotation = m.radians(10)
    for curve in curves:
        params = rg.Curve.DivideByLength(curve,Brick.REFERENCE_LENGTH/4+ gap, False)
        for param in params:
            brick_pos = rg.Curve.PointAt(curve,param)
            brick_tan = rg.Curve.TangentAt(curve,param)

            vec1= rg.Vector3d.CrossProduct(brick_tan,rg. Vector3d.ZAxis)
            vec2= rg.Vector3d.CrossProduct(vec1,rg.Vector3d.ZAxis)
            plane = rg.Plane(brick_pos,vec2,vec1)
            
            brick_planes.append(plane)

    for i, plane in enumerate(brick_planes):
        if i % 4 == 0:
            brick_planes_even.append(plane)
        elif i % 4 == 2:
            brick_planes_odd.append(plane)
            
    brick_planes_o.append(brick_planes_even)
    brick_planes_o.append(brick_planes_odd)
    return brick_planes_o

    
def brick_possitions_split(curve_planes):
    """Genrates a Rhino Geometry plane for each brick

    Returns
    ----------
    brick_planes : [Rhino Geometry Plane, Rhino Geometry Plane, ...]

    """
    planes = []
    y_positive = 0
    y_negative = 0
    rotation = m.radians(0)
    for i  in range (wall_height):  # layer heigh
        if i % 2 == 0:
            for j, plane in enumerate(curve_planes[0]):  # layer length
                x_pos = plane.OriginX
                y_pos = plane.OriginY # why no rg
                z_value = Brick.REFERENCE_HEIGHT * i + i*0.1

                if j < split_start+1 :
                    pt2 = rg.Point3d(x_pos, y_pos, z_value)
                    p = rg.Plane(pt2, plane.XAxis, plane.YAxis)
                    p.Rotate(m.radians(90), rg.Vector3d.ZAxis)
                    planes.append(p)
                    # create planes here aswell
                    
                elif split_start+1 <= j < split_mid+1 :
                    for k in range(2):
                        if k == 0:
                            y_positive += s-0.5
                            y_offset_vector = plane.YAxis  # when you split, use the y axis of the plane to copy and offset the new plane rg.Plane.YAxis 
                            
                            pt2 = rg.Point3d(x_pos, y_pos, z_value) + y_offset_vector*(y_positive+6)
                            p = rg.Plane(pt2, plane.XAxis, plane.YAxis)# create the plane 
                            p.Rotate(rotation+m.radians(-30), rg.Vector3d.ZAxis)
                            planes.append(p)

                        else:
                            y_negative -= s-0.5
                            y_offset_vector = plane.YAxis
                            
                            pt2 = rg.Point3d(x_pos, y_pos, z_value) + y_offset_vector*(y_negative-6)
                            p = rg.Plane(pt2, plane.XAxis, plane.YAxis)
                            p.Rotate(rotation+m.radians(30), rg.Vector3d.ZAxis)
                            planes.append(p)

                elif split_mid+1 <= j < split_end+1 :
                    for k in range(2):
                        if k == 0:
                            y_positive -= s-0.5
                            y_offset_vector = plane.YAxis
                            
                            pt2 = rg.Point3d(x_pos, y_pos, z_value) + y_offset_vector*(y_positive+15)
                            p = rg.Plane(pt2, plane.XAxis, plane.YAxis)
                            p.Rotate(rotation+m.radians(30), rg.Vector3d.ZAxis)
                            planes.append(p)
                        else:
                            y_negative += s-0.5
                            y_offset_vector = plane.YAxis
                            pt2 = rg.Point3d(x_pos, y_pos, z_value) + y_offset_vector*(y_negative-13)
                            p = rg.Plane(pt2, plane.XAxis, plane.YAxis)
                            p.Rotate(rotation+m.radians(-30), rg.Vector3d.ZAxis)
                            planes.append(p)

                else :
                    pt2 = rg.Point3d(x_pos, y_pos, z_value)
                    p = rg.Plane(pt2, plane.XAxis, plane.YAxis)
                    p.Rotate(m.radians(90), rg.Vector3d.ZAxis)
                    planes.append(p)#
            planes[0].Translate(planes[0].YAxis*2)



        else:
            for j, plane in enumerate(curve_planes[1]):
                x_pos = plane.OriginX 
                y_pos = plane.OriginY
                z_value = Brick.REFERENCE_HEIGHT * i + i*0.1
                if j < split_start+1:
                    planes.append(rg.Plane(rg.Point3d(x_pos, y_pos, z_value), plane.XAxis, plane.YAxis))
                elif split_start+1<= j < split_mid+1:
                    for k in range(2):
                        if k == 0:
                            y_positive += s+0.3
                            y_offset_vector = plane.YAxis
                            pt2 = rg.Point3d(x_pos, y_pos, z_value) + y_offset_vector*(y_positive+6)
                            p = rg.Plane(pt2, plane.XAxis, plane.YAxis)
                            p.Rotate(rotation+m.radians(-30), rg.Vector3d.ZAxis)
                            planes.append(p)
                        else:
                            y_negative -= s+0.3
                            y_offset_vector = plane.YAxis
                            pt2 = rg.Point3d(x_pos, y_pos, z_value) + y_offset_vector*(y_negative-6)
                            p = rg.Plane(pt2, plane.XAxis, plane.YAxis)
                            p.Rotate(rotation+m.radians(30), rg.Vector3d.ZAxis)
                            planes.append(p)
                elif split_mid+1 <= j < split_end+1 :
                    for k in range(2):
                        if k == 0:
                            y_positive -= s-0.6
                            y_offset_vector = plane.YAxis
                            pt2 = rg.Point3d(x_pos, y_pos, z_value) + y_offset_vector*(y_positive+6.5)
                            p = rg.Plane(pt2, plane.XAxis, plane.YAxis)
                            p.Rotate(rotation+m.radians(30), rg.Vector3d.ZAxis)
                            planes.append(p)
                        else:
                            y_negative += s-0.6
                            y_offset_vector = plane.YAxis
                            pt2 = rg.Point3d(x_pos, y_pos, z_value) + y_offset_vector*(y_negative-6.5)
                            p = rg.Plane(pt2, plane.XAxis, plane.YAxis)
                            p.Rotate(rotation+m.radians(-30), rg.Vector3d.ZAxis)
                            planes.append(p)
                else:
                    planes.append(rg.Plane(rg.Point3d(x_pos, y_pos, z_value), plane.XAxis, plane.YAxis))
            planes[-1].Rotate(m.radians(90), rg.Vector3d.ZAxis)
            planes[-1].Translate(planes[-1].YAxis*-8)
    return planes


curve_planes=curve_to_planes_eo() #planes_even = planes[0] planes_odd = planes[1] 
planes = brick_possitions_split(curve_planes)


picking_planes = []
meshes = []
test_brick = []
for p in planes:
    myBrick = Brick(p)
    picking_planes.append(myBrick.picking_plane())
    meshes.append(myBrick.mesh())
    test_brick.append(myBrick)
# ---------- end python_5 ----------
pln_6 = Plane(python_5.picking_planes)
mesh_3 = Mesh(python_5.meshes)
pt_5 = Point(python_5.pts)
item_4 = ListItem(List=mesh_3, Index=Slider(0, range=0..500), Wrap=True)
preview_3 = CustomPreview(Geometry=mesh_3, Material=ColourSwatch(SwatchColor=RGB(137, 154, 184)))

python_6 = GhPythonScript(curves=crv_3, split_start=number_slider_9, split_end=number_slider_10)  # -> out, planes, b, split_planes; inputs curves: list of Curve
# ---------- python_6: Python ----------
from compas_rhino import unload_modules
unload_modules('model')

import Rhino.Geometry as rg
import rhinoscriptsyntax as rs
from model import Brick


def curve_to_planes():
    brick_planes = []
    brick_planes_split =[]
    for curve in curves:
        params = rg.Curve.DivideByLength(curve, Brick.REFERENCE_LENGTH, False)
        for param in params:
            brick_pos = rg.Curve.PointAt(curve, param)
            brick_tan = rg.Curve.TangentAt(curve, param)
            vec1= rg.Vector3d.CrossProduct(brick_tan,rg. Vector3d.ZAxis)
            vec2= rg.Vector3d.CrossProduct(vec1,rg.Vector3d.ZAxis)
            plane = rg.Plane(brick_pos,vec2,vec1)
            brick_planes.append(plane)
        brick_planes_split.append(brick_planes)

    #return brick_planes
    return brick_planes_split

brick_planes_split = curve_to_planes() 
#planes = curve_to_planes() 


for j, list in enumerate(brick_planes_split):
    split_planes = [plane for i, plane in enumerate(list) if split_start <= i < split_end]
#test=planes[4]  


#test.OriginY)
# ---------- end python_6 ----------
pln_7 = Plane(python_6.split_planes)
pln_8 = Plane(python_6.b)
pln_9 = Plane(python_6.planes)

dam = DataDam(DataA=python_5.planes, BufferDelay=10000000, BufferMode=0)
input = DataInput(UpdateDelay=5)
pln_10 = Plane(dam)
output = DataOutput(DataInput=pln_10)
python_7 = GhPythonScript(planes=pln_10)  # -> out, bricks; inputs planes: list of Plane
# ---------- python_7: Python ----------
__author__ = "Fen"
__version__ = "2020.11.06"

from compas_rhino import unload_modules
unload_modules('model_Explore')

from model_Explore import Brick

bricks=[]

for plane in planes:
    bricks.append(Brick(plane))
# ---------- end python_7 ----------

preview_4 = CustomPreview(Geometry=pln_7, Material=ColourSwatch(SwatchColor=RGB(255, 167, 184)))

dam_2 = DataDam(DataA=python_5.test_brick, BufferDelay=10000000, BufferMode=0)
partition = PartitionList(List=dam_2, Size="72")  # -> simplify(Chunks)
branch = TreeBranch(Tree=partition, Path="0", MaintainPaths=True)
branch_2 = TreeBranch(Tree=partition, Path="1", MaintainPaths=True)
branch_3 = TreeBranch(Tree=partition, Path="2", MaintainPaths=True)
branch_4 = TreeBranch(Tree=partition, Path="3", MaintainPaths=True)
branch_5 = TreeBranch(Tree=partition, Path="4", MaintainPaths=True)
branch_6 = TreeBranch(Tree=partition, Path="5", MaintainPaths=True)
fabrication = GhPythonScript(bricks=branch_3)  # -> out, rhino_base_way_planes, robot_planes; inputs bricks: list
# ---------- fabrication: Python ----------
from compas_rhino import unload_modules
unload_modules('model_Explore')

import Rhino.Geometry as rg
import simple_comm as c
import simple_ur_script as ur
import math as m
from model_Explore import Brick



geo = []
rhino_base_way_planes = []
for brick in bricks:
    rhino_base_way_planes.append(brick.base_plane())
    
    


def tcp(script):
    """ This funktion sets tcp 
    """
    script += ur.set_tcp_by_angles(
        0.0, 0.0, 74.0, m.radians(0.0), m.radians(180.0), m.radians(0))
    return script

def set_robot_base_plane_from_pts():
    z = 0.3
    pt_0 = rg.Point3d(329, 223, z)  # base plane origin
    # point on base plane positive x direction
    pt_1 = rg.Point3d(529, 223, z)
    pt_2 = rg.Point3d(529, 329, z)  # point on base plane positive xy

    robot_base = rg.Plane(pt_0, pt_1-pt_0, pt_2-pt_0)
    return robot_base

def rhino_to_robot_space(rhino_plane):
    """ this funktion translates planes from the rhino cordinate system to
    the robot cordinate system 
    """
    robot_plane = rhino_plane.Clone()
    _r_matrix = rg.Transform.PlaneToPlane(
        rg.Plane.WorldXY, set_robot_base_plane_from_pts())
    print robot_plane.Origin
    print(robot_plane.Transform(_r_matrix))
    print robot_plane.Origin
    return robot_plane
    
    
    
def pickup_brick(pick_up_plane, script):
    """Pick up a brick procedure

    Parameters
    ----------
    pick_up_plane : rhino.geometry.plane
    
    Returns:
    Procedure for pickin up plane
    """
    accel = 0.3    # m/s2
    vel = 0.2      # m/s

    safe_distance = 50
    
    way_planes = []

    safe_plane = pick_up_plane.Clone()
    safe_plane.Translate(rg.Vector3d(0, 0, safe_distance))

    script += ur.move_l(safe_plane, accel, vel)
    way_planes.append(safe_plane)

    script += ur.move_l(pick_up_plane, accel, vel)
    way_planes.append(pick_up_plane)

    script += ur.set_digital_out(4, True)
    script += ur.sleep(0.5)

    script += ur.move_l(safe_plane, accel, vel)
    way_planes.append(safe_plane)

    return script 

def place_brick(plane, script):
    """
    this function gereates the robotic sequience for placing a brick
    Requires a plane wich describes the possition of the brick"""

    safe_distance = 50
    accel = 0.3
    vel = 0.5
    way_planes = []

    safe_plane = plane.Clone()
    safe_plane.Translate(rg.Vector3d(0, 0, safe_distance))

    script += ur.move_l(safe_plane, accel, vel)
    way_planes.append(safe_plane)

    script += ur.move_l(plane, accel, vel)
    way_planes.append(plane)

    script += ur.set_digital_out(4, False)
    script += ur.sleep(0.5)

    script += ur.move_l(safe_plane, accel, vel)
    way_planes.append(safe_plane)

    return script

""" Robotic fabrication procedure
"""
script = ""

script = tcp(script)



"""pick _up plane is measured in the robot base plane
"""
pick_up_plane = rg.Plane(rg.Point3d(-57, 507, 0), rg.Vector3d.XAxis, rg.Vector3d.YAxis) #adapt the pickup position, set z=10 to safe the tool

robot_planes = []

"""We are translating all way_planes from rhino base to robot_base
"""
for rhino_plane in (rhino_base_way_planes):
    robot_planes.append(rhino_to_robot_space(rhino_plane))



pick_up_planes =[]
for i in range(6):  # rows x-direction
    for j in range(12):  # rows y-direction
        x_pos = i * (Brick.REFERENCE_LENGTH)
        y_pos = j * (Brick.REFERENCE_WIDTH)
        origin = rg.Point3d(-57+x_pos, 507-y_pos, 0)
        pick_up_plane = rg.Plane(origin, rg.Vector3d.XAxis, rg.Vector3d.YAxis)
        pick_up_planes.append(pick_up_plane)
        
pick_up_planes.reverse()


robot_planes = []
"""We are translating all way_planes from rhino base to robot_base
"""
for rhino_plane in (rhino_base_way_planes):
    robot_planes.append(rhino_to_robot_space(rhino_plane))
for robot_plane, pick_up_plane in zip(robot_planes, pick_up_planes):
    #pick up a plane 
    script = pickup_brick(pick_up_plane, script)
    script = place_brick(robot_plane, script)
script = c.concatenate_script(script)
script = c.concatenate_script(script)

send = False
print script
if send:
    c.send_script(script, "192.168.10.10")
# ---------- end fabrication ----------

python_8 = GhPythonScript(
    s=number_slider_8,
    curves=crv_3,
    wall_height=number_slider_2,
    gap=number_slider_3,
    split_start=number_slider_9,
    split_end=number_slider_10,
    split_mid=division_2)  # -> out, pts, planes, picking_planes, meshes, curve_planes; inputs s: Int32, curves: list of Curve, wall_height: Int32, split_start: Int32, split_end: Int32, split_mid: Int32; disabled
# ---------- python_8: Python ----------
from compas_rhino import unload_modules
unload_modules('model_Explore')

from model_Explore import Brick
from model_Explore import Fabrication
import random as r
import Rhino.Geometry as rg
import rhinoscriptsyntax as rs
import math as m
import simple_comm as c
import simple_ur_script as ur



def curve_to_planes_eo():
    brick_planes_even =[]
    brick_planes_odd =[]
    brick_planes = []
    brick_planes_o = []
    brick_planes_mul = []
    rotation = m.radians(10)
    for curve in curves:
        params = rg.Curve.DivideByLength(curve,Brick.REFERENCE_LENGTH/4+ gap, False)
        for param in params:
            brick_pos = rg.Curve.PointAt(curve,param)
            brick_tan = rg.Curve.TangentAt(curve,param)

            vec1= rg.Vector3d.CrossProduct(brick_tan,rg. Vector3d.ZAxis)
            vec2= rg.Vector3d.CrossProduct(vec1,rg.Vector3d.ZAxis)
            plane = rg.Plane(brick_pos,vec2,vec1)
            
            brick_planes.append(plane)

    for i, plane in enumerate(brick_planes):
        if i % 4 == 0:
            brick_planes_even.append(plane)
        elif i % 4 == 1:
            brick_planes_odd.append(plane)
            
    brick_planes_o.append(brick_planes_even)
    brick_planes_o.append(brick_planes_odd)
    #return brick_planes_even, brick_planes_odd
    #brick_planes_mul.append(brick_planes_o)
    
    return brick_planes_o

    
def brick_possitions_split(curve_planes):
    """Genrates a Rhino Geometry plane for each brick

    Returns
    ----------
    brick_planes : [Rhino Geometry Plane, Rhino Geometry Plane, ...]

    """
    planes = []
    y_positive = 0
    y_negative = 0
    rotation = m.radians(0)
    for i  in range (wall_height):  # layer heigh
        if i % 2 == 0:
            for j, plane in enumerate(curve_planes[0]):  # layer length
                x_pos = plane.OriginX
                y_pos = plane.OriginY # why no rg
                z_value = Brick.REFERENCE_HEIGHT * i + i*(gap)

                if j < split_start  or j >= split_end :
                    planes.append(rg.Plane(rg.Point3d(x_pos, y_pos, z_value), plane.XAxis, plane.YAxis))#P
                    # create planes here aswell
                    
                elif split_start  <= j < split_mid :
                    for k in range(2):
                        if k == 0:
                            y_positive += s
                            y_offset_vector = plane.YAxis  # when you split, use the y axis of the plane to copy and offset the new plane rg.Plane.YAxis 
                            
                            pt2 = rg.Point3d(x_pos, y_pos, z_value) + y_offset_vector*(y_positive+12-0.3*i)
                            p = rg.Plane(pt2, plane.XAxis, plane.YAxis)# create the plane 
                            p.Rotate(rotation+m.radians(j), rg.Vector3d.ZAxis)
                            planes.append(p)

                        else:
                            y_negative -= s
                            y_offset_vector = plane.YAxis
                            
                            pt2 = rg.Point3d(x_pos, y_pos, z_value) + y_offset_vector*(y_negative-12+0.3*i)
                            p = rg.Plane(pt2, plane.XAxis, plane.YAxis)
                            p.Rotate(rotation+m.radians(-j), rg.Vector3d.ZAxis)
                            planes.append(p)

                elif split_mid <= j < split_end :
                    for k in range(2):
                        if k == 0:
                            y_positive -= s
                            y_offset_vector = plane.YAxis
                            
                            pt2 = rg.Point3d(x_pos, y_pos, z_value) + y_offset_vector*(y_positive+12-0.3*i)
                            p = rg.Plane(pt2, plane.XAxis, plane.YAxis)
                            p.Rotate(rotation+m.radians(-j), rg.Vector3d.ZAxis)
                            planes.append(p)
                        else:
                            y_negative += s
                            y_offset_vector = plane.YAxis
                            pt2 = rg.Point3d(x_pos, y_pos, z_value) + y_offset_vector*(y_negative-12+0.3*i)
                            p = rg.Plane(pt2, plane.XAxis, plane.YAxis)
                            p.Rotate(rotation+m.radians(j), rg.Vector3d.ZAxis)
                            planes.append(p)

        else:
            for j, plane in enumerate(curve_planes[1]):
                x_pos = plane.OriginX 
                y_pos = plane.OriginY
                z_value = Brick.REFERENCE_HEIGHT * i + i*gap
                if j < split_start or j >= split_end :
                    planes.append(rg.Plane(rg.Point3d(x_pos, y_pos, z_value), plane.XAxis, plane.YAxis))
                    
                if split_start <= j < split_mid :
                    for k in range(2):
                        if k == 0:
                            y_positive += s 
                            y_offset_vector = plane.YAxis
                            pt2 = rg.Point3d(x_pos, y_pos, z_value) + y_offset_vector*(y_positive+12-0.8*i)
                            p = rg.Plane(pt2, plane.XAxis, plane.YAxis)
                            p.Rotate(rotation+m.radians(-j), rg.Vector3d.ZAxis)
                            planes.append(p)
                        else:
                            y_negative -= s 
                            y_offset_vector = plane.YAxis
                            pt2 = rg.Point3d(x_pos, y_pos, z_value) + y_offset_vector*(y_negative-12+0.8*i)
                            p = rg.Plane(pt2, plane.XAxis, plane.YAxis)
                            p.Rotate(rotation+m.radians(j), rg.Vector3d.ZAxis)
                            planes.append(p)
                elif split_mid <= j < split_end:
                    for k in range(2):
                        if k == 0:
                            y_positive -= s
                            y_offset_vector = plane.YAxis
                            pt2 = rg.Point3d(x_pos, y_pos, z_value) + y_offset_vector*(y_positive+12)
                            p = rg.Plane(pt2, plane.XAxis, plane.YAxis)
                            p.Rotate(rotation+m.radians(j), rg.Vector3d.ZAxis)
                            planes.append(p)
                        else:
                            y_negative += s
                            y_offset_vector = plane.YAxis
                            pt2 = rg.Point3d(x_pos, y_pos, z_value) + y_offset_vector*(y_negative-12)
                            p = rg.Plane(pt2, plane.XAxis, plane.YAxis)
                            p.Rotate(rotation+m.radians(-j), rg.Vector3d.ZAxis)
                            planes.append(p)
    return planes
    

curve_planes=curve_to_planes_eo() #planes_even = planes[0] planes_odd = planes[1] 
planes = brick_possitions_split(curve_planes)


picking_planes = []
meshes = []
for p in planes:
    myBrick = Brick(p)
    picking_planes.append(myBrick.picking_plane())
    meshes.append(myBrick.mesh())
# ---------- end python_8 ----------

geo = Geometry([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])
visualization = GhPythonScript(bricks=dam_2, robot_base=geo)  # -> out, geo, transformed_robot_base, v_w_p, s_crv; inputs bricks: list, robot_base: list of Brep
# ---------- visualization: Python ----------
"""Generates a 3D model of the wall

Returns
----------
geo : [Rhino Geometry Surface, Rhino Geometry Surface, ...]

"""
from compas_rhino import unload_modules
unload_modules('model_Explore')

import Rhino.Geometry as rg

from model_Explore import Fabrication
from model_Explore import Brick

planes = []
geo = []

for brick in bricks:
    geo.append(brick.mesh())

visualizeFabrication = Fabrication(brick_planes=planes)
visualizeFabrication.procedure(transform=False)


# return 
robot_matrix = visualizeFabrication.robot_transformation()
transformed_robot_base = []
for brep in robot_base:
    trans_brep = brep.Duplicate()
    trans_brep.Transform(robot_matrix)
    transformed_robot_base.append(trans_brep)
# ---------- end visualization ----------
geo_2 = Geometry(visualization.transformed_robot_base)
geo_3 = Geometry(visualization.s_crv)
grp = Group(visualization.geo)
geo_4 = Geometry(visualization.v_w_p)

circle_test = GhPythonScript(
    s=number_slider_8,
    curves=crv_3,
    wall_height=number_slider_2,
    gap=number_slider_3,
    split_start=number_slider_9,
    split_end=number_slider_10,
    split_mid=division_2)  # -> out, pts, planes, picking_planes, meshes, curve_planes, test_brick; inputs s: Int32, curves: list of Curve, wall_height: Int32, split_start: Int32, split_end: Int32, split_mid: Int32
# ---------- circle_test: Python ----------
from compas_rhino import unload_modules
unload_modules('model_Explore')

from model_Explore import Brick
from model_Explore import Fabrication
import random as r
import Rhino.Geometry as rg
import rhinoscriptsyntax as rs
import math as m
import simple_comm as c
import simple_ur_script as ur



def curve_to_planes_eo():
    brick_planes_even =[]
    brick_planes_odd =[]
    brick_planes = []
    brick_planes_o = []
    rotation = m.radians(10)
    for curve in curves:
        params = rg.Curve.DivideByLength(curve,Brick.REFERENCE_LENGTH/4+ gap, False)
        for param in params:
            brick_pos = rg.Curve.PointAt(curve,param)
            brick_tan = rg.Curve.TangentAt(curve,param)

            vec1= rg.Vector3d.CrossProduct(brick_tan,rg. Vector3d.ZAxis)
            vec2= rg.Vector3d.CrossProduct(vec1,rg.Vector3d.ZAxis)
            plane = rg.Plane(brick_pos,vec2,vec1)
            
            brick_planes.append(plane)

    for i, plane in enumerate(brick_planes):
        if i % 4 == 0:
            brick_planes_even.append(plane)
        elif i % 4 == 2:
            brick_planes_odd.append(plane)
            
    brick_planes_o.append(brick_planes_even)
    brick_planes_o.append(brick_planes_odd)
    return brick_planes_o

    
def brick_possitions_split(curve_planes):
    """Genrates a Rhino Geometry plane for each brick

    Returns
    ----------
    brick_planes : [Rhino Geometry Plane, Rhino Geometry Plane, ...]

    """
    planes = []
    y_positive = 0
    y_negative = 0
    rotation = m.radians(0)
    for i  in range (wall_height):  # layer heigh
        if i % 2 == 0:
            for j, plane in enumerate(curve_planes[0]):  # layer length
                x_pos = plane.OriginX
                y_pos = plane.OriginY # why no rg
                z_value = Brick.REFERENCE_HEIGHT * i + i*0.1

                if j < split_start   or j >= split_end :
                    planes.append(rg.Plane(rg.Point3d(x_pos, y_pos, z_value), plane.XAxis, plane.YAxis))#P
                    # create planes here aswell
                    
                elif split_start <= j < split_mid :
                    for k in range(2):
                        if k == 0:
                            y_positive += s
                            y_offset_vector = plane.YAxis  # when you split, use the y axis of the plane to copy and offset the new plane rg.Plane.YAxis 
                            
                            pt2 = rg.Point3d(x_pos, y_pos, z_value) + y_offset_vector*(y_positive+11)
                            p = rg.Plane(pt2, plane.XAxis, plane.YAxis)# create the plane 
                            p.Rotate(rotation+m.radians(-45), rg.Vector3d.ZAxis)
                            planes.append(p)

                        else:
                            y_negative -= s
                            y_offset_vector = plane.YAxis
                            
                            pt2 = rg.Point3d(x_pos, y_pos, z_value) + y_offset_vector*(y_negative-11)
                            p = rg.Plane(pt2, plane.XAxis, plane.YAxis)
                            p.Rotate(rotation+m.radians(45), rg.Vector3d.ZAxis)
                            planes.append(p)

                elif split_mid <= j < split_end :
                    for k in range(2):
                        if k == 0:
                            y_positive -= s
                            y_offset_vector = plane.YAxis
                            
                            pt2 = rg.Point3d(x_pos, y_pos, z_value) + y_offset_vector*(y_positive+15)
                            p = rg.Plane(pt2, plane.XAxis, plane.YAxis)
                            p.Rotate(rotation+m.radians(-45), rg.Vector3d.ZAxis)
                            planes.append(p)
                        else:
                            y_negative += s
                            y_offset_vector = plane.YAxis
                            pt2 = rg.Point3d(x_pos, y_pos, z_value) + y_offset_vector*(y_negative-15)
                            p = rg.Plane(pt2, plane.XAxis, plane.YAxis)
                            p.Rotate(rotation+m.radians(45), rg.Vector3d.ZAxis)
                            planes.append(p)

        else:
            for j, plane in enumerate(curve_planes[1]):
                x_pos = plane.OriginX 
                y_pos = plane.OriginY
                z_value = Brick.REFERENCE_HEIGHT * i + i*0.1
                if j < split_start   or j >= split_end :
                    planes.append(rg.Plane(rg.Point3d(x_pos, y_pos, z_value), plane.XAxis, plane.YAxis))
                    
                if split_start <= j < split_mid :
                    for k in range(2):
                        if k == 0:
                            y_positive += s 
                            y_offset_vector = plane.YAxis
                            pt2 = rg.Point3d(x_pos, y_pos, z_value) + y_offset_vector*(y_positive+11)
                            p = rg.Plane(pt2, plane.XAxis, plane.YAxis)
                            p.Rotate(rotation+m.radians(i*6), rg.Vector3d.ZAxis)
                            planes.append(p)
                        else:
                            y_negative -= s 
                            y_offset_vector = plane.YAxis
                            pt2 = rg.Point3d(x_pos, y_pos, z_value) + y_offset_vector*(y_negative-11)
                            p = rg.Plane(pt2, plane.XAxis, plane.YAxis)
                            p.Rotate(rotation+m.radians(i*-6), rg.Vector3d.ZAxis)
                            planes.append(p)
                elif split_mid <= j < split_end :
                    for k in range(2):
                        if k == 0:
                            y_positive -= s
                            y_offset_vector = plane.YAxis
                            pt2 = rg.Point3d(x_pos, y_pos, z_value) + y_offset_vector*(y_positive+15)
                            p = rg.Plane(pt2, plane.XAxis, plane.YAxis)
                            p.Rotate(rotation+m.radians(i*45), rg.Vector3d.ZAxis)
                            planes.append(p)
                        else:
                            y_negative += s
                            y_offset_vector = plane.YAxis
                            pt2 = rg.Point3d(x_pos, y_pos, z_value) + y_offset_vector*(y_negative-15)
                            p = rg.Plane(pt2, plane.XAxis, plane.YAxis)
                            p.Rotate(rotation+m.radians(i*-45), rg.Vector3d.ZAxis)
                            planes.append(p)
    return planes
    

curve_planes=curve_to_planes_eo() #planes_even = planes[0] planes_odd = planes[1] 
planes = brick_possitions_split(curve_planes)


picking_planes = []
meshes = []
test_brick = []
for p in planes:
    myBrick = Brick(p)
    picking_planes.append(myBrick.picking_plane())
    meshes.append(myBrick.mesh())
    test_brick.append(myBrick)
# ---------- end circle_test ----------
fabrication_2 = GhPythonScript(bricks=python_5.test_brick)  # -> out, rhino_base_way_planes, robot_planes; inputs bricks: list
# ---------- fabrication_2: Python ----------
import Rhino.Geometry as rg
import simple_comm as c
import simple_ur_script as ur
from model_Explore import Brick
import math as m

geo = []
rhino_base_way_planes = []
for brick in bricks:
    rhino_base_way_planes.append(brick.base_plane())
    
    


def tcp(script):
    """ This funktion sets tcp 
    """
    script += ur.set_tcp_by_angles(
        0.0, 0.0, 74.0, m.radians(0.0), m.radians(180.0), m.radians(0))
    return script

def set_robot_base_plane_from_pts():
    z = 0.9
    pt_0 = rg.Point3d(329, 233, z)  # base plane origin
    # point on base plane positive x direction
    pt_1 = rg.Point3d(529, 233, z)
    pt_2 = rg.Point3d(529, 329, z)  # point on base plane positive xy

    robot_base = rg.Plane(pt_0, pt_1-pt_0, pt_2-pt_0)
    return robot_base

def rhino_to_robot_space(rhino_plane):
    """ this funktion translates planes from the rhino cordinate system to
    the robot cordinate system 
    """
    robot_plane = rhino_plane.Clone()
    _r_matrix = rg.Transform.PlaneToPlane(
        rg.Plane.WorldXY, set_robot_base_plane_from_pts())
    return robot_plane
    
    
    
def pickup_brick(pick_up_plane, script):
    """Pick up a brick procedure

    Parameters
    ----------
    pick_up_plane : rhino.geometry.plane
    
    Returns:
    Procedure for pickin up plane
    """
    accel = 0.1    # m/s2
    vel = 0.1      # m/s

    safe_distance = 50
    
    way_planes = []

    safe_plane = pick_up_plane.Clone()
    safe_plane.Translate(rg.Vector3d(0, 0, safe_distance))

    script += ur.move_l(safe_plane, accel, vel)
    way_planes.append(safe_plane)

    script += ur.move_l(pick_up_plane, accel, vel)
    way_planes.append(pick_up_plane)

    script += ur.set_digital_out(4, True)
    script += ur.sleep(1)

    script += ur.move_l(safe_plane, accel, vel)
    way_planes.append(safe_plane)

    return script 

def place_brick(plane, script):
    """
    this function gereates the robotic sequience for placing a brick
    Requires a plane wich describes the possition of the brick"""

    safe_distance = 50
    accel = 0.1
    vel = 0.1
    way_planes = []

    safe_plane = plane.Clone()
    safe_plane.Translate(rg.Vector3d(0, 0, safe_distance))

    script += ur.move_l(safe_plane, accel, vel)
    way_planes.append(safe_plane)

    script += ur.move_l(plane, accel, vel)
    way_planes.append(plane)

    script += ur.set_digital_out(4, False)
    script += ur.sleep(1)

    script += ur.move_l(safe_plane, accel, vel)
    way_planes.append(safe_plane)

    return script

""" Robotic fabrication procedure
"""
script = ""

script = tcp(script)

pick_up_planes =[]
for i in range(6):  # rows x-direction
    for j in range(12):  # rows y-direction
        x_pos = i * (Brick.REFERENCE_LENGTH)
        y_pos = j * (Brick.REFERENCE_WIDTH)
        origin = rg.Point3d(-57+x_pos, 507-y_pos, 0)
        pick_up_plane = rg.Plane(origin, rg.Vector3d.XAxis, rg.Vector3d.YAxis)
        pick_up_planes.append(pick_up_plane)
        
pick_up_planes.reverse()
print Brick.REFERENCE_LENGTH

robot_planes = []
"""We are translating all way_planes from rhino base to robot_base
"""
for rhino_plane in (rhino_base_way_planes):
    robot_planes.append(rhino_to_robot_space(rhino_plane))
for robot_plane, pick_up_plane in zip(robot_planes, pick_up_planes):
    #pick up a plane 
    script = pickup_brick(pick_up_plane, script)
    script = place_brick(robot_plane, script)
script = c.concatenate_script(script)
send = False

if send:
    c.send_script(script, "192.168.10.10")





#"""pick _up plane is measured in the robot base plane
#"""
#pick_up_plane = rg.Plane(rg.Point3d(-57, 507, 0), rg.Vector3d.XAxis, rg.Vector3d.YAxis) #adapt the pickup position, set z=10 to safe the tool
#
#robot_planes = []
#
#"""We are translating all way_planes from rhino base to robot_base
#"""
#for rhino_plane in (rhino_base_way_planes):
#    robot_planes.append(rhino_to_robot_space(rhino_plane))
#
#
#
#for robot_plane in (robot_planes):
#    #pick up a plane 
#    script = pickup_brick(pick_up_plane, script)
#    script = place_brick(robot_plane, script)
#    
#script = c.concatenate_script(script)
#
#send = False
#if send:
#    c.send_script(script, "192.168.10.10")
# ---------- end fabrication_2 ----------

# ---- group: Curve_to_Plane
crv_4 = Curve([<curve referenced from the Rhino model> x2])  # disabled
python_9 = GhPythonScript(curves=crv_4, split_start=number_slider_9, split_end=number_slider_10)  # -> out, planes, test, split_planes; inputs curves: list of Curve; disabled
# ---------- python_9: Python ----------
from compas_rhino import unload_modules
unload_modules('model')

import Rhino.Geometry as rg
import rhinoscriptsyntax as rs
from model import Brick


def curve_to_planes():
    brick_planes = []
    for curve in curves:
        params = rg.Curve.DivideByLength(curve, Brick.REFERENCE_LENGTH, False)
        for param in params:
            brick_pos = rg.Curve.PointAt(curve, param)
            brick_tan = rg.Curve.TangentAt(curve, param)
            vec1= rg.Vector3d.CrossProduct(brick_tan,rg. Vector3d.ZAxis)
            vec2= rg.Vector3d.CrossProduct(vec1,rg.Vector3d.ZAxis)
            plane = rg.Plane(brick_pos,vec2,vec1)
            brick_planes.append(plane)

    return brick_planes

  
planes = curve_to_planes() 
split_planes = [plane for i, plane in enumerate(planes) if split_start <= i < split_end]

print(len(planes))

#test=planes[4]  


#test.OriginY)
# ---------- end python_9 ----------
swatch_2 = ColourSwatch(SwatchColor=RGB(255, 167, 184))  # disabled
pln_11 = Plane(python_9.planes)  # disabled

# ----
pln_12 = Plane(python_9.split_planes)  # disabled
pln_13 = Plane(python_9.test)  # disabled

# ---- group: Curve_to_Plane (continued)
preview_5 = CustomPreview(Geometry=pln_12, Material=swatch_2)  # disabled
