# Grasshopper definition Brickwall_08112020.ghx (Grasshopper 1.0.7)

number_slider = Slider(7.5, range=0..10)
geometry = Geometry([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])
multiplication = Multiplication(A=number_slider, B=Slider(3.5, range=0..10))
bricks = GhPythonScript(
    robot_base_geometry=geometry,
    gap=Slider(3, range=0..10),
    rad=Slider(6.7, range=0..10),
    amp=number_slider,
    dis=multiplication)  # -> out, meshes, bricks, line_pts, planes; inputs robot_base_geometry: list of Brep
# ---------- bricks: Python ----------
from compas_rhino import unload_modules
unload_modules('model')

import rhinoscriptsyntax as rs
import Rhino.Geometry as rg
import math
from model import Brick

planes = []
meshes = []
points = []

all_line_pts = []
for k in range(3):
    for i in range(19):
        line_points = []
        for j in range(10):
        
        
#            gap = 3
#            rad = 2*math.pi/15
#            amp = 7
#            dis = amp * 3.5
            
            
            if i % 2 == 1:
                x_value = (Brick.REFERENCE_LENGTH) * j + (gap*j) +  (Brick.REFERENCE_LENGTH+gap)/3
                if k % 2 == 1:
                    y_value = dis*k + -1 * ((math.sin(i*rad)* amp) * (math.cos(j*rad)* amp) / 4)
                else:
                    y_value = dis*k + (math.sin(i*rad)* amp) * (math.cos(j*rad)* amp) / 4
                z_value = Brick.REFERENCE_HEIGHT * i
                
                plane_origin = rg.Point3d(x_value, y_value, z_value)
                
            else:
                x_value = Brick.REFERENCE_LENGTH * j + (gap*j)
                if k % 2 == 1:
                    y_value = dis*k + -1 * ((math.sin(i*rad)* amp) * (math.cos(j*rad)* amp) / 4)
                else:
                    y_value = dis*k + (math.sin(i*rad)* amp) * (math.cos(j*rad)* amp) / 4
                z_value = Brick.REFERENCE_HEIGHT * i
                
                plane_origin = rg.Point3d(x_value, y_value, z_value)
               
                
            line_points.append(plane_origin)
        all_line_pts.append(line_points)


all_line_vecs = []


for line_pts in all_line_pts:
    line_vecs = []
    for i in range(len(line_pts)-1):
        pt_vec = line_pts[i+1]-line_pts[i]
        line_vecs.append(pt_vec)
    line_vecs.append(line_vecs[-1])
    all_line_vecs.append(line_vecs)


planes = []
bricks = []
"""
points1 = []
points2 = []
points3 = []

for i, j in enumerate(len(all_line_pts), all_line_pts):
    if i % 3 == 0:
        points1.append(j)
    elif i % 3 == 1:
        points2.append(j)
    else:
        points3.append(j)
        
a = points1
"""

for i in range(len(all_line_pts)):
    line_pts = all_line_pts[i]
    line_vectors = all_line_vecs[i]
    for pt, vec in zip(line_pts, line_vectors):
        
        y_vec = rg.Vector3d.CrossProduct(vec, rg.Vector3d.ZAxis)
        plane = rg.Plane(pt, vec, y_vec)
        
        planes.append(plane)
        bricks.append(Brick(rg.Plane(plane)))

#bricks.append(Brick(planes))
# ---------- end bricks ----------
plane = Plane(bricks.planes)

fabrication = GhPythonScript(bricks=bricks.bricks)  # -> out, rhino_base_way_planes, robot_planes, a; inputs bricks: list
# ---------- fabrication: Python ----------
import Rhino.Geometry as rg
import simple_comm as c
import simple_ur_script as ur

import math as m

geo = []
planes = []
for brick in bricks:
    planes.append(brick.base_plane())

for rhino_plane in (planes):
    planes.append(rhino_to_robot_space(rhino_plane))

for rhino_plane in (planes):
    robot_planes.append(rhino_to_robot_space(rhino_plane))


for robot_plane in (robot_planes):
    #pick up a plane 
    script = pickup_brick(pick_up_plane, script)
    script = place_brick(robot_plane, script)
    
script = c.concatenate_script(script)
# ---------- end fabrication ----------
ghpython_script = GhPythonScript(planes=bricks.planes)  # -> out, planes1, planes2, planes3; inputs planes: list of Point3d
# ---------- ghpython_script: Python ----------
planes1 = planes[0:191]
planes2 = planes[192:381]
planes3 = planes[382:]
# ---------- end ghpython_script ----------
geometry_2 = Geometry(ghpython_script.planes1)
geometry_3 = Geometry(ghpython_script.planes2)
geometry_4 = Geometry(ghpython_script.planes3)
ghpython_script_2 = GhPythonScript(points1=geometry_2, points2=geometry_3, points3=geometry_4)  # -> out, checked_points_1, checked_points_2, checked_points_3; inputs points1: list of Plane, points2: list of Plane, points3: list of Plane
# ---------- ghpython_script_2: Python ----------
from compas_rhino import unload_modules
unload_modules('model')

import rhinoscriptsyntax as rs
import Rhino.Geometry as rg
import math
from model import Brick


checked_points_1 = []
checked_points_2 = []
checked_points_2_1 = []
checked_points_2_2 = []
checked_points_3 = []



for pt_1, pt_2 in zip (points1 , points2):
    dis = rg.Point3d.DistanceTo(pt_1.Origin, pt_2.Origin)
    if dis > 13:
        checked_points_1.append(pt_1)
        checked_points_2_1.append(pt_2)
    else:
        new_pt_vec = (pt_1.Origin-pt_2.Origin)/2
        new_pt = pt_1.Origin + new_pt_vec
        new_plane = rg.Plane(new_pt, rg.Vector3d.ZAxis)
#        new_plane = rg.Transform.Rotation(
        checked_points_1.append(new_plane)



for c_pt_2, pt_3 in zip (points2 , points3):
    dis = rg.Point3d.DistanceTo(c_pt_2.Origin, pt_3.Origin)
    if dis > 13:
        checked_points_3.append(pt_3)
        checked_points_2_2.append(c_pt_2)
    else:
        new_pt_vec = (pt_3.Origin-c_pt_2.Origin)/2
        new_pt = pt_3.Origin + new_pt_vec
        new_plane = rg.Plane(new_pt, rg.Vector3d.ZAxis)
        checked_points_3.append(new_plane)


for i in checked_points_2_1:
    if i in checked_points_2_2:
        checked_points_2.append(i)
print (checked_points_2)
# ---------- end ghpython_script_2 ----------
panel = Panel(ghpython_script_2.out)
ghpython_script_3 = GhPythonScript()  # -> out, brick_planes, point; inputs curves: list of Curve
# ---------- ghpython_script_3: Python ----------
from compas_rhino import unload_modules
unload_modules('model')
import rhinoscriptsyntax as rs
import Rhino.Geometry as rg
from model import Brick

def curve_to_planes():
    brick_planes =[]
    for curve in curves:
#            for i in range (10):
#        for j in range (20):
        if curve % 2 == 1:

            params = rg.Curve.DivideByLength(curve, Brick.REFERENCE_WIDTH+2, False)
        else:
            params = rg.Curve.DivideByLength(curve, (Brick.REFERENCE_WIDTH+2)*2, False)
        
#        params = rg.Curve.DivideByLength(curve, Brick.REFERENCE_WIDTH+2, False)
        for param in params:
            brick_pos = rg.Curve.PointAt(curve, param)
            brick_tan = rg.Curve.TangentAt(curve, param)
            vec1 = rg.Vector3d.CrossProduct(brick_tan, rg.Vector3d.ZAxis)
            vec2 = rg.Vector3d.CrossProduct(vec1, rg.Vector3d.ZAxis)
            plane = rg.Plane(brick_pos, vec1, vec2)
            planar = rg.Transform.Rotation(vec1, vec2, brick_pos)
            brick_planes.append(plane)
            
    return brick_planes
brick_planes = curve_to_planes()
# ---------- end ghpython_script_3 ----------
geometry_5 = Geometry(ghpython_script_2.checked_points_1)
geometry_6 = Geometry(ghpython_script_2.checked_points_2)
geometry_7 = Geometry(ghpython_script_2.checked_points_3)
bricks_2 = GhPythonScript(plane1=geometry_5, plane2=geometry_6, plane3=geometry_7)  # -> out, meshes, surfaces, planes, brick_pts, pick_plane, robot_crv, bricks, mesh; inputs plane1: list of Plane, plane2: list of Plane, plane3: list of Plane
# ---------- bricks_2: Python ----------
from compas_rhino import unload_modules
unload_modules('model')

import Rhino.Geometry as rg

from model import Brick


plane = zip(plane1, plane2, plane3)

bricks = []
planes = []
meshes = []

for i in plane:
    for j in i:
        planar= rg.Plane(j)
        myBrick = Brick(planar)
        meshes.append(myBrick.mesh())
        bricks.append(myBrick)
#        planes.append(myBrick.base_plane())
# ---------- end bricks_2 ----------
bricks_3 = GhPythonScript(plane1=geometry_5, plane2=geometry_6, plane3=geometry_7)  # -> meshes, bricks; inputs plane1: list of Plane, plane2: list of Plane, plane3: list of Plane; disabled
# ---------- bricks_3: Python ----------
from compas_rhino import unload_modules
unload_modules('model')

import Rhino.Geometry as rg

from model import Brick


bricks = []
planes = []
meshes = []

for i in plane1:
    planar= rg.Plane(i)
    myBrick = Brick(planar)
    meshes.append(myBrick.mesh())
    bricks.append(myBrick)
    planes.append(myBrick.base_plane())

for i in plane2:
    planar= rg.Plane(i)
    myBrick = Brick(planar)
    meshes.append(myBrick.mesh())
    bricks.append(myBrick)
    planes.append(myBrick.base_plane())
    
for i in plane3:
    planar= rg.Plane(i)
    myBrick = Brick(planar)
    meshes.append(myBrick.mesh())
    bricks.append(myBrick)
    planes.append(myBrick.base_plane())
# ---------- end bricks_3 ----------
geometry_8 = Geometry(bricks_2.planes)
geo = Geometry([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])
visualization = GhPythonScript(bricks=bricks_2.bricks, robot_base=geo)  # -> out, geo, transformed_robot_base, v_w_p, s_crv; inputs bricks: list, robot_base: list of Brep; disabled
# ---------- visualization: Python ----------
"""Generates a 3D model of the wall

Returns
----------
geo : [Rhino Geometry Surface, Rhino Geometry Surface, ...]

"""
from compas_rhino import unload_modules
unload_modules('model')

import Rhino.Geometry as rg

from model import Fabrication
from model import Brick

planes = []
geo = []

for brick in bricks:
    geo.append(brick.mesh())

visualizeFabrication = Fabrication(brick_planes=planes)
visualizeFabrication.procedure(transform=False)


# return 
robot_matrix = visualizeFabrication.robot_transformation()
transformed_robot_base = []
for brep in robot_base:
    trans_brep = brep.Duplicate()
    trans_brep.Transform(robot_matrix)
    transformed_robot_base.append(trans_brep)
# ---------- end visualization ----------
geometry_9 = Geometry(bricks_2.planes)
geo_2 = Geometry(visualization.transformed_robot_base)
grp = Group(visualization.geo)
geo_3 = Geometry(visualization.s_crv)
geo_4 = Geometry(visualization.v_w_p)
