# Grasshopper definition Brickwall_09112020_4.ghx (Grasshopper 1.0.7)

# ---- group: Create Brickwall
number_slider = Slider(4, range=0..10)
number_slider_2 = Slider(5.8, range=0..10)
multiplication = Multiplication(A=number_slider_2, B=Slider(4.5, range=0..10))
bricks = GhPythonScript(gap=number_slider, rad=Slider(0.5, range=0..1), amp=number_slider_2, dis=multiplication)  # -> meshes, bricks, planes1, planes2, planes3
# ---------- bricks: Python ----------
from compas_rhino import unload_modules
unload_modules('model')

import rhinoscriptsyntax as rs
import Rhino.Geometry as rg
import math
from model import Brick

planes = []
meshes = []
bricks = []

all_line_pts = []
all_line_vecs = []

for k in range(3):
    for i in range(20):
        line_points = []
        for j in range(6):
            if i % 2 == 1:
                x_value = (Brick.REFERENCE_LENGTH) * j + (gap*j) +  (Brick.REFERENCE_LENGTH+gap)/3
                if k % 2 == 1:
                    y_value = dis*k + -1 * ((math.cos(i*rad)* amp) * (math.sin(j*rad)* amp) / 4)
                else:
                    y_value = dis*k + (math.cos(i*rad)* amp) * (math.sin(j*rad)* amp) / 4
                z_value =  Brick.REFERENCE_HEIGHT * i
                
                plane_origin = rg.Point3d(x_value, y_value, z_value)
                
            else:
                x_value = Brick.REFERENCE_LENGTH * j + (gap*j)
                if k % 2 == 1:
                    y_value = dis*k + -1 * ((math.cos(i*rad)* amp) * (math.sin(j*rad)* amp) / 4)
                else:
                    y_value = dis*k + (math.cos(i*rad)* amp) * (math.sin(j*rad)* amp) / 4
                z_value =  Brick.REFERENCE_HEIGHT * i
                
                plane_origin = rg.Point3d(x_value, y_value, z_value)
                
            line_points.append(plane_origin)
        all_line_pts.append(line_points)



for line_pts in all_line_pts:
    line_vecs = []
    for i in range(len(line_pts)-1):
        pt_vec = line_pts[i+1]-line_pts[i]
        line_vecs.append(pt_vec)
    line_vecs.append(line_vecs[-1])
    all_line_vecs.append(line_vecs)


for i in range(len(all_line_pts)):
    line_pts = all_line_pts[i]
    line_vectors = all_line_vecs[i]
    for pt, vec in zip(line_pts, line_vectors):
        
        y_vec = rg.Vector3d.CrossProduct(vec, -rg.Vector3d.ZAxis)
        plane = rg.Plane(pt, vec, y_vec)
        
        planes.append(plane)
        planar= rg.Plane(plane)
        myBrick = Brick(planar)
        
        bricks.append(myBrick)
        meshes.append(myBrick.mesh())


planes1 = planes[0:int(len(planes)/3)]
planes2 = planes[int(len(planes)/3):int(len(planes)/3*2)]
planes3 = planes[int(len(planes)/3*2):]
# ---------- end bricks ----------

# ---- group: Brick Orientation
geometry = Geometry(bricks.planes2)
geometry_2 = Geometry(bricks.planes1)
geometry_3 = Geometry(bricks.planes3)
ghpython_script = GhPythonScript(points1=geometry_2, points2=geometry, points3=geometry_3, gap=number_slider, dist=Slider(1.2, range=1..2.3))  # -> meshes, bricks, bricks_a, bricks_b, bricks_c, bricks_d; inputs points1: list of Plane, points2: list of Plane, points3: list of Plane
# ---------- ghpython_script: Python ----------
from compas_rhino import unload_modules
unload_modules('model')

import rhinoscriptsyntax as rs
import Rhino.Geometry as rg
import math
from model import Brick

checked_points_1 = []
checked_points_2 = []
checked_points_2_1 = []
checked_points_3 = []

for pt_1, pt_2 in zip (points1 , points2):
    dis = rg.Point3d.DistanceTo(pt_1.Origin, pt_2.Origin)
    if dis < (Brick.REFERENCE_WIDTH*dist):
        new_pt_vec = (pt_1.Origin - pt_2.Origin)/2
        new_pt_1 = pt_1.Origin -  1.2*new_pt_vec - ((Brick.REFERENCE_LENGTH+gap)/4)*rg.Vector3d.XAxis
        new_pt_2 = pt_2.Origin + 1.2* new_pt_vec + ((Brick.REFERENCE_LENGTH+gap)/4)*rg.Vector3d.XAxis
        new_plane_1 = rg.Plane(new_pt_1, rg.Vector3d.YAxis, -rg.Vector3d.XAxis)
        new_plane_2_1 = rg.Plane(new_pt_2, rg.Vector3d.YAxis, -rg.Vector3d.XAxis)
        checked_points_1.append(new_plane_1)
        checked_points_2_1.append(new_plane_2_1)

    else:
        checked_points_1.append(pt_1)
        checked_points_2_1.append(pt_2)

for c_pt_2, pt_3 in zip (checked_points_2_1 , points3):
    dis = rg.Point3d.DistanceTo(c_pt_2.Origin, pt_3.Origin)
    if dis < (Brick.REFERENCE_WIDTH*dist):
        new_pt_vec = (c_pt_2.Origin - pt_3.Origin)/2
        new_pt_2 = c_pt_2.Origin - 1.2*new_pt_vec - ((Brick.REFERENCE_LENGTH+gap)/4)*rg.Vector3d.XAxis
        new_pt_3 = pt_3.Origin + 1.2* new_pt_vec + ((Brick.REFERENCE_LENGTH+gap)/4)*rg.Vector3d.XAxis
        new_plane_2_2 = rg.Plane(new_pt_2, rg.Vector3d.YAxis, -rg.Vector3d.XAxis)
        new_plane_3 = rg.Plane(new_pt_3, rg.Vector3d.YAxis, -rg.Vector3d.XAxis)
        checked_points_3.append(new_plane_3)
        checked_points_2.append(new_plane_2_2)

    else:
        checked_points_3.append(pt_3)
        checked_points_2.append(c_pt_2)

bricks = []
planes = []
meshes = []


for i, j, k in zip(checked_points_1, checked_points_2, checked_points_3):
    planar1= rg.Plane(i)
    planar2= rg.Plane(j)
    planar3= rg.Plane(k)
    
    myBrick = Brick(planar1)
    meshes.append(myBrick.mesh())
    bricks.append(myBrick)
    planes.append(myBrick.base_plane())
    
    myBrick = Brick(planar2)
    meshes.append(myBrick.mesh())
    bricks.append(myBrick)
    planes.append(myBrick.base_plane())
    
    myBrick = Brick(planar3)
    meshes.append(myBrick.mesh())
    bricks.append(myBrick)
    planes.append(myBrick.base_plane())


bricks_a = bricks[0:int(len(bricks)/3)]
bricks_b = bricks[int(len(bricks)/3):int(len(bricks)/3*2)]
bricks_c = bricks[int(len(bricks)/3*2):int(len(bricks)/3*3)]
#bricks_d = bricks[int(len(bricks)/4*3):]
# ---------- end ghpython_script ----------
