# Grasshopper definition Fabrication_Pascal-Priyank.ghx (Grasshopper 1.0.7)

fabrication = GhPythonScript(send=Toggle(True))  # -> out, rhino_base_way_planes, robot_planes, robot_base, pick_up_planes, glue_stat; inputs bricks: list
# ---------- fabrication: Python ----------
import Rhino.Geometry as rg
import simple_comm as c
import simple_ur_script as ur
from model import Brick
import math as m

geo = []
rhino_base_way_planes = []
for brick in bricks:
    rhino_base_way_planes.append(brick.base_plane())
    
    


def tcp(script):
    """ This funktion sets tcp 
    """
    script += ur.set_tcp_by_angles(
        0.0, 0.0, 74.0, m.radians(0.0), m.radians(180), m.radians(0))
    return script

def set_robot_base_plane_from_pts():

    pt_0 = rg.Point3d(150, 163+100, 5)  # base plane origin
    # point on base plane positive x direction
    pt_1 = rg.Point3d(499,163+100 , 5)
    pt_2 = rg.Point3d(499, 299, 5)  # point on base plane positive xy

    robot_base = rg.Plane(pt_0, pt_1-pt_0, pt_2-pt_0)
    return robot_base


def rhino_to_robot_space(rhino_plane):
    """ this funktion translates planes from the rhino cordinate system to
    the robot cordinate system 
    """
    robot_plane = rhino_plane.Clone()
    _r_matrix = rg.Transform.PlaneToPlane(
        rg.Plane.WorldXY, set_robot_base_plane_from_pts())
    print robot_plane.Origin
    print(robot_plane.Transform(_r_matrix))
    print robot_plane.Origin
    return robot_plane
    

def pickup_brick(pick_up_plane, script):
    """Pick up a brick procedure

    Parameters
    ----------
    pick_up_plane : rhino.geometry.plane
    
    Returns:
    Procedure for pickin up plane
    """
    accel = 0.5    # m/s2
    vel = 0.5     # m/s

    safe_distance = 50
    
    way_planes = []

    safe_plane = pick_up_plane.Clone()
    safe_plane.Translate(rg.Vector3d(0, 0, safe_distance))

    script += ur.move_l(safe_plane, accel, vel)
    way_planes.append(safe_plane)

    script += ur.move_l(pick_up_plane, accel, vel)
    way_planes.append(pick_up_plane)

    script += ur.set_digital_out(4, True)
    script += ur.sleep(0.2)

    script += ur.move_l(safe_plane, accel, vel)
    way_planes.append(safe_plane)

    return script 
    
def place_brick(plane, script):
    """
    this function gereates the robotic sequience for placing a brick
    Requires a plane wich describes the possition of the brick"""

    safe_distance = 50
    accel = 0.5
    vel = 0.5
    way_planes = []

    safe_plane = plane.Clone()
    safe_plane.Translate(rg.Vector3d(0, 0, safe_distance))

    script += ur.move_l(safe_plane, accel, vel)
    way_planes.append(safe_plane)

    script += ur.move_l(plane, accel, vel)
    way_planes.append(plane)

    script += ur.set_digital_out(4, False)
    script += ur.sleep(0.2)

    script += ur.move_l(safe_plane, accel, vel)
    way_planes.append(safe_plane)

    return script

""" Robotic fabrication procedure
"""
script = ""

script = tcp(script)


"""pick _up plane is measured in the robot base plane
"""
pick_up_planes =[]
glue_stat=[]
for k in range(2):  # rows z-direction
    for i in range(6):  # rows y-direction
        for j in range(12): # rows x-direction
            x_pos = i * (Brick.REFERENCE_LENGTH)
            y_pos = j * (Brick.REFERENCE_WIDTH*1.012)
            z_pos = k * (Brick.REFERENCE_HEIGHT*1.009)
            origin = rg.Point3d(x_pos-58, y_pos+373, z_pos)
            pick_up_plane = rg.Plane(origin, rg.Vector3d.XAxis, rg.Vector3d.YAxis )
            pick_up_planes.append(pick_up_plane)
pick_up_planes.reverse()

#glue_pt = rg.Point3d(10,300,14)
#glue_planes = rg.Plane(glue_pt,rg.Vector3d.XAxis, rg.Vector3d.YAxis )
#glue_stat.append(glue_planes)

def glue_brick(script):
    glue_plane = rg.Plane(rg.Point3d(10,300,19),rg.Vector3d(0,0,1))
    safe_distance = 100
    accel = 0.5
    vel = 0.5
    way_planes = []
    safe_plane = glue_plane.Clone()
    safe_plane.Translate(rg.Vector3d(0, 0, safe_distance))
    script += ur.move_l(safe_plane, accel, vel)
    way_planes.append(safe_plane)
    script += ur.move_l(glue_plane, accel, vel)
    way_planes.append(glue_plane)
    script += ur.set_digital_out(4, True)
    script += ur.sleep(0.3)
    script += ur.move_l(safe_plane, accel, vel)
    way_planes.append(safe_plane)
    return script

#robot_planes = []
#"""We are translating all way_planes from rhino base to robot_base
#"""
#for rhino_plane in (rhino_base_way_planes):
#    robot_planes.append(rhino_to_robot_space(rhino_plane))
#for robot_plane, pick_up_plane in zip(robot_planes, pick_up_planes):
#    #pick up a plane 
#    script = pickup_brick(pick_up_plane, script)
#    script = place_brick(robot_plane, script)



robot_planes = []
"""We are translating all way_planes from rhino base to robot_base
"""
for rhino_plane in (rhino_base_way_planes):
    robot_planes.append(rhino_to_robot_space(rhino_plane))
    
for robot_plane, pick_up_plane in zip(robot_planes, pick_up_planes):
    #pick up a plane 
    script = pickup_brick(pick_up_plane, script)
    script = glue_brick(script)
    script = place_brick(robot_plane, script)

script = c.concatenate_script(script)

if send:
    c.send_script(script, "192.168.10.10")
# ---------- end fabrication ----------
geometry = Geometry(fabrication.robot_planes)
geometry_2 = Geometry(fabrication.glue_stat)
geometry_3 = Geometry(fabrication.pick_up_planes)
