# Grasshopper definition GH_python_remote.ghx (Grasshopper 1.0.7)

# Turn me on!   -->
python = PythonScript()  # -> rhino_doc_dir
# ---------- python: Python ----------
import scriptcontext as sc
from os import path

rhino_doc_dir = path.abspath(path.dirname(sc.doc.Path))
# ---------- end python ----------
crv = Curve(reparameterize(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))
# GH to python remote example.
# Pierre Cuvilliers, 2017
# Released under the MIT license
# github.com/pilcru/ghpythonremote
# Runs and connects to an external python engine, and
# assigns imported modules to scriptcontext.sticky variables.
# 
# Arguments:
#       code (str): Path to the GH_to_python.py code file.
#       location (str): Path to a python executable, or to a folder
#             containing `python.exe`, or the name of a conda-created
#             virtual environment prefixed by `conda://` (`conda://env_name`).
#             If empty, finds python from your windows %PATH%.
#       run (boolean): Creates the connection, and imports new
#             modules, when turned to True. Kills the connection,
#             and deletes the references to the imports, when turned
#             to False.
#       modules (str list): List of module names to import in the
#             remote python. They will be added to the
#             scriptcontext.sticky dictionary, allowing them to be
#             reused from other python components in the same
#             Grasshopper document. Submodules (for example
#             `numpy.linalg`) have to be added explicitly to this list
#             to be available later, and importing the parent package is
#             also required even if only the submodule is used.
#       log_level (str from ['NOTSET', 'DEBUG', 'INFO', 'WARNING', 'ERROR', 'CRITICAL']):
#             Logging level to use for the local IronPython and the
#             remote python instance.
#       working_dir (str): Working directory for the remote python
#             instance.
# 
# Returns:
#       out (str): Console output with DEBUG information.
#       linked_modules (str list): list of imported module names.
#       rpy (rpyc connection object): The object representing the remote Python interpreter.
panel = Panel("C:\Users\trtku\anaconda3\envs\rhinoremote\python.exe")
list = ValueList({"CRITICAL", "ERROR", "WARNING", "INFO", "DEBUG", "NOTSET"}, selected="DEBUG")

# ---- group: Import remote python modules
panel_2 = Panel(python)
panel_3 = Panel("""numpy
scipy
numpy.linalg
sklearn
sklearn.cluster""")
panel_4 = Panel("C:\Users\simon\anaconda3\envs\rhinoremote\python.exe")
ghpythonremote = GHPythonRemote(location=panel, run=Toggle(False), modules=panel_3, log_level=list, working_dir=panel_2)  # -> out, linked_modules, rpy; inputs run: Boolean, modules: list
# ---------- ghpythonremote: Python ----------
import inspect
import logging
from os import path
import sys
from time import sleep

import scriptcontext

import ghpythonremote
from ghpythonremote.connectors import GrasshopperToPythonRemote

local_log_level = getattr(logging, log_level, logging.WARNING)
logger = logging.getLogger("ghpythonremote")
logger.setLevel(local_log_level)
ch = logging.StreamHandler()
ch.setLevel(local_log_level)
formatter = logging.Formatter("%(levelname)s: %(name)s:\n%(message)s")
ch.setFormatter(formatter)
logger.handlers = []
logger.addHandler(ch)
logger = logging.getLogger("ghpythonremote.GH_to_python")

ROOT = path.abspath(path.dirname(inspect.getfile(ghpythonremote)))
rpyc_server_py = path.join(ROOT, "pythonservice.py")

# Set connection to CLOSED if this is the first run
# and initialize set of linked modules
try:
    remote_python_status
except NameError:
    remote_python_status = "CLOSED"
    lkd_modules = set()

# Wait for connection to connect or terminate
timer = 0
while remote_python_status == "CONNECTING" or remote_python_status == "CLOSING":
    sleep(1)
    timer += 1
    if timer == 10:
        try:
            gh2py_manager.__exit__(*sys.exc_info())
        except Exception:
            pass
        remote_python_status = "CLOSED"
        lkd_modules = set()
        raise RuntimeError(
            "Connection left in an inconsistent state and not returning. Reset "
            "everything."
        )

if run:
    if not remote_python_status == "OPEN":
        remote_python_status = "CONNECTING"
        gh2py_manager = GrasshopperToPythonRemote(
            rpyc_server_py,
            location=location,
            timeout=10,
            port=None,
            log_level=log_level,
            working_dir=working_dir,
        )
        gh2py = gh2py_manager.__enter__()
        remote_python_status = "OPEN"

    # Stuff that we can reach
    rpymod = gh2py.py_remote_modules  # A getter function for a named python module
    rpy = gh2py.connection  # Represents the remote instance root object
    scriptcontext.sticky["rpy"] = rpy
    # Add modules
    for mod in modules:
        try:
            scriptcontext.sticky[mod] = rpymod(mod)
            lkd_modules.add(mod)
        except ImportError:
            gh2py_manager.__exit__(*sys.exc_info())
            raise

elif not remote_python_status == "CLOSED":
    remote_python_status = "CLOSING"
    # Remove linked modules
    for mod in lkd_modules:
        del scriptcontext.sticky[mod]
    del scriptcontext.sticky["rpy"]
    gh2py_manager.__exit__(*sys.exc_info())
    lkd_modules = set()
    remote_python_status = "CLOSED"

# Change variable name because ghpython resets outputs to None before each run
linked_modules = lkd_modules

logger.info("GH to python connection is {}".format(remote_python_status))
# ---------- end ghpythonremote ----------
panel_5 = Panel(ghpythonremote.out)

# ----
python_2 = PythonScript(module_names=ghpythonremote.linked_modules)  # -> import_statements; inputs module_names: list
# ---------- python_2: Python ----------
import_statements = ["import scriptcontext as sc"]
for module_name in module_names:
    import_statements.append("{0} = sc.sticky['{0}']".format(module_name))

if len(module_names) == 0:
    import_statements = []
# ---------- end python_2 ----------

divdist = DivideDistance(Curve=crv, Distance=Slider(50, range=0..100))  # -> Points, Tangents, Parameters
graph = GraphMapper(
    divdist.Parameters,
    x0=0,
    x1=1,
    y0=0,
    y1=1,
    container_name="Bezier",
    cpx=[0, 0.1085271314, 0.9085272551, 1],
    cpy=[0, 0.4688524604, 0.3934426308, 1])
eval = EvaluateCurve(Curve=crv, Parameter=graph)  # -> Point, Tangent, Angle
dist = Distance(PointA=graft(eval.Point), PointB=eval.Point)  # -> flatten(Distance)
mindist = GhPythonScript(x=dist)  # -> minDist; inputs x: list
# ---------- mindist: Python ----------
X = [i for i in x if i != 0]

minDist = min(X)

print(minDist)
# ---------- end mindist ----------
min_distance = Panel(mindist)

panel_6 = Panel(python_2)
createareas = GhPythonScript(params=graph, starting_curve=crv, layers=Slider(6, range=0..10))  # -> out, areas_list, areas_dict, first_area_bricks, first_brick_meshes; inputs params: list, starting_curve: Curve, layers: Int32
# ---------- createareas: Python ----------
import rhinoscriptsyntax as rs
import Rhino.Geometry as rg
import Rhino.DocObjects as rd
import ghpythonlib.components as ghc
import random
random.seed(2)
from compas_rhino import unload_modules
unload_modules('model')

from model import Brick, Area, areas_dict, areas_list


curve = starting_curve

def areas_on_curve(crv, layer,width, params=params):
    layer_areas = []
    for i, _ in enumerate(params[:-1]):
        key = "L{}A{}".format(layer, i)
        area = Area(initial_curve=crv, start_param=params[i], end_param=params[i+1], layer=layer, area_index=i, width=width)
        areas_dict[key] = area
        layer_areas.append(area)
    return layer_areas

def move_curve_up(crv, height=Brick.REFERENCE_HEIGHT, trim_factor=0.05):
    V = rg.Vector3d.ZAxis * height
    crv.Translate(V)
    length = crv.GetLength()
    new_length = length * (1.0 - trim_factor)
    trim_length = (length - new_length) / 2
    _ , p0 = crv.LengthParameter(trim_length)
    _ , p1 = crv.LengthParameter(length - trim_length)
    trim = crv.Trim(rg.Interval(p0,p1))
    trim.Domain = rg.Interval(0.0, 1.0)
    return trim

def bbox_boolean_intersect(bbox_a, bbox_b):
    if (bbox_a.Min.X < bbox_b.Max.X) and (bbox_a.Max.X > bbox_b.Min.X) and (bbox_a.Min.Y < bbox_b.Max.Y) and (bbox_a.Max.Y > bbox_b.Min.Y):
        return True
    else:
        return False

def gen_first_bricks(a, d=1.0):
    """
    a = Area Class
    d = density of bricks (default should be 1.0)
    """
    bricks = []
    bbox = a.bounding_area()
    num_b = a.num_brick(bbox, density=d)
    points = a.populate_points(bbox, num_b)
    planes = a.random_brick_planes(points)
    for plane in planes:
        brick = Brick(plane)
        bricks.append(brick)
    return bricks



"""Run code"""

# create curve and Areas for each layer
max_width = 100
shorten_factor = 0.9
for i in range(layers):
    layer_areas = areas_on_curve(crv=curve, layer=i, width=max_width)
    areas_list.append(layer_areas)
    curve = move_curve_up(curve)
    max_width *= shorten_factor


"""Build topological model for Areas and store area_key in Area Class
- find sub layer neighbors
"""
first_area_bricks = []
first_brick_meshes = []

for l in areas_list:
    for a in l:
        #create the first layer
        if a.layer == 0:
            #create list of Brick object (a=Area class, d=density of bricks(default=1.0))
            bricks = gen_first_bricks(a, d=0.65)
            for brick in bricks:
                first_area_bricks.append(brick)
                first_brick_meshes.append(brick.mesh())
        
        # add sub layer neighbors for every Area
        if a.sub_layer() is None:
            continue
        sub_neighbors = []
        bbox_a = a.project_bbox_extend_on_ground()
        sub_layer = areas_list[a.sub_layer()]
        for sub_area in sub_layer:
            bbox_b = sub_area.project_bbox_extend_on_ground()
            if bbox_boolean_intersect(bbox_a, bbox_b) is True:
                sub_neighbors.append(sub_area.area_key)
        a.sub_layer_neighbors = sub_neighbors


areas_dict = [ areas_dict ]
# ---------- end createareas ----------
intersectingbricks = GhPythonScript(areas_list=createareas.areas_list, areas_dict=createareas.areas_dict)  # -> out, areas_list, areas_dict; inputs areas_list: list, areas_dict: list
# ---------- intersectingbricks: Python ----------
import rhinoscriptsyntax as rs
import Rhino.Geometry as rg
from compas_rhino import unload_modules
unload_modules('model')

from model import Brick, Area

areas_dict = areas_dict[0]

for layer in areas_list:
    for a in layer:
       a.check_intersecting_bricks()
       
areas_dict = [ areas_dict ]
# ---------- end intersectingbricks ----------

# ---- group: Use numpy, click to open and run
python_3 = PythonScript()  # -> out, a
# ---------- python_3: Python ----------
import scriptcontext
import ghpythonremote
np = scriptcontext.sticky['numpy']
rpy = scriptcontext.sticky['rpy']
# Do some numpy stuff
a = np.arange(15).reshape(3, 5)
print(a)
print(np.linalg.eig(np.arange(9).reshape(3, 3)))

# Fast way of sending data for numpy array creation
remote_range = ghpythonremote.deliver(rpy, range(1000))
array = np.array(remote_range)
# This is much slower
#b = np.array(range(1000))

# Get the array back as a local IronPython list
list = ghpythonremote.obtain(array.tolist())

# Get an error
#np.arange(9).reshape(4,3)
# ---------- end python_3 ----------
panel_7 = Panel(python_3.out)

# ----
pt = Point([Point(-9.698162549, 6.63043076, 0), Point(-6.043687717, -1.21120833, 0), Point(-0.8027259509, -12.44375734, 0), Point(10.02723339, -11.71019846, 0), Point(7.893509827, 3.755803632, 0), Point(3.748694495, -4.876799225, 0), Point(-8.386561543, 19.67342788, 0), Point(-20.45341992, 5.737899588, 0), Point(-26.10422294, 22.51734479, 0), Point(4.805184169, 16.297325, 0), Point(-13.03158806, -4.687151248, 0), Point(8.17645959, -22.20285981, 0), Point(13.67181106, -9.063340538, 0), Point(-7.615937887, -20.80561033, 0), Point(-22.23083857, -16.65299024, 0), Point(-34.39470085, -1.316462112, 0)])
python_4 = GhPythonScript(areas_list=intersectingbricks.areas_list, areas_dict=intersectingbricks.areas_dict)  # -> out, a; inputs areas_list: list, areas_dict: list
# ---------- python_4: Python ----------
import rhinoscriptsyntax as rs
import Rhino.Geometry as rg
from compas_rhino import unload_modules
unload_modules('model')

from model import Brick, Area

areas_dict = areas_dict[0]

print(areas_dict["L3A3"].area_key)
# ---------- end python_4 ----------
python_5 = GhPythonScript(x=pt)  # -> out, cluster1, cluster2, cluster3; inputs x: list of Point3d
# ---------- python_5: Python ----------
import scriptcontext as sc
import ghpythonremote
import Rhino.Geometry as rg
np = sc.sticky['numpy']
rpy = sc.sticky['rpy']
sklearn = sc.sticky['sklearn']
sklearn.cluster = sc.sticky['sklearn.cluster']


data = [ [float(p.X), float(p.Y), float(p.Z)] for p in x ] 

data = np.array(data)


kmeans = sklearn.cluster.KMeans(n_clusters=3, n_init=2000, max_iter=1000).fit(data)

clusters = {}
for i, point in zip(kmeans.labels_, data):

    if i not in clusters:
        clusters[i] = []
    clusters[i].append(point)

cluster1 = []
cluster2 = []
cluster3 = []

for p in clusters[0]:
    cluster1.append(rg.Point3d(p[0], p[1], p[2]))
    
for p in clusters[1]:
    cluster2.append(rg.Point3d(p[0], p[1], p[2]))
    
for p in clusters[2]:
    cluster3.append(rg.Point3d(p[0], p[1], p[2]))
# ---------- end python_5 ----------
pt_2 = Point(python_5.cluster1)
pt_3 = Point(python_5.cluster2)
pt_4 = Point(python_5.cluster3)
panel_8 = Panel(python_5.cluster1)
