# Grasshopper definition Herring_brick_fabrication_comb_WeiTing.gh (Grasshopper 1.0.7)

# ---- group: Oriented plan
panel = Panel("""{299, 63, 0}
{499, 63, 0}
{499, 299, 0}""")
pt = Point(panel)
pline = PolyLine(Vertices=pt, Closed=False)
points = PointList(Points=pt, Size=Slider(20, range=0..100))

# ----
robotmodel = Geometry([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])
# Main Program
unpack = GhPythonScript()  # -> Upackdata; disabled
# ---------- unpack: Python ----------
from ghpythonlib.componentbase import executingcomponent as component
import Grasshopper, GhPython
import System
import Rhino
import rhinoscriptsyntax as rs

class MyComponent(component):
    
    def RunScript(self, Tree):
        ### unpack IRONPYTHON
        Upackdata = Tree
        
        
        # return outputs if you have them; here I try it for you:
        return Upackdata
# ---------- end unpack ----------
swatch = ColourSwatch(SwatchColor=RGBA(255, 255, 255, 46))  # disabled
number_slider = Slider(3, range=0..10)  # disabled
number_slider_2 = Slider(5, range=0..10)  # disabled
rotate_angle = Slider(3, range=0..30)  # disabled

# ---- group: HerringBrcik
python = GhPythonScript(plan_depth=number_slider_2, height=number_slider, angle=rotate_angle)  # -> out, planes, planes_base, meshes; inputs plan_depth: Int32, height: Int32; disabled
# ---------- python: Python ----------
from compas_rhino import unload_modules
unload_modules('model')

from model import Brick
import Rhino.Geometry as rg
import math

def herring_Brick(plane, x_gap, y_gap, angle):
    planes = []
    planes_base =[]
    # create brick
    plane_origin = (plane.Origin
                   +(plane.XAxis * x_gap)
                   +(plane.YAxis * y_gap))
    brick_plane = rg.Plane(plane_origin, plane.XAxis, plane.YAxis)
    brick_plane.Rotate(math.radians(angle), rg.Vector3d.ZAxis)
    planes_base.append(brick_plane)
    plane_rot = brick_plane.Clone()
    brick_rot = Brick(plane_rot)
    planes.append(brick_rot.picking_plane())
    return planes, planes_base


#####          #####
##### RUN CODE #####
#####          #####

meshes =[]
planes = []
planes_base = []


# rotate and stack bricks 
for i in range(plan_depth):
    for j in range(height):
        # plan gap
        gap_h = Brick.REFERENCE_WIDTH+ 2.5
        # vertcal gap
        gap_v = Brick.REFERENCE_HEIGHT
        brick_plane = rg.Plane(rg.Point3d(gap_h * i, gap_h* i, gap_v),
                                rg.Vector3d.XAxis, 
                                rg.Vector3d.YAxis)
        #T = rg.Transform.Rotation(math.radians(10)*i, rg.Point3d(0,0,0))
        brick_plane.Rotate(math.radians(angle)*j, rg.Vector3d.ZAxis, rg.Point3d(0,0,0))
        
        ### Bricks 
        
        #Brick_gap_and_positon
        x_gap_R1, y_gap_R1 = Brick.REFERENCE_LENGTH +0.8, Brick.REFERENCE_WIDTH/2
        x_gap_R2, y_gap_R2 = Brick.REFERENCE_WIDTH/2, Brick.REFERENCE_LENGTH/2
        x_gap_L1, y_gap_L1 = -.5, Brick.REFERENCE_LENGTH + Brick.REFERENCE_WIDTH/2 +1.3
        x_gap_L2, y_gap_L2 = -1*(Brick.REFERENCE_LENGTH/2 + Brick.REFERENCE_WIDTH/2 + 1.8), Brick.REFERENCE_LENGTH + Brick.REFERENCE_WIDTH +1.8
        
        # Top plane
        
        planes.extend(herring_Brick(brick_plane ,x_gap_R1, y_gap_R1, 0)[0]) 
        planes.extend(herring_Brick(brick_plane ,x_gap_R2, y_gap_R2, 0)[0])
        planes.extend(herring_Brick(brick_plane ,x_gap_L1, y_gap_L1, 0)[0])
        planes.extend(herring_Brick(brick_plane ,x_gap_L2, y_gap_L2, 0)[0])
        
        #  Meshes base plane
        planes_base.extend(herring_Brick(brick_plane ,x_gap_R1, y_gap_R1, 90)[1]) 
        planes_base.extend(herring_Brick(brick_plane ,x_gap_R2, y_gap_R2, 0)[1])
        planes_base.extend(herring_Brick(brick_plane ,x_gap_L1, y_gap_L1, 90)[1])
        planes_base.extend(herring_Brick(brick_plane ,x_gap_L2, y_gap_L2, 0)[1])
        
        
for plane in planes_base:
    b = Brick(plane)
    meshes.append(b.mesh())
# ---------- end python ----------

# ----
bricks = GhPythonScript()  # -> out, bricks; disabled
# ---------- bricks: Python ----------
from compas_rhino import unload_modules
unload_modules('model')

import Rhino.Geometry as rg

from model import Brick

import math as m

bricks = []


for i in range(10):  # layer count
    for j in range(10):  # layer length

        if i % 2 == 0:
            x_pos = j * (Brick.REFERENCE_LENGTH+1)
            rotation = m.radians(10)
        else:
            x_pos = j * (Brick.REFERENCE_LENGTH+1) + (Brick.REFERENCE_LENGTH/2)-1
            rotation = m.radians(-10)

        z_pos = i * (Brick.REFERENCE_HEIGHT)

        origin = rg.Point3d(x_pos, 0, z_pos)
        plane = rg.Plane(origin, rg.Vector3d.XAxis, rg.Vector3d.YAxis)
        plane.Rotate(rotation, rg.Vector3d.ZAxis)
        bricks.append(Brick(plane))
# ---------- end bricks ----------
swatch_2 = ColourSwatch(SwatchColor=RGBA(255, 255, 255, 88))  # disabled
preview = CustomPreview(Geometry=python.meshes, Material=swatch_2)  # disabled
number_slider_3 = Slider(40, range=0..100)
panel_2 = Panel("360")
visualization = GhPythonScript()  # -> out, geo, transformed_robot_base, v_w_p, s_crv; inputs way_planes: list, robot_base: list of Brep; disabled
# ---------- visualization: Python ----------
"""Generates a 3D model of the wall

Returns
----------
geo : [Rhino Geometry Surface, Rhino Geometry Surface, ...]

"""
from compas_rhino import unload_modules
unload_modules('model')

import Rhino.Geometry as rg

from model import Fabrication
from model import Brick

plane = []
geo = []

for brick in way_planes:
    geo.append(brick.planes())

visualizeFabrication = Fabrication(brick_planes=plane)
visualizeFabrication.procedure(transform=False)


# return 
robot_matrix = visualizeFabrication.robot_transformation()
transformed_robot_base = []
for brep in robot_base:
    trans_brep = brep.Duplicate()
    trans_brep.Transform(robot_matrix)
    transformed_robot_base.append(trans_brep)
# ---------- end visualization ----------
# Create Bricks
# Roate decrease number of brick by Surface
number_slider_4 = Slider(8, range=0..100)
rotate_angle_2 = Slider(15, range=0..30)
number_slider_5 = Slider(8, range=0..100)  # disabled
number_slider_6 = Slider(2, range=0..100)  # disabled
rotate_angle_3 = Slider(6, range=0..30)  # disabled
division = Division(A="180", B=number_slider_3)
rotate_center = Point(Point(19.93794571, -6.545157164, 0))
# Roate decrease number of brick by Rules
number_slider_7 = Slider(5, range=0..100)
division_2 = Division(A="180", B=Slider(100, range=0..100))
number_slider_8 = Slider(100, range=0..100)  # disabled
rotate_center_2 = Point(Point(19.93794571, -6.545157164, 0))  # disabled

# ---- group: Reference Curve
number_slider_9 = Slider(1, range=0..1)  # disabled
number_slider_10 = Slider(0, range=0..1)  # disabled
number_slider_11 = Slider(5, range=0..100)  # disabled
number_slider_12 = Slider(63.866, range=0..100)  # disabled
cir = Circle(Plane=rotate_center_2, Radius=1)  # disabled
dom = ConstructDomain(DomainStart=number_slider_10, DomainEnd=number_slider_9)  # disabled
series = Series(Start=0, Step=number_slider_12, Count=expr("x+1", number_slider_11))  # disabled
range = Range(Domain=dom, Steps=number_slider_11)  # disabled
Z = UnitZ(Factor=series)  # disabled
graph = GraphMapper(
    range,
    x0=0,
    x1=1,
    y0=0,
    y1=1,
    Ox=0.5107557774,
    Oy=0.1394865513,
    Px=0.7360822558,
    Py=0.2907927036,
    container_name="Parabola")  # disabled
number_slider_13 = Slider(114.7, range=0..1000)  # disabled
move = Move(Geometry=cir, Motion=Z)  # -> Geometry, Transform; disabled
multiplication = Multiplication(A=graph, B=number_slider_13)  # disabled
area = Area(Geometry=move.Geometry)  # -> Area, Centroid; disabled
number_slider_14 = Slider(20, range=0..100)  # disabled
number_slider_15 = Slider(6, range=0..10)  # disabled
scale = Scale(Geometry=move.Geometry, Center=area.Centroid, Factor=multiplication)  # -> Geometry, Transform; disabled
divide = DivideCurve(Curve=scale.Geometry, Count=number_slider_14, Kinks=False)  # -> simplify(Points), Tangents, Parameters; disabled
tstat = TreeStatistics(Tree=divide.Points)  # -> Paths, Length, Count; disabled
series_2 = Series(Start=0, Step=number_slider_15, Count=tstat.Count)  # -> graft(Series); disabled
shift = ShiftList(List=divide.Points, Shift=series_2, Wrap=True)  # disabled
item = ListItem(List=shift, Index=0, Wrap=True)  # -> flatten(Item); disabled
intcrv = Interpolate(Vertices=item, Degree=3, Periodic=False, KnotStyle=1)  # -> Curve, Length, Domain; disabled

# ----
crv = Curve(intcrv.Curve)  # disabled
# Two Bricks as a group
rotate_angle_4 = Slider(6, range=0..30)  # disabled
number_slider_16 = Slider(8, range=0..100)  # disabled
number_slider_17 = Slider(5, range=0..100)  # disabled
# Roate decrease number of brick by Curve
rotate_angle_5 = Slider(0, range=0..30)  # disabled
number_slider_18 = Slider(8, range=0..100)  # disabled
number_slider_19 = Slider(1, range=0..100)  # disabled

# ---- group: Should be equal
number_slider_20 = Slider(8, range=0..10)  # disabled
number_slider_21 = Slider(7, range=0..10)  # disabled

# ----
panel_3 = Panel(division)
rotate_center_3 = Point(Point(-0.03039079075, -0.003853279266, 0))
panel_4 = Panel(division_2)
rotate_center_4 = Point(Point(-0.3248594848, -0.03725805962, 0))  # disabled
neg = Negative(Value=division)
geo = Geometry(visualization.transformed_robot_base)  # disabled
geo_2 = Geometry(visualization.v_w_p)  # disabled
geo_3 = Geometry(visualization.s_crv)  # disabled
grp = Group(visualization.geo)  # disabled

# ---- group: HerringBrcik
python_2 = GhPythonScript(
    plan_depth=number_slider_5,
    height=number_slider_6,
    angle_vetical=rotate_angle_3,
    center_point=rotate_center_2,
    substract_curve=crv,
    distance=number_slider_8)  # -> out, planes, planes_base, subtract_planes, subtract_planes_base, meshes; inputs plan_depth: Int32, height: Int32, center_point: Point3d, substract_curve: Curve; disabled
# ---------- python_2: Python ----------
from compas_rhino import unload_modules
unload_modules('model')
from model import Brick
import Rhino.Geometry as rg
import math

### this funtion is plane for herring bone
def herring_bone(plan_depth ,x_postion ,y_postion, z_postion, angle):
    """
    x_postion is brick X coordinate
    y_postion is brick Y coordinate
    z_postion is brick z coordinate
    angle is brick place direction
    """
    planes = [] # Top plane for robot picking up
    planes_base = [] # base plane for create visual brick
    # horizontal gap
    gap_hori = Brick.REFERENCE_WIDTH +2.5
    for i in range(plan_depth):
        x_value = gap_hori * i + x_postion
        y_value = gap_hori * i + y_postion
        z_value = z_postion
        
        # create brick plane
        plane_origin = rg.Point3d(x_value, y_value, z_value)
        brick_plane = rg.Plane(plane_origin, rg.Vector3d.XAxis, rg.Vector3d.YAxis)
        brick_plane.Rotate(math.radians(angle), rg.Vector3d.ZAxis)
        planes_base.append(brick_plane)
        plane_rot = brick_plane.Clone()
        brick_rot = Brick(plane_rot)
        planes.append(brick_rot.picking_plane())
    return planes, planes_base

# rotate plane 
def rotateBycentre(planes, angle, center_point):
    center_point = c_p # rotate centre
    plane_rot =[] 
    for p in planes:
        T = rg.Transform.Rotation(angle, c_p)
        p.Transform(T)
        plane_rot.append(p)
    return plane_rot

#find plane inside surface
def subtractionBysurface(planes, surface, tolerance):
    inside_planes = []
    for p in planes:
        # bool value of distance_closest_pts 
        in_or_out = surface.IsPointInside(p.Origin, tolerance, False)
        if in_or_out == False:
            new_plane = rg.Plane(p.Origin, p.XAxis, p.YAxis)
            inside_planes.append(new_plane)
    return inside_planes

def substractByCurve(plane, curves, distance):
    planes = []
    for p in plane:
        # curve closest points
        bool, dist = curves.ClosestPoint(p.Origin, distance)

        if bool == True:
            new_plane = rg.Plane(p.Origin, p.XAxis, p.YAxis)
            planes.append(new_plane)
    return planes


#####          #####
##### RUN CODE #####
#####          #####

# define the x_postion and y_postion for bricks
## modify brick gap here
b_leng = Brick.REFERENCE_LENGTH
b_wid = Brick.REFERENCE_WIDTH

x_p_R1, y_p_R1 = b_leng +0.8, b_wid/2
x_p_R2, y_p_R2 = b_wid/2, b_leng/2
x_p_L1, y_p_L1 = -.5, b_leng + b_wid/2 +1.3
x_p_L2, y_p_L2 = -1*(b_leng/2 + b_wid/2 + 1.8), b_leng + b_wid +1.8

##########
meshes =[]
planes = []
planes_base = []

# stacking
for i in range(height):
    b_h = Brick.REFERENCE_HEIGHT 
    c_p = center_point # rotate centre
    angle = math.radians(angle_vetical)
    
    # create plane
    planes_r1, planes_base_r1 = herring_bone(plan_depth, x_p_R1, y_p_R1, b_h *i, 90)
    planes_r2, planes_base_r2 = herring_bone(plan_depth, x_p_R2, y_p_R2, b_h *i, 0)
    planes_r3, planes_base_r3 = herring_bone(plan_depth, x_p_L1, y_p_L1, b_h *i, 90)
    
    # rotate plane
    rotateBycentre(planes_r1, angle*i, c_p)
    rotateBycentre(planes_r2, angle*i, c_p)
    rotateBycentre(planes_r3, angle*i, c_p)
    
    rotateBycentre(planes_base_r1, angle*i, c_p)
    rotateBycentre(planes_base_r2, angle*i, c_p)
    rotateBycentre(planes_base_r3, angle*i, c_p)
    
    # create pattern by remove last brick 
    planes.append(planes_r1
                + planes_r2 
                + planes_r3)
                
    planes_base.append(planes_base_r1
                    + planes_base_r2
                    + planes_base_r3)


# subratct by Curve
subtract_planes = []
subtract_planes_base = []
for p in planes:
    subtract_planes.extend(substractByCurve(p, substract_curve, distance))
for p in planes_base:
    subtract_planes_base.append(substractByCurve(p, substract_curve, distance))


#create brick mesh
meshes =[]
for plane in subtract_planes_base:
    for p in plane:
        b = Brick(p)
        meshes.append(b.mesh())

# all meshes
#meshes =[]
#for plane in planes_base:
#    for p in plane:
#        b = Brick(p)
#        meshes.append(b.mesh())
# ---------- end python_2 ----------

python_3 = GhPythonScript(plan_depth=number_slider_7, height=Slider(10, range=0..100), angle_vetical=division, center_point=rotate_center_3)  # -> out, planes, planes_base, meshes; inputs plan_depth: Int32, height: Int32, center_point: Point3d
# ---------- python_3: Python ----------
from compas_rhino import unload_modules
unload_modules('model')
from model import Brick
import Rhino.Geometry as rg
import math

### this funtion is plane for herring bone
def herring_bone(plan_depth ,x_postion ,y_postion, z_postion, angle):
    """
    x_postion is brick X coordinate
    y_postion is brick Y coordinate
    z_postion is brick z coordinate
    angle is brick place direction
    """
    planes = [] # Top plane for robot picking up
    planes_base = [] # base plane for create visual brick
    # horizontal gap
    gap_hori = Brick.REFERENCE_WIDTH +2.5
    for i in range(plan_depth):
        x_value = gap_hori * i + x_postion
        y_value = gap_hori * i + y_postion
        z_value = z_postion
        
        # create brick plane
        plane_origin = rg.Point3d(x_value, y_value, z_value)
        brick_plane = rg.Plane(plane_origin, rg.Vector3d.XAxis, rg.Vector3d.YAxis)
        brick_plane.Rotate(math.radians(angle), rg.Vector3d.ZAxis)
        planes_base.append(brick_plane)
        plane_rot = brick_plane.Clone()
        brick_rot = Brick(plane_rot)
        planes.append(brick_rot.picking_plane())
    return planes, planes_base


# rotate plane 
def rotateBycentre(planes, angle, center_point):
    center_point = c_p # rotate centre
    plane_rot =[] 
    for p in planes:
        T = rg.Transform.Rotation(angle, c_p)
        p.Transform(T)
        plane_rot.append(p)
    return plane_rot

#####          #####
##### RUN CODE #####
#####          #####

# define the x_postion and y_postion for bricks
## modify brick gap here
b_leng = Brick.REFERENCE_LENGTH
b_wid = Brick.REFERENCE_WIDTH

x_p_R1, y_p_R1 = b_leng +0.8, b_wid/2
x_p_R2, y_p_R2 = b_wid/2, b_leng/2
x_p_L1, y_p_L1 = -.5, b_leng + b_wid/2 +1.3
x_p_L2, y_p_L2 = -1*(b_leng/2 + b_wid/2 + 1.8), b_leng + b_wid +1.8

##########
meshes =[]
planes = []
planes_base = []

# stacking
for i in range(height):
    b_h = Brick.REFERENCE_HEIGHT 
    c_p = center_point # rotate centre
    angle = math.radians(angle_vetical)
    # create plane
    planes_r1, planes_base_r1 = herring_bone(plan_depth, x_p_R1, y_p_R1, b_h *i, 0)
    planes_r2, planes_base_r2 = herring_bone(plan_depth, x_p_R2, y_p_R2, b_h *i, 90)
    planes_r3, planes_base_r3 = herring_bone(plan_depth, x_p_L1, y_p_L1, b_h *i, 0)
    planes_r4, planes_base_r4 = herring_bone(plan_depth, x_p_L2, y_p_L2, b_h *i, 90)
    
    # create pattern by remove last brick 
    if i == 0:
        planes.append(planes_r1
                    + planes_r2 
                    + planes_r3
                    + planes_r4)
                    
        planes_base.append(planes_base_r1
                        + planes_base_r2
                        + planes_base_r3
                        + planes_base_r4)
    elif i >=1 and  i <plan_depth:
        rotateBycentre(planes_r1, angle*i, c_p)
        rotateBycentre(planes_r2, angle*i, c_p)
        rotateBycentre(planes_r3, angle*i, c_p)
        rotateBycentre(planes_r4, angle*i, c_p)
        
        
        rotateBycentre(planes_base_r1, angle*i, c_p)
        rotateBycentre(planes_base_r2, angle*i, c_p)
        rotateBycentre(planes_base_r3, angle*i, c_p)
        rotateBycentre(planes_base_r4, angle*i, c_p)
        planes.append(planes_r1
                    + planes_r2 
                    + planes_r3
                    + planes_r4)
        planes_base.append(planes_base_r1[0:(plan_depth-i+1)]
                        + planes_base_r2
                        + planes_base_r3
                        + planes_base_r4[0:(plan_depth-i+1)])
    #############
    # reverse rotate plane
    
    
    
    
    
# all meshes
#meshes =[]
for plane in planes_base:
    for p in plane:
        b = Brick(p)
        meshes.append(b.mesh())
# ---------- end python_3 ----------

python_4 = GhPythonScript(
    plan_depth=Slider(2, range=0..100),
    height=Slider(3, range=0..100),
    angle_vetical=division_2,
    center_point=rotate_center_3)  # -> out, planes, planes_base, meshes; inputs plan_depth: Int32, height: Int32, center_point: Point3d
# ---------- python_4: Python ----------
from compas_rhino import unload_modules
unload_modules('model')
from model import Brick
import Rhino.Geometry as rg
import math

### this funtion is plane for herring bone
def herring_bone(plan_depth ,x_postion ,y_postion, z_postion, angle):
    """
    x_postion is brick X coordinate
    y_postion is brick Y coordinate
    z_postion is brick z coordinate
    angle is brick place direction
    """
    planes = [] # Top plane for robot picking up
    planes_base = [] # base plane for create visual brick
    # horizontal gap
    gap_hori = Brick.REFERENCE_WIDTH +2.5
    for i in range(plan_depth):
        x_value = gap_hori * i + x_postion
        y_value = gap_hori * i + y_postion
        z_value = z_postion
        
        # create brick plane
        plane_origin = rg.Point3d(x_value, y_value, z_value)
        brick_plane = rg.Plane(plane_origin, rg.Vector3d.XAxis, rg.Vector3d.YAxis)
        brick_plane.Rotate(math.radians(angle), rg.Vector3d.ZAxis)
        planes_base.append(brick_plane)
        plane_rot = brick_plane.Clone()
        brick_rot = Brick(plane_rot)
        planes.append(brick_rot.picking_plane())
    return planes, planes_base


# rotate plane 
def rotateBycentre(planes, angle, center_point):
    center_point = c_p # rotate centre
    plane_rot =[] 
    for p in planes:
        T = rg.Transform.Rotation(angle, c_p)
        p.Transform(T)
        plane_rot.append(p)
    return plane_rot

#####          #####
##### RUN CODE #####
#####          #####

# define the x_postion and y_postion for bricks
## modify brick gap here
b_leng = Brick.REFERENCE_LENGTH
b_wid = Brick.REFERENCE_WIDTH

x_p_R1, y_p_R1 = b_leng +0.8, b_wid/2
x_p_R2, y_p_R2 = b_wid/2, b_leng/2
x_p_L1, y_p_L1 = -.5, b_leng + b_wid/2 +1.3
x_p_L2, y_p_L2 = -1*(b_leng/2 + b_wid/2 + 1.8), b_leng + b_wid +1.8

##########
meshes =[]
planes = []
planes_base = []

# stacking
for i in range(height):
    b_h = Brick.REFERENCE_HEIGHT 
    c_p = center_point # rotate centre
    angle = math.radians(angle_vetical)
    
    # create pattern by remove last brick 
    if i % 2 ==0:
        # create plane
        planes_r1, planes_base_r1 = herring_bone(plan_depth, x_p_R1, y_p_R1, b_h *i, 0)
        planes_r2, planes_base_r2 = herring_bone(plan_depth, x_p_R2, y_p_R2, b_h *i, 90)
        planes_r3, planes_base_r3 = herring_bone(plan_depth, x_p_L1, y_p_L1, b_h *i, 0)
        planes_r4, planes_base_r4 = herring_bone(plan_depth, x_p_L2, y_p_L2, b_h *i, 90)
        planes.append(planes_r1
                    + planes_r2 
                    + planes_r3
                    + planes_r4)
                    
        planes_base.append(planes_base_r1
                        + planes_base_r2
                        + planes_base_r3
                        + planes_base_r4)
    elif i % 2 ==1:
        planes_r1, planes_base_r1 = herring_bone(plan_depth, x_p_R1, y_p_R1, b_h *i, 90)
        planes_r2, planes_base_r2 = herring_bone(plan_depth, x_p_R2, y_p_R2, b_h *i, 0)
        planes_r3, planes_base_r3 = herring_bone(plan_depth, x_p_L1, y_p_L1, b_h *i, 90)
        planes_r4, planes_base_r4 = herring_bone(plan_depth, x_p_L2, y_p_L2, b_h *i, 0)
        planes.append(planes_r1
                    + planes_r2 
                    + planes_r3
                    + planes_r4)
        planes_base.append(planes_base_r1
                        + planes_base_r2
                        + planes_base_r3
                        + planes_base_r4)
    #############
    rotateBycentre(planes_r1, angle*i, c_p)
    rotateBycentre(planes_r2, angle*i, c_p)
    rotateBycentre(planes_r3, angle*i, c_p)
    rotateBycentre(planes_r4, angle*i, c_p)
    
    rotateBycentre(planes_base_r1, angle*i, c_p)
    rotateBycentre(planes_base_r2, angle*i, c_p)
    rotateBycentre(planes_base_r3, angle*i, c_p)
    rotateBycentre(planes_base_r4, angle*i, c_p)
########




# all meshes
#meshes =[]
for plane in planes_base:
    for p in plane:
        b = Brick(p)
        meshes.append(b.mesh())
# ---------- end python_4 ----------

python_5 = GhPythonScript(plan_depth=number_slider_16, height=number_slider_18, angle_vetical=rotate_angle_4)  # -> out, planes, planes_base, meshes; inputs plan_depth: Int32, height: Int32; disabled
# ---------- python_5: Python ----------
from compas_rhino import unload_modules
unload_modules('model')
from model import Brick
import Rhino.Geometry as rg
import math
import statistics as stat



### this funtion is plane for herring bone
def herring_bone(plan_depth ,x_postion ,y_postion, z_postion, angle):
    """
    x_postion is brick X coordinate
    y_postion is brick Y coordinate
    z_postion is brick z coordinate
    angle is brick place direction
    """
    planes = [] # Top plane for robot picking up
    planes_base = [] # base plane for create visual brick
    # horizontal gap
    gap_hori = Brick.REFERENCE_WIDTH +2.5
    for i in range(plan_depth):
        
        x_value = gap_hori * i + x_postion
        y_value = gap_hori * i + y_postion
        z_value = z_postion
        
        # create brick plane
        plane_origin = rg.Point3d(x_value, y_value, z_value)
        brick_plane = rg.Plane(plane_origin, rg.Vector3d.XAxis, rg.Vector3d.YAxis)
        brick_plane.Rotate(math.radians(angle), rg.Vector3d.ZAxis)
        planes_base.append(brick_plane)
        plane_rot = brick_plane.Clone()
        brick_rot = Brick(plane_rot)
        planes.append(brick_rot.picking_plane())
    return planes, planes_base

# rotate plane 
def rotateBycentre(planes, angle, center_point):
    # rotate centre
    plane_rot =[] 
    for p in planes:
        T = rg.Transform.Rotation(angle, center_point)
        p.Transform(T)
        plane_rot.append(p)
    return plane_rot

def average_pt(planes):
    """
    Create center point of planes
    """
    planeX = []
    planeY = []
    planeZ= []
    for plane in planes:
        planeX.append(plane.Origin.X)
        planeY.append(plane.Origin.Y)
        planeZ.append(plane.Origin.Z)
        
    center_pt = rg.Point3d(stat.mean(planeX), stat.mean(planeY),stat.mean(planeZ))
    return center_pt

#####          #####
##### RUN CODE #####
#####          #####

# define the x_postion and y_postion for bricks
## modify brick gap here
b_leng = Brick.REFERENCE_LENGTH
b_wid = Brick.REFERENCE_WIDTH

x_p_R1, y_p_R1 = b_leng +0.8, b_wid/2
x_p_R2, y_p_R2 = b_wid/2, b_leng/2
x_p_L1, y_p_L1 = -.5, b_leng + b_wid/2 +1.3
x_p_L2, y_p_L2 = -1*(b_leng/2 + b_wid/2 + 1.8), b_leng + b_wid +1.8

##########
meshes =[]
planes = []
planes_base = []

# stacking
for i in range(height):
    b_h = Brick.REFERENCE_HEIGHT 
    angle = math.radians(angle_vetical)
    # create plane
    planes_r1, planes_base_r1 = herring_bone(plan_depth, x_p_R1, y_p_R1, b_h *i, 0)
    planes_r2, planes_base_r2 = herring_bone(plan_depth, x_p_R2, y_p_R2, b_h *i, 90)
    planes_r3, planes_base_r3 = herring_bone(plan_depth, x_p_L1, y_p_L1, b_h *i, 0)
    
    planes_temp =[]
    planes_temp.append(planes_r1 + planes_r2 +planes_r3)
    for p in planes:
        cen_pt = average_pt(p)
        # rotate centre
        # rotate plane
        rotateBycentre(planes_r1, angle, cen_pt)
        rotateBycentre(planes_r2, angle, cen_pt)
        rotateBycentre(planes_r3, angle, cen_pt)
        
        rotateBycentre(planes_base_r1, angle, cen_pt)
        rotateBycentre(planes_base_r2, angle, cen_pt)
        rotateBycentre(planes_base_r3, angle, cen_pt)
    
    
    # create pattern by remove last brick
    if i == 0 :
        planes.append(planes_r1
                     + planes_r2 
                     + planes_r3)
        planes_base.append(planes_base_r1 
                         + planes_base_r2 
                        + planes_base_r3)
    else: 
        planes.append(planes_r1
                     + planes_r2
                     + planes_r3 )
        planes_base.append(planes_base_r1 
                         + planes_base_r2 
                        + planes_base_r3 )



# all meshes
meshes =[]
for plane in planes_base:
    for p in plane:
        b = Brick(p)
        meshes.append(b.mesh())
# ---------- end python_5 ----------

python_6 = GhPythonScript(plan_depth=Slider(5, range=0..100), height=number_slider_3, angle_vetical=neg, center_point=rotate_center_3)  # -> out, planes, planes_base, meshes; inputs plan_depth: Int32, height: Int32, center_point: Point3d
# ---------- python_6: Python ----------
from compas_rhino import unload_modules
unload_modules('model')
from model import Brick
import Rhino.Geometry as rg
import math

### this funtion is plane for herring bone
def herring_bone(plan_depth ,x_postion ,y_postion, z_postion, angle):
    """
    x_postion is brick X coordinate
    y_postion is brick Y coordinate
    z_postion is brick z coordinate
    angle is brick place direction
    """
    planes = [] # Top plane for robot picking up
    planes_base = [] # base plane for create visual brick
    # horizontal gap
    gap_hori = Brick.REFERENCE_WIDTH +2.5
    for i in range(plan_depth):
        
        x_value = gap_hori * i + x_postion
        y_value = gap_hori * i + y_postion
        z_value = z_postion
        
        # create brick plane
        plane_origin = rg.Point3d(x_value, y_value, z_value)
        brick_plane = rg.Plane(plane_origin, rg.Vector3d.XAxis, rg.Vector3d.YAxis)
        brick_plane.Rotate(math.radians(angle), rg.Vector3d.ZAxis)
        planes_base.append(brick_plane)
        plane_rot = brick_plane.Clone()
        brick_rot = Brick(plane_rot)
        planes.append(brick_rot.picking_plane())
    return planes, planes_base

# rotate plane 
def rotateBycentre(planes, angle, center_point):
    center_point = c_p # rotate centre
    plane_rot =[] 
    for p in planes:
        T = rg.Transform.Rotation(angle, c_p)
        p.Transform(T)
        plane_rot.append(p)
    return plane_rot

#####          #####
##### RUN CODE #####
#####          #####

# define the x_postion and y_postion for bricks
## modify brick gap here
b_leng = Brick.REFERENCE_LENGTH
b_wid = Brick.REFERENCE_WIDTH

x_p_R1, y_p_R1 = b_leng +0.8, b_wid/2
x_p_R2, y_p_R2 = b_wid/2, b_leng/2
x_p_L1, y_p_L1 = -.5, b_leng + b_wid/2 +1.3
x_p_L2, y_p_L2 = -1*(b_leng/2 + b_wid/2 + 1.8), b_leng + b_wid +1.8

##########
meshes =[]
planes = []
planes_base = []

# stacking
for i in range(height):
    b_h = Brick.REFERENCE_HEIGHT 
    c_p = center_point # rotate centre
    angle = math.radians(angle_vetical)
    # create plane
    planes_r1, planes_base_r1 = herring_bone(plan_depth, x_p_R1, y_p_R1, b_h *i, 0)
    planes_r2, planes_base_r2 = herring_bone(plan_depth, x_p_R2, y_p_R2, b_h *i, 90)
    planes_r3, planes_base_r3 = herring_bone(plan_depth, x_p_L1, y_p_L1, b_h *i, 0)
    
    
    # rotate plane
    rotateBycentre(planes_r1, angle, c_p.Z)
    rotateBycentre(planes_r2, angle, c_p)
    rotateBycentre(planes_r3, angle, c_p)
    rotateBycentre(planes_base_r1, angle*i, c_p)
    rotateBycentre(planes_base_r2, angle*i, c_p)
    rotateBycentre(planes_base_r3, angle*i, c_p)
    # create pattern by remove last brick 
    if i >= 0:
        planes.append(planes_r1
                    + planes_r2 
                    + planes_r3)
                    
        planes_base.append(planes_base_r1
                        + planes_base_r2
                        + planes_base_r3)

# all meshes
#meshes =[]
for plane in planes_base:
    for p in plane:
        b = Brick(p)
        meshes.append(b.mesh())
# ---------- end python_6 ----------

python_7 = GhPythonScript(plan_depth=number_slider_17, height=number_slider_19, angle_vetical=rotate_angle_5, center_point=rotate_center_4)  # -> out, planes, planes_base, meshes; inputs plan_depth: Int32, height: Int32, center_point: Point3d; disabled
# ---------- python_7: Python ----------
from compas_rhino import unload_modules
unload_modules('model')
from model import Brick
import Rhino.Geometry as rg
import math

### this funtion is plane for herring bone
def herring_bone_twoBricks(plan_depth ,x_postion ,y_postion, z_postion, angle):
    """
    x_postion is brick X coordinate
    y_postion is brick Y coordinate
    z_postion is brick z coordinate
    angle is brick place direction
    """
    planes = [] # Top plane for robot picking up
    planes_base = [] # base plane for create visual brick
    # horizontal gap
    gap_hori = Brick.REFERENCE_WIDTH +2.5
    for i in range(plan_depth):
        x_value = gap_hori * i + x_postion
        y_value = gap_hori * -i + y_postion
        z_value = z_postion
        # create brick plane
        plane_origin = rg.Point3d(x_value, y_value, z_value)
        brick_plane = rg.Plane(plane_origin, rg.Vector3d.XAxis, rg.Vector3d.YAxis)
        brick_plane.Rotate(math.radians(angle), rg.Vector3d.ZAxis)
        planes_base.append(brick_plane)
        plane_rot = brick_plane.Clone()
        brick_rot = Brick(plane_rot)
        planes.append(brick_rot.picking_plane())
    return planes, planes_base





# rotate plane 
def rotateBycentre(planes, angle, center_point):
    center_point = c_p # rotate centre
    plane_rot =[] 
    for p in planes:
        T = rg.Transform.Rotation(angle, c_p)
        p.Transform(T)
        plane_rot.append(p)
    return plane_rot


#####          #####
##### RUN CODE #####
#####          #####

# define the x_postion and y_postion for bricks
## modify brick gap here
b_leng = Brick.REFERENCE_LENGTH
b_wid = Brick.REFERENCE_WIDTH

x_p_R1, y_p_R1 = b_leng +0.8, b_wid/2
x_p_R2, y_p_R2 = b_wid/2, b_leng/2
x_p_L1, y_p_L1 = -.5, b_leng + b_wid/2 +1.3
x_p_L2, y_p_L2 = -1*(b_leng/2 + b_wid/2 + 1.8), b_leng + b_wid +1.8

##########
meshes =[]
planes = []
planes_base = []

planes, planes_base = herring_bone_twoBricks(plan_depth, x_p_R1, y_p_R1, 8, 0)
## stacking
#for i in range(height):
#    b_h = Brick.REFERENCE_HEIGHT 
#    c_p = center_point # rotate centre
#    angle = math.radians(angle_vetical)
#    
#    
#    # create plane
#    planes_r1, planes_base_r1 = herring_bone(plan_depth, x_p_R1, y_p_R1, b_h *i, 0)
#    planes_r2, planes_base_r2 = herring_bone(plan_depth, x_p_R2, y_p_R2, b_h *i, 90)
#    planes_r3, planes_base_r3 = herring_bone(plan_depth, x_p_L1, y_p_L1, b_h *i, 0)
#    
#    
#    # rotate plane
#    rotateBycentre(planes_r1, angle*i, c_p)
#    rotateBycentre(planes_r2, angle*i, c_p)
#    rotateBycentre(planes_r3, angle*i, c_p)
#    
#    rotateBycentre(planes_base_r1, angle*i, c_p)
#    rotateBycentre(planes_base_r2, angle*i, c_p)
#    rotateBycentre(planes_base_r3, angle*i, c_p)
#    
#    # create pattern by remove last brick 
#    if i >=0 and i < 2:
#        planes.append(planes_r1
#                    + planes_r2 
#                    + planes_r3)
#                    
#        planes_base.append(planes_base_r1
#                        + planes_base_r2
#                        + planes_base_r3)
#    elif i >= 2 and i <4:
#        planes.append(planes_r1[:-1]
#                    + planes_r2[:-1] 
#                    + planes_r3[:-1])
#                    
#        planes_base.append(planes_base_r1[:-1]
#                        + planes_base_r2[:-1]
#                        + planes_base_r3[:-1])
#    elif i >= 4 and i <6:
#        planes.append(planes_r1[:-1]
#                    + planes_r2[:-1] 
#                    + planes_r3[:-2][:-3])
#                    
#        planes_base.append(planes_base_r1[:-1]
#                        + planes_base_r2[:-1]
#                        + planes_base_r3[:-2][:-3])
#    else:
#        planes.append(planes_r1[:-2]
#            + planes_r2[:-2] 
#            + planes_r3[:-2][:-3])
#            
#        planes_base.append(planes_base_r1[:-2]
#                        + planes_base_r2[:-2]
#                        + planes_base_r3[:-2][:-3])
#
#
#
#
#
## all meshes
#meshes =[]
for plane in planes_base:
#    for p in plane:
    b = Brick(plane)
    meshes.append(b.mesh())
# ---------- end python_7 ----------

# ----
pt_2 = Point([Point(55.767501, 25.57517994, 0), Point(56.54932949, 71.83664512, 0), Point(63.27843336, 107.609608, 0), Point(9.203665432, 158.6058634, 0), Point(-39.59617736, 239.0710313, 0), Point(-26.83460144, 283.0261469, 0), Point(38.75053087, 250.1406694, 0), Point(38.63837303, 328.5991417, 0), Point(-24.33766357, 367.5972188, 0), Point(-53.82610382, 393.2343492, 0)])  # disabled
xy = XYPlane(Origin=pt_2)  # disabled
pflip = FlipPlane(Plane=xy, ReverseX=False, ReverseY=False, SwapAxes=True)  # disabled
unpack_2 = GhPythonScript(Tree=python_5.planes)  # -> simplify(Upackdata); disabled
# ---------- unpack_2: Python ----------
### unpack IRONPYTHON
Upackdata = Tree
# ---------- end unpack_2 ----------
python_8 = GhPythonScript(x=xy)  # -> out, robot_base_plane, b; inputs x: list; disabled
# ---------- python_8: Python ----------
import rhinoscriptsyntax as rs
import Rhino.Geometry as rg
import ghpythonlib.components as gh


def set_robot_base_plane_from_pts():
    pt_0 = rg.Point3d(299, 63, -0)  # base plane origin
    # point on base plane positive x direction
    pt_1 = rg.Point3d(499, 63, 0)
    pt_2 = rg.Point3d(499, 299, 0)  # point on base plane positive xy

    robot_base = rg.Plane(pt_0, pt_1-pt_0, pt_2-pt_0)
    return robot_base

def rhino_to_robot_space(rhino_plane):
    """ this funktion translates planes from the rhino cordinate system to
    the robot cordinate system 
    """
    robot_plane = rhino_plane.Clone()
    _r_matrix = rg.Transform.PlaneToPlane(rg.Plane.WorldXY, set_robot_base_plane_from_pts())
    robot_plane.Transform(_r_matrix)
    return robot_plane

b = []
for plane in x:
    b.append(rhino_to_robot_space(plane))
# ---------- end python_8 ----------
unpack_3 = GhPythonScript(Tree=python_7.planes)  # -> simplify(Upackdata); disabled; same code as unpack_2
unpack_4 = GhPythonScript(Tree=python_7.planes_base)  # -> simplify(Upackdata); disabled; same code as unpack_2
unpack_5 = GhPythonScript(Tree=python_6.planes)  # -> simplify(Upackdata); disabled; same code as unpack_2
unpack_6 = GhPythonScript(Tree=python_3.planes_base)  # -> simplify(Upackdata); same code as unpack_2
unpack_7 = GhPythonScript(Tree=python_4.planes_base)  # -> simplify(Upackdata); same code as unpack_2
unpack_8 = GhPythonScript(Tree=python_3.planes)  # -> simplify(Upackdata); same code as unpack_2
unpack_9 = GhPythonScript(Tree=python_4.planes)  # -> simplify(Upackdata); same code as unpack_2
unpack_10 = GhPythonScript(Tree=python_6.planes_base)  # -> simplify(Upackdata); disabled; same code as unpack_2

number_slider_22 = Slider(5, range=0..10)  # disabled
pln = Plane(unpack_2)  # disabled
points_2 = PointList(Points=pln, Size=number_slider_22)  # disabled

bricks_2 = Mesh(python_7.meshes)  # disabled
geo_4 = Geometry(python_5.meshes)  # disabled
unpack_11 = GhPythonScript(Tree=python_2.planes)  # -> simplify(Upackdata); disabled; same code as unpack_2
unpack_12 = GhPythonScript(Tree=python_2.planes_base)  # -> simplify(Upackdata); disabled; same code as unpack_2
python_9 = GhPythonScript()  # -> out, a; disabled
# ---------- python_9: Python ----------
__author__ = "WeiTingChen"
__version__ = "2020.10.09"

import rhinoscriptsyntax as rs
import Rhino.Geometry as rg
import ghpythonlib.components as gh



def subtractionBysurface(planes, surface, distance):
    inside_planes = []
    for p in planes:
        # distance_closest_pts 
        closest_pts = surface.ClosestPoint(p.Origin)
        print (closest_pts)
        closest_distane = closest_pts.DistanceTo(p.Origin)
        if closest_distane <= distance:
            new_plane = rg.Plane(p.Origin, p.XAxis, p.YAxis)
            inside_planes.append(new_plane)
    return inside_planes
# ---------- end python_9 ----------
bricks_3 = Mesh(python_2.meshes)  # disabled
plnaxis = PlaneAxis(P=python_8.b, B=35)  # disabled
unflatten = UnflattenTree(Tree=python_4.meshes, Guide=unpack_7)
unflatten_2 = UnflattenTree(Tree=python_3.meshes, Guide=unpack_6)
unflatten_3 = UnflattenTree(Tree=python_6.meshes, Guide=unpack_10)  # disabled
plane_for_visualization = Plane(flatten(unpack_6))  # disabled
planetorobot = Plane(flatten(unpack_8))  # disabled
bricks_4 = Mesh(python_3.meshes)  # disabled
# Visualization
python_10 = GhPythonScript(Base_plane=plane_for_visualization)  # -> out, bricks; inputs Base_plane: list
# ---------- python_10: Python ----------
import rhinoscriptsyntax as rs
import Rhino.Geometry as rg
import ghpythonlib.components as gh

from model import Brick

def set_robot_base_plane_from_pts():
    pt_0 = rg.Point3d(299, 63, -0)  # base plane origin
    # point on base plane positive x direction
    pt_1 = rg.Point3d(499, 63, 0)
    pt_2 = rg.Point3d(499, 299, 0)  # point on base plane positive xy

    robot_base = rg.Plane(pt_0, pt_1-pt_0, pt_2-pt_0)
    return robot_base

def rhino_to_robot_space(rhino_plane):
    """ this funktion translates planes from the rhino cordinate system to
    the robot cordinate system 
    """
    robot_plane = rhino_plane.Clone()
    _r_matrix = rg.Transform.PlaneToPlane(rg.Plane.WorldXY, set_robot_base_plane_from_pts())
    robot_plane.Transform(_r_matrix)
    return robot_plane

###          ### 
### Run Code ###
###          ###
bricks = []
for plane in Base_plane:
    planes = rhino_to_robot_space(plane)
    b = Brick(planes)
    bricks.append(b.mesh())
# ---------- end python_10 ----------

# ---- group: SEND TO ROBOT
button = Button()

# ----
# Robotic Fabrication
plane = Geometry(flatten(planetorobot))

# ---- group: Total Counts
lng = ListLength(List=bricks_4)
panel_5 = Panel(lng)

# ----
fabrication = GhPythonScript(way_plane=plane, send=button)  # -> out, robot_planes, pick_up_planes, glue_plane, script; inputs way_plane: list
# ---------- fabrication: Python ----------
from compas_rhino import unload_modules
unload_modules('model')
from model import Brick

import Rhino.Geometry as rg
import simple_comm as c
import simple_ur_script as ur
import math as m


rhino_base_way_planes = way_plane

def tcp(script):
    """ This funktion sets tcp 
    """
    script += ur.set_tcp_by_angles(
        0.0, 0.0, 70, m.radians(0.0), m.radians(180.0), m.radians(0))
    return script


### set robot orint plane
def set_robot_base_plane_from_pts():

    pt_0 = rg.Point3d(299, 63, 0)  # base plane origin
    # point on base plane positive x direction
    pt_1 = rg.Point3d(499, 63, 0)
    pt_2 = rg.Point3d(499, 299, 0)  # point on base plane positive xy

    robot_base = rg.Plane(pt_0, pt_1-pt_0, pt_2-pt_0)
    return robot_base

def rhino_to_robot_space(rhino_plane):
    """ this funktion translates planes from the rhino cordinate system to
    the robot cordinate system 
    """
    robot_plane = rhino_plane.Clone()
    _r_matrix = rg.Transform.PlaneToPlane(rg.Plane.WorldXY, set_robot_base_plane_from_pts())
    robot_plane.Transform(_r_matrix)
    return robot_plane

def pickup_brick(pick_up_plane, script):
    """Pick up a brick procedure

    Parameters
    ----------
    pick_up_plane : rhino.geometry.plane
    
    Returns:
    Procedure for pickin up plane
    """
    accel = 0.3    # m/s2
    vel = 0.5      # m/s

    safe_distance = 50
    
    way_planes = []

    safe_plane = pick_up_plane.Clone()
    safe_plane.Translate(rg.Vector3d(0, 0, safe_distance))

    script += ur.move_l(safe_plane, accel, vel)
    way_planes.append(safe_plane)

    script += ur.move_l(pick_up_plane, accel, vel)
    way_planes.append(pick_up_plane)

    script += ur.set_digital_out(0, True)
    script += ur.sleep(1)

    script += ur.move_l(safe_plane, accel, vel)
    way_planes.append(safe_plane)

    return script 

def place_brick(plane, script):
    """
    this function gereates the robotic sequience for placing a brick
    Requires a plane wich describes the possition of the brick"""

    safe_distance = 50
    accel = 0.1
    vel = 0.3
    way_planes = []

    safe_plane = plane.Clone()
    safe_plane.Translate(rg.Vector3d(0, 0, safe_distance))

    script += ur.move_l(safe_plane, accel, vel)
    way_planes.append(safe_plane)

    script += ur.move_l(plane, accel, vel)
    way_planes.append(plane)

    script += ur.set_digital_out(0, False)
    script += ur.sleep(1)

    script += ur.move_l(safe_plane, accel, vel)
    way_planes.append(safe_plane)

    return script

def glue(plane, script):
    """
    this function gereates the robotic sequience for using_glue
    Requires a plane wich describes the possition of the brick"""

    safe_distance = 50
    accel = 0.5
    vel = 1
    
    way_planes = []

    safe_plane = plane.Clone()
    safe_plane.Translate(rg.Vector3d(0, 0, safe_distance))

    script += ur.move_l(safe_plane, accel, vel)
    way_planes.append(safe_plane)

    script += ur.move_l(plane, accel, vel)
    way_planes.append(plane)
    
    script += ur.move_l(safe_plane, accel, vel)
    way_planes.append(safe_plane)

    return script



""" Robotic fabrication procedure
"""
script = ""
script = tcp(script)

"""pick _up plane is measured in the robot base plane
"""
pick_up_planes =[]
for i in range(3):  # rows x-direction
    for j in range(12):  # rows y-direction
        for k in range(6):
            x_pos = k * (Brick.REFERENCE_LENGTH)
            y_pos = j * (Brick.REFERENCE_WIDTH)
            z_pos = i * (Brick.REFERENCE_HEIGHT)
            origin = rg.Point3d(-60+x_pos, 508-y_pos, 6.0+z_pos)
            pick_up_plane = rg.Plane(origin, rg.Vector3d.XAxis, rg.Vector3d.YAxis)
            pick_up_plane.Rotate(m.radians(-90), rg.Vector3d.ZAxis)
            pick_up_planes.append(pick_up_plane)
pick_up_planes.reverse()


robot_planes = []


"""We are translating all way_planes from rhino base to robot_base
"""
for rhino_plane in (rhino_base_way_planes):
    robot_planes.append(rhino_to_robot_space(rhino_plane))

glue_plane = rg.Plane(rg.Point3d(178.4, 466.2, 17.5), rg.Vector3d.XAxis, rg.Vector3d.YAxis)
glue_plane.Rotate(m.radians(-90), rg.Vector3d.ZAxis)


# set the start postion 
s_pos = [ m.radians(94.51),
   m.radians(-85.99),
   m.radians(-126.91),
   m.radians(-57.21),
   m.radians(90),
   m.radians(0)]
script += ur.move_j(s_pos, 0.4, 0.4)

for i in range(len(robot_planes)-1):
    #pick up a plane 
    if i< 24:
        script = pickup_brick(pick_up_planes[i], script)
        script = place_brick(robot_planes[i], script)
    else:
        script = pickup_brick(pick_up_planes[i], script)
        script = glue(glue_plane, script)
        script = place_brick(robot_planes[i], script)


#for robot_plane, pick_up_plane in zip(robot_planes, pick_up_planes):
#    #pick up a plane 
#    script = pickup_brick(pick_up_plane, script)
#    script = glue(glue_plane, script)
#    script = place_brick(robot_plane, script)


script = c.concatenate_script(script)

if send == True :
    c.send_script(script, "192.168.10.10")
# ---------- end fabrication ----------

# ---- group: Gule
number_slider_23 = Slider(75, range=0..1000)
dom_2 = ConstructDomain(DomainStart=number_slider_23, DomainEnd=expr("x*-1", number_slider_23))
pt_3 = Point(fabrication.glue_plane)
rectangle = Rectangle(Plane=pt_3, XSize=dom_2, YSize=dom_2, Radius=0)  # -> Rectangle, Length

# ---- group: Brick
pln_2 = Plane(fabrication.robot_planes)
preview_2 = CustomPreview(Geometry=python_10.bricks, Material=ColourSwatch(SwatchColor=RGBA(0, 0, 0, 101)))
points_3 = PointList(Points=pln_2, Size=Slider(1.22, range=0..10))

# ---- group: Robot_ enviroment
preview_3 = CustomPreview(Geometry=robotmodel, Material=ColourSwatch(SwatchColor=RGBA(255, 255, 255, 46)))

# ---- group: select the path
knob = ControlKnob(Decimals=0, Limit=True, Maximum=10, Minimum=0, Range=10, Value=0)  # disabled

# ----
number_slider_24 = Slider(10, range=0..10)

pln_3 = Plane(fabrication.pick_up_planes)
points_4 = PointList(Points=pln_3, Size=Slider(1.26, range=0..10))

plnaxis_2 = PlaneAxis(P=fabrication.glue_plane, B=number_slider_24)
plnaxis_3 = PlaneAxis(P=fabrication.pick_up_planes, B=number_slider_24)

# ----
# RotateByCenter
# 20201105
rotate_angle_6 = Slider(7.5, range=0..30)  # disabled
number_slider_25 = Slider(3, range=0..100)  # disabled
number_slider_26 = Slider(4, range=0..100)  # disabled
pt_4 = Point(Point(28.4153801, 37.74651724, 0))  # disabled

# ---- group: HerringBrcik
python_11 = GhPythonScript(plan_depth=number_slider_25, height=number_slider_26, angle=rotate_angle_6, rotate_centre=pt_4)  # -> out, planes, planes_base, meshes; inputs plan_depth: Int32, height: Int32, rotate_centre: Point3d; disabled
# ---------- python_11: Python ----------
from compas_rhino import unload_modules
unload_modules('model')

from model import Brick
import Rhino.Geometry as rg
import math

def herring_Brick(plane):
    planes = []
    planes_base =[]
    
    # first brick
    plane_origin = (plane.Origin
                   +(plane.XAxis * Brick.REFERENCE_WIDTH/2)
                   +(plane.YAxis * Brick.REFERENCE_LENGTH/2))
    
    brick_1_plane = rg.Plane(plane_origin, plane.XAxis, plane.YAxis)
    brick_1_plane.Rotate(math.radians(90), rg.Vector3d.ZAxis)
    planes_base.append(brick_1_plane)
    plane_rot = brick_1_plane.Clone()
    brick_rot = Brick(plane_rot)
    planes.append(brick_rot.picking_plane())
    
    # second brick
    plane_2_origin = (plane.Origin 
                   +(plane.XAxis * (Brick.REFERENCE_LENGTH + 1.5))
                   +(plane.YAxis * Brick.REFERENCE_WIDTH/2))
    
    brick_2_plane = rg.Plane(plane_2_origin, plane.XAxis, plane.YAxis)
    brick_2_plane.Rotate(math.radians(0), rg.Vector3d.ZAxis)
    planes_base.append(brick_2_plane)
    plane_2_rot = brick_2_plane.Clone()
    brick_2_rot = Brick(plane_2_rot)
    planes.append(brick_2_rot.picking_plane())
    
    # third brick
    plane_3_origin = (plane.Origin 
                        -(plane.XAxis/2)
                        +(plane.YAxis 
                        *(Brick.REFERENCE_LENGTH + Brick.REFERENCE_WIDTH/2 +1.5)))
    
    brick_3_plane = rg.Plane(plane_3_origin, plane.XAxis, plane.YAxis)
    brick_3_plane.Rotate(math.radians(0), rg.Vector3d.ZAxis)
    planes_base.append(brick_3_plane)
    plane_3_rot = brick_3_plane.Clone()
    brick_3_rot = Brick(plane_3_rot)
    planes.append(brick_3_rot.picking_plane())
    
    # FOUR brick
    plane_origin = (plane.Origin
                   -(plane.XAxis*(Brick.REFERENCE_LENGTH/2 + Brick.REFERENCE_WIDTH/2 + 2.5) )
                   +(plane.YAxis *(Brick.REFERENCE_LENGTH + Brick.REFERENCE_WIDTH + 2.5)))
    
    brick_1_plane = rg.Plane(plane_origin, plane.XAxis, plane.YAxis)
    brick_1_plane.Rotate(math.radians(90), rg.Vector3d.ZAxis)
    planes_base.append(brick_1_plane)
    plane_rot = brick_1_plane.Clone()
    brick_rot = Brick(plane_rot)
    planes.append(brick_rot.picking_plane())
    
    return planes, planes_base


def del_nosupport_brick(plane, planes):
    
    plane_origin = plane.Origin
    planes_orgin = planes.Origin
    distance  = plane.DistanceTo(plane_origin)
    print(distance)

meshes =[]
planes = []
planes_base = []

# rotate and stack bricks 
for i in range(plan_depth):
    for j in range(height):
        # plan gap
        gap_h = Brick.REFERENCE_WIDTH + 1.5 
        # vertcal gap
        gap_v = Brick.REFERENCE_HEIGHT
#        if j%2 == 0:
        brick_plane = rg.Plane(rg.Point3d(gap_h * (i), gap_h* (i), j*gap_v),
                                rg.Vector3d.XAxis, 
                                rg.Vector3d.YAxis)
        #T = rg.Transform.Rotation(math.radians(10)*i, rg.Point3d(0,0,0))
        brick_plane.Rotate(math.radians(angle)*j, rg.Vector3d.ZAxis, rotate_centre)
        planes.extend(herring_Brick(brick_plane)[0])
        # print(herring_Brick(brick_plane)[0][0])
        planes_base.extend(herring_Brick(brick_plane)[1])
#        else:
#            brick_plane = rg.Plane(rg.Point3d(gap_h * (i-1), gap_h* i, j*gap_v),
#                                    rg.Vector3d.XAxis, 
#                                    rg.Vector3d.YAxis)
#            #T = rg.Transform.Rotation(math.radians(10)*i, rg.Point3d(0,0,0))
#            brick_plane.Rotate(math.radians(angle)*j, rg.Vector3d.ZAxis, rotate_centre)
#            planes.extend(herring_Brick(brick_plane)[0])
#            # print(herring_Brick(brick_plane)[0][0])
#            planes_base.extend(herring_Brick(brick_plane)[1])
        
for plane in planes_base:
    b = Brick(plane)
    meshes.append(b.mesh())
# ---------- end python_11 ----------

# ----
pln_4 = Plane(python_11.planes)  # disabled
pln_5 = Plane(python_11.planes_base)  # disabled
geo_5 = Geometry(python_11.meshes)  # disabled

number_slider_27 = Slider(5, range=0..100)  # disabled
number_slider_28 = Slider(1, range=0..100)  # disabled
rotate_angle_7 = Slider(3, range=0..30)  # disabled
number_slider_29 = Slider(2, range=0..10)  # disabled
number_slider_30 = Slider(303, range=0..500)  # disabled
number_slider_31 = Slider(141, range=0..500)  # disabled
X = UnitX(Factor=number_slider_30)  # disabled
panel_6 = Panel("1")  # disabled
series_3 = Series(Start=panel_6, Step=1, Count=number_slider_27)  # -> reverse(Series); disabled
Y = UnitY(Factor=number_slider_31)  # disabled
panel_7 = Panel("4")  # disabled
multiplication_2 = Multiplication(A=series_3, B=panel_7)  # disabled
number_slider_32 = Slider(2, range=0..10)  # disabled
button_2 = Button()  # disabled

# ---- group: HerringBrcik
python_12 = GhPythonScript(plan_depth=number_slider_27, height=number_slider_28, angle=rotate_angle_7)  # -> out, planes, planes_base, meshes; inputs plan_depth: Int32, height: Int32; disabled
# ---------- python_12: Python ----------
from compas_rhino import unload_modules
unload_modules('model')

from model import Brick
import Rhino.Geometry as rg
import math

def herring_Brick(plane):
    planes = []
    planes_base =[]
    # first brick
    plane_origin = (plane.Origin
                   +(plane.XAxis * Brick.REFERENCE_WIDTH/2)
                   +(plane.YAxis * Brick.REFERENCE_LENGTH/2))
    
    brick_1_plane = rg.Plane(plane_origin, plane.XAxis, plane.YAxis)
    brick_1_plane.Rotate(math.radians(90), rg.Vector3d.ZAxis)
    planes_base.append(brick_1_plane)
    plane_rot = brick_1_plane.Clone()
    brick_rot = Brick(plane_rot)
    planes.append(brick_rot.picking_plane())
    
    # second brick
    plane_2_origin = (plane.Origin 
                   +(plane.XAxis * (Brick.REFERENCE_LENGTH +0.8))
                   +(plane.YAxis * Brick.REFERENCE_WIDTH/2))
    
    brick_2_plane = rg.Plane(plane_2_origin, plane.XAxis, plane.YAxis)
    brick_2_plane.Rotate(math.radians(0), rg.Vector3d.ZAxis)
    planes_base.append(brick_2_plane)
    plane_2_rot = brick_2_plane.Clone()
    brick_2_rot = Brick(plane_2_rot)
    planes.append(brick_2_rot.picking_plane())
    
    # third brick
    plane_3_origin = (plane.Origin 
                        -(plane.XAxis/2)
                        +(plane.YAxis 
                        *(Brick.REFERENCE_LENGTH + Brick.REFERENCE_WIDTH/2 +1.3)))
    
    brick_3_plane = rg.Plane(plane_3_origin, plane.XAxis, plane.YAxis)
    brick_3_plane.Rotate(math.radians(0), rg.Vector3d.ZAxis)
    planes_base.append(brick_3_plane)
    plane_3_rot = brick_3_plane.Clone()
    brick_3_rot = Brick(plane_3_rot)
    planes.append(brick_3_rot.picking_plane())
    
    # FOUR brick
    plane_origin = (plane.Origin
                   -(plane.XAxis*(Brick.REFERENCE_LENGTH/2 + Brick.REFERENCE_WIDTH/2 + 1.8) )
                   +(plane.YAxis *(Brick.REFERENCE_LENGTH + Brick.REFERENCE_WIDTH +1.8 )))
    
    brick_1_plane = rg.Plane(plane_origin, plane.XAxis, plane.YAxis)
    brick_1_plane.Rotate(math.radians(90), rg.Vector3d.ZAxis)
    planes_base.append(brick_1_plane)
    plane_rot = brick_1_plane.Clone()
    brick_rot = Brick(plane_rot)
    planes.append(brick_rot.picking_plane())
    
    return planes, planes_base


def del_nosupport_brick(plane, planes):
    
    plane_origin = plane.Origin
    planes_orgin = planes.Origin
    distance  = plane.DistanceTo(plane_origin)
    print(distance)

meshes =[]
planes = []
planes_base = []

# rotate and stack bricks 
for i in range(plan_depth):
    for j in range(height):
        # plan gap
        gap_h = Brick.REFERENCE_WIDTH+ 2.5
        # vertcal gap
        gap_v = Brick.REFERENCE_HEIGHT
        if (i + j) < height :
            brick_plane = rg.Plane(rg.Point3d(gap_h * i, gap_h* i, j*gap_v),
                                    rg.Vector3d.XAxis, 
                                    rg.Vector3d.YAxis)
            #T = rg.Transform.Rotation(math.radians(10)*i, rg.Point3d(0,0,0))
            brick_plane.Rotate(math.radians(angle)*j, rg.Vector3d.ZAxis, rg.Point3d(0,0,0))
            planes.extend(herring_Brick(brick_plane)[0])
            # print(herring_Brick(brick_plane)[0][0])
            planes_base.extend(herring_Brick(brick_plane)[1])
        
for plane in planes_base:
    b = Brick(plane)
    meshes.append(b.mesh())
# ---------- end python_12 ----------

# ----
pln_6 = Plane(python_12.planes)  # disabled
pln_7 = Plane(python_12.planes_base)  # disabled
geo_6 = Geometry(python_12.meshes)  # disabled
points_5 = PointList(Points=flatten(pln_6), Size=number_slider_29)  # disabled
move_2 = Move(Geometry=pln_6, Motion=X)  # -> Geometry, Transform; disabled
move_3 = Move(Geometry=move_2.Geometry, Motion=Y)  # -> Geometry, Transform; disabled
pdecon = Deconstruct(Point=move_3.Geometry)  # -> XComponent, YComponent, ZComponent; disabled
sort = SortList(Keys=pdecon.ZComponent, ValuesA=move_3.Geometry)  # -> Keys, ValuesA; disabled
partition = PartitionList(List=sort.ValuesA, Size=multiplication_2)  # disabled
pdecon_2 = Deconstruct(Point=partition)  # -> XComponent, YComponent, ZComponent; disabled
sort_2 = SortList(Keys=pdecon_2.YComponent, ValuesA=partition)  # -> Keys, flatten(ValuesA); disabled
geo_7 = Geometry(sort_2.ValuesA)  # disabled
points_6 = PointList(Points=flatten(sort_2.ValuesA), Size=number_slider_32)  # disabled
order = PointOrder(Points=flatten(sort_2.ValuesA))  # disabled
fabrication_2 = GhPythonScript(way_plane=geo_7, send=button_2)  # -> out, pick_up_brick_planes, rhino_base_way_planes, robot_planes, script; inputs way_plane: list; disabled
# ---------- fabrication_2: Python ----------
from compas_rhino import unload_modules
unload_modules('model')
from model import Brick

import Rhino.Geometry as rg
import simple_comm as c
import simple_ur_script as ur
import math as m


rhino_base_way_planes = way_plane

def tcp(script):
    """ This funktion sets tcp 
    """
    script += ur.set_tcp_by_angles(
        0.0, 0.0, 69.8, m.radians(0.0), m.radians(180.0), m.radians(0))
    return script


### set robot orint plane
def set_robot_base_plane_from_pts():

    pt_0 = rg.Point3d(299, 63, 0)  # base plane origin
    # point on base plane positive x direction
    pt_1 = rg.Point3d(499, 63, 0)
    pt_2 = rg.Point3d(499, 299, 0)  # point on base plane positive xy

    robot_base = rg.Plane(pt_0, pt_1-pt_0, pt_2-pt_0)
    return robot_base


def rhino_to_robot_space(rhino_plane):
    """ this funktion translates planes from the rhino cordinate system to
    the robot cordinate system 
    """
    robot_plane = rhino_plane.Clone()
    _r_matrix = rg.Transform.PlaneToPlane(rhino_plane, set_robot_base_plane_from_pts())
    
    return robot_plane




def pickup_brick(pick_up_plane, script):
    """Pick up a brick procedure

    Parameters
    ----------
    pick_up_plane : rhino.geometry.plane
    
    Returns:
    Procedure for pickin up plane
    """
    accel = 0.1    # m/s2
    vel = 0.1      # m/s

    safe_distance = 50
    
    way_planes = []

    safe_plane = pick_up_plane.Clone()
    safe_plane.Translate(rg.Vector3d(0, 0, safe_distance))

    script += ur.move_l(safe_plane, accel, vel)
    way_planes.append(safe_plane)

    script += ur.move_l(pick_up_plane, accel, vel)
    way_planes.append(pick_up_plane)

    script += ur.set_digital_out(0, True)
    script += ur.sleep(1)

    script += ur.move_l(safe_plane, accel, vel)
    way_planes.append(safe_plane)

    return script 

def place_brick(plane, script):
    """
    this function gereates the robotic sequience for placing a brick
    Requires a plane wich describes the possition of the brick"""

    safe_distance = 50
    accel = 0.1
    vel = 0.1
    way_planes = []

    safe_plane = plane.Clone()
    safe_plane.Translate(rg.Vector3d(0, 0, safe_distance))

    script += ur.move_l(safe_plane, accel, vel)
    way_planes.append(safe_plane)

    script += ur.move_l(plane, accel, vel)
    way_planes.append(plane)

    script += ur.set_digital_out(0, False)
    script += ur.sleep(1)

    script += ur.move_l(safe_plane, accel, vel)
    way_planes.append(safe_plane)

    return script

""" Robotic fabrication procedure
"""
script = ""
script = tcp(script)

"""pick _up plane is measured in the robot base plane
"""
pick_up_planes =[]
for i in range(6):  # rows x-direction
    for j in range(10):  # rows y-direction
        x_pos = i * (Brick.REFERENCE_LENGTH)
        y_pos = j * (Brick.REFERENCE_WIDTH)
        origin = rg.Point3d(-60+x_pos, 504.5-y_pos, 4.0)
        pick_up_plane = rg.Plane(origin, rg.Vector3d.XAxis, rg.Vector3d.YAxis)
        pick_up_planes.append(pick_up_plane)
pick_up_planes.reverse()

robot_planes = []

"""We are translating all way_planes from rhino base to robot_base
"""
for rhino_plane in (rhino_base_way_planes):
    robot_planes.append(rhino_to_robot_space(rhino_plane))

for robot_plane, pick_up_plane in zip(robot_planes, pick_up_planes):
    #pick up a plane 
    script = pickup_brick(pick_up_plane, script)
    script = place_brick(robot_plane, script)

script = c.concatenate_script(script)


if send == True :
    c.send_script(script, "192.168.10.10")
# ---------- end fabrication_2 ----------
geo_8 = Geometry(fabrication_2.rhino_base_way_planes)  # disabled
geo_9 = Geometry(fabrication_2.robot_planes)  # disabled
geo_10 = Geometry(fabrication_2.pick_up_brick_planes)  # disabled

# ---- group: Reference surface
# Create Surface and Curve
# Roate decrease number of brick by each layer
# Three Brick
pdecon_3 = Deconstruct(Point=rotate_center)  # -> XComponent, YComponent, ZComponent
merge = Merge(Data1=pdecon_3.ZComponent, Data2=Slider(101.563, range=0..1000), Data3=Slider(239.375, range=0..1000))
pt_5 = ConstructPoint(XCoordinate=pdecon_3.XComponent, YCoordinate=pdecon_3.YComponent, ZCoordinate=merge)
item_2 = ListItem(List=pt_5, Index=0, Wrap=True)  # -> Item, Item1, Item2

ellipse = Ellipse(Plane=item_2.Item, Radius1=Slider(150, range=0..200), Radius2=Slider(150, range=0..200))  # -> Ellipse, Focus1, Focus2

ellipse_2 = Ellipse(Plane=item_2.Item1, Radius1=Slider(80, range=0..100), Radius2=Slider(80, range=0..100))  # -> Ellipse, Focus1, Focus2

ellipse_3 = Ellipse(Plane=item_2.Item2, Radius1=Slider(100, range=0..100), Radius2=Slider(100, range=0..100))  # -> Ellipse, Focus1, Focus2

loft = Loft(
    Curves=[ellipse.Ellipse, ellipse_2.Ellipse, ellipse_3.Ellipse],
    Options={Adjust=False, Closed=False, LoftEnds=0, LoftSimp=0, LoftType=0, Rebuild=10, Refit=0.01})
cap = CapHoles(Brep=loft)

# ----
preview_4 = CustomPreview(Geometry=cap, Material=swatch)  # disabled
base_surface = Brep(cap)

# ---- group: HerringBrcik
python_13 = GhPythonScript(
    plan_depth=number_slider_4,
    height=Slider(25, range=0..100),
    angle_vetical=rotate_angle_2,
    center_point=rotate_center,
    subtractSrf=base_surface)  # -> out, planes, planes_base, subtract_planes, subtract_planes_base, meshes; inputs plan_depth: Int32, height: Int32, center_point: Point3d
# ---------- python_13: Python ----------
from compas_rhino import unload_modules
unload_modules('model')

from model import Brick
import Rhino.Geometry as rg
import math

from compas_rhino import unload_modules
unload_modules('model')

import Rhino.Geometry as rg
from model import Brick
import math



### this funtion is plane for herring bone
def herring_bone(plan_depth ,x_postion ,y_postion, z_postion, angle):
    """
    x_postion is brick X coordinate
    y_postion is brick Y coordinate
    z_postion is brick z coordinate
    angle is brick place direction
    """
    planes = [] # Top plane for robot picking up
    planes_base = [] # base plane for create visual brick
    # horizontal gap
    gap_hori = Brick.REFERENCE_WIDTH +2.5
    for i in range(plan_depth):
        x_value = gap_hori * i + x_postion
        y_value = gap_hori * i + y_postion
        z_value = z_postion
        
        # create brick plane
        plane_origin = rg.Point3d(x_value, y_value, z_value)
        brick_plane = rg.Plane(plane_origin, rg.Vector3d.XAxis, rg.Vector3d.YAxis)
        brick_plane.Rotate(math.radians(angle), rg.Vector3d.ZAxis)
        planes_base.append(brick_plane)
        plane_rot = brick_plane.Clone()
        brick_rot = Brick(plane_rot)
        planes.append(brick_rot.picking_plane())
    return planes, planes_base

# rotate plane 
def rotateBycentre(planes, angle, center_point):
    center_point = c_p # rotate centre
    plane_rot =[] 
    for p in planes:
        T = rg.Transform.Rotation(angle, c_p)
        p.Transform(T)
        plane_rot.append(p)
    return plane_rot

#find plane inside surface
def subtractionBysurface(planes, surface, tolerance):
    inside_planes = []
    for p in planes:
        # distance_closest_pts 
        in_or_out = surface.IsPointInside(p.Origin, tolerance, False)
        if in_or_out == True:
            new_plane = rg.Plane(p.Origin, p.XAxis, p.YAxis)
            inside_planes.append(new_plane)
    return inside_planes




#####          #####
##### RUN CODE #####
#####          #####

# define the x_postion and y_postion for bricks
## modify brick gap here
b_leng = Brick.REFERENCE_LENGTH
b_wid = Brick.REFERENCE_WIDTH

x_p_R1, y_p_R1 = b_leng +0.8, b_wid/2
x_p_R2, y_p_R2 = b_wid/2, b_leng/2
x_p_L1, y_p_L1 = -.5, b_leng + b_wid/2 +1.3
x_p_L2, y_p_L2 = -1*(b_leng/2 + b_wid/2 + 1.8), b_leng + b_wid +1.8

##########
meshes =[]
planes = []
planes_base = []

# stacking
for i in range(height):
    b_h = Brick.REFERENCE_HEIGHT 
    c_p = center_point # rotate centre
    angle = math.radians(angle_vetical)
    
    # create plane
    planes_r1, planes_base_r1 = herring_bone(plan_depth, x_p_R1, y_p_R1, b_h *i, 90)
    planes_r2, planes_base_r2 = herring_bone(plan_depth, x_p_R2, y_p_R2, b_h *i, 0)
    planes_r3, planes_base_r3 = herring_bone(plan_depth, x_p_L1, y_p_L1, b_h *i, 90)
    
    # rotate plane
    rotateBycentre(planes_r1, angle*i, c_p)
    rotateBycentre(planes_r2, angle*i, c_p)
    rotateBycentre(planes_r3, angle*i, c_p)
    
    rotateBycentre(planes_base_r1, angle*i, c_p)
    rotateBycentre(planes_base_r2, angle*i, c_p)
    rotateBycentre(planes_base_r3, angle*i, c_p)
    
    # create pattern by remove last brick 
    planes.append(planes_r1
                + planes_r2 
                + planes_r3)
                
    planes_base.append(planes_base_r1
                    + planes_base_r2
                    + planes_base_r3)

# subratct by surface
subtract_planes = []
subtract_planes_base = []
for p in planes:
    subtract_planes.extend(subtractionBysurface(p, subtractSrf, 0.1))
for p in planes_base:
    subtract_planes_base.extend(subtractionBysurface(p, subtractSrf, 0.1))


#create brick mesh
meshes =[]
for plane in subtract_planes_base:
    b = Brick(plane)
    meshes.append(b.mesh())

# all meshes
#meshes =[]
#for plane in planes_base:
#    for p in plane:
#        b = Brick(p)
#        meshes.append(b.mesh())
# ---------- end python_13 ----------

# ----
unpack_13 = GhPythonScript(Tree=python_13.planes)  # -> simplify(Upackdata); same code as unpack_2
unpack_14 = GhPythonScript(Tree=python_13.planes_base)  # -> simplify(Upackdata); same code as unpack_2

# ----
# Roate decrease number of brick by each layer
rotate_angle_8 = Slider(6, range=0..30)  # disabled

# ---- group: HerringBrcik
python_14 = GhPythonScript(plan_depth=number_slider_20, height=number_slider_21, angle_vetical=rotate_angle_8)  # -> out, planes, planes_base, meshes; inputs plan_depth: Int32, height: Int32; disabled
# ---------- python_14: Python ----------
from compas_rhino import unload_modules
unload_modules('model')

from model import Brick
import Rhino.Geometry as rg
import math

from compas_rhino import unload_modules
unload_modules('model')

import Rhino.Geometry as rg
from model import Brick
import math



### this funtion is plane for herring bone
def herring_bone(plan_depth ,x_postion ,y_postion, z_postion, angle):
    """
    x_postion is brick X coordinate
    y_postion is brick Y coordinate
    z_postion is brick z coordinate
    angle is brick place direction
    """
    planes = [] # Top plane for robot picking up
    planes_base = [] # base plane for create visual brick
    # horizontal gap
    gap_hori = Brick.REFERENCE_WIDTH +2.5
    for i in range(plan_depth):
        x_value = gap_hori * i + x_postion
        y_value = gap_hori * i + y_postion
        z_value = z_postion
        
        # create brick plane
        plane_origin = rg.Point3d(x_value, y_value, z_value)
        brick_plane = rg.Plane(plane_origin, rg.Vector3d.XAxis, rg.Vector3d.YAxis)
        brick_plane.Rotate(math.radians(angle), rg.Vector3d.ZAxis)
        planes_base.append(brick_plane)
        plane_rot = brick_plane.Clone()
        brick_rot = Brick(plane_rot)
        planes.append(brick_rot.picking_plane())
    return planes, planes_base


def rotateBycentre(planes, angle, center_point):
    center_point = c_p # rotate centre
    plane_rot =[] 
    for p in planes:
        T = rg.Transform.Rotation(angle, c_p)
        p.Transform(T)
        plane_rot.append(p)
    return plane_rot




#####          #####
##### RUN CODE #####
#####          #####

# define the x_postion and y_postion for bricks
## modify brick gap here
b_leng = Brick.REFERENCE_LENGTH
b_wid = Brick.REFERENCE_WIDTH

x_p_R1, y_p_R1 = b_leng +0.8, b_wid/2
x_p_R2, y_p_R2 = b_wid/2, b_leng/2
x_p_L1, y_p_L1 = -.5, b_leng + b_wid/2 +1.3
x_p_L2, y_p_L2 = -1*(b_leng/2 + b_wid/2 + 1.8), b_leng + b_wid +1.8

##########
meshes =[]
planes = []
planes_base = []

# stacking
for i in range(height):
    b_h = Brick.REFERENCE_HEIGHT 
    c_p = rg.Point3d(0,0,0) # rotate centre
    angle = math.radians(angle_vetical)
    
    # create plane
    planes_r1, planes_base_r1 = herring_bone(plan_depth, x_p_R1, y_p_R1, b_h *i, 90)
    planes_r2, planes_base_r2 = herring_bone(plan_depth, x_p_R2, y_p_R2, b_h *i, 0)
    planes_r3, planes_base_r3 = herring_bone(plan_depth, x_p_L1, y_p_L1, b_h *i, 90)
    planes_r4, planes_base_r4 = herring_bone(plan_depth, x_p_L2, y_p_L2, b_h *i, 0)
    
    # rotate plane
    rotateBycentre(planes_r1, angle*i, c_p)
    rotateBycentre(planes_r2, angle*i, c_p)
    rotateBycentre(planes_r3, angle*i, c_p)
    rotateBycentre(planes_r4, angle*i, c_p)
    # planes.append(planes_r1+ planes_r2 + planes_r3 + planes_r4)  
    
    rotateBycentre(planes_base_r1, angle*i, c_p)
    rotateBycentre(planes_base_r2, angle*i, c_p)
    rotateBycentre(planes_base_r3, angle*i, c_p)
    rotateBycentre(planes_base_r4, angle*i, c_p)
    # planes_base.append(planes_base_r1 + planes_base_r2 + planes_base_r3 + planes_base_r4)
    
    
    # create pattern by remove last brick 
    planes.append(planes_r1[:-i+height]
                + planes_r2[:-i+height] 
                + planes_r3[:-i+height]
                + planes_r4[:-i+height])
    planes_base.append(planes_base_r1[:-i+height] 
                    + planes_base_r2[:-i+height] 
                    + planes_base_r3[:-i+height]
                    + planes_base_r4[:-i+height])


#create brick mesh
meshes =[]
for plane in planes_base:
    for p in plane:
        b = Brick(p)
        meshes.append(b.mesh())
# ---------- end python_14 ----------

# ----
unpack_15 = GhPythonScript(Tree=python_14.planes)  # -> out, simplify(Upackdata); disabled; same code as unpack_2
unpack_16 = GhPythonScript(Tree=python_14.planes_base)  # -> out, simplify(Upackdata); disabled; same code as unpack_2

# ---- group: sperate the number of planes to fabrication
number_slider_33 = Slider(10, range=0..10)  # disabled
number_slider_34 = Slider(6, range=0..10)  # disabled
multiplication_3 = Multiplication(A=number_slider_34, B=number_slider_33)  # disabled
lng_2 = ListLength(List=planetorobot)  # disabled
panel_8 = Panel("1")  # disabled
panel_9 = Panel("0")  # disabled

# ---- group: sperate the number of planes to fabrication / mod_and_divid
python_15 = GhPythonScript(x=lng_2, y=multiplication_3)  # -> out, a; disabled
# ---------- python_15: Python ----------
while (x>y):
    x=x-y
    print(y)
else:
    a =x
# ---------- end python_15 ----------

# ---- group: sperate the number of planes to fabrication (continued)
merge_2 = Merge(Data1=flatten(python_15.out), Data2=flatten(python_15.a))  # disabled
ma = MassAddition(Input=merge_2)  # -> Result, PartialResults; disabled
shift_2 = ShiftList(List=ma.PartialResults, Shift=-1, Wrap=invert(True))  # disabled
addition = Addition(A=shift_2, B=panel_8)  # disabled
merge_3 = Merge(Data1=panel_9, Data2=addition)  # -> flatten(Result); disabled
series_4 = Series(Start=merge_3, Step=1, Count=merge_2)  # disabled
tstat_2 = TreeStatistics(Tree=series_4)  # -> Paths, Length, Count; disabled
panel_10 = Panel(tstat_2.Count)  # disabled

# ---- group: sperate the number of planes to fabrication / check not out of path
python_16 = GhPythonScript(x=knob, y=tstat_2.Count)  # -> out, a; disabled
# ---------- python_16: Python ----------
if x <= y-1:
    print(int(x))
else:
    print(int(y-1))
# ---------- end python_16 ----------

# ---- group: sperate the number of planes to fabrication (continued)
branch = TreeBranch(Tree=simplify(series_4), Path=python_16.out, MaintainPaths=True)  # disabled
item_3 = ListItem(List=planetorobot, Index=branch, Wrap=True)  # disabled

# ==== cluster PlaneAxis: show plane X Y Z axis.
P = ClusterInput()
B = ClusterInput()
deplane = DeconstructPlane(Plane=graft(P))  # -> Origin, XAxis, YAxis, ZAxis
multiplication = Multiplication(A=[deplane.XAxis, deplane.YAxis, deplane.ZAxis], B=B)
vdisex = VectorDisplayEx(
    Point=deplane.Origin,
    Vector=multiplication,
    Colour=[ColourSwatch(SwatchColor=RGB(235, 52, 52)), ColourSwatch(SwatchColor=RGB(90, 207, 48)), ColourSwatch(SwatchColor=RGB(54, 126, 227))],
    Width=2)
