# Grasshopper definition Herring_brick_fabrication_comb_plan.gh (Grasshopper 1.0.7)

final_herringbone_planes = Plane(Tree({0}: [Plane(origin=(25.8, 6, 8), x=(0, 1, 0), y=(-1, 0, 0)), Plane(origin=(41.3, 21.5, 8), x=(0, 1, 0), y=(-1, 0, 0)), Plane(origin=(56.8, 37, 8), x=(0, 1, 0), y=(-1, 0, 0)), Plane(origin=(72.3, 52.5, 8), x=(0, 1, 0), y=(-1, 0, 0)), Plane(origin=(87.8, 68, 8), x=(0, 1, 0), y=(-1, 0, 0)), PlaneXY(6, 12.5, 8)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], {1}: [Plane(origin=(25.03092486, 8.667121319, 16), x=(0.9945218954, 0.1045284633, 0), y=(-0.1045284633, 0.9945218954, 0)), Plane(origin=(38.82582306, 25.70240188, 16), x=(0.9945218954, 0.1045284633, 0), y=(-0.1045284633, 0.9945218954, 0)), Plane(origin=(52.62072125, 42.73768244, 16), x=(0.9945218954, 0.1045284633, 0), y=(-0.1045284633, 0.9945218954, 0)), Plane(origin=(66.41561945, 59.772963, 16), x=(0.9945218954, 0.1045284633, 0), y=(-0.1045284633, 0.9945218954, 0)), Plane(origin=(4.65995632, 13.06185007, 16), x=(-0.1045284633, 0.9945218954, 0), y=(-0.9945218954, -0.1045284633, 0)), Plane(origin=(80.21051765, 76.80824355, 16), x=(0.9945218954, 0.1045284633, 0), y=(-0.1045284633, 0.9945218954, 0))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], {2}: [Plane(origin=(26.85456943, 5.12415152, 24), x=(0.02090075226, -0.9997815554, 0), y=(-0.9997815554, -0.02090075226, 0)), Plane(origin=(3.268524216, 13.48054955, 24), x=(0.9781476007, 0.2079116908, 0), y=(-0.2079116908, 0.9781476007, 0)), Plane(origin=(71.74189912, 84.7749177, 24), x=(-0.2079116908, 0.9781476007, 0), y=(-0.9781476007, -0.2079116908, 0)), Plane(origin=(15.20718082, 31.86446857, 24), x=(0.9781476007, 0.2079116908, 0), y=(-0.2079116908, 0.9781476007, 0)), Plane(origin=(27.14583742, 50.24838759, 24), x=(0.9781476007, 0.2079116908, 0), y=(-0.2079116908, 0.9781476007, 0)), Plane(origin=(39.08449403, 68.63230661, 24), x=(0.9781476007, 0.2079116908, 0), y=(-0.2079116908, 0.9781476007, 0))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], {3}: [Plane(origin=(22.68047799, 13.68818023, 32), x=(0.9510565163, 0.3090169944, 0), y=(-0.3090169944, 0.9510565163, 0)), Plane(origin=(32.63209058, 33.21931965, 32), x=(0.9510565163, 0.3090169944, 0), y=(-0.3090169944, 0.9510565163, 0)), Plane(origin=(1.840948508, 13.7515111, 32), x=(-0.3090169944, 0.9510565163, 0), y=(-0.9510565163, -0.3090169944, 0)), Plane(origin=(42.58370317, 52.75045906, 32), x=(0.9510565163, 0.3090169944, 0), y=(-0.3090169944, 0.9510565163, 0)), Plane(origin=(52.53531576, 72.28159848, 32), x=(0.9510565163, 0.3090169944, 0), y=(-0.3090169944, 0.9510565163, 0)), Plane(origin=(62.48692835, 91.81273789, 32), x=(0.9510565163, 0.3090169944, 0), y=(-0.3090169944, 0.9510565163, 0))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], {4}: [Plane(origin=(26.85456943, 5.12415152, 40), x=(0.02090075226, -0.9997815554, 0), y=(-0.9997815554, -0.02090075226, 0)), Plane(origin=(0.3928700156, 13.87176599, 40), x=(0.9135454576, 0.4067366431, 0), y=(-0.4067366431, 0.9135454576, 0)), Plane(origin=(8.248406641, 34.33613855, 40), x=(0.9135454576, 0.4067366431, 0), y=(-0.4067366431, 0.9135454576, 0)), Plane(origin=(52.54700476, 97.8445963, 40), x=(-0.4067366431, 0.9135454576, 0), y=(-0.9135454576, -0.4067366431, 0)), Plane(origin=(16.10394327, 54.80051112, 40), x=(0.9135454576, 0.4067366431, 0), y=(-0.4067366431, 0.9135454576, 0)), Plane(origin=(23.95947989, 75.26488368, 40), x=(0.9135454576, 0.4067366431, 0), y=(-0.4067366431, 0.9135454576, 0))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], {5}: [Plane(origin=(19.33745718, 18.11083158, 48), x=(0.8660254038, 0.5, 0), y=(-0.5, 0.8660254038, 0)), Plane(origin=(25.01085094, 39.28422534, 48), x=(0.8660254038, 0.5, 0), y=(-0.5, 0.8660254038, 0)), Plane(origin=(-1.059845811, 13.8399967, 48), x=(-0.5, 0.8660254038, 0), y=(-0.8660254038, -0.5, 0)), Plane(origin=(30.6842447, 60.45761909, 48), x=(0.8660254038, 0.5, 0), y=(-0.5, 0.8660254038, 0)), Plane(origin=(36.35763846, 81.63101285, 48), x=(0.8660254038, 0.5, 0), y=(-0.5, 0.8660254038, 0)), Plane(origin=(4.613547948, 35.01339046, 48), x=(-0.5, 0.8660254038, 0), y=(-0.8660254038, -0.5, 0))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]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))
final_herringbone_planes_forrobot = Plane(flatten(final_herringbone_planes))
branch = TreeBranch(Tree=final_herringbone_planes, Path=Slider(0, range=0..19), MaintainPaths=True)
points = PointList(Points=branch, Size=Slider(10, range=0..10))
