# Grasshopper definition Mini_Brick_110720_update.gh (Grasshopper 1.0.7)

# ---- group: Brick_without offset
crv = Curve(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)
python = GhPythonScript(curves=crv)  # -> out, pts, plane, meshes, planes; inputs curves: list of Curve
# ---------- python: Python ----------
from compas_rhino import unload_modules
unload_modules('model_Explore')

from model_Explore import Brick
from model_Explore import Fabrication
import random as r
import Rhino.Geometry as rg
import rhinoscriptsyntax as rs
import math as m
import simple_comm as c
import simple_ur_script as ur

def brick_possitions_split(planes):
    """Genrates a Rhino Geometry plane for each brick

    Returns
    ----------
    brick_planes : [Rhino Geometry Plane, Rhino Geometry Plane, ...]

    """
    
    brick_planes = []
  
    pts = []
    y_positive = 0
    y_negative = 0
    
    for i  in range (2):  # layer heigh
        for j, plane in enumerate(planes):  # layer length
            if i % 2 == 0:
                x_pos = plane.OriginX
                y_pos = plane.OriginY# why no rg
                z_value = Brick.REFERENCE_HEIGHT * i + i*1
                if j < 4 or j >=14:
                    pts.append(rg.Point3d(x_pos, y_pos, z_value))

                    # create planes here aswell
#---------------------------------------------------------------------------
                if 4 <= j < 9:
                    for k in range(2):
                        if k == 0:
                            y_positive += 9
                            y_offset_vector = plane.XAxis  #rg.Plane.YAxis 
                            
                            pt2 = rg.Point3d(x_pos, y_pos, z_value) + y_offset_vector*y_positive
                            pts.append(pt2)
                            
                            # create the plane 
                            
                            # when you split, use the y axis of the plane to copy and offset the new plane
                        else:
                            y_negative -= 9
                            y_offset_vector = plane.XAxis
                            
                            pt2 = rg.Point3d(x_pos, y_pos, z_value) + y_offset_vector*y_negative
                            pts.append(pt2)
                elif 9 <= j < 14:
                    for k in range(2):
                        if k == 0:
                            y_positive -= 9
                            y_offset_vector = plane.XAxis
                            
                            pt2 = rg.Point3d(x_pos, y_pos, z_value) + y_offset_vector*y_positive
                            pts.append(pt2)
                        else:
                            y_negative += 9
                            y_offset_vector = plane.XAxis
                            pt2 = rg.Point3d(x_pos, y_pos, z_value) + y_offset_vector*y_negative
                            pts.append(pt2)
#---------------------------------------------------------------------------
            else:
                x_pos = plane.OriginX 
                y_pos = plane.OriginY
                z_value = Brick.REFERENCE_HEIGHT * i + i*1
                if j < 4 or j >=14:
                    #pts.append(plane.Origin)
                    pts.append(rg.Point3d(x_pos, y_pos, z_value))
                if 4 <= j < 9:
                    for k in range(2):
                        if k == 0:
                            y_positive += 9
                            y_offset_vector = plane.XAxis
                            pt2 = rg.Point3d(x_pos, y_pos, z_value) + y_offset_vector*y_positive
                            pts.append(pt2)
                        else:
                            y_negative -= 9
                            y_offset_vector = plane.XAxis
                            pt2 = rg.Point3d(x_pos, y_pos, z_value) + y_offset_vector*y_negative
                            pts.append(pt2)
                elif 9 <= j < 14:
                    for k in range(2):
                        if k == 0:
                            y_positive -= 9
                            y_offset_vector = plane.XAxis
                            pt2 = rg.Point3d(x_pos, y_pos, z_value) + y_offset_vector*y_positive
                            pts.append(pt2)
                        else:
                            y_negative += 9
                            y_offset_vector = plane.XAxis
                            pt2 = rg.Point3d(x_pos, y_pos, z_value) + y_offset_vector*y_negative
                            pts.append(pt2)

    return pts

def curve_to_planes():
    brick_planes = []
    for curve in curves:
        params = rg.Curve.DivideByLength(curve,Brick.REFERENCE_LENGTH,False)
        for param in params:
            brick_pos = rg.Curve.PointAt(curve,param)
            brick_tan = rg.Curve.TangentAt(curve,param)
            
            vec1= rg.Vector3d.CrossProduct(brick_tan,rg. Vector3d.ZAxis)
            vec2= rg.Vector3d.CrossProduct(vec1,rg.Vector3d.ZAxis)
            plane = rg.Plane(brick_pos,vec1,vec2)
            brick_planes.append(plane)

    return brick_planes
planes=curve_to_planes()

pts = brick_possitions_split(planes)
# ---------- end python ----------
pln = Plane(python.planes)
mesh = Mesh(python.meshes)
pln_2 = Plane(python.plane)
pt = Point(python.pts)
item = ListItem(List=pt, Index=Slider(10, range=0..100), Wrap=True)

# ---- group: Curve_to_Plane_offset
python_2 = GhPythonScript(curves=crv)  # -> out, planes_odd, pts; inputs curves: list of Curve
# ---------- python_2: Python ----------
from compas_rhino import unload_modules
unload_modules('model')

import Rhino.Geometry as rg
import rhinoscriptsyntax as rs
from model import Brick


#def curve_to_planes():
#    brick_planes = []
#    
#    for curve in curves:
#        params = rg.Curve.DivideByLength(curve, Brick.REFERENCE_LENGTH, False)
#        print (params)
#        for param in params:
#            brick_pos = rg.Curve.PointAt(curve, param)
#            brick_tan = rg.Curve.TangentAt(curve, param)
#            vec1 = rg.Vector3d.CrossProduct(brick_tan, rg.Vector3d.ZAxis)
#            vec2 = rg.Vector3d.CrossProduct(vec1, rg.Vector3d.ZAxis)
#            
#            plane = rg.Plane(brick_pos, vec1, vec2)
#            brick_planes.append(plane)
#    return brick_planes
#    
#planes = curve_to_planes()

def curve_to_planes_eo():
    brick_planes_even =[]
    brick_planes_odd =[]
    brick_planes = []
    brick_planes_o = []
    for curve in curves:
        params = rg.Curve.DivideByLength(curve,Brick.REFERENCE_LENGTH/2,False)
        for param in params:
            brick_pos = rg.Curve.PointAt(curve,param)
            brick_tan = rg.Curve.TangentAt(curve,param)
            
            vec1= rg.Vector3d.CrossProduct(brick_tan,rg. Vector3d.ZAxis)
            vec2= rg.Vector3d.CrossProduct(vec1,rg.Vector3d.ZAxis)
            plane = rg.Plane(brick_pos,-vec2,-vec1)
            brick_planes.append(plane)
            
    for i, plane in enumerate(brick_planes):
        if i % 2 == 0:
            brick_planes_even.append(plane)
        else:
            brick_planes_odd.append(plane)
            
    brick_planes_o.append(brick_planes_even)
    brick_planes_o.append(brick_planes_odd)
    #return brick_planes_even, brick_planes_odd
    return brick_planes_o

planes=curve_to_planes_eo()
planes_odd = planes[1]
# ---------- end python_2 ----------
pln_3 = Plane(python_2.planes_odd)
preview = CustomPreview(Geometry=pln_3, Material=ColourSwatch(SwatchColor=RGB(255, 167, 184)))

# ---- group: Brick_offset
number_slider = Slider(8, range=0..30)  # disabled
number_slider_2 = Slider(24, range=0..60)  # disabled
addition = Addition(A=number_slider, B=number_slider_2)  # disabled
panel = Panel("2")  # disabled
crv_2 = Curve(<curve referenced from the Rhino model>)  # disabled
division = Division(A=addition, B=panel)  # disabled
python_3 = GhPythonScript(curves=crv_2, split_start=number_slider, split_end=number_slider_2, split_mid=division)  # -> out, pts, planes, picking_planes, meshes, curve_planes; inputs curves: list of Curve, split_start: Int32, split_end: Int32, split_mid: Int32; disabled
# ---------- python_3: Python ----------
from compas_rhino import unload_modules
unload_modules('model_Explore')

from model_Explore import Brick
from model_Explore import Fabrication
import random as r
import Rhino.Geometry as rg
import rhinoscriptsyntax as rs
import math as m
import simple_comm as c
import simple_ur_script as ur

def brick_possitions_split(curve_planes):
    """Genrates a Rhino Geometry plane for each brick

    Returns
    ----------
    brick_planes : [Rhino Geometry Plane, Rhino Geometry Plane, ...]

    """
    pts = []
    planes = []
    y_positive = 0
    y_negative = 0
    
    for i  in range (9):  # layer heigh
        if i % 2 == 0:
            for j, plane in enumerate(curve_planes[0]):  # layer length
                x_pos = plane.OriginX
                y_pos = plane.OriginY# why no rg
                z_value = Brick.REFERENCE_HEIGHT * i + i*1
                if j < split_start or j >= split_end:
                    pts.append(rg.Point3d(x_pos, y_pos, z_value))
                    planes.append(rg.Plane(rg.Point3d(x_pos, y_pos, z_value), plane.XAxis, plane.YAxis))#P
                    # create planes here aswell
#---------------------------------------------------------------------------
                if split_start <= j < split_mid:
                    for k in range(2):
                        if k == 0:
                            y_positive += 9
                            y_offset_vector = plane.YAxis  #rg.Plane.YAxis 
                            
                            pt2 = rg.Point3d(x_pos, y_pos, z_value) + y_offset_vector*y_positive
                            pts.append(pt2)
                            planes.append(rg.Plane(pt2, plane.XAxis, plane.YAxis))
                            # create the plane 
                            
                            # when you split, use the y axis of the plane to copy and offset the new plane
                        else:
                            y_negative -= 9
                            y_offset_vector = plane.YAxis
                            
                            pt2 = rg.Point3d(x_pos, y_pos, z_value) + y_offset_vector*y_negative
                            pts.append(pt2)
                            planes.append(rg.Plane(pt2, plane.XAxis, plane.YAxis))
                elif split_mid <= j < split_end:
                    for k in range(2):
                        if k == 0:
                            y_positive -= 9
                            y_offset_vector = plane.YAxis
                            
                            pt2 = rg.Point3d(x_pos, y_pos, z_value) + y_offset_vector*y_positive
                            pts.append(pt2)
                            planes.append(rg.Plane(pt2, plane.XAxis, plane.YAxis))
                        else:
                            y_negative += 9
                            y_offset_vector = plane.YAxis
                            pt2 = rg.Point3d(x_pos, y_pos, z_value) + y_offset_vector*y_negative
                            pts.append(pt2)
                            planes.append(rg.Plane(pt2, plane.XAxis, plane.YAxis))
#---------------------------------------------------------------------------
        else:
            for j, plane in enumerate(curve_planes[1]):
                x_pos = plane.OriginX 
                y_pos = plane.OriginY
                z_value = Brick.REFERENCE_HEIGHT * i + i*1
                if j < split_start or j >= split_end:
                    pts.append(rg.Point3d(x_pos, y_pos, z_value))
                    planes.append(rg.Plane(rg.Point3d(x_pos, y_pos, z_value), plane.XAxis, plane.YAxis))
                    
                if split_start <= j < split_mid:
                    for k in range(2):
                        if k == 0:
                            y_positive += 9
                            y_offset_vector = plane.YAxis
                            pt2 = rg.Point3d(x_pos, y_pos, z_value) + y_offset_vector*y_positive
                            pts.append(pt2)
                            planes.append(rg.Plane(pt2, plane.XAxis, plane.YAxis))
                        else:
                            y_negative -= 9
                            y_offset_vector = plane.YAxis
                            pt2 = rg.Point3d(x_pos, y_pos, z_value) + y_offset_vector*y_negative
                            pts.append(pt2)
                            planes.append(rg.Plane(pt2, plane.XAxis, plane.YAxis))
                elif split_mid <= j < split_end:
                    for k in range(2):
                        if k == 0:
                            y_positive -= 9
                            y_offset_vector = plane.YAxis
                            pt2 = rg.Point3d(x_pos, y_pos, z_value) + y_offset_vector*y_positive
                            pts.append(pt2)
                            planes.append(rg.Plane(pt2, plane.XAxis, plane.YAxis))
                        else:
                            y_negative += 9
                            y_offset_vector = plane.YAxis
                            pt2 = rg.Point3d(x_pos, y_pos, z_value) + y_offset_vector*y_negative
                            pts.append(pt2)
                            planes.append(rg.Plane(pt2, plane.XAxis, plane.YAxis))
                            

    return planes
    
def curve_to_planes_eo():
    brick_planes_even =[]
    brick_planes_odd =[]
    brick_planes = []
    brick_planes_o = []
    for curve in curves:
        params = rg.Curve.DivideByLength(curve,Brick.REFERENCE_LENGTH/2,False)
        for param in params:
            brick_pos = rg.Curve.PointAt(curve,param)
            brick_tan = rg.Curve.TangentAt(curve,param)

            vec1= rg.Vector3d.CrossProduct(brick_tan,rg. Vector3d.ZAxis)
            vec2= rg.Vector3d.CrossProduct(vec1,rg.Vector3d.ZAxis)
            plane = rg.Plane(brick_pos,vec2,vec1)
            
            brick_planes.append(plane)

    for i, plane in enumerate(brick_planes):
        if i % 2 == 0:
            brick_planes_even.append(plane)
        else:
            brick_planes_odd.append(plane)
            
    brick_planes_o.append(brick_planes_even)
    brick_planes_o.append(brick_planes_odd)
    #return brick_planes_even, brick_planes_odd
    return brick_planes_o

curve_planes=curve_to_planes_eo() #planes_even = planes[0] planes_odd = planes[1] 
planes = brick_possitions_split(curve_planes)


picking_planes = []
meshes = []
for p in planes:
    myBrick = Brick(p)
    picking_planes.append(myBrick.picking_plane())
    meshes.append(myBrick.mesh())
# ---------- end python_3 ----------
pln_4 = Plane(python_3.picking_planes)  # disabled
mesh_2 = Mesh(python_3.meshes)  # disabled
number_slider_3 = Slider(0, range=0..100)  # disabled
pt_2 = Point(python_3.pts)  # disabled
pln_5 = Plane(python_3.planes)  # disabled
swatch = ColourSwatch(SwatchColor=RGB(255, 167, 184))  # disabled
item_2 = ListItem(List=mesh_2, Index=number_slider_3, Wrap=True)  # disabled
preview_2 = CustomPreview(Geometry=item_2, Material=swatch)  # disabled

# ----
pt_3 = Point(python_2.pts)
number_slider_4 = Slider(4, range=0..30)
number_slider_5 = Slider(1, range=1..10)
number_slider_6 = Slider(7, range=0..15)
number_slider_7 = Slider(8, range=0..15)
expression = Expression(x=number_slider_4, y=Slider(6, range=0..10), Expression="6+x+y")
expression_2 = Expression(x=number_slider_4, y=expression, Expression="(x+y)/2")
number_slider_8 = Slider(10, range=0..10)
neg = Negative(Value=number_slider_7)
neg_2 = Negative(Value=number_slider_6)

# ---- group: Curve_to_Plane
crv_3 = Curve(<curve referenced from the Rhino model>)
python_4 = GhPythonScript(
    curve=crv_3,
    ss=number_slider_4,
    se=expression,
    sm=expression_2,
    t1=Slider(180, range=10..200),
    tm=Slider(-124, range=-200..100),
    t2=Slider(116, range=10..200))  # -> out, planes, nurbs_crv, pts_temp, planes_branch; inputs curve: Curve, ss: Int32, se: Int32, sm: Int32, t1: Int32, tm: Int32, t2: Int32
# ---------- python_4: Python ----------
from compas_rhino import unload_modules
unload_modules('model')
import Rhino.Collections as rc
import Rhino.Geometry as rg
import rhinoscriptsyntax as rs
from model import Brick


def curve_to_planes_eo(curve):
    brick_planes_even =[]
    brick_planes_odd =[]
    brick_planes = []
    brick_planes_o = []

    params = rg.Curve.DivideByLength(curve,Brick.REFERENCE_LENGTH/2+1,False)
    for param in params:
        brick_pos = rg.Curve.PointAt(curve,param)
        brick_tan = rg.Curve.TangentAt(curve,param)

        vec1= rg.Vector3d.CrossProduct(brick_tan,rg. Vector3d.ZAxis)
        vec2= rg.Vector3d.CrossProduct(vec1,rg.Vector3d.ZAxis)
        plane = rg.Plane(brick_pos,vec2,vec1)
        
        brick_planes.append(plane)

    for i, plane in enumerate(brick_planes):
        if i % 2 == 0:
            brick_planes_even.append(plane)
        else:
            brick_planes_odd.append(plane)
            
    brick_planes_o.append(brick_planes_even)
    brick_planes_o.append(brick_planes_odd)
    return brick_planes_o
    
planes = curve_to_planes_eo(curve) 
planes1 = planes[0]

# "s_pt"is start point,"e_pt"is end point,"m_pt"is middle point of the curve

s_pt=planes[0][ss-1].Origin
s_pt_f=planes[0][ss].Origin   
e_pt=planes[0][se-1].Origin
e_pt_b=planes[0][se-2].Origin
m_pt=planes[0][sm-1].Origin
m_pt_1=planes[0][sm+1].Origin
m_pt_2=planes[0][sm-3].Origin

offset_vector_m = planes[0][sm-1].YAxis
offset_vector_m1 = planes[0][sm+1].YAxis
offset_vector_m2 = planes[0][sm-3].YAxis

pts = [s_pt ,s_pt_f, m_pt_2+t2*offset_vector_m2 , m_pt+tm*offset_vector_m , m_pt_1+t1*offset_vector_m1 , e_pt_b, e_pt ]
l_pts = rc.Point3dList(pts)
crv = rg.BezierCurve(l_pts)
nurbs_crv = rg.BezierCurve.ToNurbsCurve(crv)


planes_branch = curve_to_planes_eo(nurbs_crv)[0]
# ---------- end python_4 ----------
pln_6 = Plane(python_4.planes)

# ----
pt_4 = Point(python_4.pts_temp)
geo = Geometry(python_4.nurbs_crv)
pln_7 = Plane(python_4.planes_branch)
python_5 = GhPythonScript()  # -> out, pts, nurbs_crv; disabled
# ---------- python_5: Python ----------
import rhinoscriptsyntax as rs
import Rhino.Geometry as rg
import Rhino.Collections as rc


pts = [rg.Point3d(0,0,0),rg.Point3d(2,2,0),rg.Point3d(5,0,0),rg.Point3d(10,5,0)]
l_pts = rc.Point3dList(pts)

crv = rg.BezierCurve(l_pts)
nurbs_crv = rg.BezierCurve.ToNurbsCurve(crv)
# ---------- end python_5 ----------
crv_4 = Curve(python_5.nurbs_crv)  # disabled
pt_5 = Point(python_5.pts)  # disabled

python_6 = GhPythonScript()  # -> out, pts
# ---------- python_6: Python ----------
from compas_rhino import unload_modules
unload_modules('model_Explore')

from model_Explore import Brick
from model_Explore import Fabrication
import random as r
import Rhino.Geometry as rg
import rhinoscriptsyntax as rs
import math as m
from math import e, sqrt, pi
import simple_comm as c
import simple_ur_script as ur

def brick_possitions_split():
    """Genrates a Rhino Geometry plane for each brick

    Returns
    ----------
    brick_planes : [Rhino Geometry Plane, Rhino Geometry Plane, ...]

    """
    brick_planes = []
  
    pts = []
    bpts = []
    y_positive = 0
    y_negtive = 0
    y_list = [1,9,1,5,1,5,1,5,1,5]

    for i in range(20):  # layer count
        x_pos = i * (Brick.REFERENCE_LENGTH+1)
        #print (x_pos)

        if 4 <= i < 14:
            #y_pos = [y_pos+9 if j==0 else y_posn-9 for j in range(2)]
            #print (y_pos)
            for j in range(2):

                if j == 0:
                    y_positive = y_list[i-4]
                    pt2 = rg.Point3d(x_pos, y_positive, 0)
                    pts.append(pt2)

                else:
                    y_negtive -= 9
                    pt2 = rg.Point3d(x_pos, y_negtive, 0)
                    pts.append(pt2)

#        elif 9 <= i < 14:
#            
#            for j in range(2):
#
#                if j == 0:
#                    y_positive -= 9
#                    pt2 = rg.Point3d(x_pos, y_positive, 0)
#                    pts.append(pt2)
#
#                else:
#                    y_negtive += 9
#                    pt2 = rg.Point3d(x_pos, y_negtive, 0)
#                    pts.append(pt2)

        else:
            y_pos = 0
            #print (x_pos)
            pt1 = rg.Point3d(x_pos, y_pos, 0)

            pts.append(pt1)

    return pts

pts = brick_possitions_split()
# ---------- end python_6 ----------
item_3 = ListItem(List=python_6.pts, Index=Slider(20, range=0..20), Wrap=True)
pt_6 = Point(graft(python_6.pts))

number_slider_9 = Slider(4, range=0..30)
crv_5 = Curve(<curve referenced from the Rhino model>)

expression_3 = Expression(x=number_slider_9, y=Slider(2, range=0..10), Expression="6+x+y")
expression_4 = Expression(x=number_slider_9, y=expression_3, Expression="(x+y)/2")

python_7 = GhPythonScript(
    curve=crv_5,
    ss=number_slider_9,
    se=expression_3,
    sm=expression_4,
    layers=Slider(5, range=1..10),
    t1=Slider(54, range=10..200),
    tm=Slider(38, range=-200..100),
    t2=Slider(72, range=10..200),
    t1_m=Slider(-153, range=-200..-10),
    tm_m=Slider(-9, range=-100..200),
    t2_m=Slider(-145, range=-200..-10),
    ay_1=number_slider_7,
    ay_1_m=neg,
    ay_2=number_slider_6,
    ay_2_m=neg_2,
    ax_1=Slider(2, range=-5..5))  # -> out, pts, planes, picking_planes, meshes, brick_all, planes_branch_v2; inputs curve: Curve, ss: Int32, se: Int32, sm: Int32, layers: Int32
# ---------- python_7: Python ----------
from compas_rhino import unload_modules
unload_modules('model_Explore')

from model_Explore import Brick
from model_Explore import Fabrication
import random as r
import Rhino.Geometry as rg
import rhinoscriptsyntax as rs
import math as m
import simple_comm as c
import simple_ur_script as ur
import Rhino.Collections as rc

def brick_possitions_split(curve_planes, branch_planes_1, branch_planes_2):
    """Genrates a Rhino Geometry plane for each brick

    Returns
    ----------
    brick_planes : [Rhino Geometry Plane, Rhino Geometry Plane, ...]

    """
    planes = []
    y_positive = 0
    y_negative = 0
    
    
    for i  in range (layers):  # layer heigh
        if i % 2 == 0:
            for j, plane in enumerate(curve_planes[0]):  # layer length
                x_pos = plane.OriginX
                y_pos = plane.OriginY
                z_value = Brick.REFERENCE_HEIGHT * i + i*0.2
                if j < ss-1 or j > se:
                    planes.append(rg.Plane(rg.Point3d(x_pos, y_pos, z_value), plane.XAxis, plane.YAxis))
                if j == ss-1:
                    pl_1 = rg.Plane(rg.Point3d(x_pos, y_pos, z_value), plane.XAxis, plane.YAxis)
                    pl_1.Rotate(m.radians(90), pl_1.ZAxis)
                    pl_1.Translate(pl_1.YAxis*(-Brick.REFERENCE_WIDTH/2-1.5))
                    planes.append(pl_1)
                #if j == se+1:
                    #pl_1 = rg.Plane(rg.Point3d(x_pos, y_pos, z_value), plane.XAxis, plane.YAxis)
                    #pl_1.Rotate(m.radians(90), pl_1.ZAxis)
                    #pl_1.Translate(pl_1.YAxis*(-Brick.REFERENCE_WIDTH*2+4))
                    #planes.append(pl_1)
            for k, b1_plane in enumerate(branch_planes_1[0]):
                x_pos_b1 = b1_plane.OriginX
                y_pos_b1 = b1_plane.OriginY
                z_value = Brick.REFERENCE_HEIGHT * i + i*0.2
                planes.append(rg.Plane(rg.Point3d(x_pos_b1, y_pos_b1, z_value), b1_plane.XAxis, b1_plane.YAxis))
            for l, b2_plane in enumerate(branch_planes_2[0]):
                x_pos_b2 = b2_plane.OriginX
                y_pos_b2 = b2_plane.OriginY
                z_value = Brick.REFERENCE_HEIGHT * i + i*0.2
                planes.append(rg.Plane(rg.Point3d(x_pos_b2, y_pos_b2, z_value), b2_plane.XAxis, b2_plane.YAxis))
        else:
            for j, plane in enumerate(curve_planes[1]):
                x_pos = plane.OriginX 
                y_pos = plane.OriginY
                z_value = Brick.REFERENCE_HEIGHT * i + i*0.2
                if j < ss-1  or j >= se+1:
                    planes.append(rg.Plane(rg.Point3d(x_pos, y_pos, z_value), plane.XAxis, plane.YAxis))
                #if j == se+1:
                    #pl_1 = rg.Plane(rg.Point3d(x_pos, y_pos, z_value), plane.XAxis, plane.YAxis)
                    #pl_1.Rotate(m.radians(90), pl_1.ZAxis)
                    #pl_1.Translate(pl_1.YAxis*(-Brick.REFERENCE_WIDTH*2+3))
                    #planes.append(pl_1)
                if j == ss-1:
                    pl_1 = rg.Plane(rg.Point3d(x_pos, y_pos, z_value), plane.XAxis, plane.YAxis)
                    pl_1.Rotate(m.radians(90), pl_1.ZAxis)
                    pl_1.Translate(pl_1.YAxis*(-Brick.REFERENCE_WIDTH/2-2))
                    planes.append(pl_1)
                    #rg.Plane.Rotate(
            for k, b1_plane in enumerate(branch_planes_1[1]):
                x_pos_b1 = b1_plane.OriginX
                y_pos_b1 = b1_plane.OriginY
                z_value = Brick.REFERENCE_HEIGHT * i + i*0.2
                planes.append(rg.Plane(rg.Point3d(x_pos_b1, y_pos_b1, z_value), b1_plane.XAxis, b1_plane.YAxis))
            for l, b2_plane in enumerate(branch_planes_2[1]):
                x_pos_b2 = b2_plane.OriginX
                y_pos_b2 = b2_plane.OriginY
                z_value = Brick.REFERENCE_HEIGHT * i + i*0.2
                planes.append(rg.Plane(rg.Point3d(x_pos_b2, y_pos_b2, z_value), b2_plane.XAxis, b2_plane.YAxis))

    return planes

def curve_to_planes_eo(curve):
    brick_planes_even =[]
    brick_planes_odd =[]
    brick_planes = []
    brick_planes_o = []

    params = rg.Curve.DivideByLength(curve,Brick.REFERENCE_LENGTH/2+1,False)
    for param in params:
        brick_pos = rg.Curve.PointAt(curve,param)
        brick_tan = rg.Curve.TangentAt(curve,param)

        vec1= rg.Vector3d.CrossProduct(brick_tan,rg. Vector3d.ZAxis)
        vec2= rg.Vector3d.CrossProduct(vec1,rg.Vector3d.ZAxis)
        plane = rg.Plane(brick_pos,vec2,vec1)
        
        brick_planes.append(plane)

    for i, plane in enumerate(brick_planes):
        if i % 2 == 0:
            brick_planes_even.append(plane)
        else:
            brick_planes_odd.append(plane)
            
    brick_planes_o.append(brick_planes_even)
    brick_planes_o.append(brick_planes_odd)
    #return brick_planes_even, brick_planes_odd
    return brick_planes_o


def branch_curve(c_plane,d1,d2,d3,a1,a2,a3):
    # "s_pt"is start point,"e_pt"is end point,"m_pt"is middle point of the curve
    s_pt=c_plane[ss-1].Origin
    s_pt_f=c_plane[ss+1].Origin   
    e_pt=c_plane[se+1].Origin
    e_pt_b=c_plane[se-2].Origin
    m_pt=c_plane[sm-1].Origin
    m_pt_1=c_plane[sm+1].Origin
    m_pt_2=c_plane[sm-3].Origin
    
    offset_vector_s = c_plane[ss-1].YAxis
    offset_vector_sf = c_plane[ss+1].YAxis
    offset_vector_e = c_plane[se].YAxis
    offset_vector_e_x = c_plane[se].XAxis
    offset_vector_eb = c_plane[se-1].YAxis
    offset_vector_m = c_plane[sm-1].YAxis
    offset_vector_m1 = c_plane[sm+1].YAxis
    offset_vector_m2 = c_plane[sm-3].YAxis
    
    pts = [s_pt + offset_vector_s*a1,
           s_pt_f + offset_vector_sf*a1, 
           m_pt_2 + d1*offset_vector_m2 , 
           m_pt + d2*offset_vector_m , 
           m_pt_1 + d3*offset_vector_m1 , 
           e_pt_b + offset_vector_eb*a2, 
           e_pt + offset_vector_e*a2]
    l_pts = rc.Point3dList(pts)
    crv = rg.BezierCurve(l_pts)
    
    nurbs_crv = rg.BezierCurve.ToNurbsCurve(crv)
    return nurbs_crv

curve_planes=curve_to_planes_eo(curve) # even and odd planes are two lists in one big list 


b_crv_1 = branch_curve(curve_planes[0],t1,tm,t2,ay_1,ay_2,ax_1)
b_crv_2 = branch_curve(curve_planes[0],t1_m,tm_m,t2_m,ay_1_m,ay_2_m,1)

planes_branch_1 = curve_to_planes_eo(b_crv_1) 
planes_branch_2 = curve_to_planes_eo(b_crv_2) 

planes_branch_v1 = curve_to_planes_eo(b_crv_1)[0] 
planes_branch_v2 = curve_to_planes_eo(b_crv_2)[0] 

planes = brick_possitions_split(curve_planes,planes_branch_1,planes_branch_2)


picking_planes = []
meshes = []
brick_all = []
for p in planes:
    myBrick = Brick(p)
    picking_planes.append(myBrick.picking_plane())
    brick_all.append(myBrick)
    meshes.append(myBrick.mesh())
# ---------- end python_7 ----------
pln_8 = Plane(python_7.planes)
pt_7 = Point(python_7.pts)
pln_9 = Plane(python_7.picking_planes)
mesh_3 = Mesh(python_7.meshes)
item_4 = ListItem(List=mesh_3, Index=Slider(0, range=0..100), Wrap=True)
preview_3 = CustomPreview(Geometry=mesh_3, Material=ColourSwatch(SwatchColor=RGB(255, 167, 184)))

data = Data(python_7.brick_all)
pln_10 = Plane(python_7.planes_branch_v2)

number_slider_10 = Slider(2, range=0..30)
crv_6 = Curve(<curve referenced from the Rhino model>)

expression_5 = Expression(x=number_slider_10, y=Slider(4, range=0..10), Expression="6+x+y")

addition_2 = Addition(A=number_slider_10, B=expression_5)
division_2 = Division(A=addition_2, B="2")
python_8 = GhPythonScript(curves=crv_6, split_start=number_slider_10, split_end=expression_5, split_mid=division_2, layers=Slider(1, range=1..10))  # -> out, pts, planes, picking_planes, meshes, curve_planes; inputs curves: list of Curve, split_start: Int32, split_end: Int32, split_mid: Int32, layers: Int32
# ---------- python_8: Python ----------
from compas_rhino import unload_modules
unload_modules('model_Explore')

from model_Explore import Brick
from model_Explore import Fabrication
import random as r
import Rhino.Geometry as rg
import rhinoscriptsyntax as rs
import math as m
import simple_comm as c
import simple_ur_script as ur

def brick_possitions_split(curve_planes):
    """Genrates a Rhino Geometry plane for each brick

    Returns
    ----------
    brick_planes : [Rhino Geometry Plane, Rhino Geometry Plane, ...]

    """
    pts = []
    planes = []
    y_positive = 0
    y_negative = 0
    
    
    for i  in range (layers):  # layer heigh
        if i % 2 == 0:
            for j, plane in enumerate(curve_planes[0]):  # layer length
                x_pos = plane.OriginX
                y_pos = plane.OriginY# why no rg
                z_value = Brick.REFERENCE_HEIGHT * i + i*1
                if j < split_start or j >= split_end:
                    pts.append(rg.Point3d(x_pos, y_pos, z_value))
                    planes.append(rg.Plane(rg.Point3d(x_pos, y_pos, z_value), plane.XAxis, plane.YAxis))#P
                    # create planes here aswell
#---------------------------------------------------------------------------
                if split_start <= j < split_mid:
                    for k in range(2):
                        if k == 0:
                            y_positive += 9
                            y_offset_vector = plane.YAxis  #rg.Plane.YAxis 
                            
                            pt2 = rg.Point3d(x_pos, y_pos, z_value) + y_offset_vector*y_positive
                            pts.append(pt2)
                            planes.append(rg.Plane(pt2, plane.XAxis, plane.YAxis))
                            # create the plane 
                            
                            # when you split, use the y axis of the plane to copy and offset the new plane
                        else:
                            y_negative -= 9
                            y_offset_vector = plane.YAxis
                            
                            pt2 = rg.Point3d(x_pos, y_pos, z_value) + y_offset_vector*y_negative
                            pts.append(pt2)
                            planes.append(rg.Plane(pt2, plane.XAxis, plane.YAxis))
                elif split_mid <= j < split_end:
                    for k in range(2):
                        if k == 0:
                            y_positive -= 9
                            y_offset_vector = plane.YAxis
                            
                            pt2 = rg.Point3d(x_pos, y_pos, z_value) + y_offset_vector*y_positive
                            pts.append(pt2)
                            planes.append(rg.Plane(pt2, plane.XAxis, plane.YAxis))
                        else:
                            y_negative += 9
                            y_offset_vector = plane.YAxis
                            pt2 = rg.Point3d(x_pos, y_pos, z_value) + y_offset_vector*y_negative
                            pts.append(pt2)
                            planes.append(rg.Plane(pt2, plane.XAxis, plane.YAxis))
#---------------------------------------------------------------------------
        else:
            for j, plane in enumerate(curve_planes[1]):
                x_pos = plane.OriginX 
                y_pos = plane.OriginY
                z_value = Brick.REFERENCE_HEIGHT * i + i*1
                if j < split_start or j >= split_end:
                    pts.append(rg.Point3d(x_pos, y_pos, z_value))
                    planes.append(rg.Plane(rg.Point3d(x_pos, y_pos, z_value), plane.XAxis, plane.YAxis))
                    
                if split_start <= j < split_mid:
                    for k in range(2):
                        if k == 0:
                            y_positive += 9
                            y_offset_vector = plane.YAxis
                            pt2 = rg.Point3d(x_pos, y_pos, z_value) + y_offset_vector*y_positive
                            pts.append(pt2)
                            planes.append(rg.Plane(pt2, plane.XAxis, plane.YAxis))
                        else:
                            y_negative -= 9
                            y_offset_vector = plane.YAxis
                            pt2 = rg.Point3d(x_pos, y_pos, z_value) + y_offset_vector*y_negative
                            pts.append(pt2)
                            planes.append(rg.Plane(pt2, plane.XAxis, plane.YAxis))
                elif split_mid <= j < split_end:
                    for k in range(2):
                        if k == 0:
                            y_positive -= 9
                            y_offset_vector = plane.YAxis
                            pt2 = rg.Point3d(x_pos, y_pos, z_value) + y_offset_vector*y_positive
                            pts.append(pt2)
                            planes.append(rg.Plane(pt2, plane.XAxis, plane.YAxis))
                        else:
                            y_negative += 9
                            y_offset_vector = plane.YAxis
                            pt2 = rg.Point3d(x_pos, y_pos, z_value) + y_offset_vector*y_negative
                            pts.append(pt2)
                            planes.append(rg.Plane(pt2, plane.XAxis, plane.YAxis))
                            

    return planes
    
def curve_to_planes_eo():
    brick_planes_even =[]
    brick_planes_odd =[]
    brick_planes = []
    brick_planes_o = []
    for curve in curves:
        params = rg.Curve.DivideByLength(curve,Brick.REFERENCE_LENGTH/2+1,False)
        for param in params:
            brick_pos = rg.Curve.PointAt(curve,param)
            brick_tan = rg.Curve.TangentAt(curve,param)

            vec1= rg.Vector3d.CrossProduct(brick_tan,rg. Vector3d.ZAxis)
            vec2= rg.Vector3d.CrossProduct(vec1,rg.Vector3d.ZAxis)
            plane = rg.Plane(brick_pos,vec2,vec1)
            
            brick_planes.append(plane)

    for i, plane in enumerate(brick_planes):
        if i % 2 == 0:
            brick_planes_even.append(plane)
        else:
            brick_planes_odd.append(plane)
            
    brick_planes_o.append(brick_planes_even)
    brick_planes_o.append(brick_planes_odd)
    #return brick_planes_even, brick_planes_odd
    return brick_planes_o

curve_planes=curve_to_planes_eo() #planes_even = planes[0] planes_odd = planes[1] 
planes = brick_possitions_split(curve_planes)

picking_planes = []
meshes = []
for p in planes:
    myBrick = Brick(p)
    picking_planes.append(myBrick.picking_plane())
    meshes.append(myBrick.mesh())
# ---------- end python_8 ----------
pln_11 = Plane(python_8.picking_planes)
mesh_4 = Mesh(python_8.meshes)
pt_8 = Point(python_8.pts)
pln_12 = Plane(python_8.planes)
item_5 = ListItem(List=mesh_4, Index=Slider(0, range=0..100), Wrap=True)
preview_4 = CustomPreview(Geometry=item_5, Material=ColourSwatch(SwatchColor=RGB(255, 167, 184)))
