# Grasshopper definition Pascal.ghx (Grasshopper 1.0.7)

geo = Geometry([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])  # disabled
geo_2 = Geometry([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])
bricks = GhPythonScript(robot_base_geometry=geo)  # -> out, surfaces, planes, robot_crv, transformed_robot_base; inputs robot_base_geometry: list of Brep; disabled
# ---------- bricks: Python ----------
from compas_rhino import unload_modules
unload_modules('model')

from model import Wall
from model import Fabrication
import Rhino.Geometry as rg



myWall = Wall(5,10)
surfaces, visualisation, robot_transformation = myWall.geometric_model()
#script, visualisation_robot_coordinate_system = myWall.fabrication_model()
#print(type(robot_transformation))
#planes, robot_crv = visualisation_robot_coordinate_system


#print (script)
transformed_robot_base = []
for geometry in robot_base_geometry:
    trans_geometry = geometry.Duplicate()
    trans_geometry.Transform(robot_transformation)
    transformed_robot_base.append(trans_geometry)
# ---------- end bricks ----------
bricks_2 = GhPythonScript(robot_base_geometry=geo_2)  # -> out, meshes, surfaces, planes, robot_crv, transformed_robot_base, mesh, pick_plane; inputs robot_base_geometry: list of Brep
# ---------- bricks_2: Python ----------
from compas_rhino import unload_modules
unload_modules('model')

import Rhino.Geometry as rg
from model import Brick

planes = rg.Plane(rg.Point3d(0,0,100), rg.Vector3d.XAxis, rg.Vector3d.YAxis)


myFirstBrick = Brick(planes)
mesh = myFirstBrick.mesh()

surfaces = myFirstBrick.surface()
pick_plane = myFirstBrick.picking_plane()

planes = []
meshes = []

for i in range(20):
    for j in range(10):
        gap = 1
        
        if i % 2 == 1:
            x_value = Brick.REFERENCE_LENGTH * j + (gap*j) + (Brick.REFERENCE_LENGTH+gap)/2
            z_value = Brick.REFERENCE_HEIGHT * i
        
        else:
            x_value = Brick.REFERENCE_LENGTH * j + (1*j)
            z_value = Brick.REFERENCE_HEIGHT * i
        
        plane_origin = rg.Point3d(x_value, 0, z_value)
        plane = rg.Plane(plane_origin, rg.Vector3d.XAxis, rg.Vector3d.YAxis)
        
        myBrick = Brick(plane)
        planes.append(myBrick.picking_plane())
        
        meshes.append(myBrick.mesh())
# ---------- end bricks_2 ----------
number_slider = Slider(94, range=0..100)  # disabled
geo_3 = Geometry(bricks.surfaces)  # disabled
geo_4 = Geometry(bricks_2.surfaces)
item = ListItem(List=bricks.surfaces, Index=number_slider, Wrap=True)  # disabled
geo_5 = Geometry(bricks.robot_crv)  # disabled
geo_6 = Geometry(bricks.planes)  # disabled
geo_7 = Geometry(bricks.transformed_robot_base)  # disabled
item_2 = ListItem(List=bricks_2.surfaces, Index=Slider(94, range=0..100), Wrap=True)
geo_8 = Geometry(bricks_2.robot_crv)
geo_9 = Geometry(bricks_2.planes)
geo_10 = Geometry(bricks_2.transformed_robot_base)
geo_11 = Geometry(bricks_2.meshes)
geo_12 = Geometry(bricks_2.pick_plane)
geo_13 = Geometry(item)  # disabled
geo_14 = Geometry(item_2)
