# Grasshopper definition brick_laying_Priyank02.ghx (Grasshopper 1.0.7)

number_slider = Slider(25, range=0..100)  # disabled
division = Division(A=number_slider, B=2)  # disabled
geo = Geometry([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])
xy_plane = XYPlane(Origin=Point(0, 0, 0))
xz_plane = XZPlane(Origin=Point(0, 0, 0))

# ---- group: Curve points
number_slider_2 = Slider(15, range=0..200)
dom = ConstructDomain(DomainStart=Slider(0, range=-100..100), DomainEnd=Slider(10.183, range=0..100))
series = Series(Start=0, Step=1, Count=number_slider_2)
range = Range(Domain=dom, Steps=number_slider_2)

# ----
sine = Sine(Value=range)
cull_index = CullIndex(List=sine, Indices=expr("-1", -1), Wrap=True)
pt = ConstructPoint(XCoordinate=0, YCoordinate=expr("-1*x", cull_index), ZCoordinate=series)

# ---- group: Curve points (continued)
pt_2 = ConstructPoint(XCoordinate=series, YCoordinate=cull_index, ZCoordinate=0)

# ----
interpolate = Interpolate(Vertices=pt, Degree=3, Periodic=False, KnotStyle=1)  # -> Curve, Length, Domain
interpolate_2 = Interpolate(Vertices=pt_2, Degree=3, Periodic=False, KnotStyle=1)  # -> Curve, Length, Domain
move = Move(Geometry=interpolate_2.Curve, Motion=pt)  # -> Geometry, Transform
scale = Scale(Geometry=move.Geometry, Center=Point(0, 0, 0), Factor=Slider(10, range=0..10))  # -> Geometry, Transform
dispatch = Dispatch(List=scale.Geometry, DispatchPattern=[True, False])  # -> ListA, ListB; disabled
panel = Panel(pt_2)
deconstruct = Deconstruct(Point=pt_2)  # -> XComponent, YComponent, ZComponent
ghpython_script = GhPythonScript(curves=scale.Geometry)  # -> out, brick_planes, point; inputs curves: list of Curve
# ---------- ghpython_script: Python ----------
from compas_rhino import unload_modules
unload_modules('model')
import rhinoscriptsyntax as rs
import Rhino.Geometry as rg
from model import Brick

def curve_to_planes():
    brick_planes =[]
    for curve in curves:
#            for i in range (10):
#        for j in range (20):
        if curve % 2 == 1:

            params = rg.Curve.DivideByLength(curve, Brick.REFERENCE_WIDTH+2, False)
        else:
            params = rg.Curve.DivideByLength(curve, (Brick.REFERENCE_WIDTH+2)*2, False)
        
#        params = rg.Curve.DivideByLength(curve, Brick.REFERENCE_WIDTH+2, False)
        for param in params:
            brick_pos = rg.Curve.PointAt(curve, param)
            brick_tan = rg.Curve.TangentAt(curve, param)
            vec1 = rg.Vector3d.CrossProduct(brick_tan, rg.Vector3d.ZAxis)
            vec2 = rg.Vector3d.CrossProduct(vec1, rg.Vector3d.ZAxis)
            plane = rg.Plane(brick_pos, vec1, vec2)
            planar = rg.Transform.Rotation(vec1, vec2, brick_pos)
            brick_planes.append(plane)
            
    return brick_planes
brick_planes = curve_to_planes()
# ---------- end ghpython_script ----------
divide_length = DivideLength(Curve=dispatch.ListB, Length=division)  # -> Points, Tangents, Parameters; disabled
divide_length_2 = DivideLength(Curve=dispatch.ListA, Length=number_slider)  # -> Points, Tangents, Parameters; disabled
point_list = PointList(Points=pt_2, Size=Slider(1, range=0..1))
bricks = GhPythonScript(robot_base_geometry=geo, plane=ghpython_script.brick_planes, th=Slider(164, range=0..360), ve=pt)  # -> out, meshes, surfaces, planes, brick_pts, pick_plane, robot_crv, transformed_robot_base, mesh; inputs robot_base_geometry: list of Brep, ve: Point3d; disabled
# ---------- bricks: Python ----------
from compas_rhino import unload_modules
unload_modules('model')

import Rhino.Geometry as rg

from model import Brick

meshes = []

#for i in range (10):
#    for j in range (20):
#        if i % 2 == 1:
#        
#            x_value = (Brick.REFERENCE_LENGTH * j)+(1*j)+(Brick.REFERENCE_LENGTH/2)
#        
#            z_value = Brick.REFERENCE_HEIGHT * i + i*1
#            
#        else:
#            
#            x_value = (Brick.REFERENCE_LENGTH * j)+(1*j)
#        
#            z_value = Brick.REFERENCE_HEIGHT * i + i*1

planar= rg.Plane(plane)
myBrick = Brick(planar)
meshes.append(myBrick.mesh())


#Brick(rg.Plane.Rotate(

#rg.Plane(plane))
#rg.Plane.Rotate(
#rg.Vector3d(
# ---------- end bricks ----------
dispatch_2 = Dispatch(List=divide_length.Points, DispatchPattern=[True, False])  # -> ListA, ListB
dispatch_3 = Dispatch(List=divide_length.Tangents, DispatchPattern=[True, False])  # -> ListA, ListB
panel_2 = Panel(dispatch_3.ListB)
point = Point(divide_length_2.Points)
point_2 = Point(dispatch_2.ListB)
xy_plane_2 = XYPlane(Origin=point)
geometry = Geometry(bricks.meshes)
xy_plane_3 = XYPlane(Origin=point_2)
plane_normal = PlaneNormal(Origin=dispatch_2.ListB, ZAxis=dispatch_3.ListB)
rotate_3d = Rotate3D(Geometry=plane_normal, Angle=0, Center=dispatch_3.ListB, Axis=xy_plane)  # -> Geometry, Transform
plane = Plane(rotate_3d.Geometry)  # disabled
