# Grasshopper definition brick_laying_Priyank02_ES.gh (Grasshopper 1.0.7)

number_slider = Slider(28, range=0..100)
division = Division(A=number_slider, B=2)
geo = Geometry([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])

# ---- group: Curve points
number_slider_2 = Slider(31, range=0..200)
dom = ConstructDomain(DomainStart=Slider(0, range=-100..100), DomainEnd=Slider(15, range=0..100))
series = Series(Start=0, Step=1, Count=number_slider_2)
range = Range(Domain=dom, Steps=number_slider_2)

# ----
sine = Sine(Value=range)
cull_index = CullIndex(List=sine, Indices=expr("-1", -1), Wrap=True)
pt = ConstructPoint(XCoordinate=0, YCoordinate=expr("-1*x", cull_index), ZCoordinate=series)

# ---- group: Curve points (continued)
pt_2 = ConstructPoint(XCoordinate=series, YCoordinate=cull_index, ZCoordinate=0)

# ----
interpolate = Interpolate(Vertices=pt, Degree=3, Periodic=False, KnotStyle=1)  # -> Curve, Length, Domain
interpolate_2 = Interpolate(Vertices=pt_2, Degree=Slider(1, range=0..1), Periodic=False, KnotStyle=1)  # -> Curve, Length, Domain
move = Move(Geometry=interpolate_2.Curve, Motion=pt)  # -> Geometry, Transform
scale = Scale(Geometry=move.Geometry, Center=Point(0, 0, 0), Factor=Slider(10, range=0..10))  # -> Geometry, Transform
dispatch = Dispatch(List=scale.Geometry, DispatchPattern=[True, False])  # -> ListA, ListB
panel = Panel(pt_2)
deconstruct = Deconstruct(Point=pt_2)  # -> XComponent, YComponent, ZComponent
divide_length = DivideLength(Curve=dispatch.ListB, Length=division)  # -> Points, Tangents, Parameters
divide_length_2 = DivideLength(Curve=dispatch.ListA, Length=number_slider)  # -> Points, Tangents, Parameters
point_list = PointList(Points=pt_2, Size=Slider(1, range=0..1))
dispatch_2 = Dispatch(List=divide_length.Points, DispatchPattern=[True, False])  # -> ListA, ListB
dispatch_3 = Dispatch(List=divide_length.Tangents, DispatchPattern=[True, False])  # -> ListA, ListB
point = Point(dispatch_2.ListB)
point_2 = Point(divide_length_2.Points)
plane_normal = PlaneNormal(Origin=dispatch_2.ListB, ZAxis=dispatch_3.ListB)
xy_plane = XYPlane(Origin=point_2)  # -> flatten(Plane)
deplane = DeconstructPlane(Plane=plane_normal)  # -> Origin, XAxis, YAxis, ZAxis
rotate_3d = Rotate3D(Geometry=plane_normal, Angle=degrees(Slider(90, range=0..100)), Center=plane_normal, Axis=deplane.XAxis)  # -> Geometry, Transform
pflip = FlipPlane(Plane=rotate_3d.Geometry, ReverseX=False, ReverseY=False, SwapAxes=True)  # -> flatten(Plane)
data = Data([xy_plane, pflip])
cull_i = CullIndex(List=data, Indices=0, Wrap=True)
bricks = GhPythonScript(robot_base_geometry=geo, plane=cull_i, th=Slider(164, range=0..360), ve=pt)  # -> out, meshes, surfaces, planes, brick_pts, pick_plane, robot_crv, transformed_robot_base, mesh; inputs robot_base_geometry: list of Brep, ve: Point3d; disabled
# ---------- bricks: Python ----------
from compas_rhino import unload_modules
unload_modules('model')

import Rhino.Geometry as rg

from model import Brick

meshes = []

#for i in range (10):
#    for j in range (20):
#        if i % 2 == 1:
#        
#            x_value = (Brick.REFERENCE_LENGTH * j)+(1*j)+(Brick.REFERENCE_LENGTH/2)
#        
#            z_value = Brick.REFERENCE_HEIGHT * i + i*1
#            
#        else:
#            
#            x_value = (Brick.REFERENCE_LENGTH * j)+(1*j)
#        
#            z_value = Brick.REFERENCE_HEIGHT * i + i*1

planar= rg.Plane(plane)
myBrick = Brick(planar)
meshes.append(myBrick.mesh())


#Brick(rg.Plane.Rotate(

#rg.Plane(plane))
#rg.Plane.Rotate(
#rg.Vector3d(
# ---------- end bricks ----------
geometry = Geometry(bricks.meshes)
