# Grasshopper definition curve2planes+slicer.ghx (Grasshopper 1.0.7)

# ----
# Curve_to_planes
geo = Geometry(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)
Z = UnitZ(Factor=1)
contour = Contour(Shape=geo, Point=Point(0, 0, 0), Direction=Z, Distance="8")  # -> flatten(Contours)
python = GhPythonScript(curves=contour)  # -> out, brick_planes, meshes; inputs curves: list of Curve
# ---------- python: Python ----------
from compas_rhino import unload_modules
unload_modules('model')

import rhinoscriptsyntax as rs
import Rhino.Geometry as rg

from model import Brick

brick_planes =[]
planes =[]
meshes = []

for curve in curves:
    params = rg.Curve.DivideByLength(curve, Brick.REFERENCE_LENGTH, False)
    
    for param in params:
        brick_pos = rg.Curve.PointAt(curve, param)
        brick_tan = rg.Curve.TangentAt(curve, param)
        vec1 = rg.Vector3d.CrossProduct(brick_tan, rg.Vector3d.ZAxis)
        vec2 = rg.Vector3d.CrossProduct(vec1, rg.Vector3d.ZAxis)
        plane = rg.Plane(brick_pos, vec2, vec1)
        
        brick_planes.append(plane)
        myBrick = Brick(plane)
        meshes.append(myBrick.mesh())
# ---------- end python ----------
pln = Plane(python.brick_planes)
geo_2 = Geometry(python.meshes)

# ----
# Slicer
ghpython_script = GhPythonScript(input_brep=geo)  # -> out, contour_curves; inputs input_brep: Brep
# ---------- ghpython_script: Python ----------
from compas_rhino import unload_modules
unload_modules('model')

import rhinoscriptsyntax as rs
import Rhino.Geometry as rg

from model import Brick


# gets the bb and its corners
bounding_box = input_brep.GetBoundingBox(True)
corners = bounding_box.GetCorners()

#generate haigh and low placeholder values
min_z = 99999
max_z = -99999


for p in corners:
    if p.Z < min_z:
        min_z = p.Z
    elif p.Z > max_z:
        max_z = p.Z
#return min_z, max_z

contour_curves =rg.Brep.CreateContourCurves(input_brep, 
rg.Point3d(0,0,min_z), rg.Point3d(0,0, max_z), Brick.REFERENCE_HEIGHT)
# ---------- end ghpython_script ----------
ghpython_script_2 = GhPythonScript(curves=ghpython_script.contour_curves)  # -> out, brick_planes; inputs curves: list of Curve
# ---------- ghpython_script_2: Python ----------
from compas_rhino import unload_modules
unload_modules('model')

import rhinoscriptsyntax as rs
import Rhino.Geometry as rg

from model import Brick


def curve_to_planes():
    brick_planes =[]
    
    for curve in curves:
        params = rg.Curve.DivideByLength(curve, Brick.REFERENCE_LENGTH, False)
        print(params)
        for param in params:
            brick_pos = rg.Curve.PointAt(curve, param)
            brick_tan = rg.Curve.TangentAt(curve, param)
            vec1 = rg.Vector3d.CrossProduct(brick_tan, rg.Vector3d.ZAxis)
            vec2 = rg.Vector3d.CrossProduct(vec1, rg.Vector3d.ZAxis)
            plane = rg.Plane(brick_pos, vec1, vec2)
            brick_planes.append(plane)
    return brick_planes

brick_planes = curve_to_planes()
# ---------- end ghpython_script_2 ----------
plane = Plane(ghpython_script_2.brick_planes)
