# Grasshopper definition parametric_column_analysis.ghx (Grasshopper 1.0.7)
# plug-ins: karambaGH

construct_point = ConstructPoint(XCoordinate=Slider(0, range=0..100), YCoordinate=Slider(22, range=0..100), ZCoordinate=Slider(120, range=0..1000))
construct_point_2 = ConstructPoint(XCoordinate=Slider(0, range=0..100), YCoordinate=Slider(10, range=0..100), ZCoordinate=Slider(80, range=0..100))
construct_point_3 = ConstructPoint(XCoordinate=Slider(0, range=0..100), YCoordinate=Slider(47, range=0..100), ZCoordinate=Slider(160, range=0..1000))
xy_plane = XYPlane(Origin=Point(0, 0, 0))
xy_plane_2 = XYPlane(Origin=construct_point)
xy_plane_3 = XYPlane(Origin=construct_point_2)
xy_plane_4 = XYPlane(Origin=construct_point_3)
ellipse = Ellipse(Plane=xy_plane, Radius1=Slider(13, range=0..100), Radius2=Slider(29, range=0..100))  # -> Ellipse, Focus1, Focus2
ellipse_2 = Ellipse(Plane=xy_plane_2, Radius1=Slider(13.3, range=0..100), Radius2=Slider(43, range=0..100))  # -> Ellipse, Focus1, Focus2
ellipse_3 = Ellipse(Plane=xy_plane_3, Radius1=Slider(13.3, range=0..100), Radius2=Slider(28, range=0..100))  # -> Ellipse, Focus1, Focus2
ellipse_4 = Ellipse(Plane=xy_plane_4, Radius1=Slider(35, range=0..100), Radius2=Slider(86, range=0..100))  # -> Ellipse, Focus1, Focus2
loft = Loft(
    Curves=[ellipse.Ellipse, ellipse_3.Ellipse, ellipse_2.Ellipse, ellipse_4.Ellipse],
    Options={Adjust=False, Closed=False, LoftEnds=0, LoftSimp=0, LoftType=0, Rebuild=10, Refit=0.01})
mesh_breps_karamba3d = MeshBrepsKaramba3D(
    Brep=loft,
    MeshResolution=Slider(1, range=1..20),
    EdgeRefinementFactor=0.67,
    PointReduction=False,
    SmoothingStepSize=0,
    SmoothingIterations=5)  # -> Mesh, Info
mesh_to_shell_karamba3d = MeshToShellKaramba3D(Mesh=mesh_breps_karamba3d.Mesh, LimitDistance_m=0.005)  # -> Element, Points, Info

deconstruct = Deconstruct(Point=mesh_to_shell_karamba3d.Points)  # -> XComponent, YComponent, ZComponent
smaller_than = SmallerThan(FirstNumber=deconstruct.ZComponent, SecondNumber=Slider(0.005, range=0..0.01))  # -> SmallerThan, OrEqualTo
cull_pattern = CullPattern(List=mesh_to_shell_karamba3d.Points, CullPattern=smaller_than.SmallerThan)

number_slider = Slider(0.4836, range=0..1)
number_slider_2 = Slider(4.836, range=0..10)
negative = Negative(Value=Slider(0.004836, range=0..0.01))
unit_z = UnitZ(Factor=negative)
support_karamba3d = SupportKaramba3D(PosInd=cull_pattern, menu=[buttons(on, on, on, on, on, on)])
loads_karamba3d = LoadsKaramba3D(ForceVector=unit_z, Local=False, PosInd=mesh_to_shell_karamba3d.Points, LCase=Slider(0, range=0..100), mode="Point")
assemble_model_karamba3d = AssembleModelKaramba3D(Elem=mesh_to_shell_karamba3d.Element, Support=support_karamba3d, Load=loads_karamba3d, LimitDistance_m=0.005)  # -> Model, Info, Mass_kg, CenterOfGravity
analyze_karamba3d = AnalyzeKaramba3D(Model=assemble_model_karamba3d.Model)  # -> CalculatedModel, MaximumDisplacement_cm, ResultingForceOfGravity_kN, ElasticEnergy_kNm
model_view_karamba3d = ModelViewKaramba3D(Model=analyze_karamba3d.CalculatedModel, ResultFactors=1, ResultCase=-1)  # -> Model, DeformedMesh, DeformedAxes, DeformedModel
shell_view_karamba3d = ShellViewKaramba3D(Model=model_view_karamba3d.Model, IndexOfLayer=0)  # -> Model, MeshesOfRenderedShells, LegendColors, LegendTags
legend = Legend(Colour=shell_view_karamba3d.LegendColors, Tags=shell_view_karamba3d.LegendTags, LegendType=1)
mesh = Mesh(shell_view_karamba3d.MeshesOfRenderedShells)
