# Grasshopper definition populate_bricks.ghx (Grasshopper 1.0.7)

# 8.8 sec
crv = Curve(reparameterize(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))
# 471 mms
crv_2 = Curve(reparameterize(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))
# 30.9 sec
crv_3 = Curve(reparameterize(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))
# 1.3 sec
crv_4 = Curve(reparameterize(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))
crv_5 = Curve(reparameterize(crv_2))
# Turn me on!   -->
python = PythonScript()  # -> rhino_doc_dir
# ---------- python: Python ----------
import scriptcontext as sc
from os import path

rhino_doc_dir = path.abspath(path.dirname(sc.doc.Path))
# ---------- end python ----------

divdist = DivideDistance(Curve=crv_5, Distance=Slider(50, range=0..100))  # -> Points, Tangents, Parameters
graph = GraphMapper(
    divdist.Parameters,
    x0=0,
    x1=1,
    y0=0,
    y1=1,
    container_name="Bezier",
    cpx=[0, 0.1085271314, 0.9085272551, 1],
    cpy=[0, 0.4688524604, 0.3934426308, 1])
eval = EvaluateCurve(Curve=crv_5, Parameter=graph)  # -> Point, Tangent, Angle
dist = Distance(PointA=graft(eval.Point), PointB=eval.Point)  # -> flatten(Distance)
mindist = GhPythonScript(x=dist)  # -> minDist; inputs x: list
# ---------- mindist: Python ----------
X = [i for i in x if i != 0]

minDist = min(X)

print(minDist)
# ---------- end mindist ----------
min_distance = Panel(mindist)

panel = Panel("C:\Users\trtku\anaconda3\envs\rhinoremote\python.exe")
list = ValueList({"CRITICAL", "ERROR", "WARNING", "INFO", "DEBUG", "NOTSET"}, selected="DEBUG")

# ---- group: Import remote python modules
panel_2 = Panel(python)
panel_3 = Panel("""numpy
scipy
numpy.linalg
sklearn
sklearn.cluster""")
ghpythonremote = GHPythonRemote(
    location="C:\Users\simon\anaconda3\envs\rhinoremote\python.exe",
    run=Toggle(True),
    modules=panel_3,
    log_level=list,
    working_dir=panel_2)  # -> out, linked_modules, rpy; inputs run: Boolean, modules: list
# ---------- ghpythonremote: Python ----------
import inspect
import logging
from os import path
import sys
from time import sleep

import scriptcontext

import ghpythonremote
from ghpythonremote.connectors import GrasshopperToPythonRemote

local_log_level = getattr(logging, log_level, logging.WARNING)
logger = logging.getLogger("ghpythonremote")
logger.setLevel(local_log_level)
ch = logging.StreamHandler()
ch.setLevel(local_log_level)
formatter = logging.Formatter("%(levelname)s: %(name)s:\n%(message)s")
ch.setFormatter(formatter)
logger.handlers = []
logger.addHandler(ch)
logger = logging.getLogger("ghpythonremote.GH_to_python")

ROOT = path.abspath(path.dirname(inspect.getfile(ghpythonremote)))
rpyc_server_py = path.join(ROOT, "pythonservice.py")

# Set connection to CLOSED if this is the first run
# and initialize set of linked modules
try:
    remote_python_status
except NameError:
    remote_python_status = "CLOSED"
    lkd_modules = set()

# Wait for connection to connect or terminate
timer = 0
while remote_python_status == "CONNECTING" or remote_python_status == "CLOSING":
    sleep(1)
    timer += 1
    if timer == 10:
        try:
            gh2py_manager.__exit__(*sys.exc_info())
        except Exception:
            pass
        remote_python_status = "CLOSED"
        lkd_modules = set()
        raise RuntimeError(
            "Connection left in an inconsistent state and not returning. Reset "
            "everything."
        )

if run:
    if not remote_python_status == "OPEN":
        remote_python_status = "CONNECTING"
        gh2py_manager = GrasshopperToPythonRemote(
            rpyc_server_py,
            location=location,
            timeout=10,
            port=None,
            log_level=log_level,
            working_dir=working_dir,
        )
        gh2py = gh2py_manager.__enter__()
        remote_python_status = "OPEN"

    # Stuff that we can reach
    rpymod = gh2py.py_remote_modules  # A getter function for a named python module
    rpy = gh2py.connection  # Represents the remote instance root object
    scriptcontext.sticky["rpy"] = rpy
    # Add modules
    for mod in modules:
        try:
            scriptcontext.sticky[mod] = rpymod(mod)
            lkd_modules.add(mod)
        except ImportError:
            gh2py_manager.__exit__(*sys.exc_info())
            raise

elif not remote_python_status == "CLOSED":
    remote_python_status = "CLOSING"
    # Remove linked modules
    for mod in lkd_modules:
        del scriptcontext.sticky[mod]
    del scriptcontext.sticky["rpy"]
    gh2py_manager.__exit__(*sys.exc_info())
    lkd_modules = set()
    remote_python_status = "CLOSED"

# Change variable name because ghpython resets outputs to None before each run
linked_modules = lkd_modules

logger.info("GH to python connection is {}".format(remote_python_status))
# ---------- end ghpythonremote ----------
panel_4 = Panel(ghpythonremote.out)

# ----
python_2 = PythonScript(module_names=ghpythonremote.linked_modules)  # -> import_statements; inputs module_names: list
# ---------- python_2: Python ----------
import_statements = ["import scriptcontext as sc"]
for module_name in module_names:
    import_statements.append("{0} = sc.sticky['{0}']".format(module_name))

if len(module_names) == 0:
    import_statements = []
# ---------- end python_2 ----------
createareas = GhPythonScript(params=graph, starting_curve=crv_5, layers=Slider(2, range=0..10))  # -> out, areas_list, areas_dict, layer_curves, first_brick_meshes; inputs params: list, starting_curve: Curve, layers: Int32
# ---------- createareas: Python ----------
import rhinoscriptsyntax as rs
import Rhino.Geometry as rg
import Rhino.DocObjects as rd
import ghpythonlib.components as ghc
import random
random.seed(2)
from compas_rhino import unload_modules
unload_modules('model')

from model import Brick, Area, areas_dict, areas_list


curve = starting_curve

def areas_on_curve(crv, layer,width, params=params):
    layer_areas = []
    for i, _ in enumerate(params[:-1]):
        key = "L{}A{}".format(layer, i)
        area = Area(initial_curve=crv, start_param=params[i], end_param=params[i+1], layer=layer, area_index=i, width=width)
        areas_dict[key] = area
        layer_areas.append(area)
    return layer_areas

def move_curve_up(crv, height=Brick.REFERENCE_HEIGHT, trim_factor=0.05):
    V = rg.Vector3d.ZAxis * height
    crv.Translate(V)
    length = crv.GetLength()
    new_length = length * (1.0 - trim_factor)
    trim_length = (length - new_length) / 2
    _ , p0 = crv.LengthParameter(trim_length)
    _ , p1 = crv.LengthParameter(length - trim_length)
    trim = crv.Trim(rg.Interval(p0,p1))
    trim.Domain = rg.Interval(0.0, 1.0)
    return trim

def bbox_boolean_intersect(bbox_a, bbox_b):
    if (bbox_a.Min.X < bbox_b.Max.X) and (bbox_a.Max.X > bbox_b.Min.X) and (bbox_a.Min.Y < bbox_b.Max.Y) and (bbox_a.Max.Y > bbox_b.Min.Y):
        return True
    else:
        return False

def gen_first_bricks(a, d=1.0):
    """
    a = Area Class
    d = density of bricks (default should be 1.0)
    """
    bricks = []
    bbox = a.bounding_area()
    num_b = a.num_brick(bbox, density=d)
    points = a.populate_points(bbox, num_b)
    planes = a.random_brick_planes(points)
    for plane in planes:
        brick = Brick(plane)
        bricks.append(brick)
    a.area_bricks = bricks
    return bricks



"""Run code"""

# create curve and Areas for each layer
max_width = 100
shorten_factor = 0.9

for i in range(layers):
    layer_areas = areas_on_curve(crv=curve, layer=i, width=max_width)
    areas_list.append(layer_areas)
    curve = move_curve_up(curve)
    max_width *= shorten_factor

# this appends all layer curves to list so that we can visualize them
layer_curves = []
for l in areas_list:
    layer_curves.append(l[0].initial_curve)


"""Populate first layer with bricks &
Build topological model for Areas and store area_key in Area Class
- First populate ground layer with random bricks
- Second, initiate number of bricks for each area and store in self.initial_number_bricks
- Third find sub layer neighbors
"""
first_area_bricks = []
first_brick_meshes = []
density = 0.65

for l in areas_list:
    for a in l:
        # if first layer: populate areas with random bricks
        if a.sub_layer() is None:
            #create list of Brick object (a=Area class, d=density of bricks(default=1.0))
            bricks = gen_first_bricks(a, d=density)
            for brick in bricks:
                first_area_bricks.append(brick)
                first_brick_meshes.append(brick.mesh())
            continue
        # initiate number of bricks for each area
        bounding_area = a.bounding_area()
        num_b = a.num_brick(bounding_area, density=density)
        # add sub layer neighbors for every Area
        sub_neighbors = []
        bbox_a = a.project_bbox_extend_on_ground()
        sub_layer = areas_list[a.sub_layer()]
        for sub_area in sub_layer:
            bbox_b = sub_area.project_bbox_extend_on_ground()
            if bbox_boolean_intersect(bbox_a, bbox_b) is True:
                sub_neighbors.append(sub_area.area_key)
        a.sub_layer_neighbors = sub_neighbors


areas_dict = [ areas_dict ]
# ---------- end createareas ----------
panel_5 = Panel(python_2)
intersectingbricks = GhPythonScript(areas_list=createareas.areas_list, areas_dict=createareas.areas_dict)  # -> out, areas_list, areas_dict; inputs areas_list: list, areas_dict: list
# ---------- intersectingbricks: Python ----------
import rhinoscriptsyntax as rs
import Rhino.Geometry as rg
from compas_rhino import unload_modules
unload_modules('model')

from model import Brick, Area

areas_dict = areas_dict[0]

#for layer in areas_list:
#    for a in layer:
#       n_intersections, intersection_pairs = a.check_intersecting_bricks()
       
areas_dict = [ areas_dict ]
# ---------- end intersectingbricks ----------
clustering = GhPythonScript(areas_list=intersectingbricks.areas_list, areas_dict=intersectingbricks.areas_dict)  # -> out, clusters, points, label_tree, convex; inputs areas_list: list, areas_dict: list; disabled
# ---------- clustering: Python ----------
import rhinoscriptsyntax as rs
import Rhino.Geometry as rg
import ghpythonlib.treehelpers as th
import ghpythonlib.components as ghc
from compas_rhino import unload_modules
unload_modules('model')

from model import Brick, Area

areas_dict = areas_dict[0]

area_clusters = []
convex = [] 

for i in range(3,4):
    area = areas_list[1][i]
    clusters, points, labels = area.cluster_sub_layer_points()
    area_clusters.append(clusters)
    for cluster in clusters:
        convex.append(ghc.ConvexHull(cluster)[1])

#for area in areas_list[1]:
#    clusters, points, labels = area.cluster_sub_layer_points()
#    area_clusters.append(clusters)
#    for cluster in clusters:
#        convex.append(ghc.ConvexHull(cluster)[0])

#label_tree = th.list_to_tree(labels)
# ---------- end clustering ----------

# ---- group: Visualize outputs
first_layer_bricks = Mesh(createareas.first_brick_meshes)
layer_curve = Curve(createareas.layer_curves)
cluster_hulls = Curve(clustering.convex)

# ----
pt = Point(clustering.points)
