# Grasshopper definition populate_bricks_KO.ghx (Grasshopper 1.0.7)

crv = Curve(reparameterize(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))

divdist = DivideDistance(Curve=crv, Distance=Slider(50, range=0..100))  # -> Points, Tangents, Parameters
graph = GraphMapper(
    divdist.Parameters,
    x0=0,
    x1=1,
    y0=0,
    y1=1,
    container_name="Bezier",
    cpx=[0, 0.1085271314, 0.9085272551, 1],
    cpy=[0, 0.4688524604, 0.3934426308, 1])
eval = EvaluateCurve(Curve=crv, Parameter=graph)  # -> Point, Tangent, Angle
dist = Distance(PointA=graft(eval.Point), PointB=eval.Point)  # -> flatten(Distance)
mindist = GhPythonScript(x=dist)  # -> minDist; inputs x: list
# ---------- mindist: Python ----------
X = [i for i in x if i != 0]

minDist = min(X)

print(minDist)
# ---------- end mindist ----------
min_distance = Panel(mindist)

createareas = GhPythonScript(params=graph, starting_curve=crv, layers=Slider(2, range=2..8))  # -> out, mesh_bricks, pts_inside, test_mesh, Amesh; inputs params: list, starting_curve: Curve, layers: Int32
# ---------- createareas: Python ----------
import rhinoscriptsyntax as rs
import Rhino.Geometry as rg
import Rhino.DocObjects as rd
import ghpythonlib.components as ghc
import random
random.seed(2)
from compas_rhino import unload_modules
unload_modules('model')

from model import Brick, Area

curve = starting_curve

areas_dict = {}
areas_list = []

def areas_on_curve(crv, layer, width, params=params):
    layer_areas = []
    for i, _ in enumerate(params[:-1]):
        key = "L{}A{}".format(layer, i)
        area = Area(initial_curve=crv, start_param=params[i], end_param=params[i+1], layer=layer, area_index=i, width=width)
        areas_dict[key] = area
        layer_areas.append(area)
    return layer_areas

def move_curve_up(crv, height=Brick.REFERENCE_HEIGHT, trim_factor=0.05):
    V = rg.Vector3d.ZAxis * height
    crv.Translate(V)
    length = crv.GetLength()
    new_length = length * (1.0 - trim_factor)
    trim_length = (length - new_length) / 2
    _ , p0 = crv.LengthParameter(trim_length)
    _ , p1 = crv.LengthParameter(length - trim_length)
    trim = crv.Trim(rg.Interval(p0,p1))
    trim.Domain = rg.Interval(0.0, 1.0)
    return trim

def bbox_boolean_intersect(bbox_a, bbox_b):
    if (bbox_a.Min.X < bbox_b.Max.X) and (bbox_a.Max.X > bbox_b.Min.X) and (bbox_a.Min.Y < bbox_b.Max.Y) and (bbox_a.Max.Y > bbox_b.Min.Y):
        return True
    else:
        return False

def random_brick_planes(points):
    planes = []
    if points == None:
        pass
    else:
        for point in points:
            plane = rg.Plane(point, rg.Vector3d.ZAxis)
            start_vec = rg.Vector3d.XAxis
            end_vec = rg.Vector3d( random.random(), random.random(), 0)
            T = rg.Transform.Rotation( start_vec, end_vec, plane.Origin )
            plane.Transform(T)
            planes.append(plane)
    return planes



"""Run code"""

# create curve and Areas for each layer
max_width = 100
shorten_factor = 0.9 # there is a min value depends on number of layer (ko needs to check the reason !!!)

for i in range(layers):
    layer_areas = areas_on_curve(crv=curve, layer=i, width=max_width)
    areas_list.append(layer_areas)
    curve = move_curve_up(curve)
    max_width = max_width * shorten_factor


# fill area with bricks
mesh_bricks = []
for l in areas_list:
    for a in l:
        if a.layer == 0:
            area_bricks = []
            bbox = a.bounding_area()
            num_b = a.num_brick(bbox)
            points = a.populate_points(bbox, num_b)
            planes = random_brick_planes(points)
            for plane in planes:
                brick = Brick(plane)
                area_bricks.append(brick)
                mesh_bricks.append(brick.mesh())
        else:
            area_bricks = []
            bbox = a.bounding_area()
            num_b = a.num_brick(bbox)
            points = a.populate_points(bbox, num_b)
            planes = random_brick_planes(points)
            for plane in planes:
                brick = Brick(plane)
                area_bricks.append(brick)
                mesh_bricks.append(brick.mesh())
        a.area_bricks = area_bricks
        
        
        # get neighbors
        if a.sub_layer() is None:
            continue
        sub_neighbors = []
        bbox_a = a.project_bbox_extend_on_ground()
        sub_layer = areas_list[a.sub_layer()]
        for sub_area in sub_layer:
            bbox_b = sub_area.project_bbox_extend_on_ground()
            if bbox_boolean_intersect(bbox_a, bbox_b) is True:
                sub_neighbors.append(sub_area.area_key)
        a.sub_layer_neighbors = sub_neighbors
        


"""test for dict"""

testA = areas_dict['L1A14']

nbrs = testA.sub_layer_neighbors
vertices = []
for n in nbrs:
    verts = areas_dict[n].get_bricks_vertices()
    vertices.extend(verts)
    
pts_inside = testA.find_points_in_extend(vertices)

bricksA = testA.area_bricks[2]
test_mesh = []
test_mesh.append(bricksA.mesh())

bricksB = testA.area_bricks[3]
test_mesh.append(bricksB.mesh())

#print(bricksA.brick_intersect_brick(bricksB))
# ---------- end createareas ----------
createareas_2 = GhPythonScript(params=graph, starting_curve=crv, layers=Slider(3, range=2..8))  # -> out, mesh_bricks, pts_inside; inputs params: list, starting_curve: Curve, layers: Int32
# ---------- createareas_2: Python ----------
import rhinoscriptsyntax as rs
import Rhino.Geometry as rg
import Rhino.DocObjects as rd
import ghpythonlib.components as ghc
import random
random.seed(2)
from compas_rhino import unload_modules
unload_modules('model')

from model import Brick, Area

curve = starting_curve

areas_dict = {}
areas_list = []

def areas_on_curve(crv, layer, width, params=params):
    layer_areas = []
    for i, _ in enumerate(params[:-1]):
        key = "L{}A{}".format(layer, i)
        area = Area(initial_curve=crv, start_param=params[i], end_param=params[i+1], layer=layer, area_index=i, width=width)
        areas_dict[key] = area
        layer_areas.append(area)
    return layer_areas

def move_curve_up(crv, height=Brick.REFERENCE_HEIGHT, trim_factor=0.05):
    V = rg.Vector3d.ZAxis * height
    crv.Translate(V)
    length = crv.GetLength()
    new_length = length * (1.0 - trim_factor)
    trim_length = (length - new_length) / 2
    _ , p0 = crv.LengthParameter(trim_length)
    _ , p1 = crv.LengthParameter(length - trim_length)
    trim = crv.Trim(rg.Interval(p0,p1))
    trim.Domain = rg.Interval(0.0, 1.0)
    return trim

def bbox_boolean_intersect(bbox_a, bbox_b):
    if (bbox_a.Min.X < bbox_b.Max.X) and (bbox_a.Max.X > bbox_b.Min.X) and (bbox_a.Min.Y < bbox_b.Max.Y) and (bbox_a.Max.Y > bbox_b.Min.Y):
        return True
    else:
        return False

def random_brick_planes(points):
    planes = []
    if points == None:
        pass
    else:
        for point in points:
            plane = rg.Plane(point, rg.Vector3d.ZAxis)
            start_vec = rg.Vector3d.XAxis
            end_vec = rg.Vector3d( random.random(), random.random(), 0)
            T = rg.Transform.Rotation( start_vec, end_vec, plane.Origin )
            plane.Transform(T)
            planes.append(plane)
    return planes



"""Run code"""

# create curve and Areas for each layer
max_width = 100
shorten_factor = 0.9 # there is a min value depends on number of layer (ko needs to check the reason !!!)

for i in range(layers):
    layer_areas = areas_on_curve(crv=curve, layer=i, width=max_width)
    areas_list.append(layer_areas)
    curve = move_curve_up(curve)
    max_width = max_width * shorten_factor


# fill area with bricks
mesh_bricks = []
for l in areas_list:
    for a in l:
        if a.layer == 0:
            area_bricks = []
            bbox = a.bounding_area()
            num_b = a.num_brick(bbox)
            points = a.populate_points(bbox, num_b)
            planes = random_brick_planes(points)
            for plane in planes:
                brick = Brick(plane)
                area_bricks.append(brick)
                mesh_bricks.append(brick.mesh())
        else:
            area_bricks = []
            bbox = a.bounding_area()
            num_b = a.num_brick(bbox)
            # we should go to clustering phase from here
            """
            points = a.populate_points(bbox, num_b)
            planes = random_brick_planes(points)
            for plane in planes:
                brick = Brick(plane)
                area_bricks.append(brick)
                mesh_bricks.append(brick.mesh())
            """
        a.area_bricks = area_bricks
        
        # get neighbors
        if a.sub_layer() is None:
            continue
        sub_neighbors = []
        bbox_a = a.project_bbox_extend_on_ground()
        sub_layer = areas_list[a.sub_layer()]
        for sub_area in sub_layer:
            bbox_b = sub_area.project_bbox_extend_on_ground()
            if bbox_boolean_intersect(bbox_a, bbox_b) is True:
                sub_neighbors.append(sub_area.area_key)
        a.sub_layer_neighbors = sub_neighbors
        


"""test for dict"""

testA = areas_dict['L1A14']

nbrs = testA.sub_layer_neighbors
vertices = []
for n in nbrs:
    verts = areas_dict[n].get_bricks_vertices()
    vertices.extend(verts)
    
pts_inside = testA.find_points_in_extend(vertices)

#print(pts_inside)
# ---------- end createareas_2 ----------
mesh = Mesh(createareas_2.mesh_bricks)
pt = Point(createareas_2.pts_inside)
mesh_2 = Mesh(createareas.mesh_bricks)
pt_2 = Point(createareas.pts_inside)
mesh_3 = Mesh(createareas.test_mesh)
mesh_4 = Mesh(createareas.Amesh)
preview = CustomPreview(Geometry=mesh, Material=ColourSwatch(SwatchColor=RGBA(255, 255, 255, 62)))
preview_2 = CustomPreview(Geometry=mesh_2, Material=ColourSwatch(SwatchColor=RGBA(255, 255, 255, 62)))
pt_3 = Point()
k_mean_clustering = CSharpScript(points=pt_3, groupsNumber=Slider(7, range=0..250), precision="0.000001", seed=Slider(24, range=0..50))  # -> out, simplify(G); inputs points: tree of Point3d, groupsNumber: Int32, precision: Double, seed: Int32
# ---------- k_mean_clustering: C# ----------
    //Code by Dieter Toews
    //https://www.grasshopper3d.com/forum/topics/kmeans-1
    //Rewritten in January 2019 by Laurent Delrieu
    DataTree<Point3d> groupingsTree = new DataTree<Point3d>();
    for (int k_i = 0; k_i < points.BranchCount; k_i++)

    {List<Point3d> subpoints = points.Branch(k_i);
      Print(points.Path(k_i).ToString());
      //***************** Initialize K-Means Algorithm ****************************
      //Print("--------Initializing " + groupsNumber + " groupings-------");
      Component.Message = "K-Means Clustering";
      List<List<int>> groupings = new List<List<int>>();
      List<Point3d> oldCentroids = new  List<Point3d> ();
      List<Point3d> newCentroids = new  List<Point3d> ();
      for (int i = 0; i < groupsNumber; i++)
      {
        groupings.Add(new List<int>());
        newCentroids.Add(Point3d.Origin);
        oldCentroids.Add(Point3d.Origin);
        //Print("creating grouping " + i);
      }
      //randomly assign points from the input list (intialze the k-mean groups)
      //Print("--------Initializing group assignments (random)-------");
      Random r = new Random(seed);

      for (int j = 0 ; j < subpoints.Count; j++)
      {
        int groupNum = RandomNumber(r, groupsNumber - 1, 0);
        groupings[groupNum].Add(j);
        //Print("Adding index value " + groupings[groupNum][groupings[groupNum].Count - 1] + " to group " + groupNum + ".");
      }
      //***************** Do K-Means Algorithm ************************************
      //Print("--------Entering main k-means loop--------");
      bool isStillMoving = true;
      //Number of while counting
      int k = 0;
      double minDist, dist;
      Point3d XYZ = Point3d.Origin;
      Point3d pt = Point3d.Origin;

      while ( isStillMoving)
      {
        isStillMoving = false;
        //find new centroids
        //Print(".....finding new centroids");
        for (int i = 0; i < groupsNumber; i++)
        {
          oldCentroids[i] = newCentroids[i];
          for (int j = 0; j < groupings[i].Count; j++)
          {
            XYZ = XYZ + subpoints[groupings[i][j]];
          }
          XYZ = XYZ / ((double) groupings[i].Count + 1);

          Point3d newCentroid = XYZ;
          newCentroids[i] = newCentroid;
          //Print("New centroid for group " + i + " is " + newCentroids[i].ToString());
          groupings[i].Clear();
          dist = newCentroid.DistanceTo(oldCentroids[i]);

          if (dist > precision)
          {
            //Print("need to do more work");
            isStillMoving = true;
          }
        }
        //create new groupings

        //Print(".....creating new groupings");

        for (int j = 0; j < subpoints.Count; j++)
        {
          pt = subpoints[j];
          minDist = pt.DistanceTo(newCentroids[0]);
          int groupNum = 0;
          for (int i = 0; i < groupsNumber; i++)
          {
            dist = pt.DistanceTo(newCentroids[i]);
            if( minDist >= dist )
            {
              groupNum = i;
              minDist = dist;
            }
          }
          groupings[groupNum].Add(j);
          if ( isStillMoving == false)
          {
            groupingsTree.Add(pt, points.Path(k_i).AppendElement(groupNum));
          }
        }
        if (isStillMoving == false)
        {
          //Print("***************all groups setled exiting loop********************");
          //Print("***************total loop count is " + k + "************************");
        }
        //a hard limit on the number of loops to execute....
        if(k > 1000)
        {
          isStillMoving = false;
        }
        k += 1;
      }//End while
    }
    G = groupingsTree;
# ---------- k_mean_clustering: C# additional code ----------
  public int RandomNumber(Random r, int MaxNumber, int MinNumber)
  {
    //if passed incorrect arguments, swap them
    //can also throw exception or return 0
    if (MinNumber > MaxNumber)
    {
      int t = MinNumber;
      MinNumber = MaxNumber;
      MaxNumber = t;
    }
    return r.Next(MinNumber, MaxNumber);
  }
# ---------- end k_mean_clustering ----------

# ---- group: visualise clusters
hull = ConvexHull(Points=k_mean_clustering.G, Plane=PlaneXY(0, 0, 0))  # -> Hull, HullZ, Indices
crv_2 = Curve(hull.HullZ)
boundary = BoundarySurfaces(Edges=crv_2)
Z = UnitZ(Factor=1)
move = Move(Geometry=boundary, Motion=Z)  # -> Geometry, Transform
preview_3 = CustomPreview(Geometry=move.Geometry, Material=ColourSwatch(SwatchColor=RGBA(255, 255, 255, 158)))

# ----
create_average_crv = GhPythonScript(clustered_pts=k_mean_clustering.G)  # -> out, bricks; inputs clustered_pts: tree of Point3d
# ---------- create_average_crv: Python ----------
import Rhino.Geometry as rg
import ghpythonlib.components as ghc
import math
import random
from model import Brick

path_count = ghc.TreeStatistics(clustered_pts) [2]
diagonal = math.sqrt(12.5*12.5 + 12*12)
floating_edges = []


for i in range(path_count):
    # pick up one branch (list of Point3d)
    clustered_pt = ghc.TreeBranch(clustered_pts,i) 
    # create the edges inside a cluster (list of Line)
    edges = ghc.DelaunayEdges(clustered_pt)[1]
    
    floating_edge = []
    picked_up_edges = []
    #check the length of edges to get floating edge
    for edge in edges:
        length = edge.Length
        if (24.9 < length) or (11.9 < length < 12.1+0.5) or (diagonal-0.1 < length < diagonal+0.1):
            pass
        else:
            #create a list of floating edges
            floating_edge.append( edge )
    
    #create a list of lists of floating edges
    floating_edges.append( floating_edge )


# create average curve from the list of floating edges
average_crvs = []
average_vecs = []
for floating_edge in floating_edges:
    # create average crv
    average_crv = ghc.Pufferfish.AverageCurve(floating_edge, 0, 0)
    # get direction of average crv
    start_vec          = rg.Vector3d( average_crv.PointAtStart )
    end_vec            = rg.Vector3d( average_crv.PointAtEnd   )
    average_vec = end_vec - start_vec
    
    average_crvs.append(average_crv)
    average_vecs.append(average_vec)

#create planes
planes = []
for crv, dir in zip( average_crvs,average_vecs ):
    center = crv.PointAt(0.5)
    plane = rg.Plane(center, rg.Vector3d.ZAxis)
    T = rg.Transform.Rotation(rg.Vector3d.XAxis, dir, center)
    plane.Transform(T)
    planes.append(plane)



#f = average_crvs
#g = planes

bricks = []
for plane in planes:
    brick = Brick(plane)
    bricks.append(brick.mesh())
# ---------- end create_average_crv ----------
preview_4 = CustomPreview(Geometry=create_average_crv.bricks, Material=ColourSwatch(SwatchColor=RGBA(0, 89, 255, 163)))
