# Grasshopper definition populate_bricks_changeW_intersect_float.ghx (Grasshopper 1.0.7)

# ---- group: initial_crv_sample
# 1.3 sec
# 8.8 sec
# 471 mms
# 30.9 sec
crv = Curve(reparameterize(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))
crv_2 = Curve(reparameterize(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))
crv_3 = Curve(reparameterize(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))
crv_4 = Curve(reparameterize(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))
crv_5 = Curve(reparameterize(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))
crv_6 = Curve(reparameterize(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))

# ----
# Turn me on!   -->
python = PythonScript()  # -> rhino_doc_dir
# ---------- python: Python ----------
import scriptcontext as sc
from os import path

rhino_doc_dir = path.abspath(path.dirname(sc.doc.Path))
# ---------- end python ----------
pln = Plane([Plane(origin=(14.5, 40.95556769, 0), x=(-1, 0, 0), y=(0, -1, 0)), Plane(origin=(14.82080859, 16.47778373, 0), x=(-0.5680647805, 0.8229838426, 0), y=(-0.8229838426, -0.5680647805, 0)), Plane(origin=(12.62190122, 65.35014243, 0), x=(0.3546049349, -0.9350162245, 0), y=(0.9350162245, 0.3546049349, 0)), Plane(origin=(16.15838737, 91.37115654, 0), x=(0.7485108568, -0.6631225356, 0), y=(0.6631225356, 0.7485108568, 0)), Plane(origin=(16.15838737, 112.746932, 0), x=(0.7485108568, -0.6631225356, 0), y=(0.6631225356, 0.7485108568, 0)), Plane(origin=(33.14714765, 64.31414184, 0), x=(-0.1205370056, 0.9927088346, 0), y=(-0.9927088346, -0.1205370056, 0))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])

crv_7 = Curve(reparameterize(crv_6))

divdist = DivideDistance(Curve=crv_7, Distance=Slider(115, range=0..200))  # -> Points, Tangents, Parameters
graph = GraphMapper(
    divdist.Parameters,
    x0=0,
    x1=1,
    y0=0,
    y1=1,
    container_name="Bezier",
    cpx=[0, 0.1085271314, 0.9085272551, 1],
    cpy=[0, 0.4688524604, 0.3934426308, 1])
eval = EvaluateCurve(Curve=crv_7, Parameter=graph)  # -> Point, Tangent, Angle
dist = Distance(PointA=graft(eval.Point), PointB=eval.Point)  # -> flatten(Distance)
mindist = GhPythonScript(x=dist)  # -> minDist; inputs x: list
# ---------- mindist: Python ----------
X = [i for i in x if i != 0]

minDist = min(X)

print(minDist)
# ---------- end mindist ----------
min_distance = Panel(mindist)

# ---- group: w_params (ot change width of b_area)
t_parameter = Number(divdist.Parameters)
shift = ShiftList(List=t_parameter, Shift=1, Wrap=False)
bnd = Bounds(Numbers=shift)
dom = ConstructDomain(DomainStart="0", DomainEnd="1")
remap = RemapNumbers(Value=shift, Source=bnd, Target=dom)  # -> Mapped, Clipped
graph_2 = GraphMapper(remap.Mapped, x0=0, x1=1, y0=0, y1=1, Ox=0.5, Oy=0, Px=0.75, Py=0.25, container_name="Parabola")
panel = Panel(graph_2)

# ----
createareas = GhPythonScript(params=graph, starting_curve=crv_7, w_params=graph_2, first_planes=pln, layers=Slider(2, range=0..10))  # -> out, areas_list, areas_dict, layer_curves, first_brick_meshes, b_area; inputs params: list, starting_curve: Curve, w_params: list, first_planes: list of Plane, layers: Int32
# ---------- createareas: Python ----------
import rhinoscriptsyntax as rs
import Rhino.Geometry as rg
import Rhino.DocObjects as rd
import ghpythonlib.components as ghc
import random
random.seed(2)
from compas_rhino import unload_modules
unload_modules('model')

from model import Brick, Area, areas_dict, areas_list


curve = starting_curve

def areas_on_curve(crv, layer,width, params=params):
    layer_areas = []
    for i, _ in enumerate(params[:-1]):
        key = "L{}A{}".format(layer, i)
        area = Area(initial_curve=crv, start_param=params[i], end_param=params[i+1], layer=layer, area_index=i, width=width)
        areas_dict[key] = area
        layer_areas.append(area)
    return layer_areas

def move_curve_up(crv, height=Brick.REFERENCE_HEIGHT, trim_factor=0.0):
    V = rg.Vector3d.ZAxis * height
    crv.Translate(V)
    length = crv.GetLength()
    new_length = length * (1.0 - trim_factor)
    trim_length = (length - new_length) / 2
    _ , p0 = crv.LengthParameter(trim_length)
    _ , p1 = crv.LengthParameter(length - trim_length)
    trim = crv.Trim(rg.Interval(p0,p1))
    trim.Domain = rg.Interval(0.0, 1.0)
    return trim

def bbox_boolean_intersect(bbox_a, bbox_b):
    if (bbox_a.Min.X < bbox_b.Max.X) and (bbox_a.Max.X > bbox_b.Min.X) and (bbox_a.Min.Y < bbox_b.Max.Y) and (bbox_a.Max.Y > bbox_b.Min.Y):
        return True
    else:
        return False



"""Run code"""

# create curve and Areas for each layer
max_width = 100
shorten_factor = 1.0

for i in range(layers):
    layer_areas = areas_on_curve(crv=curve, layer=i, width=max_width)
    areas_list.append(layer_areas)
    curve = move_curve_up(curve)
    max_width *= shorten_factor

# this appends all layer curves to list so that we can visualize them
layer_curves = []
for l in areas_list:
    layer_curves.append(l[0].initial_curve)


"""Populate first layer with bricks &
Build topological model for Areas and store area_key in Area Class
- First populate ground layer with random bricks
- Second, initiate number of bricks for each area and store in self.initial_number_bricks
- Third find sub layer neighbors
"""
first_area_bricks = []
first_brick_meshes = []
b_area = []

density      = 0.6 #default=1.0
slope        = 1.0 #default=0.0
width_factor = 5.0 #default=1.0

for l in areas_list:
    for a in l:
        division_factor = width_factor/( w_params[ a.area_index ] +slope)
        # if first layer: populate areas with random bricks
        if a.sub_layer() is None:
            bounding_area = a.bounding_area(division_factor)
            b_area.append( bounding_area )
            num_b = a.num_brick(bounding_area, density=density)
            geo = ghc.BoundarySurfaces(bounding_area)
            pts = ghc.PopulateGeometry(geo, num_b, seed=0)
            planes = a.random_brick_planes(pts)
            
            bricks = []
            for plane in planes:
                bricks.append( Brick(plane) )
            a.area_bricks = bricks
            #just for visualisation
            for brick in bricks:
                first_area_bricks.append(brick)
                first_brick_meshes.append(brick.mesh())
            continue
        
        # initiate number of bricks for each area
        bounding_area = a.bounding_area(division_factor)
        b_area.append( bounding_area )
        num_b = a.num_brick(bounding_area, density=density)
        # add sub layer neighbors for every Area
        sub_neighbors = []
        bbox_a = a.project_bbox_extend_on_ground()
        sub_layer = areas_list[a.sub_layer()]
        for sub_area in sub_layer:
            bbox_b = sub_area.project_bbox_extend_on_ground()
            if bbox_boolean_intersect(bbox_a, bbox_b) is True:
                sub_neighbors.append(sub_area.area_key)
        a.sub_layer_neighbors = sub_neighbors



areas_dict = [ areas_dict ]
# ---------- end createareas ----------
list = ValueList({"CRITICAL", "ERROR", "WARNING", "INFO", "DEBUG", "NOTSET"}, selected="DEBUG")

# ---- group: Import remote python modules
panel_2 = Panel(python)
panel_3 = Panel("""numpy
scipy
numpy.linalg
sklearn
sklearn.cluster""")
panel_4 = Panel("C:\Users\simon\anaconda3\envs\rhinoremote\python.exe")
ghpythonremote = GHPythonRemote(
    location="C:\Users\trtku\anaconda3\envs\rhinoremote\python.exe",
    run=Toggle(False),
    modules=panel_3,
    log_level=list,
    working_dir=panel_2)  # -> out, linked_modules, rpy; inputs run: Boolean, modules: list
# ---------- ghpythonremote: Python ----------
import inspect
import logging
from os import path
import sys
from time import sleep

import scriptcontext

import ghpythonremote
from ghpythonremote.connectors import GrasshopperToPythonRemote

local_log_level = getattr(logging, log_level, logging.WARNING)
logger = logging.getLogger("ghpythonremote")
logger.setLevel(local_log_level)
ch = logging.StreamHandler()
ch.setLevel(local_log_level)
formatter = logging.Formatter("%(levelname)s: %(name)s:\n%(message)s")
ch.setFormatter(formatter)
logger.handlers = []
logger.addHandler(ch)
logger = logging.getLogger("ghpythonremote.GH_to_python")

ROOT = path.abspath(path.dirname(inspect.getfile(ghpythonremote)))
rpyc_server_py = path.join(ROOT, "pythonservice.py")

# Set connection to CLOSED if this is the first run
# and initialize set of linked modules
try:
    remote_python_status
except NameError:
    remote_python_status = "CLOSED"
    lkd_modules = set()

# Wait for connection to connect or terminate
timer = 0
while remote_python_status == "CONNECTING" or remote_python_status == "CLOSING":
    sleep(1)
    timer += 1
    if timer == 10:
        try:
            gh2py_manager.__exit__(*sys.exc_info())
        except Exception:
            pass
        remote_python_status = "CLOSED"
        lkd_modules = set()
        raise RuntimeError(
            "Connection left in an inconsistent state and not returning. Reset "
            "everything."
        )

if run:
    if not remote_python_status == "OPEN":
        remote_python_status = "CONNECTING"
        gh2py_manager = GrasshopperToPythonRemote(
            rpyc_server_py,
            location=location,
            timeout=10,
            port=None,
            log_level=log_level,
            working_dir=working_dir,
        )
        gh2py = gh2py_manager.__enter__()
        remote_python_status = "OPEN"

    # Stuff that we can reach
    rpymod = gh2py.py_remote_modules  # A getter function for a named python module
    rpy = gh2py.connection  # Represents the remote instance root object
    scriptcontext.sticky["rpy"] = rpy
    # Add modules
    for mod in modules:
        try:
            scriptcontext.sticky[mod] = rpymod(mod)
            lkd_modules.add(mod)
        except ImportError:
            gh2py_manager.__exit__(*sys.exc_info())
            raise

elif not remote_python_status == "CLOSED":
    remote_python_status = "CLOSING"
    # Remove linked modules
    for mod in lkd_modules:
        del scriptcontext.sticky[mod]
    del scriptcontext.sticky["rpy"]
    gh2py_manager.__exit__(*sys.exc_info())
    lkd_modules = set()
    remote_python_status = "CLOSED"

# Change variable name because ghpython resets outputs to None before each run
linked_modules = lkd_modules

logger.info("GH to python connection is {}".format(remote_python_status))
# ---------- end ghpythonremote ----------
panel_5 = Panel(ghpythonremote.out)

# ----
python_2 = PythonScript(module_names=ghpythonremote.linked_modules)  # -> import_statements; inputs module_names: list
# ---------- python_2: Python ----------
import_statements = ["import scriptcontext as sc"]
for module_name in module_names:
    import_statements.append("{0} = sc.sticky['{0}']".format(module_name))

if len(module_names) == 0:
    import_statements = []
# ---------- end python_2 ----------
intersectingbricks = GhPythonScript(areas_list=createareas.areas_list, areas_dict=createareas.areas_dict)  # -> out, areas_list, areas_dict, intersecting_brick; inputs areas_list: list, areas_dict: list
# ---------- intersectingbricks: Python ----------
import rhinoscriptsyntax as rs
import Rhino.Geometry as rg
from compas_rhino import unload_modules
unload_modules('model')

from model import Brick, Area

areas_dict = areas_dict[0]

#to check intersect
intersecting_brick = []
for layer in areas_list:
    for a in layer:
        n_intersections, intersection_pairs = a.check_intersecting_bricks()
        for pair in intersection_pairs:
#            a.area_bricks.remove( pair[1] )
            intersecting_brick.append(pair[1].mesh())

areas_dict = [ areas_dict ] 

#for layer in areas_list:
#    for area in layer:
#        print(area.initial_number_bricks)
#
# ---------- end intersectingbricks ----------
panel_6 = Panel(python_2)
clustering = GhPythonScript(areas_list=intersectingbricks.areas_list)  # -> out, areas_list, areas_dict, clusters, label_tree, convex, mesh_bricks; inputs areas_list: list, areas_dict: list
# ---------- clustering: Python ----------
import rhinoscriptsyntax as rs
import Rhino.Geometry as rg
import ghpythonlib.treehelpers as th
import ghpythonlib.components as ghc
from compas_rhino import unload_modules
unload_modules('model')

from model import Brick, Area

areas_dict = areas_dict[0]

mesh_bricks = []


for layer in areas_list:
    if layer[0].layer == 0:
        continue
    for area in layer:
        bricks = []
        ave_planes = []
        clusters, points, labels = area.cluster_sub_layer_points()
        
        for cluster in clusters:
            if len(cluster) < 3:
                continue
            f = area.floating_edges(cluster)
            average_plane = area.average_planes(f)
            ave_planes.append( average_plane )
        
        for plane in ave_planes:
            if plane == None:
                continue
            b = Brick(plane)
            bricks.append(b)
            mesh_b = b.mesh()
            mesh_bricks.append(mesh_b)
        area.area_bricks = bricks

areas_dict = [ areas_dict ]
# ---------- end clustering ----------

# ---- group: Visualize outputs
first_layer_bricks = Mesh(createareas.first_brick_meshes)
layer_crvs = Curve(createareas.layer_curves)
b_area = Curve(createareas.b_area)
intersecting_bricks = Mesh(intersectingbricks.intersecting_brick)
cluster_hulls = Curve(clustering.convex)
mesh_bricks = Mesh(clustering.mesh_bricks)
convex = Curve(clustering.convex)
preview = CustomPreview(Geometry=mesh_bricks, Material=ColourSwatch(SwatchColor=RGBA(15, 131, 255, 210)))

# ----
floatingbricks = GhPythonScript(areas_list=clustering.areas_list)  # -> out, areas_list, areas_dict, floating_bricks, center_pts, convex_hulls; inputs areas_list: list, areas_dict: list
# ---------- floatingbricks: Python ----------
import rhinoscriptsyntax as rs
import Rhino.Geometry as rg
from compas_rhino import unload_modules
unload_modules('model')

from model import Brick, Area

areas_dict = areas_dict[0]

intersecting_brick = []
floating_bricks = []
convex_hulls = []
center_pts = []

for layer in areas_list:
    for a in layer:
        bricks,hulls,centers = a.find_floating_bricks()
        for i in range( len(bricks) ):
            floating_bricks.append( bricks[i].mesh() )

areas_dict = [ areas_dict ]
# ---------- end floatingbricks ----------
brick_index = Slider(0, range=0..20)
python_3 = GhPythonScript(areas_list=floatingbricks.areas_list, brick_index=brick_index)  # -> out, a; inputs areas_list: list, brick_index: Int32
# ---------- python_3: Python ----------
a = []
test_brick = areas_list[1][0].area_bricks[brick_index]
sup_b = test_brick.supporting_bricks
for b in sup_b:
    a.append(b.mesh())
# ---------- end python_3 ----------
floating_bricks = Mesh(floatingbricks.floating_bricks)

crv_8 = Curve(<curve referenced from the Rhino model>)
crv_9 = Curve(<curve referenced from the Rhino model>)
boundary = BoundarySurfaces(Edges=crv_9)
boundary_2 = BoundarySurfaces(Edges=crv_8)
rint = RegionIntersection(CurvesA=crv_8, CurvesB=crv_9)
brep = Brep(boundary_2)
brep_2 = Brep(boundary)
python_4 = GhPythonScript(x=brep, y=brep_2)  # -> out, a, b; inputs x: Brep, y: Brep
# ---------- python_4: Python ----------
import Rhino.Geometry as rg

tol = 0.01

a = rg.Brep.CreateBooleanIntersection(x, y, tol)
print(a)
b = a[0].DuplicateVertices()
# ---------- end python_4 ----------
python_5 = GhPythonScript(x=crv_8, y=crv_9)  # -> out, a, b, c; inputs x: Curve, y: Curve
# ---------- python_5: Python ----------
import Rhino.Geometry as rg

a = rg.Curve.CreateBooleanIntersection(x, y)
print(a[0])

b = rg.NurbsCurve.ToPolyline(a[0], 0.01, 0.01, 0.01, 0.01)
print(b)
c = b.Point(0)
# ---------- end python_5 ----------
brep_3 = Brep(python_4.a)

mesh = Mesh(python_3.a)
preview_2 = CustomPreview(Geometry=floating_bricks, Material=ColourSwatch(SwatchColor=RGBA(255, 231, 15, 185)))
preview_3 = CustomPreview(Geometry=mesh, Material=ColourSwatch(SwatchColor=RGB(15, 255, 43)))
brep_4 = Brep(<brep referenced from the Rhino model>)
brep_5 = Brep(<brep referenced from the Rhino model>)
python_6 = GhPythonScript(x=brep_5, y=brep_4)  # -> out, a, b; inputs x: Brep, y: Brep; same code as python_4
crv_10 = Curve(<curve referenced from the Rhino model>)
crv_11 = Curve(<curve referenced from the Rhino model>)
python_7 = GhPythonScript(x=crv_10, y=crv_11)  # -> out, a; inputs x: Curve, y: Curve
# ---------- python_7: Python ----------
import Rhino.Geometry as rg

tol = 0.01
tol2 = 0.01

CI = rg.Intersect.Intersection.CurveCurve(x, y, tol, tol2)

print(CI.Count)
# ---------- end python_7 ----------
panel_7 = Panel(python_7.out)
python_8 = GhPythonScript(x=brep, y=brep_2)  # -> out, a
# ---------- python_8: Python ----------
__author__ = "trtku"
__version__ = "2020.11.09"

import rhinoscriptsyntax as rs
a = rs.IntersectBreps(x, y)
# ---------- end python_8 ----------
