# Grasshopper definition populate_bricks_floating.ghx (Grasshopper 1.0.7)

crv = Curve([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])
crv_2 = Curve([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])
crv_3 = Curve([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])
crv_4 = Curve([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])
crv_5 = Curve([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])
cluster = Cluster(crv=crv)
cluster_2 = Cluster(crv=crv_2)
cluster_3 = Cluster(crv=crv_3)
cluster_4 = Cluster(crv=crv_4)
cluster_5 = Cluster(crv=crv_5)
pln = Plane(cluster)
pln_2 = Plane(cluster_2)
pln_3 = Plane(cluster_3)
pln_4 = Plane(cluster_4)
pln_5 = Plane(cluster_5)

# ---- group: initial_crv_sample
line_for_test = Curve(reparameterize(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))
crv_for_test = Curve(reparameterize(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))

# ----
design_crv = Curve(reparameterize(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))
number_slider = Slider(2, range=0..10)  # disabled
pln_6 = Plane([Plane(origin=(14.5, 40.95556769, 0), x=(-1, 0, 0), y=(0, -1, 0)), Plane(origin=(14.82080859, 16.47778373, 0), x=(-0.5680647805, 0.8229838426, 0), y=(-0.8229838426, -0.5680647805, 0)), Plane(origin=(12.62190122, 65.35014243, 0), x=(0.3546049349, -0.9350162245, 0), y=(0.9350162245, 0.3546049349, 0)), Plane(origin=(16.15838737, 91.37115654, 0), x=(0.7485108568, -0.6631225356, 0), y=(0.6631225356, 0.7485108568, 0)), Plane(origin=(16.15838737, 112.746932, 0), x=(0.7485108568, -0.6631225356, 0), y=(0.6631225356, 0.7485108568, 0)), Plane(origin=(33.14714765, 64.31414184, 0), x=(-0.1205370056, 0.9927088346, 0), y=(-0.9927088346, -0.1205370056, 0))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])  # disabled
# Turn me on!   -->
python = PythonScript()  # -> rhino_doc_dir
# ---------- python: Python ----------
import scriptcontext as sc
from os import path

rhino_doc_dir = path.abspath(path.dirname(sc.doc.Path))
# ---------- end python ----------

crv_6 = Curve(reparameterize(design_crv))

divdist = DivideDistance(Curve=crv_6, Distance=Slider(150, range=0..200))  # -> Points, Tangents, Parameters
graph = GraphMapper(
    divdist.Parameters,
    x0=0,
    x1=1,
    y0=0,
    y1=1,
    container_name="Bezier",
    cpx=[0, 0.1085271314, 0.9085272551, 1],
    cpy=[0, 0.4688524604, 0.3934426308, 1])
eval = EvaluateCurve(Curve=crv_6, Parameter=graph)  # -> Point, Tangent, Angle
dist = Distance(PointA=graft(eval.Point), PointB=eval.Point)  # -> flatten(Distance)
mindist = GhPythonScript(x=dist)  # -> minDist; inputs x: list
# ---------- mindist: Python ----------
X = [i for i in x if i != 0]

minDist = min(X)

print(minDist)
# ---------- end mindist ----------
min_distance = Panel(mindist)

# ---- group: w_params (ot change width of b_area)
t_parameter = Number(divdist.Parameters)
shift = ShiftList(List=t_parameter, Shift=1, Wrap=False)
bnd = Bounds(Numbers=shift)
dom = ConstructDomain(DomainStart="0", DomainEnd="1")
remap = RemapNumbers(Value=shift, Source=bnd, Target=dom)  # -> Mapped, Clipped
graph_2 = GraphMapper(remap.Mapped, x0=0, x1=1, y0=0, y1=1, Ox=0.5, Oy=0, Px=0.75, Py=0.25, container_name="Parabola")
panel = Panel(graph_2)

# ----
createareas = GhPythonScript(params=graph, starting_curve=crv_6, w_params=graph_2, layers=number_slider)  # -> out, areas_list, areas_dict, layer_curves, first_brick_meshes, b_area; inputs params: list, starting_curve: Curve, w_params: list, first_planes: list of Plane, layers: Int32; disabled
# ---------- createareas: Python ----------
import rhinoscriptsyntax as rs
import Rhino.Geometry as rg
import Rhino.DocObjects as rd
import ghpythonlib.components as ghc
import random
random.seed(2)
from compas_rhino import unload_modules
unload_modules('model')

from model import Brick, Area, areas_dict, areas_list


curve = starting_curve

def areas_on_curve(crv, layer,width, params=params):
    layer_areas = []
    for i, _ in enumerate(params[:-1]):
        key = "L{}A{}".format(layer, i)
        area = Area(initial_curve=crv, start_param=params[i], end_param=params[i+1], layer=layer, area_index=i, width=width)
        areas_dict[key] = area
        layer_areas.append(area)
    return layer_areas

def move_curve_up(crv, height=Brick.REFERENCE_HEIGHT, trim_factor=0.0):
    V = rg.Vector3d.ZAxis * height
    crv.Translate(V)
    length = crv.GetLength()
    new_length = length * (1.0 - trim_factor)
    trim_length = (length - new_length) / 2
    _ , p0 = crv.LengthParameter(trim_length)
    _ , p1 = crv.LengthParameter(length - trim_length)
    trim = crv.Trim(rg.Interval(p0,p1))
    trim.Domain = rg.Interval(0.0, 1.0)
    return trim

def bbox_boolean_intersect(bbox_a, bbox_b):
    if (bbox_a.Min.X < bbox_b.Max.X) and (bbox_a.Max.X > bbox_b.Min.X) and (bbox_a.Min.Y < bbox_b.Max.Y) and (bbox_a.Max.Y > bbox_b.Min.Y):
        return True
    else:
        return False



"""Run code"""

#parameters
max_width      = 100
shorten_factor = 1.0
density        = 0.6 #default=1.0
slope          = 1.0 #default=0.0
width_factor   = 2.5 #default=1.0

# create curve and Areas for each layer
for i in range(layers):
    layer_areas = areas_on_curve(crv=curve, layer=i, width=max_width)
    areas_list.append(layer_areas)
    curve = move_curve_up(curve)
    max_width *= shorten_factor

# this appends all layer curves to list so that we can visualize them
layer_curves = []
for l in areas_list:
    layer_curves.append(l[0].initial_curve)


"""Populate first layer with bricks &
Build topological model for Areas and store area_key in Area Class
- First populate ground layer with random bricks
- Second, initiate number of bricks for each area and store in self.initial_number_bricks
- Third find sub layer neighbors
"""
first_area_bricks = []
first_brick_meshes = []
b_area = []

for l in areas_list:
    for a in l:
        print(a.area_index)
        division_factor = width_factor/( w_params[ a.area_index ] +slope)
        # if first layer: populate areas with random bricks
        if a.sub_layer() is None:
            bounding_area = a.bounding_area(division_factor)
            b_area.append( bounding_area )
            num_b = a.num_brick(bounding_area, density=density)
            geo = ghc.BoundarySurfaces(bounding_area)
            pts = ghc.PopulateGeometry(geo, num_b, seed=0)
            planes = a.random_brick_planes(pts)
            
            bricks = []
            for plane in planes:
                bricks.append( Brick(plane) )
            a.area_bricks = bricks
            #just for visualisation
            for brick in bricks:
                first_area_bricks.append(brick)
                first_brick_meshes.append(brick.mesh())
            continue
        
        # initiate number of bricks for each area
        bounding_area = a.bounding_area(division_factor)
        b_area.append( bounding_area )
        num_b = a.num_brick(bounding_area, density=density)
        # add sub layer neighbors for every Area
        sub_neighbors = []
        bbox_a = a.project_bbox_extend_on_ground()
        sub_layer = areas_list[a.sub_layer()]
        for sub_area in sub_layer:
            bbox_b = sub_area.project_bbox_extend_on_ground()
            if bbox_boolean_intersect(bbox_a, bbox_b) is True:
                sub_neighbors.append(sub_area.area_key)
        a.sub_layer_neighbors = sub_neighbors



areas_dict = [ areas_dict ]
# ---------- end createareas ----------
createareas_2 = GhPythonScript(
    params=graph,
    starting_curve=crv_6,
    w_params=graph_2,
    f_planes_1=pln,
    f_planes_2=pln_2,
    f_planes_3=pln_3,
    f_planes_4=pln_4,
    f_planes_5=pln_5,
    layers=Slider(7, range=0..10))  # -> out, areas_list, areas_dict, layer_curves, first_brick_meshes, mesh_bricks_WALL, mesh_bricks_WALL_NEW, b_area, floating_bricks_WALL; inputs params: list, starting_curve: Curve, w_params: list, f_planes_1: list of Plane, f_planes_2: list of Plane, f_planes_3: list of Plane, f_planes_4: list of Plane, f_planes_5: list of Plane, layers: Int32
# ---------- createareas_2: Python ----------
import rhinoscriptsyntax as rs
import Rhino.Geometry as rg
import Rhino.DocObjects as rd
import ghpythonlib.components as ghc
import random
random.seed(2)
from compas_rhino import unload_modules
unload_modules('model')

from model import Brick, Area, areas_dict, areas_list


curve = starting_curve

def areas_on_curve(crv, layer,width, params=params):
    layer_areas = []
    for i, _ in enumerate(params[:-1]):
        key = "L{}A{}".format(layer, i)
        area = Area(initial_curve=crv, start_param=params[i], end_param=params[i+1], layer=layer, area_index=i, width=width)
        areas_dict[key] = area
        layer_areas.append(area)
    return layer_areas

def move_curve_up(crv, height=Brick.REFERENCE_HEIGHT, trim_factor=0.0):
    V = rg.Vector3d.ZAxis * height
    crv.Translate(V)
    length = crv.GetLength()
    new_length = length * (1.0 - trim_factor)
    trim_length = (length - new_length) / 2
    _ , p0 = crv.LengthParameter(trim_length)
    _ , p1 = crv.LengthParameter(length - trim_length)
    trim = crv.Trim(rg.Interval(p0,p1))
    trim.Domain = rg.Interval(0.0, 1.0)
    return trim

def bbox_boolean_intersect(bbox_a, bbox_b):
    if (bbox_a.Min.X < bbox_b.Max.X) and (bbox_a.Max.X > bbox_b.Min.X) and (bbox_a.Min.Y < bbox_b.Max.Y) and (bbox_a.Max.Y > bbox_b.Min.Y):
        return True
    else:
        return False

def cluster_and_put_bricks(area):
    bricks = []
    ave_planes = []
    mesh_bricks = []
    clusters, points, labels = area.cluster_sub_layer_points()
    
    if clusters is None:
        # if there are no clusters found, we cannot put new bricks so return empty list
        return None
    
    for cluster in clusters:
        if len(cluster) < 3:
            continue
        f = area.floating_edges(cluster)
        average_plane = area.average_planes(f)
        ave_planes.append( average_plane )

    for plane in ave_planes:
        if plane == None:
            continue
        b = Brick(plane)
        bricks.append(b)
        mesh_b = b.mesh()
        mesh_bricks.append(mesh_b)
    area.area_bricks = bricks
    return mesh_bricks

def delete_intersecting_bricks_first_iteration(area):
    area.area_bricks.sort(key=lambda x: x.n_intersections, reverse=True)
    max_intersections = area.area_bricks[0].n_intersections
    
    while max_intersections > 5:
        # if the first item in list (so with most intersections) has > 0 intersections --> remove brick
        removed_brick = area.area_bricks.pop(0)
        max_intersections = area.area_bricks[0].n_intersections

def delete_intersecting_bricks(area):
    area.area_bricks.sort(key=lambda x: x.n_intersections, reverse=True)
    worst_brick = area.area_bricks[0]
    if worst_brick.n_intersections > 0:
        removed_brick = area.area_bricks.pop(0)


"""Run code"""

#parameters
max_width      = 100
shorten_factor = 1.0
density        = 1.0 #default=1.0
slope          = 1.0 #default=0.0
width_factor   = 4.0 #default=1.0

# create curve and Areas for each layer
for i in range(layers):
    layer_areas = areas_on_curve(crv=curve, layer=i, width=max_width)
    areas_list.append(layer_areas)
    curve = move_curve_up(curve)
    max_width *= shorten_factor

# this appends all layer curves to list so that we can visualize them
layer_curves = []
for l in areas_list:
    layer_curves.append(l[0].initial_curve)

"""Populate first layer with bricks &
Build topological model for Areas and store area_key in Area Class
- First populate ground layer with random bricks
- Second, initiate number of bricks for each area and store in self.initial_number_bricks
- Third build topoligical model with sub layer neighbors
"""
first_area_bricks = []
first_brick_meshes = []
b_area = []

for l in areas_list:
    for a in l:
        division_factor = width_factor/( w_params[ a.area_index ] +slope)
        # if first layer: populate areas with random bricks
        if a.sub_layer() is None:
            bricks = []
            if a.area_index == 0:
                
                for plane in f_planes_1:
                    bricks.append( Brick(plane) )
                a.area_bricks = bricks
#            if a.area_index == 1:
#                bricks = []
#                for plane in f_planes_2:
#                    bricks.append( Brick(plane) )
#                a.area_bricks = bricks
#            if a.area_index == 2:
#                bricks = []
#                for plane in f_planes_3:
#                    bricks.append( Brick(plane) )
#                a.area_bricks = bricks
#            if a.area_index == 3:
#                bricks = []
#                for plane in f_planes_4:
#                    bricks.append( Brick(plane) )
#                a.area_bricks = bricks
#            if a.area_index == 4:
#                bricks = []
#                for plane in f_planes_5:
#                    bricks.append( Brick(plane) )
#                a.area_bricks = bricks
            
            #just for visualisation
            for brick in bricks:
                first_area_bricks.append(brick)
                first_brick_meshes.append(brick.mesh())
            continue
        
        # initiate number of bricks for each area
        bounding_area = a.bounding_area(division_factor)
        b_area.append( bounding_area )
        num_b = a.num_brick(bounding_area, density=density)
        # add sub layer neighbors for every Area
        sub_neighbors = []
        bbox_a = a.project_bbox_extend_on_ground()
        sub_layer = areas_list[a.sub_layer()]
        for sub_area in sub_layer:
            bbox_b = sub_area.project_bbox_extend_on_ground()
            if bbox_boolean_intersect(bbox_a, bbox_b) is True:
                sub_neighbors.append(sub_area.area_key)
        a.sub_layer_neighbors = sub_neighbors


"""Second loop to populate the area with bricks
- Cluster and triangulate points and put the bricks in place
- Check for intersecting and floating bricks
"""
mesh_bricks_WALL = []
mesh_bricks_WALL_NEW = []
floating_bricks_WALL = []

for layer in areas_list:
    if layer[0].layer == 0:
        # we dont have to put bricks for first layer
        continue
    for area in layer[:1]:      # change here to run all all !!!!!!!!!!!!!!!!!!!!!!!!!!!!!!!!!!
        mesh_bricks_AREA = cluster_and_put_bricks(area)
        if mesh_bricks_AREA:
            mesh_bricks_WALL.extend(mesh_bricks_AREA)
            # check intersecting bricks inside area and with previous area
            n_intersections, intersection_pairs = area.check_intersecting_bricks()
#            if n_intersections > 0:
#                area.rotate_bricks(intersection_pairs)
#                n_intersections, intersection_pairs = area.check_intersecting_bricks()
            if n_intersections > 0:
                delete_intersecting_bricks_first_iteration(area)
                n_intersections, intersection_pairs = area.check_intersecting_bricks()
                
            # now delete more carefully
            while n_intersections > 0:
                n_intersections, intersection_pairs = area.check_intersecting_bricks()
                if n_intersections > 0:
                    delete_intersecting_bricks(area)
            # check floating bricks
            floating_bricks = area.find_floating_bricks(delete=False)
            floating_bricks_AREA = [ brick.mesh() for brick in floating_bricks ]
            floating_bricks_WALL.extend(floating_bricks_AREA)
#           
            # rotate last layer
#            if area.layer == layers - 1 or area.layer == layers - 2 or area.layer == layers - 3:
#                area.last_layer_rotate_bricks()

#            # create meshes
            mesh_bricks_AREA = [ b.mesh() for b in area.area_bricks ]
            mesh_bricks_WALL_NEW.extend(mesh_bricks_AREA)
        
        else:
            # no new bricks can be placed
            continue



areas_dict = [ areas_dict ]
# ---------- end createareas_2 ----------
crv_7 = Curve(createareas_2.b_area)
bricks = GhPythonScript(areas_list=createareas_2.areas_list)  # -> out, fabricate_bricks; inputs areas_list: list
# ---------- bricks: Python ----------
import rhinoscriptsyntax as rs
import Rhino.Geometry as rg
import Rhino.DocObjects as rd
import ghpythonlib.components as ghc
import random
random.seed(2)
from compas_rhino import unload_modules
unload_modules('model')

from model import Brick, Area

fabricate_bricks = []

for layer in areas_list:
    for area in layer:
        for brick in area.area_bricks:
            fabricate_bricks.append(brick)
# ---------- end bricks ----------
panel_2 = Panel("C:\Users\trtku\anaconda3\envs\rhinoremote\python.exe")
intersectingbricks = GhPythonScript(areas_list=createareas.areas_list, areas_dict=createareas.areas_dict)  # -> out, areas_list, areas_dict, intersecting_brick; inputs areas_list: list, areas_dict: list; disabled
# ---------- intersectingbricks: Python ----------
import rhinoscriptsyntax as rs
import Rhino.Geometry as rg
from compas_rhino import unload_modules
unload_modules('model')

from model import Brick, Area

areas_dict = areas_dict[0]

#to check intersect
intersecting_brick = []
polys = []
for layer in areas_list:
    for a in layer:
        
        n_intersections, intersection_pairs = a.check_intersecting_bricks()
        
        for pair in intersection_pairs:
            intersecting_brick.append(pair[0].mesh())

areas_dict = [ areas_dict ] 

#for layer in areas_list:
#    for area in layer:
#        print(area.initial_number_bricks)
#
# ---------- end intersectingbricks ----------
list = ValueList({"CRITICAL", "ERROR", "WARNING", "INFO", "DEBUG", "NOTSET"}, selected="DEBUG")

# ---- group: Import remote python modules
panel_3 = Panel(python)
panel_4 = Panel("""numpy
scipy
numpy.linalg
sklearn
sklearn.cluster""")
ghpythonremote = GHPythonRemote(
    location="C:\Users\simon\anaconda3\envs\rhinoremote\python.exe",
    run=Toggle(True),
    modules=panel_4,
    log_level=list,
    working_dir=panel_3)  # -> out, linked_modules, rpy; inputs run: Boolean, modules: list
# ---------- ghpythonremote: Python ----------
import inspect
import logging
from os import path
import sys
from time import sleep

import scriptcontext

import ghpythonremote
from ghpythonremote.connectors import GrasshopperToPythonRemote

local_log_level = getattr(logging, log_level, logging.WARNING)
logger = logging.getLogger("ghpythonremote")
logger.setLevel(local_log_level)
ch = logging.StreamHandler()
ch.setLevel(local_log_level)
formatter = logging.Formatter("%(levelname)s: %(name)s:\n%(message)s")
ch.setFormatter(formatter)
logger.handlers = []
logger.addHandler(ch)
logger = logging.getLogger("ghpythonremote.GH_to_python")

ROOT = path.abspath(path.dirname(inspect.getfile(ghpythonremote)))
rpyc_server_py = path.join(ROOT, "pythonservice.py")

# Set connection to CLOSED if this is the first run
# and initialize set of linked modules
try:
    remote_python_status
except NameError:
    remote_python_status = "CLOSED"
    lkd_modules = set()

# Wait for connection to connect or terminate
timer = 0
while remote_python_status == "CONNECTING" or remote_python_status == "CLOSING":
    sleep(1)
    timer += 1
    if timer == 10:
        try:
            gh2py_manager.__exit__(*sys.exc_info())
        except Exception:
            pass
        remote_python_status = "CLOSED"
        lkd_modules = set()
        raise RuntimeError(
            "Connection left in an inconsistent state and not returning. Reset "
            "everything."
        )

if run:
    if not remote_python_status == "OPEN":
        remote_python_status = "CONNECTING"
        gh2py_manager = GrasshopperToPythonRemote(
            rpyc_server_py,
            location=location,
            timeout=10,
            port=None,
            log_level=log_level,
            working_dir=working_dir,
        )
        gh2py = gh2py_manager.__enter__()
        remote_python_status = "OPEN"

    # Stuff that we can reach
    rpymod = gh2py.py_remote_modules  # A getter function for a named python module
    rpy = gh2py.connection  # Represents the remote instance root object
    scriptcontext.sticky["rpy"] = rpy
    # Add modules
    for mod in modules:
        try:
            scriptcontext.sticky[mod] = rpymod(mod)
            lkd_modules.add(mod)
        except ImportError:
            gh2py_manager.__exit__(*sys.exc_info())
            raise

elif not remote_python_status == "CLOSED":
    remote_python_status = "CLOSING"
    # Remove linked modules
    for mod in lkd_modules:
        del scriptcontext.sticky[mod]
    del scriptcontext.sticky["rpy"]
    gh2py_manager.__exit__(*sys.exc_info())
    lkd_modules = set()
    remote_python_status = "CLOSED"

# Change variable name because ghpython resets outputs to None before each run
linked_modules = lkd_modules

logger.info("GH to python connection is {}".format(remote_python_status))
# ---------- end ghpythonremote ----------
panel_5 = Panel(ghpythonremote.out)

# ----
python_2 = PythonScript(module_names=ghpythonremote.linked_modules)  # -> import_statements; inputs module_names: list
# ---------- python_2: Python ----------
import_statements = ["import scriptcontext as sc"]
for module_name in module_names:
    import_statements.append("{0} = sc.sticky['{0}']".format(module_name))

if len(module_names) == 0:
    import_statements = []
# ---------- end python_2 ----------
intersectingbricks_2 = GhPythonScript(areas_list=createareas_2.areas_list, areas_dict=createareas_2.areas_dict)  # -> out, areas_list, areas_dict, intersecting_brick; inputs areas_list: list, areas_dict: list; disabled
# ---------- intersectingbricks_2: Python ----------
import rhinoscriptsyntax as rs
import Rhino.Geometry as rg
from compas_rhino import unload_modules
unload_modules('model')

from model import Brick, Area

areas_dict = areas_dict[0]

##to check intersect
#intersecting_brick = []
#for layer in areas_list:
#    for a in layer:
#        print(a.area_bricks)
#        n_intersections, intersection_pairs = a.check_intersecting_bricks()
#        for pair in intersection_pairs:
##            a.area_bricks.remove( pair[1] )
#            intersecting_brick.append(pair[1].mesh())

areas_dict = [ areas_dict ] 

#for layer in areas_list:
#    for area in layer:
#        print(area.initial_number_bricks)
#
# ---------- end intersectingbricks_2 ----------
mesh = Mesh(createareas_2.first_brick_meshes)
mesh_2 = Mesh(createareas_2.mesh_bricks_WALL_NEW)
mesh_3 = Mesh(createareas_2.mesh_bricks_WALL)
geo = Geometry([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])
merge = Merge(Data1=mesh_2, Data2=mesh)
visualization = GhPythonScript(bricks=bricks.fabricate_bricks, robot_base=geo)  # -> out, geo, transformed_robot_base, v_w_p, s_crv; inputs bricks: list, robot_base: list of Brep
# ---------- visualization: Python ----------
"""Generates a 3D model of the wall

Returns
----------
geo : [Rhino Geometry Surface, Rhino Geometry Surface, ...]

"""
from compas_rhino import unload_modules
unload_modules('model')

import Rhino.Geometry as rg

from model import Fabrication
from model import Brick

planes = []
geo = []

for brick in bricks:
    geo.append(brick.mesh())

visualizeFabrication = Fabrication(brick_planes=planes)
visualizeFabrication.procedure(transform=False)


# return 
robot_matrix = visualizeFabrication.robot_transformation()
transformed_robot_base = []
for brep in robot_base:
    trans_brep = brep.Duplicate()
    trans_brep.Transform(robot_matrix)
    transformed_robot_base.append(trans_brep)
# ---------- end visualization ----------
fabrication = GhPythonScript()  # -> out, rhino_base_way_planes, robot_planes; inputs bricks: list
# ---------- fabrication: Python ----------
import Rhino.Geometry as rg
import simple_comm as c
import simple_ur_script as ur
from model import Brick
from compas_rhino import unload_modules
unload_modules('model')

import math as m

send = False

geo = []
rhino_base_way_planes = []
for brick in bricks:
    rhino_base_way_planes.append(brick.base_plane())
    
    

def tcp(script):
    """ This funktion sets tcp 
    """
    script += ur.set_tcp_by_angles(
        0.0, 0.0, 74.0, m.radians(0.0), m.radians(180.0), m.radians(0))
    return script

def set_robot_base_plane_from_pts():
    pt_0 = rg.Point3d(-554, -33, -4)  # base plane origin
    # point on base plane positive x direction
    pt_1 = rg.Point3d(-345, -33, -4)
    pt_2 = rg.Point3d(-554, 151, -4)  # point on base plane positive xy

    robot_base = rg.Plane(pt_0, pt_1-pt_0, pt_2-pt_0)
    return robot_base

def rhino_to_robot_space(rhino_plane):
    """ this funktion translates planes from the rhino cordinate system to
    the robot cordinate system 
    """
    robot_plane = rhino_plane.Clone()
    _r_matrix = rg.Transform.PlaneToPlane(
        rg.Plane.WorldXY, set_robot_base_plane_from_pts())
    print robot_plane.Origin
    print(robot_plane.Transform(_r_matrix))
    print robot_plane.Origin
    return robot_plane

def pickup_brick(pick_up_plane, script):
    """Pick up a brick procedure

    Parameters
    ----------
    pick_up_plane : rhino.geometry.plane
    
    Returns:
    Procedure for pickin up plane
    """
    accel = 0.4    # m/s2
    vel = 0.4      # m/s

    safe_distance = 50
    
    way_planes = []

    safe_plane = pick_up_plane.Clone()
    safe_plane.Translate(rg.Vector3d(0, 0, safe_distance))

    script += ur.move_l(safe_plane, 1.0, 1.0)
    way_planes.append(safe_plane)

    script += ur.move_l(pick_up_plane, accel, vel)
    way_planes.append(pick_up_plane)

    script += ur.set_digital_out(0, True)
    script += ur.sleep(0.5)

    script += ur.move_l(safe_plane, accel, vel)
    way_planes.append(safe_plane)

    return script 

def place_brick(plane, script):
    """
    this function gereates the robotic sequience for placing a brick
    Requires a plane wich describes the possition of the brick"""

    safe_distance = 50
    accel = 0.3
    vel = 0.3
    way_planes = []

    safe_plane = plane.Clone()
    safe_plane.Translate(rg.Vector3d(0, 0, safe_distance))

    script += ur.move_l(safe_plane, 1.0, 1.0)
    way_planes.append(safe_plane)

    script += ur.move_l(plane, accel, vel)
    way_planes.append(plane)

    script += ur.set_digital_out(0, False)
    script += ur.sleep(0.3)

    script += ur.move_l(safe_plane, 1.0, 1.0)
    way_planes.append(safe_plane)

    return script

""" Robotic fabrication procedure
"""
script = ""

script = tcp(script)



"""pick _up plane is measured in the robot base plane
"""
#pick_up_plane = rg.Plane(rg.Point3d(-59, 509, 5), rg.Vector3d.XAxis, rg.Vector3d.YAxis)
#
#robot_planes = []
#
#"""We are translating all way_planes from rhino base to robot_base
#"""
#for rhino_plane in (rhino_base_way_planes):
#    robot_planes.append(rhino_to_robot_space(rhino_plane))
#
#
#
#for robot_plane in (robot_planes):
#    #pick up a plane 
#    script = pickup_brick(pick_up_plane, script)
#    script = place_brick(robot_plane, script)
#
#script = c.concatenate_script(script)


"""
Carlos
""" 

pick_up_planes =[]
for i in range(6):  # rows x-direction
    for j in range(12):  # rows y-direction
        x_pos = i * (Brick.REFERENCE_LENGTH)
        y_pos = j * (Brick.REFERENCE_WIDTH)
        origin = rg.Point3d(-59+x_pos, 509-y_pos, 2)
        pick_up_plane = rg.Plane(origin, rg.Vector3d.XAxis, rg.Vector3d.YAxis)
        pick_up_planes.append(pick_up_plane)
pick_up_planes.reverse()
robot_planes = []
"""We are translating all way_planes from rhino base to robot_base
"""
for rhino_plane in (rhino_base_way_planes):
    robot_planes.append(rhino_to_robot_space(rhino_plane))
for robot_plane, pick_up_plane in zip(robot_planes, pick_up_planes):
    #pick up a plane 
    script = pickup_brick(pick_up_plane, script)
    script = place_brick(robot_plane, script)
script = c.concatenate_script(script)


if send:
    c.send_script(script, "192.168.10.10")
# ---------- end fabrication ----------
clustering = GhPythonScript(areas_list=intersectingbricks.areas_list, areas_dict=intersectingbricks.areas_dict)  # -> out, areas_list, areas_dict, clusters, label_tree, convex, mesh_bricks; inputs areas_list: list, areas_dict: list; disabled
# ---------- clustering: Python ----------
import rhinoscriptsyntax as rs
import Rhino.Geometry as rg
import ghpythonlib.treehelpers as th
import ghpythonlib.components as ghc
from compas_rhino import unload_modules
unload_modules('model')

from model import Brick, Area

areas_dict = areas_dict[0]

mesh_bricks = []


for layer in areas_list:
    if layer[0].layer == 0:
        continue
    for area in layer:
        bricks = []
        ave_planes = []
        clusters, points, labels = area.cluster_sub_layer_points()
        
        for cluster in clusters:
            if len(cluster) < 3:
                continue
            f = area.floating_edges(cluster)
            average_plane = area.average_planes(f)
            ave_planes.append( average_plane )
        
        for plane in ave_planes:
            if plane == None:
                continue
            b = Brick(plane)
            bricks.append(b)
            mesh_b = b.mesh()
            mesh_bricks.append(mesh_b)
        area.area_bricks = bricks

areas_dict = [ areas_dict ]
# ---------- end clustering ----------

# ---- group: Visualize outputs
first_layer_bricks = Mesh(createareas.first_brick_meshes)  # disabled
layer_crvs = Curve(createareas.layer_curves)  # disabled
b_area = Curve(createareas.b_area)  # disabled
intersecting_bricks = Mesh(intersectingbricks.intersecting_brick)  # disabled
cluster_hulls = Curve(clustering.convex)  # disabled
mesh_bricks = Mesh(clustering.mesh_bricks)  # disabled
convex = Curve(clustering.convex)  # disabled
swatch = ColourSwatch(SwatchColor=RGBA(15, 131, 255, 210))  # disabled
preview = CustomPreview(Geometry=mesh_bricks, Material=swatch)  # disabled

# ----
clustering_2 = GhPythonScript(areas_list=intersectingbricks_2.areas_list)  # -> out, areas_list, areas_dict, clusters, label_tree, convex, mesh_bricks; inputs areas_list: list, areas_dict: list; same code as clustering
panel_6 = Panel(python_2)
floatingbricks = GhPythonScript(areas_list=clustering_2.areas_list)  # -> out, areas_list, areas_dict, floating_bricks, center_pts, convex_hulls; inputs areas_list: list, areas_dict: list
# ---------- floatingbricks: Python ----------
import rhinoscriptsyntax as rs
import Rhino.Geometry as rg
from compas_rhino import unload_modules
unload_modules('model')

from model import Brick, Area

areas_dict = areas_dict[0]

intersecting_brick = []
floating_bricks = []
convex_hulls = []
center_pts = []

for layer in areas_list:
    for a in layer:
        bricks,hulls,centers = a.find_floating_bricks()
        for i in range( len(bricks) ):
            floating_bricks.append( bricks[i].mesh() )

areas_dict = [ areas_dict ]
# ---------- end floatingbricks ----------
grp = Group(visualization.geo)
geo_2 = Geometry(visualization.transformed_robot_base)
geo_3 = Geometry(visualization.v_w_p)
geo_4 = Geometry(visualization.s_crv)
floatingbricks_2 = GhPythonScript(areas_list=clustering.areas_list, areas_dict=clustering.areas_dict)  # -> out, areas_list, areas_dict, floating_bricks, center_pts, convex_hulls; inputs areas_list: list, areas_dict: list; disabled; same code as floatingbricks
brick_index = Slider(0, range=0..20)  # disabled

# ---- group: VISUALISE
brick_index_2 = Slider(0, range=0..20)
python_3 = GhPythonScript(areas_list=floatingbricks.areas_list, brick_index=brick_index_2)  # -> out, a; inputs areas_list: list, brick_index: Int32
# ---------- python_3: Python ----------
a = []
test_brick = areas_list[1][0].area_bricks[brick_index]
sup_b = test_brick.supporting_bricks
for b in sup_b:
    a.append(b.mesh())
# ---------- end python_3 ----------
supporting_bricks = Mesh(python_3.a)
floating_bricks = Mesh(createareas_2.floating_bricks_WALL)
_2nd_layer = Mesh(clustering_2.mesh_bricks)
_1st_layer = Mesh(createareas_2.first_brick_meshes)
preview_2 = CustomPreview(Geometry=_1st_layer, Material=ColourSwatch(SwatchColor=RGBA(255, 15, 15, 185)))
preview_3 = CustomPreview(Geometry=_2nd_layer, Material=ColourSwatch(SwatchColor=RGBA(15, 131, 255, 34)))
preview_4 = CustomPreview(Geometry=floating_bricks, Material=ColourSwatch(SwatchColor=RGB(255, 231, 15)))
preview_5 = CustomPreview(Geometry=supporting_bricks, Material=ColourSwatch(SwatchColor=RGB(15, 255, 43)))

# ----
python_4 = GhPythonScript(areas_list=floatingbricks_2.areas_list, brick_index=brick_index)  # -> out, a; inputs areas_list: list, brick_index: Int32; disabled; same code as python_3
floating_bricks_2 = Mesh(floatingbricks_2.floating_bricks)  # disabled
swatch_2 = ColourSwatch(SwatchColor=RGBA(255, 231, 15, 185))  # disabled
swatch_3 = ColourSwatch(SwatchColor=RGB(15, 255, 43))  # disabled
mesh_4 = Mesh(python_4.a)  # disabled
preview_6 = CustomPreview(Geometry=floating_bricks_2, Material=swatch_2)  # disabled
preview_7 = CustomPreview(Geometry=mesh_4, Material=swatch_3)  # disabled

# ==== cluster Cluster
crv = ClusterInput()
crv_2 = Curve(crv)
explode = Explode(Curve=crv_2, Recursive=True)  # -> Segments, Vertices
area = Area(Geometry=crv_2)  # -> Area, Centroid
item = ListItem(List=explode.Segments, Index=0, Wrap=True)  # -> Item, Item1, Item2, Item3
midpt = CurveMiddle(Curve=item.Item1)
midpt_2 = CurveMiddle(Curve=item.Item3)
midpt_3 = CurveMiddle(Curve=item.Item)
midpt_4 = CurveMiddle(Curve=item.Item2)
vec2pt = Vector2Pt(PointA=midpt, PointB=midpt_2, Unitize=False)  # -> flatten(Vector), Length
vec2pt_2 = Vector2Pt(PointA=midpt_3, PointB=midpt_4, Unitize=False)  # -> flatten(Vector), Length
pl = ConstructPlane(Origin=area.Centroid, XAxis=vec2pt.Vector, YAxis=vec2pt_2.Vector)
pl_2 = ClusterOutput(pl)
