# Grasshopper definition robotic_brick_basic rotation.gh (Grasshopper 1.0.7)

geo = Geometry([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])
geo_2 = Geometry([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])
bricks = GhPythonScript(robot_base_geometry=geo_2)  # -> out, surfaces, planes, robot_crv, transformed_robot_base; inputs robot_base_geometry: list of Brep
# ---------- bricks: Python ----------
from compas_rhino import unload_modules
unload_modules('model')

from model import Wall
from model import Fabrication
import Rhino.Geometry as rg



myWall = Wall(10,10)
surfaces, visualisation, robot_transformation = myWall.geometric_model()
#script, visualisation_robot_coordinate_system = myWall.fabrication_model()
#print(type(robot_transformation))
#planes, robot_crv = visualisation_robot_coordinate_system


#print (script)
transformed_robot_base = []
for geometry in robot_base_geometry:
    trans_geometry = geometry.Duplicate()
    trans_geometry.Transform(robot_transformation)
    transformed_robot_base.append(trans_geometry)
# ---------- end bricks ----------
bricks_2 = GhPythonScript(robot_base_geometry=geo)  # -> out, surfaces, planes, robot_crv, transformed_robot_base, meshes; inputs robot_base_geometry: list of Brep
# ---------- bricks_2: Python ----------
from compas_rhino import unload_modules
unload_modules('model')


from model import Brick
from model import Fabrication
import Rhino.Geometry as rg
import math as m


planes = []
meshes = []
#for i in range (1):
#    for j in range (2):
#        if i % 2 == 1:
#            x_value = (Brick.REFERENCE_LENGTH * j)+(1*j) 
#            
#            z_value = Brick.REFERENCE_HEIGHT * i +i*1
#            
#            
#        else:
#            x_value = (Brick.REFERENCE_LENGTH * j)+(1*j) 
#            
#            z_value = Brick.REFERENCE_HEIGHT * i +i*1
            
plane_origin = rg.Point3d(0,0,0)
plane = rg.Plane(plane_origin, rg.Vector3d.XAxis, rg.Vector3d.YAxis)
plane_rot = plane.Rotate(m.radians(30), rg.Vector3d.ZAxis)

myBrick = Brick(plane) 
myBricks_rot = Brick(plane_rot)
#myBrick_rot = Brick(plane_rot)

print plane_rot
planes.append(myBrick_rot.picking_plane())
meshes.append(myBrick_rot.mesh())
print meshes

        #planes.append()
# ---------- end bricks_2 ----------
geo_3 = Geometry(bricks.surfaces)
geo_4 = Geometry(bricks_2.meshes)
geo_5 = Geometry(bricks.planes)
geo_6 = Geometry(bricks_2.surfaces)
geo_7 = Geometry(bricks.robot_crv)
geo_8 = Geometry(bricks_2.planes)
geo_9 = Geometry(bricks.transformed_robot_base)
geo_10 = Geometry(bricks_2.robot_crv)
item = ListItem(List=bricks.surfaces, Index=Slider(94, range=0..100), Wrap=True)
geo_11 = Geometry(bricks_2.transformed_robot_base)
item_2 = ListItem(List=bricks_2.surfaces, Index=Slider(94, range=0..100), Wrap=True)
geo_12 = Geometry(item)
geo_13 = Geometry(item_2)
