# Grasshopper definition robotic_brick_laying.ghx (Grasshopper 1.0.7)

geo = Geometry([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])
bricks = GhPythonScript(robot_base_geometry=geo)  # -> out, surfaces, plane, robot_crv, transformed_robot_base; inputs robot_base_geometry: list of Brep
# ---------- bricks: Python ----------
from compas_rhino import unload_modules
unload_modules('model')

import Rhino.Geometry as rg

from model import Brick



planes = rg.Plane(rg.Point3d(0,0,100), rg.Vector3d.XAxis, rg.Vector3d.YAxis)
# ---------- end bricks ----------
geo_2 = Geometry(bricks.surfaces)
geo_3 = Geometry(bricks.transformed_robot_base)
geo_4 = Geometry(bricks.plane)
geo_5 = Geometry(bricks.robot_crv)
item = ListItem(List=bricks.surfaces, Index=Slider(94, range=0..100), Wrap=True)
geo_6 = Geometry(item)
