# Grasshopper definition robotic_brick_laying_02.ghx (Grasshopper 1.0.7)

# ---- group: contour from brep
number_slider = Slider(10, range=0..10)  # disabled
brep = Brep(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)  # disabled
scale = Scale(Geometry=brep, Center=Point(0, 0, 0), Factor=number_slider)  # -> Geometry, Transform; disabled
python = GhPythonScript(input_brep=scale.Geometry)  # -> out, contour_curves; inputs input_brep: Brep; disabled
# ---------- python: Python ----------
__author__ = "WeiTingChen"
__version__ = "2020.10.09"
from compas_rhino import unload_modules
unload_modules('model')

from model import Brick
import rhinoscriptsyntax as rs
import Rhino.Geometry as rg
import ghpythonlib.components as gh


rg.Brep.GetBoundingBox
# get the bb and its corners
bounding_box = input_brep.GetBoundingBox(True)
corners = bounding_box.GetCorners()


# generate high and low placeholder values
min_z  = -1000
max_z  = 1000

for pt in corners:
    if pt.Z < min_z:
        min_z = pt.Z
    elif pt.Z > max_z:
        max_z = pt.Z

# return min_z, max_z

contour_curves = rg.Brep.CreateContourCurves(input_brep, 
                 rg.Point3d(0, 0, min_z), rg.Point3d(0, 0, max_z), Brick.REFERENCE_HEIGHT)
# ---------- end python ----------
python_2 = GhPythonScript(curves=python.contour_curves)  # -> out, planes; inputs curves: list of Curve; disabled
# ---------- python_2: Python ----------
__author__ = "WeiTingChen"
__version__ = "2020.10.09"

import rhinoscriptsyntax as rs
import Rhino.Geometry as rg
import ghpythonlib.components as gh

from compas_rhino import unload_modules
unload_modules('model')

from model import Brick



def curve_to_planes():
    brick_planes = []
    for curve in curves:
        params = curve.DivideByLength(Brick.REFERENCE_LENGTH, False)
        for param in params:
            brick_pos = rg.Curve.PointAt(curve, param)
            brick_tan = rg.Curve.TangentAt(curve, param) # follow like tangenAt
            vec1 = rg.Vector3d.CrossProduct(brick_tan, rg.Vector3d.ZAxis)
            vec2 = rg.Vector3d.CrossProduct(vec1, rg.Vector3d.ZAxis)
            
            plane = rg.Plane(brick_pos,vec1, vec2)
            brick_planes.append(plane)
    return brick_planes

planes = curve_to_planes()
# ---------- end python_2 ----------

# ----
geo = Geometry([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])  # disabled
crv = Curve(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)
bricks = GhPythonScript(robot_base_geometry=geo)  # -> out, surfaces, planes, robot_crv, transformed_robot_base; inputs robot_base_geometry: list of Brep; disabled
# ---------- bricks: Python ----------
from compas_rhino import unload_modules
unload_modules('model')

from model import Wall
from model import Fabrication
import Rhino.Geometry as rg



myWall = Wall(5,10)
surfaces, visualisation, robot_transformation = myWall.geometric_model()
script, visualisation_robot_coordinate_system = myWall.fabrication_model()
print(type(robot_transformation))
planes, robot_crv = visualisation_robot_coordinate_system


#print (script)
transformed_robot_base = []
for geometry in robot_base_geometry:
    # rg.NurbsCurve.Duplicate()
    trans_geometry = geometry.Duplicate()
    trans_geometry.Transform(robot_transformation)
    transformed_robot_base.append(trans_geometry)
# ---------- end bricks ----------

# ---- group: find the plane by direction
python_3 = GhPythonScript(curves=crv)  # -> out, planes; inputs curves: list of Curve; same code as python_2

# ----
number_slider_2 = Slider(94, range=0..100)  # disabled
item = ListItem(List=bricks.surfaces, Index=number_slider_2, Wrap=True)  # disabled
geo_2 = Geometry(bricks.planes)  # disabled
geo_3 = Geometry(bricks.surfaces)  # disabled
geo_4 = Geometry(bricks.robot_crv)  # disabled
geo_5 = Geometry(bricks.transformed_robot_base)  # disabled
geo_6 = Geometry(item)  # disabled
row = Slider(5, range=0..100)  # disabled
column = Slider(10, range=0..100)  # disabled
python_4 = GhPythonScript()  # -> out, brick_planes; disabled
# ---------- python_4: Python ----------
from compas_rhino import unload_modules
unload_modules('model')
import Rhino.Geometry as rg
from model import Brick

x_cnt = 10
z_cnt = 5

b_length = Brick.REFERENCE_LENGTH
b_width = Brick.REFERENCE_WIDTH
b_height = Brick.REFERENCE_HEIGHT

brick_planes = []
for i in range(z_cnt):  # layer count
    for j in range(x_cnt):  # layer length

        if i % 2 == 0:
            x_pos = j * (b_length+1)
        else:
            x_pos = j * (b_length+1) + (b_length/2)-1

        z_pos = i * (b_height)
        origin = rg.Point3d(x_pos, 0, z_pos)
        plane = rg.Plane(origin, rg.Vector3d.XAxis, rg.Vector3d.YAxis)
        Attractor = rg.Point3d(10,10,0)
        distance = Attractor.DistanceTo(origin)
        rotation = distance * 0.3
        plane.Rotate(rotation, rg.Vector3d.ZAxis)
        brick_planes.append(plane)
# ---------- end python_4 ----------
python_5 = GhPythonScript()  # -> out, plane, mesh, surface, pick_plane, brick_points; disabled
# ---------- python_5: Python ----------
__author__ = "WeiTingChen"
__version__ = "2020.10.09"

from compas_rhino import unload_modules
unload_modules('model')

import Rhino.Geometry as rg
from model import Brick

plane = rg.Plane(rg.Point3d(0,0,100), rg.Vector3d.XAxis, rg.Vector3d.YAxis)



myFirstBrick  = Brick(plane)
mesh =  myFirstBrick.mesh()
surface = myFirstBrick.surface()
pick_plane = myFirstBrick.picking_plane()


brick_points = myFirstBrick.pts()

print(mesh)
# ---------- end python_5 ----------
pt = Point(Point(31, 5, 20.63717683))  # disabled
plnaxis = PlaneAxis(P=python_5.pick_plane, B=35)  # disabled
python_6 = GhPythonScript(row=row, column=column, iAttractor=pt)  # -> out, surfaces; inputs row: Int32, column: Int32, iAttractor: Point3d; disabled
# ---------- python_6: Python ----------
__author__ = "WeiTingChen"
__version__ = "2020.10.09"

import rhinoscriptsyntax as rs
import Rhino.Geometry as rg
import ghpythonlib.components as gh
from compas_rhino import unload_modules
unload_modules('brickmodel')
from brickmodel import Brick, Wall

myWall = Wall(row,column)
surfaces, visualisation, robot_transformation = myWall.geometric_model()
# ---------- end python_6 ----------
swatch = ColourSwatch(SwatchColor=RGB(145, 145, 145))  # disabled
preview = CustomPreview(Geometry=python_6.surfaces, Material=swatch)  # disabled

# ==== cluster PlaneAxis: show plane X Y Z axis.
P = ClusterInput()
B = ClusterInput()
deplane = DeconstructPlane(Plane=graft(P))  # -> Origin, XAxis, YAxis, ZAxis
multiplication = Multiplication(A=[deplane.XAxis, deplane.YAxis, deplane.ZAxis], B=B)
vdisex = VectorDisplayEx(
    Point=deplane.Origin,
    Vector=multiplication,
    Colour=[ColourSwatch(SwatchColor=RGB(235, 52, 52)), ColourSwatch(SwatchColor=RGB(90, 207, 48)), ColourSwatch(SwatchColor=RGB(54, 126, 227))],
    Width=2)
