# Grasshopper definition robotic_brick_laying_fabrication.ghx (Grasshopper 1.0.7)

bricks = GhPythonScript()  # -> out, bricks
# ---------- bricks: Python ----------
from compas_rhino import unload_modules
unload_modules('model')

import Rhino.Geometry as rg

from model import Brick

import math as m




bricks = []


for i in range(10):  # layer count
    for j in range(10):  # layer length

        if i % 2 == 0:
            x_pos = j * (Brick.REFERENCE_LENGTH+1)
            rotation = m.radians(10)
        else:
            x_pos = j * (Brick.REFERENCE_LENGTH+1) + (Brick.REFERENCE_LENGTH/2)-1
            rotation = m.radians(-10)

        z_pos = i * (Brick.REFERENCE_HEIGHT)

        origin = rg.Point3d(x_pos, 0, z_pos)
        plane = rg.Plane(origin, rg.Vector3d.XAxis, rg.Vector3d.YAxis)
        plane.Rotate(rotation, rg.Vector3d.ZAxis)
        bricks.append(Brick(plane))
# ---------- end bricks ----------

# ---- group: Robot Run
data = Data(["Grasshopper.Kernel.Types.GH_ObjectWrapper", "Grasshopper.Kernel.Types.GH_ObjectWrapper", "Grasshopper.Kernel.Types.GH_ObjectWrapper", "Grasshopper.Kernel.Types.GH_ObjectWrapper", "Grasshopper.Kernel.Types.GH_ObjectWrapper", "Grasshopper.Kernel.Types.GH_ObjectWrapper"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])
geo = Geometry([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])
visualization = GhPythonScript(bricks=bricks.bricks, robot_base=geo)  # -> out, geo, transformed_robot_base, v_w_p, s_crv; inputs bricks: list, robot_base: list of Brep
# ---------- visualization: Python ----------
"""Generates a 3D model of the wall

Returns
----------
geo : [Rhino Geometry Surface, Rhino Geometry Surface, ...]

"""
from compas_rhino import unload_modules
unload_modules('model')

import Rhino.Geometry as rg

from model import Fabrication
from model import Brick

planes = []
geo = []

for brick in bricks:
    geo.append(brick.mesh())

visualizeFabrication = Fabrication(brick_planes=planes)
visualizeFabrication.procedure(transform=False)


# return 
robot_matrix = visualizeFabrication.robot_transformation()
transformed_robot_base = []
for brep in robot_base:
    trans_brep = brep.Duplicate()
    trans_brep.Transform(robot_matrix)
    transformed_robot_base.append(trans_brep)
# ---------- end visualization ----------
fabrication = GhPythonScript(bricks=bricks.bricks)  # -> out, rhino_base_way_planes, robot_planes; inputs bricks: list
# ---------- fabrication: Python ----------
import Rhino.Geometry as rg
import simple_comm as c
import simple_ur_script as ur

import math as m

send = False

geo = []
rhino_base_way_planes = []
for brick in bricks:
    rhino_base_way_planes.append(brick.base_plane())
    
    


def tcp(script):
    """ This funktion sets tcp 
    """
    script += ur.set_tcp_by_angles(
        0.0, 0.0, 74.0, m.radians(0.0), m.radians(180.0), m.radians(0))
    return script

def set_robot_base_plane_from_pts():
    z = 0.9
    pt_0 = rg.Point3d(299, 63, z)  # base plane origin
    # point on base plane positive x direction
    pt_1 = rg.Point3d(499, 63, z)
    pt_2 = rg.Point3d(499, 299, z)  # point on base plane positive xy

    robot_base = rg.Plane(pt_0, pt_1-pt_0, pt_2-pt_0)
    return robot_base

def rhino_to_robot_space(rhino_plane):
    """ this funktion translates planes from the rhino cordinate system to
    the robot cordinate system 
    """
    robot_plane = rhino_plane.Clone()
    _r_matrix = rg.Transform.PlaneToPlane(
        rg.Plane.WorldXY, set_robot_base_plane_from_pts())
    print robot_plane.Origin
    print(robot_plane.Transform(_r_matrix))
    print robot_plane.Origin
    return robot_plane
    
    
    
def pickup_brick(pick_up_plane, script):
    """Pick up a brick procedure

    Parameters
    ----------
    pick_up_plane : rhino.geometry.plane
    
    Returns:
    Procedure for pickin up plane
    """
    accel = 0.1    # m/s2
    vel = 0.1      # m/s

    safe_distance = 50
    
    way_planes = []

    safe_plane = pick_up_plane.Clone()
    safe_plane.Translate(rg.Vector3d(0, 0, safe_distance))

    script += ur.move_l(safe_plane, accel, vel)
    way_planes.append(safe_plane)

    script += ur.move_l(pick_up_plane, accel, vel)
    way_planes.append(pick_up_plane)

    script += ur.set_digital_out(4, True)
    script += ur.sleep(1)

    script += ur.move_l(safe_plane, accel, vel)
    way_planes.append(safe_plane)

    return script 

def place_brick(plane, script):
    """
    this function gereates the robotic sequience for placing a brick
    Requires a plane wich describes the possition of the brick"""

    safe_distance = 50
    accel = 0.1
    vel = 0.1
    way_planes = []

    safe_plane = plane.Clone()
    safe_plane.Translate(rg.Vector3d(0, 0, safe_distance))

    script += ur.move_l(safe_plane, accel, vel)
    way_planes.append(safe_plane)

    script += ur.move_l(plane, accel, vel)
    way_planes.append(plane)

    script += ur.set_digital_out(4, False)
    script += ur.sleep(1)

    script += ur.move_l(safe_plane, accel, vel)
    way_planes.append(safe_plane)

    return script

""" Robotic fabrication procedure
"""
script = ""

script = tcp(script)



"""pick _up plane is measured in the robot base plane
"""
pick_up_plane = rg.Plane(rg.Point3d(-57, 507, 0), rg.Vector3d.XAxis, rg.Vector3d.YAxis) #adapt the pickup position, set z=10 to safe the tool

robot_planes = []

"""We are translating all way_planes from rhino base to robot_base
"""
for rhino_plane in (rhino_base_way_planes):
    robot_planes.append(rhino_to_robot_space(rhino_plane))



for robot_plane in (robot_planes):
    #pick up a plane 
    script = pickup_brick(pick_up_plane, script)
    script = place_brick(robot_plane, script)
    
script = c.concatenate_script(script)

send = True
if send:
    c.send_script(script, "192.168.10.10")
# ---------- end fabrication ----------
geo_2 = Geometry(visualization.transformed_robot_base)
grp = Group(visualization.geo)
geo_3 = Geometry(visualization.v_w_p)
geo_4 = Geometry(visualization.s_crv)
