# Grasshopper definition robotic_brick_laying_fabrication_ilaria.ghx (Grasshopper 1.0.7)

_0 = Number(0)
construct_point = ConstructPoint(XCoordinate=" -350", YCoordinate="-100", ZCoordinate=_0)
xy_plane = XYPlane(Origin=construct_point)
r = Slider(120, range=0..1000)
a = Slider(45, range=-180..360)
count = Slider(4, range=0..10)
arc = Arc(Plane=xy_plane, Radius=r, Angle=a)  # -> Arc, Length
mortar = Slider(1.5, range=0..2)
polar_array = PolarArray(Geometry=arc.Arc, Plane=xy_plane, Count=count, Angle=6.283185307)  # -> Geometry, Transform
ghpython_script = GhPythonScript(crv=polar_array.Geometry, mortar=mortar)  # -> out, brick_planes, planes, meshes, new_planes, bricks; inputs crv: Curve
# ---------- ghpython_script: Python ----------
from compas_rhino import unload_modules
unload_modules('model')

import rhinoscriptsyntax as rs
import Rhino.Geometry as rg

from model import Brick, Wall

blength = Brick.REFERENCE_LENGTH
bheight = Brick.REFERENCE_HEIGHT
bwidth = Brick.REFERENCE_WIDTH

planes = []
meshes = []
brick_planes = []
new_planes =[]
bricks = []

params = rg.Curve.DivideByLength (crv, (blength+bwidth)/2 + mortar, False)

layers = 10
for i in range(layers):
    for j in range(len(params)):
        param = params[j]
        brick_pos = rg.Curve.PointAt(crv, param)
        brick_tan = rg.Curve.TangentAt(crv, param)
        vec1 = rg.Vector3d.CrossProduct(brick_tan, rg.Vector3d.ZAxis)
        vec2 = rg.Vector3d.CrossProduct(vec1, rg.Vector3d.ZAxis)
        vec3 = rg.Vector3d.Negate(vec2)
        if j%2==0:
            plane = rg.Plane(brick_pos, vec2, vec1)
            plane.Translate(rg.Vector3d.ZAxis * i * bheight)
            rg.Plane.Translate(plane, vec1*(bwidth/2))
            brick_planes.append(plane)
        else:
            plane = rg.Plane(brick_pos, vec1, vec3)
            plane.Translate(rg.Vector3d.ZAxis * i * bheight)
            brick_planes.append(plane)
        myBrick = Brick(plane)
        bricks.append(myBrick)


"""
for i in range (10):
    clone_plane = rg.Plane.Clone(plane)
    rg.Plane.Translate(clone_plane, (i*bheight)*plane.ZAxis)
    new_planes.append(clone_plane)
    
    
if i%3==0:
    layer_offset = bwidth
    brick_pointing_out = True
    
elif i%3 == 1:
    layer_offset = bwidth*2
    brick_pointing_out = True
    
else:
    layer_offset = 0
    brick_pointing_out = False
    
    #myBrick = Brick(new_planes)
    #meshes.append(myBrick.mesh())
#print plane
myBrick = Brick(plane)
meshes.append(myBrick.mesh())
"""
# ---------- end ghpython_script ----------
bricks = GhPythonScript()  # -> out, bricks
# ---------- bricks: Python ----------
from compas_rhino import unload_modules
unload_modules('model')

import Rhino.Geometry as rg

from model import Brick

import math as m




bricks = []


for i in range(10):  # layer count
    for j in range(10):  # layer length

        if i % 2 == 0:
            x_pos = j * (Brick.REFERENCE_LENGTH+1)
            rotation = m.radians(10)
        else:
            x_pos = j * (Brick.REFERENCE_LENGTH+1) + (Brick.REFERENCE_LENGTH/2)-1
            rotation = m.radians(-10)

        z_pos = i * (Brick.REFERENCE_HEIGHT)

        origin = rg.Point3d(x_pos, 0, z_pos)
        plane = rg.Plane(origin, rg.Vector3d.XAxis, rg.Vector3d.YAxis)
        plane.Rotate(rotation, rg.Vector3d.ZAxis)
        bricks.append(Brick(plane))
# ---------- end bricks ----------
geo = Geometry([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])
geometry = Geometry(ghpython_script.brick_planes)
geometry_2 = Geometry(ghpython_script.planes)
geometry_3 = Geometry(ghpython_script.meshes)
geometry_4 = Geometry(ghpython_script.new_planes)
visualization = GhPythonScript(bricks=bricks.bricks, robot_base=geo)  # -> out, geo, transformed_robot_base, v_w_p, s_crv; inputs bricks: list, robot_base: list of Brep
# ---------- visualization: Python ----------
"""Generates a 3D model of the wall

Returns
----------
geo : [Rhino Geometry Surface, Rhino Geometry Surface, ...]

"""
from compas_rhino import unload_modules
unload_modules('model')

import Rhino.Geometry as rg

from model import Fabrication
from model import Brick

planes = []
geo = []

for brick in bricks:
    geo.append(brick.mesh())

visualizeFabrication = Fabrication(brick_planes=planes)
visualizeFabrication.procedure(transform=False)


# return 
robot_matrix = visualizeFabrication.robot_transformation()
transformed_robot_base = []
for brep in robot_base:
    trans_brep = brep.Duplicate()
    trans_brep.Transform(robot_matrix)
    transformed_robot_base.append(trans_brep)
# ---------- end visualization ----------

# ----
# Fabrication
fabrication = GhPythonScript(bricks=ghpython_script.bricks)  # -> out, rhino_base_way_planes, robot_planes; inputs bricks: list
# ---------- fabrication: Python ----------
import Rhino.Geometry as rg
import simple_comm as c
import simple_ur_script as ur

import math as m

send = False

geo = []
rhino_base_way_planes = []
for brick in bricks:
    rhino_base_way_planes.append(brick.base_plane())
    
    


def tcp(script):
    """ This funktion sets tcp 
    """
    script += ur.set_tcp_by_angles(
        0.0, 0.0, 74.0, m.radians(0.0), m.radians(180.0), m.radians(0))
    return script

def set_robot_base_plane_from_pts():

    pt_0 = rg.Point3d(299, 63, 2)  # base plane origin
    # point on base plane positive x direction
    pt_1 = rg.Point3d(499, 63, 2)
    pt_2 = rg.Point3d(499, 299, 2)  # point on base plane positive xy

    robot_base = rg.Plane(pt_0, pt_1-pt_0, pt_2-pt_0)
    return robot_base

def rhino_to_robot_space(rhino_plane):
    """ this funktion translates planes from the rhino cordinate system to
    the robot cordinate system 
    """
    robot_plane = rhino_plane.Clone()
    _r_matrix = rg.Transform.PlaneToPlane(
        rg.Plane.WorldXY, set_robot_base_plane_from_pts())
    print robot_plane.Origin
    print(robot_plane.Transform(_r_matrix))
    print robot_plane.Origin
    return robot_plane

def pickup_brick(pick_up_plane, script):
    """Pick up a brick procedure

    Parameters
    ----------
    pick_up_plane : rhino.geometry.plane
    
    Returns:
    Procedure for pickin up plane
    """
    accel = 0.1    # m/s2
    vel = 0.1      # m/s

    safe_distance = 50
    
    way_planes = []

    safe_plane = pick_up_plane.Clone()
    safe_plane.Translate(rg.Vector3d(0, 0, safe_distance))

    script += ur.move_l(safe_plane, accel, vel)
    way_planes.append(safe_plane)

    script += ur.move_l(pick_up_plane, accel, vel)
    way_planes.append(pick_up_plane)

    script += ur.set_digital_out(4, True)
    script += ur.sleep(1)

    script += ur.move_l(safe_plane, accel, vel)
    way_planes.append(safe_plane)

    return script 

def place_brick(plane, script):
    """
    this function gereates the robotic sequience for placing a brick
    Requires a plane wich describes the possition of the brick"""

    safe_distance = 50
    accel = 0.1
    vel = 0.1
    way_planes = []

    safe_plane = plane.Clone()
    safe_plane.Translate(rg.Vector3d(0, 0, safe_distance))

    script += ur.move_l(safe_plane, accel, vel)
    way_planes.append(safe_plane)

    script += ur.move_l(plane, accel, vel)
    way_planes.append(plane)

    script += ur.set_digital_out(4, False)
    script += ur.sleep(1)

    script += ur.move_l(safe_plane, accel, vel)
    way_planes.append(safe_plane)

    return script

""" Robotic fabrication procedure
"""
script = ""

script = tcp(script)



"""pick _up plane is measured in the robot base plane
"""
pick_up_plane = rg.Plane(rg.Point3d(-56, 505, 0), rg.Vector3d.XAxis, rg.Vector3d.YAxis)

robot_planes = []

"""We are translating all way_planes from rhino base to robot_base
"""
for rhino_plane in (rhino_base_way_planes):
    robot_planes.append(rhino_to_robot_space(rhino_plane))



for robot_plane in (robot_planes):
    #pick up a plane 
    script = pickup_brick(pick_up_plane, script)
    script = place_brick(robot_plane, script)
    
script = c.concatenate_script(script)


if send:
    c.send_script(script, "192.168.10.10")
# ---------- end fabrication ----------
geometry_5 = Geometry(fabrication.robot_planes)

grp = Group(visualization.geo)  # disabled
geo_2 = Geometry(visualization.transformed_robot_base)
geo_3 = Geometry(visualization.s_crv)
geo_4 = Geometry(visualization.v_w_p)
