# Grasshopper definition test_design_KO.ghx (Grasshopper 1.0.7)

series = Series(Start=0, Step=1, Count=Slider(50, range=10..100))
Z = UnitZ(Factor=series)
rectangle = Rectangle(Plane=PlaneXY(0, 0, 0), XSize=Slider(25, range=0..100), YSize=Slider(12, range=0..100), Radius=0)  # -> Rectangle, Length
move = Move(Geometry=rectangle.Rectangle, Motion=Z)  # -> Geometry, Transform
crv = Curve(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)
number_slider = Slider(1, range=1..100)
number_slider_2 = Slider(13, range=0..15)
number_slider_3 = Slider(4, range=1..10)
explode = Explode(Recursive=True)  # -> Segments, Vertices
item = ListItem(List=explode.Segments, Index=0, Wrap=True)  # -> Item, Item1, Item2, Item3
area = Area()  # -> Area, Centroid
midpt = CurveMiddle(Curve=item.Item)
midpt_2 = CurveMiddle(Curve=item.Item1)
midpt_3 = CurveMiddle(Curve=item.Item2)
midpt_4 = CurveMiddle(Curve=item.Item3)
vec2pt = Vector2Pt(PointA=midpt, PointB=midpt_3, Unitize=False)  # -> flatten(Vector), Length
rad = Radians(Degrees="90")
Z_2 = UnitZ(Factor=1)
vrot = Rotate(Vector=vec2pt.Vector, Axis=Z_2, Angle=rad)
pl = ConstructPlane(Origin=area.Centroid, XAxis=flatten(vec2pt.Vector), YAxis=vrot)
rotate = Rotate(Geometry=pl, Angle=rad, Plane=pl)  # -> Geometry, Transform
clean = CleanTree(RemoveNulls=True, RemoveInvalid=True, RemoveEmpty=False, Tree=rotate.Geometry)

# ----
# 8.8 sec
crv_2 = Curve(reparameterize(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))
# 471 mms
crv_3 = Curve(reparameterize(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))
# 30.9 sec
crv_4 = Curve(reparameterize(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))
crv_5 = Curve(reparameterize(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))
# 1.3 sec
crv_6 = Curve(reparameterize(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))
crv_7 = Curve(reparameterize(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))
crv_8 = Curve(reparameterize(crv_5))
# Turn me on!   -->
python = PythonScript()  # -> rhino_doc_dir
# ---------- python: Python ----------
import scriptcontext as sc
from os import path

rhino_doc_dir = path.abspath(path.dirname(sc.doc.Path))
# ---------- end python ----------

divdist = DivideDistance(Curve=crv_8, Distance=Slider(152, range=0..200))  # -> Points, Tangents, Parameters
graph = GraphMapper(
    divdist.Parameters,
    x0=0,
    x1=1,
    y0=0,
    y1=1,
    container_name="Bezier",
    cpx=[0, 0.1085271314, 0.9085272551, 1],
    cpy=[0, 0.4688524604, 0.3934426308, 1])
eval = EvaluateCurve(Curve=crv_8, Parameter=graph)  # -> Point, Tangent, Angle
dist = Distance(PointA=graft(eval.Point), PointB=eval.Point)  # -> flatten(Distance)
mindist = GhPythonScript(x=dist)  # -> minDist; inputs x: list
# ---------- mindist: Python ----------
X = [i for i in x if i != 0]

minDist = min(X)

print(minDist)
# ---------- end mindist ----------
min_distance = Panel(mindist)

panel = Panel("C:\Users\trtku\anaconda3\envs\rhinoremote\python.exe")
pln = Plane([Plane(origin=(14.5, 40.95556769, 0), x=(-1, 0, 0), y=(0, -1, 0)), Plane(origin=(14.82080859, 16.47778373, 0), x=(-0.5680647805, 0.8229838426, 0), y=(-0.8229838426, -0.5680647805, 0)), Plane(origin=(12.62190122, 65.35014243, 0), x=(0.3546049349, -0.9350162245, 0), y=(0.9350162245, 0.3546049349, 0)), Plane(origin=(16.15838737, 91.37115654, 0), x=(0.7485108568, -0.6631225356, 0), y=(0.6631225356, 0.7485108568, 0)), Plane(origin=(16.15838737, 112.746932, 0), x=(0.7485108568, -0.6631225356, 0), y=(0.6631225356, 0.7485108568, 0)), Plane(origin=(33.14714765, 64.31414184, 0), x=(-0.1205370056, 0.9927088346, 0), y=(-0.9927088346, -0.1205370056, 0))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])
list = ValueList({"CRITICAL", "ERROR", "WARNING", "INFO", "DEBUG", "NOTSET"}, selected="DEBUG")

# ---- group: Import remote python modules
panel_2 = Panel(python)
panel_3 = Panel("""numpy
scipy
numpy.linalg
sklearn
sklearn.cluster""")
ghpythonremote = GHPythonRemote(
    location="C:\Users\simon\anaconda3\envs\rhinoremote\python.exe",
    run=Toggle(True),
    modules=panel_3,
    log_level=list,
    working_dir=panel_2)  # -> out, linked_modules, rpy; inputs run: Boolean, modules: list
# ---------- ghpythonremote: Python ----------
import inspect
import logging
from os import path
import sys
from time import sleep

import scriptcontext

import ghpythonremote
from ghpythonremote.connectors import GrasshopperToPythonRemote

local_log_level = getattr(logging, log_level, logging.WARNING)
logger = logging.getLogger("ghpythonremote")
logger.setLevel(local_log_level)
ch = logging.StreamHandler()
ch.setLevel(local_log_level)
formatter = logging.Formatter("%(levelname)s: %(name)s:\n%(message)s")
ch.setFormatter(formatter)
logger.handlers = []
logger.addHandler(ch)
logger = logging.getLogger("ghpythonremote.GH_to_python")

ROOT = path.abspath(path.dirname(inspect.getfile(ghpythonremote)))
rpyc_server_py = path.join(ROOT, "pythonservice.py")

# Set connection to CLOSED if this is the first run
# and initialize set of linked modules
try:
    remote_python_status
except NameError:
    remote_python_status = "CLOSED"
    lkd_modules = set()

# Wait for connection to connect or terminate
timer = 0
while remote_python_status == "CONNECTING" or remote_python_status == "CLOSING":
    sleep(1)
    timer += 1
    if timer == 10:
        try:
            gh2py_manager.__exit__(*sys.exc_info())
        except Exception:
            pass
        remote_python_status = "CLOSED"
        lkd_modules = set()
        raise RuntimeError(
            "Connection left in an inconsistent state and not returning. Reset "
            "everything."
        )

if run:
    if not remote_python_status == "OPEN":
        remote_python_status = "CONNECTING"
        gh2py_manager = GrasshopperToPythonRemote(
            rpyc_server_py,
            location=location,
            timeout=10,
            port=None,
            log_level=log_level,
            working_dir=working_dir,
        )
        gh2py = gh2py_manager.__enter__()
        remote_python_status = "OPEN"

    # Stuff that we can reach
    rpymod = gh2py.py_remote_modules  # A getter function for a named python module
    rpy = gh2py.connection  # Represents the remote instance root object
    scriptcontext.sticky["rpy"] = rpy
    # Add modules
    for mod in modules:
        try:
            scriptcontext.sticky[mod] = rpymod(mod)
            lkd_modules.add(mod)
        except ImportError:
            gh2py_manager.__exit__(*sys.exc_info())
            raise

elif not remote_python_status == "CLOSED":
    remote_python_status = "CLOSING"
    # Remove linked modules
    for mod in lkd_modules:
        del scriptcontext.sticky[mod]
    del scriptcontext.sticky["rpy"]
    gh2py_manager.__exit__(*sys.exc_info())
    lkd_modules = set()
    remote_python_status = "CLOSED"

# Change variable name because ghpython resets outputs to None before each run
linked_modules = lkd_modules

logger.info("GH to python connection is {}".format(remote_python_status))
# ---------- end ghpythonremote ----------
panel_4 = Panel(ghpythonremote.out)

# ----
python_2 = PythonScript(module_names=ghpythonremote.linked_modules)  # -> import_statements; inputs module_names: list
# ---------- python_2: Python ----------
import_statements = ["import scriptcontext as sc"]
for module_name in module_names:
    import_statements.append("{0} = sc.sticky['{0}']".format(module_name))

if len(module_names) == 0:
    import_statements = []
# ---------- end python_2 ----------
createareas = GhPythonScript(params=divdist.Parameters, starting_curve=crv_8, first_planes=pln, layers=Slider(4, range=0..10))  # -> out, areas_list, areas_dict, layer_curves, first_brick_meshes, b_area; inputs params: list, starting_curve: Curve, first_planes: list of Plane, layers: Int32
# ---------- createareas: Python ----------
import rhinoscriptsyntax as rs
import Rhino.Geometry as rg
import Rhino.DocObjects as rd
import ghpythonlib.components as ghc
import random
random.seed(2)
from compas_rhino import unload_modules
unload_modules('model')

from model import Brick, Area, areas_dict, areas_list


curve = starting_curve

def areas_on_curve(crv, layer,width, params=params):
    layer_areas = []
    for i, _ in enumerate(params[:-1]):
        key = "L{}A{}".format(layer, i)
        area = Area(initial_curve=crv, start_param=params[i], end_param=params[i+1], layer=layer, area_index=i, width=width)
        areas_dict[key] = area
        layer_areas.append(area)
    return layer_areas

def move_curve_up(crv, height=Brick.REFERENCE_HEIGHT, trim_factor=0.01):
    V = rg.Vector3d.ZAxis * height
    crv.Translate(V)
    length = crv.GetLength()
    new_length = length * (1.0 - trim_factor)
    trim_length = (length - new_length) / 2
    _ , p0 = crv.LengthParameter(trim_length)
    _ , p1 = crv.LengthParameter(length - trim_length)
    trim = crv.Trim(rg.Interval(p0,p1))
    trim.Domain = rg.Interval(0.0, 1.0)
    return trim

def bbox_boolean_intersect(bbox_a, bbox_b):
    if (bbox_a.Min.X < bbox_b.Max.X) and (bbox_a.Max.X > bbox_b.Min.X) and (bbox_a.Min.Y < bbox_b.Max.Y) and (bbox_a.Max.Y > bbox_b.Min.Y):
        return True
    else:
        return False

def gen_first_bricks(a, d=1.0):
    """
    a = Area Class
    d = density of bricks (default should be 1.0)
    """
    bricks = []
    bbox = a.bounding_area()
    num_b = a.num_brick(bbox, density=d)
    points = a.populate_points(bbox, num_b)
    planes = a.random_brick_planes(points)
    for plane in planes:
        brick = Brick(plane)
        bricks.append(brick)
    a.area_bricks = bricks
    return bricks



"""Run code"""

# create curve and Areas for each layer
max_width = 100
shorten_factor = 0.95

for i in range(layers):
    layer_areas = areas_on_curve(crv=curve, layer=i, width=max_width)
    areas_list.append(layer_areas)
    curve = move_curve_up(curve)
    max_width *= shorten_factor

# this appends all layer curves to list so that we can visualize them
layer_curves = []
for l in areas_list:
    layer_curves.append(l[0].initial_curve)


"""Populate first layer with bricks &
Build topological model for Areas and store area_key in Area Class
- First populate ground layer with random bricks
- Second, initiate number of bricks for each area and store in self.initial_number_bricks
- Third find sub layer neighbors
"""
first_area_bricks = []
first_brick_meshes = []
b_area = []
density = 0.5


for l in areas_list:
    for a in l:
        # if first layer: populate areas with random bricks
        if a.sub_layer() is None:
            b_area.append( a.bounding_area() )
            bricks = []
            for plane in first_planes:
                bricks.append( Brick(plane) )
#            bricks = gen_first_bricks(a, d=density)
            a.area_bricks = bricks
            for brick in bricks:
                first_area_bricks.append(brick)
                first_brick_meshes.append(brick.mesh())
            continue
        # initiate number of bricks for each area
        bounding_area = a.bounding_area()
        b_area.append( bounding_area )
        num_b = a.num_brick(bounding_area, density=density)
        # add sub layer neighbors for every Area
        sub_neighbors = []
        bbox_a = a.project_bbox_extend_on_ground()
        sub_layer = areas_list[a.sub_layer()]
        for sub_area in sub_layer:
            bbox_b = sub_area.project_bbox_extend_on_ground()
            if bbox_boolean_intersect(bbox_a, bbox_b) is True:
                sub_neighbors.append(sub_area.area_key)
        a.sub_layer_neighbors = sub_neighbors


areas_dict = [ areas_dict ]
# ---------- end createareas ----------
crv_9 = Curve(createareas.b_area)
panel_5 = Panel(python_2)
intersectingbricks = GhPythonScript(areas_list=createareas.areas_list, areas_dict=createareas.areas_dict)  # -> out, areas_list, areas_dict; inputs areas_list: list, areas_dict: list
# ---------- intersectingbricks: Python ----------
import rhinoscriptsyntax as rs
import Rhino.Geometry as rg
from compas_rhino import unload_modules
unload_modules('model')

from model import Brick, Area

areas_dict = areas_dict[0]

#for layer in areas_list:
#    for a in layer:
#       n_intersections, intersection_pairs = a.check_intersecting_bricks()
       
areas_dict = [ areas_dict ] 

#for layer in areas_list:
#    for area in layer:
#        print(area.initial_number_bricks)
#
# ---------- end intersectingbricks ----------
clustering = GhPythonScript(areas_list=intersectingbricks.areas_list, areas_dict=intersectingbricks.areas_dict)  # -> out, clusters, points, label_tree, convex, mesh_bricks, L2_verts, L1_verts, floating_edges; inputs areas_list: list, areas_dict: list
# ---------- clustering: Python ----------
import rhinoscriptsyntax as rs
import Rhino.Geometry as rg
import ghpythonlib.treehelpers as th
import ghpythonlib.components as ghc
from compas_rhino import unload_modules
unload_modules('model')

from model import Brick, Area

areas_dict = areas_dict[0]

print( areas_dict.keys() )

#area_clusters = []
#convex = [] 
#ave_planes = []
#floating_edges = []
#mesh_bricks = []

L2_verts = areas_dict["L2A0"].get_bricks_vertices()
L1_verts = areas_dict["L1A0"].get_bricks_vertices()

print(L2_verts)

#for layer in areas_list:
#    if layer[0].layer == 0:
#        continue
#    for area in layer:
#        print('Layer: ', area.layer)
#        print('Sub-layer: ', area.sub_layer_neighbors)
#        clusters, points, labels = area.cluster_sub_layer_points()
#        area_clusters.append(clusters)
#        for cluster in clusters:
#            if len(cluster) <2:
#                continue
#            else:
#                convex.append(ghc.ConvexHull(cluster)[1])
#                floating_edge = area.floating_edges(cluster)
#                for edge in floating_edge[0]:
#                    floating_edges.append(edge)
#                average_plane = area.average_planes(floating_edge)
#                ave_planes.append( average_plane )
#        for planes in ave_planes:
#            for p in planes:
#                b = Brick(p)
#                area.area_bricks.append(b)
#                mesh_b = b.mesh()
#                mesh_bricks.append(mesh_b)



#for area in areas_list[1]:
#    clusters, points, labels = area.cluster_sub_layer_points()
#    area_clusters.append(clusters)
#    for cluster in clusters:
#        convex.append(ghc.ConvexHull(cluster)[0])

#label_tree = th.list_to_tree(labels)
# ---------- end clustering ----------

# ---- group: Visualize outputs
first_layer_bricks = Mesh(createareas.first_brick_meshes)
layer_curve = Curve(createareas.layer_curves)
cluster_hulls = Curve(clustering.convex)

# ----
pt = Point(clustering.points)
mesh = Mesh(clustering.mesh_bricks)
crv_10 = Curve(clustering.convex)
line = Line(clustering.floating_edges)
pt_2 = Point(clustering.L2_verts)
pt_3 = Point()

# ---- group: visualization
move_2 = Move(Geometry=mesh, Motion=Vector(0, 0, 10))  # -> Geometry, Transform
boundary = BoundarySurfaces(Edges=crv_10)
move_3 = Move(Geometry=boundary, Motion=Vector(0, 0, 10))  # -> Geometry, Transform
cloud = CloudDisplay(Points=pt, Colours=RGB(255, 20, 147), Size=Slider(3, range=0..10), SpriteType=0)
preview = CustomPreview(Geometry=line, Material=ColourSwatch(SwatchColor=RGB(255, 0, 0)))
preview_2 = CustomPreview(Geometry=move_2.Geometry, Material=ColourSwatch(SwatchColor=RGB(15, 131, 255)))

# ----
preview_3 = CustomPreview(Geometry=mesh, Material=ColourSwatch(SwatchColor=RGB(15, 131, 255)))
panel_6 = Panel(mesh)
